# Grasshopper definition Crystallon_v2-0.gh (Grasshopper 1.0.7)
# Copyright: ©2019 GNU General Public License
# Copyright: ©2018 GNU General Public License
# plug-ins: Kangaroo Components, Kangaroo2 Components

magnitude_min = MagnitudeMin()  # Magnitude of the offset (minimum value)
magnitude_max = MagnitudeMax()  # Magnitude of the offset (maximum value)
influence = Influence()  # Smoothed range of attractor influence (0-1)
attractor = Attractor()  # Any geometry to use as attractor(s)
mesh = Mesh()  # Mesh to offset
lower_limit = LowerLimit()  # Smoothing of the surface closest to the attractor
num = Number(influence)
geo = Geometry(attractor)
mesh_2 = Mesh(mesh)
num_2 = Number(lower_limit)
num_3 = Number(magnitude_min)
num_4 = Number(magnitude_max)
weld = WeldMesh(Mesh=mesh_2, Angle=3.141592654)
dom = ConstructDomain(DomainStart=num_3, DomainEnd=num_4)
demesh = DeconstructMesh(Mesh=weld)  # -> Vertices, Faces, Colours, Normals
deface = DeconstructFace(Face=demesh.Faces)  # -> CornerA, CornerB, CornerC, CornerD
item = ListItem(List=demesh.Vertices, Index=deface.CornerB, Wrap=True)
item_2 = ListItem(List=demesh.Vertices, Index=deface.CornerC, Wrap=True)
item_3 = ListItem(List=demesh.Vertices, Index=deface.CornerA, Wrap=True)
addition = Addition(A=item_3, B=item)
addition_2 = Addition(A=item_3, B=item_2)
addition_3 = Addition(A=item, B=item_2)
bcentric = Barycentric(PointA=item_3, PointB=item, PointC=item_2, CoordinateU=1, CoordinateV=1, CoordinateW=1)
division = Division(A=addition, B="2")
division_2 = Division(A=addition_3, B="2")
division_3 = Division(A=addition_2, B="2")
entwine = Entwine(Branch00=item_3, Branch01=division, Branch02=bcentric, Branch03=division_3, FlattenInputs=True)
entwine_2 = Entwine(Branch00=item, Branch01=division_2, Branch02=bcentric, Branch03=division, FlattenInputs=True)
entwine_3 = Entwine(Branch00=item_2, Branch01=division_3, Branch02=bcentric, Branch03=division_2, FlattenInputs=True)
flip = FlipMatrix(Data=entwine)
flip_2 = FlipMatrix(Data=entwine_3)
flip_3 = FlipMatrix(Data=entwine_2)
quad = MeshQuad(CornerA=0, CornerB=1, CornerC=2, CornerD=3)
quad_2 = MeshQuad(CornerA=0, CornerB=1, CornerC=2, CornerD=3)
quad_3 = MeshQuad(CornerA=0, CornerB=1, CornerC=2, CornerD=3)
panel = Panel("MESH OFFSET ATTRACTOR")
conmesh = ConstructMesh(Vertices=flip_2, Faces=quad)
conmesh_2 = ConstructMesh(Vertices=flip_3, Faces=quad_2)
conmesh_3 = ConstructMesh(Vertices=flip, Faces=quad_3)
mjoin = MeshJoin(Meshes=flatten([conmesh_3, conmesh_2, conmesh]))
demesh_2 = DeconstructMesh(Mesh=mjoin)  # -> Vertices, Faces, Colours, Normals
meshcp = MeshClosestPoint(Point=demesh_2.Vertices, Mesh=weld)  # -> Point, Index, Parameter
pull = PullPoint(Point=demesh_2.Vertices, Geometry=geo, ClosestOnly=True)  # -> ClosestPoint, Distance
lng = ListLength(List=pull.Distance)
meval = MeshEval(Mesh=weld, Parameter=meshcp.Parameter)  # -> Point, Normal, Colour
series = Series(Start=0, Step=1, Count=lng)
smaller = SmallerThan(FirstNumber=pull.Distance, SecondNumber=num_2)  # -> SmallerThan, OrEqualTo
cull = CullPattern(List=series, CullPattern=smaller.SmallerThan)
replace = ReplaceItems(List=pull.Distance, Item="0", Indices=cull, Wrap=False)
expression = Expression(x=num, y=replace, Expression="-1*e^(-x*y)")
bnd = Bounds(Numbers=expression)
remap = RemapNumbers(Value=expression, Source=bnd, Target=dom)  # -> Mapped, Clipped
amp = Amplitude(Vector=meval.Normal, Amplitude=remap.Mapped)
move = Move(Geometry=demesh_2.Vertices, Motion=amp)  # -> Geometry, Transform
conmesh_4 = ConstructMesh(Vertices=move.Geometry, Faces=demesh_2.Faces)
demesh_3 = DeconstructMesh(Mesh=mjoin)  # -> Vertices, Faces, Colours, Normals
demesh_4 = DeconstructMesh(Mesh=conmesh_4)  # -> Vertices, Faces, Colours, Normals
deface_2 = DeconstructFace(Face=demesh_3.Faces)  # -> CornerA, CornerB, CornerC, CornerD
deface_3 = DeconstructFace(Face=demesh_4.Faces)  # -> CornerA, CornerB, CornerC, CornerD
item_4 = ListItem(List=demesh_4.Vertices, Index=deface_3.CornerA, Wrap=True)
item_5 = ListItem(List=demesh_4.Vertices, Index=deface_3.CornerB, Wrap=True)
item_6 = ListItem(List=demesh_4.Vertices, Index=deface_3.CornerC, Wrap=True)
item_7 = ListItem(List=demesh_4.Vertices, Index=deface_3.CornerD, Wrap=True)
item_8 = ListItem(List=demesh_3.Vertices, Index=deface_2.CornerA, Wrap=True)
item_9 = ListItem(List=demesh_3.Vertices, Index=deface_2.CornerB, Wrap=True)
item_10 = ListItem(List=demesh_3.Vertices, Index=deface_2.CornerC, Wrap=True)
item_11 = ListItem(List=demesh_3.Vertices, Index=deface_2.CornerD, Wrap=True)
tbox = TwistedBox(
    CornerA=item_4,
    CornerB=item_5,
    CornerC=item_6,
    CornerD=item_7,
    CornerE=item_8,
    CornerF=item_9,
    CornerG=item_10,
    CornerH=item_11)
mesh_3 = Mesh(conmesh_4)
mesh_4 = Mesh(mjoin)
voxels = Voxels(tbox)  # Voxels to be filled with unit cells
quad_mesh = QuadMesh(mesh_3)  # Quad mesh generated from the input mesh
offset_quad_mesh = OffsetQuadMesh(mesh_4)  # Offset quad mesh generated from the input mesh

magnitude_max_2 = MagnitudeMax()  # Magnitude of the offset (maximum value)
influence_2 = Influence()  # Smoothed range of attractor influence (0-1)
values = Values()  # Values that correspond to points (flattened)
magnitude_min_2 = MagnitudeMin()  # Magnitude of the offset (minimum value)
distance_influence = DistanceInfluence()  # If true the distance between the points and voxels will affect the magnitude
points = Points()  # List of points (flattened)
mesh_5 = Mesh()  # Mesh to offset
mesh_6 = Mesh(mesh_5)
weld_2 = WeldMesh(Mesh=mesh_6, Angle=3.141592654)
demesh_5 = DeconstructMesh(Mesh=weld_2)  # -> Vertices, Faces, Colours, Normals
deface_4 = DeconstructFace(Face=demesh_5.Faces)  # -> CornerA, CornerB, CornerC, CornerD
item_12 = ListItem(List=demesh_5.Vertices, Index=deface_4.CornerB, Wrap=True)
item_13 = ListItem(List=demesh_5.Vertices, Index=deface_4.CornerC, Wrap=True)
item_14 = ListItem(List=demesh_5.Vertices, Index=deface_4.CornerA, Wrap=True)
panel_2 = Panel("0")
panel_3 = Panel("1")
panel_4 = Panel("2")
addition_4 = Addition(A=item_14, B=item_12)
addition_5 = Addition(A=item_14, B=item_13)
addition_6 = Addition(A=item_12, B=item_13)
bcentric_2 = Barycentric(PointA=item_14, PointB=item_12, PointC=item_13, CoordinateU=1, CoordinateV=1, CoordinateW=1)
panel_5 = Panel("A")
panel_6 = Panel("B")
division_4 = Division(A=addition_4, B="2")
panel_7 = Panel("C")
division_5 = Division(A=addition_6, B="2")
division_6 = Division(A=addition_5, B="2")
panel_8 = Panel("Z")
entwine_4 = Entwine(Branch00=item_14, Branch01=division_4, Branch02=bcentric_2, Branch03=division_6, FlattenInputs=True)
entwine_5 = Entwine(Branch00=item_12, Branch01=division_5, Branch02=bcentric_2, Branch03=division_4, FlattenInputs=True)
entwine_6 = Entwine(Branch00=item_13, Branch01=division_6, Branch02=bcentric_2, Branch03=division_5, FlattenInputs=True)
flip_4 = FlipMatrix(Data=entwine_4)
flip_5 = FlipMatrix(Data=entwine_6)
flip_6 = FlipMatrix(Data=entwine_5)
quad_4 = MeshQuad(CornerA=0, CornerB=1, CornerC=2, CornerD=3)
quad_5 = MeshQuad(CornerA=0, CornerB=1, CornerC=2, CornerD=3)
quad_6 = MeshQuad(CornerA=0, CornerB=1, CornerC=2, CornerD=3)
panel_9 = Panel("MESH OFFSET VALUE")
conmesh_5 = ConstructMesh(Vertices=flip_5, Faces=quad_4)
conmesh_6 = ConstructMesh(Vertices=flip_6, Faces=quad_5)
pt = Point(points)
conmesh_7 = ConstructMesh(Vertices=flip_4, Faces=quad_6)
num_5 = Number(values)
bnd_2 = Bounds(Numbers=num_5)
dom_2 = ConstructDomain(DomainStart=magnitude_min_2, DomainEnd=magnitude_max_2)
mjoin_2 = MeshJoin(Meshes=flatten([conmesh_7, conmesh_6, conmesh_5]))
remap_2 = RemapNumbers(Value=num_5, Source=bnd_2, Target=dom_2)  # -> Mapped, Clipped
demesh_6 = DeconstructMesh(Mesh=mjoin_2)  # -> Vertices, Faces, Colours, Normals
cp = ClosestPoint(Point=demesh_6.Vertices, Cloud=pt)  # -> ClosestPoint, CPIndex, Distance
expression_2 = Expression(x=influence_2, y=cp.Distance, Expression="-1*e^(-x*y)")
item_15 = ListItem(List=remap_2.Mapped, Index=cp.CPIndex, Wrap=True)
meshcp_2 = MeshClosestPoint(Point=demesh_6.Vertices, Mesh=weld_2)  # -> Point, Index, Parameter
bnd_3 = Bounds(Numbers=flatten(expression_2))
meval_2 = MeshEval(Mesh=weld_2, Parameter=meshcp_2.Parameter)  # -> Point, Normal, Colour
remap_3 = RemapNumbers(Value=expression_2, Source=bnd_3, Target="1 to 0")  # -> Mapped, Clipped
not = GateNot(A=distance_influence)
multiplication = Multiplication(A=item_15, B=remap_3.Mapped)
demesh_7 = DeconstructMesh(Mesh=mjoin_2)  # -> Vertices, Faces, Colours, Normals
cull_2 = CullPattern(List=multiplication, CullPattern=distance_influence)
cull_3 = CullPattern(List=item_15, CullPattern=not)
amp_2 = Amplitude(Vector=meval_2.Normal, Amplitude=[cull_2, cull_3])
move_2 = Move(Geometry=demesh_6.Vertices, Motion=amp_2)  # -> Geometry, Transform
conmesh_8 = ConstructMesh(Vertices=move_2.Geometry, Faces=demesh_6.Faces)
demesh_8 = DeconstructMesh(Mesh=conmesh_8)  # -> Vertices, Faces, Colours, Normals
deface_5 = DeconstructFace(Face=demesh_7.Faces)  # -> CornerA, CornerB, CornerC, CornerD
deface_6 = DeconstructFace(Face=demesh_8.Faces)  # -> CornerA, CornerB, CornerC, CornerD
item_16 = ListItem(List=demesh_8.Vertices, Index=deface_6.CornerA, Wrap=True)
item_17 = ListItem(List=demesh_8.Vertices, Index=deface_6.CornerB, Wrap=True)
item_18 = ListItem(List=demesh_8.Vertices, Index=deface_6.CornerC, Wrap=True)
item_19 = ListItem(List=demesh_8.Vertices, Index=deface_6.CornerD, Wrap=True)
item_20 = ListItem(List=demesh_7.Vertices, Index=deface_5.CornerA, Wrap=True)
item_21 = ListItem(List=demesh_7.Vertices, Index=deface_5.CornerB, Wrap=True)
item_22 = ListItem(List=demesh_7.Vertices, Index=deface_5.CornerC, Wrap=True)
item_23 = ListItem(List=demesh_7.Vertices, Index=deface_5.CornerD, Wrap=True)
tbox_2 = TwistedBox(
    CornerA=item_16,
    CornerB=item_17,
    CornerC=item_18,
    CornerD=item_19,
    CornerE=item_20,
    CornerF=item_21,
    CornerG=item_22,
    CornerH=item_23)
mesh_7 = Mesh(mjoin_2)
mesh_8 = Mesh(conmesh_8)
voxels_2 = Voxels(tbox_2)  # Voxels to be filled with unit cells
quad_mesh_2 = QuadMesh(mesh_8)  # Quad mesh generated from the input mesh
offset_quad_mesh_2 = OffsetQuadMesh(mesh_7)  # Offset quad mesh generated from the input mesh

geometry = Geometry()  # Geometry to voxelize
voxel_size_x = VoxelSizeX()  # Voxel size int the X direction
voxel_size_y = VoxelSizeY()  # Voxel size int the Y direction
voxel_size_z = VoxelSizeZ()  # Voxel size int the Z direction
fill_completely = FillCompletely()  # If true, Voxels will fill entire volume. If false, only Voxels with their centroid within the volume will be kept.
geo_2 = Geometry(geometry)
num_6 = Number(voxel_size_x)
num_7 = Number(voxel_size_y)
num_8 = Number(voxel_size_z)
bbox = BoundingBox(Content=geo_2, Plane=PlaneXY(0, 0, 0))  # -> Box, Box_2
boxprop = BoxProperties(Box=bbox.Box)  # -> Center, Diagonal, Area, Volume, Degeneracy
one_over_x = OneOverX(Value=num_6)
one_over_x_2 = OneOverX(Value=num_7)
one_over_x_3 = OneOverX(Value=num_8)
devec = DeconstructVector(Vector=boxprop.Center)  # -> XComponent, YComponent, ZComponent
multiplication_2 = Multiplication(A=boxprop.Diagonal, B=one_over_x_2)
multiplication_3 = Multiplication(A=boxprop.Diagonal, B=one_over_x)
multiplication_4 = Multiplication(A=boxprop.Diagonal, B=one_over_x_3)
devec_2 = DeconstructVector(Vector=multiplication_3)  # -> XComponent, YComponent, ZComponent
devec_3 = DeconstructVector(Vector=multiplication_2)  # -> XComponent, YComponent, ZComponent
devec_4 = DeconstructVector(Vector=multiplication_4)  # -> XComponent, YComponent, ZComponent
expression_3 = Expression(x=devec_2.XComponent, Expression="ceiling(x)")
expression_4 = Expression(z=devec_4.ZComponent, Expression="ceiling(z)")
expression_5 = Expression(y=devec_3.YComponent, Expression="ceiling(y)")
expression_6 = Expression(x=expression_3, u=num_6, a=devec.XComponent, Expression="-u*x/2+a")
expression_7 = Expression(y=expression_5, u=num_7, b=devec.YComponent, Expression="-u*y/2+b")
expression_8 = Expression(y=expression_4, u=num_8, b=devec.ZComponent, Expression="-u*y/2+b")
expression_9 = Expression(x=expression_3, Expression="x+1")
expression_10 = Expression(z=expression_4, Expression="z+1")
expression_11 = Expression(y=expression_5, Expression="y+1")
series_2 = Series(Start=expression_6, Step=num_6, Count=expression_9)
series_3 = Series(Start=expression_8, Step=num_8, Count=expression_10)
series_4 = Series(Start=expression_7, Step=num_7, Count=expression_11)
panel_10 = Panel("VOXELIZE")
crossref = CrossReference(ListA=series_2, ListB=series_4, ListC=series_3, CrossMode=1)  # -> ListA, ListB, ListC
sort = SortList(Keys=[num_6, num_7, num_8])  # -> Keys, ValuesA
rev = ReverseList(List=sort.Keys)
pt_2 = ConstructPoint(XCoordinate=crossref.ListA, YCoordinate=crossref.ListB, ZCoordinate=crossref.ListC)
item_24 = ListItem(List=rev, Index=0, Wrap=True)
minc = MeshInclusion(Mesh=geo_2, Point=pt_2, Strict=False)
meshcp_3 = MeshClosestPoint(Point=pt_2, Mesh=geo_2)  # -> Point, Index, Parameter
dist = Distance(PointA=pt_2, PointB=meshcp_3.Point)
expression_12 = Expression(a=item_24, d=dist, Expression="if(d<sqrt(2*(a/2)^2),True,False)")
cull_4 = CullPattern(List=pt_2, CullPattern=minc)
cull_5 = CullPattern(List=pt_2, CullPattern=expression_12)
cull_6 = CullPattern(List=cull_5, CullPattern=fill_completely)
merge = Merge(Data1=cull_4, Data2=cull_6)
expression_13 = Expression(x=num_7, Expression="x/2")
expression_14 = Expression(x=num_6, Expression="x/2")
expression_15 = Expression(x=num_8, Expression="x/2")
cullpt = CullDuplicates(Points=merge, Tolerance=".001", CullMode=3)  # -> Points, Indices, Valence
box = CenterBox(Base=cullpt.Points, X=expression_14, Y=expression_13, Z=expression_15)
voxels_3 = Voxels(box)  # Voxels to be filled with unit cells

mesh_9 = Mesh()  # Mesh to offset
mesh_10 = Mesh(mesh_9)
distance = Distance()  # Offset distance
weld_3 = WeldMesh(Mesh=mesh_10, Angle=3.141592654)
demesh_9 = DeconstructMesh(Mesh=weld_3)  # -> Vertices, Faces, Colours, Normals
deface_7 = DeconstructFace(Face=demesh_9.Faces)  # -> CornerA, CornerB, CornerC, CornerD
item_25 = ListItem(List=demesh_9.Vertices, Index=deface_7.CornerB, Wrap=True)
item_26 = ListItem(List=demesh_9.Vertices, Index=deface_7.CornerC, Wrap=True)
item_27 = ListItem(List=demesh_9.Vertices, Index=deface_7.CornerA, Wrap=True)
addition_7 = Addition(A=item_27, B=item_25)
addition_8 = Addition(A=item_27, B=item_26)
addition_9 = Addition(A=item_25, B=item_26)
bcentric_3 = Barycentric(PointA=item_27, PointB=item_25, PointC=item_26, CoordinateU=1, CoordinateV=1, CoordinateW=1)
division_7 = Division(A=addition_7, B="2")
division_8 = Division(A=addition_9, B="2")
division_9 = Division(A=addition_8, B="2")
entwine_7 = Entwine(Branch00=item_27, Branch01=division_7, Branch02=bcentric_3, Branch03=division_9, FlattenInputs=True)
entwine_8 = Entwine(Branch00=item_25, Branch01=division_8, Branch02=bcentric_3, Branch03=division_7, FlattenInputs=True)
entwine_9 = Entwine(Branch00=item_26, Branch01=division_9, Branch02=bcentric_3, Branch03=division_8, FlattenInputs=True)
flip_7 = FlipMatrix(Data=entwine_7)
flip_8 = FlipMatrix(Data=entwine_9)
flip_9 = FlipMatrix(Data=entwine_8)
quad_7 = MeshQuad(CornerA=0, CornerB=1, CornerC=2, CornerD=3)
quad_8 = MeshQuad(CornerA=0, CornerB=1, CornerC=2, CornerD=3)
quad_9 = MeshQuad(CornerA=0, CornerB=1, CornerC=2, CornerD=3)
panel_18 = Panel("MESH OFFSET")
conmesh_9 = ConstructMesh(Vertices=flip_8, Faces=quad_7)
conmesh_10 = ConstructMesh(Vertices=flip_9, Faces=quad_8)
conmesh_11 = ConstructMesh(Vertices=flip_7, Faces=quad_9)
mjoin_3 = MeshJoin(Meshes=flatten([conmesh_11, conmesh_10, conmesh_9]))
demesh_10 = DeconstructMesh(Mesh=mjoin_3)  # -> Vertices, Faces, Colours, Normals
meshcp_4 = MeshClosestPoint(Point=demesh_10.Vertices, Mesh=weld_3)  # -> Point, Index, Parameter
meval_3 = MeshEval(Mesh=weld_3, Parameter=meshcp_4.Parameter)  # -> Point, Normal, Colour
amp_3 = Amplitude(Vector=meval_3.Normal, Amplitude=distance)
move_3 = Move(Geometry=demesh_10.Vertices, Motion=amp_3)  # -> Geometry, Transform
conmesh_12 = ConstructMesh(Vertices=move_3.Geometry, Faces=demesh_10.Faces)
demesh_11 = DeconstructMesh(Mesh=mjoin_3)  # -> Vertices, Faces, Colours, Normals
demesh_12 = DeconstructMesh(Mesh=conmesh_12)  # -> Vertices, Faces, Colours, Normals
deface_8 = DeconstructFace(Face=demesh_11.Faces)  # -> CornerA, CornerB, CornerC, CornerD
deface_9 = DeconstructFace(Face=demesh_12.Faces)  # -> CornerA, CornerB, CornerC, CornerD
item_28 = ListItem(List=demesh_12.Vertices, Index=deface_9.CornerA, Wrap=True)
item_29 = ListItem(List=demesh_12.Vertices, Index=deface_9.CornerB, Wrap=True)
item_30 = ListItem(List=demesh_12.Vertices, Index=deface_9.CornerC, Wrap=True)
item_31 = ListItem(List=demesh_12.Vertices, Index=deface_9.CornerD, Wrap=True)
item_32 = ListItem(List=demesh_11.Vertices, Index=deface_8.CornerA, Wrap=True)
item_33 = ListItem(List=demesh_11.Vertices, Index=deface_8.CornerB, Wrap=True)
item_34 = ListItem(List=demesh_11.Vertices, Index=deface_8.CornerC, Wrap=True)
item_35 = ListItem(List=demesh_11.Vertices, Index=deface_8.CornerD, Wrap=True)
tbox_3 = TwistedBox(
    CornerA=item_28,
    CornerB=item_29,
    CornerC=item_30,
    CornerD=item_31,
    CornerE=item_32,
    CornerF=item_33,
    CornerG=item_34,
    CornerH=item_35)
mesh_11 = Mesh(conmesh_12)
mesh_12 = Mesh(mjoin_3)
quad_mesh_3 = QuadMesh(mesh_11)  # Quad mesh generated from the input mesh
offset_quad_mesh_3 = OffsetQuadMesh(mesh_12)  # Offset quad mesh generated from the input mesh
voxels_4 = Voxels(tbox_3)  # Voxels to be filled with unit cells

surfaces = Surfaces()  # At least 2 surfaces to morph voxels between
voxel_number_x = VoxelNumberX()  # Number of Voxels in the X direction
voxel_number_y = VoxelNumberY()  # Number of Voxels in the Y direction
voxel_number_z = VoxelNumberZ()  # Number of Voxels in the Z direction
srf = Surface(flatten(surfaces))
num_9 = Number(voxel_number_z)
num_10 = Number(voxel_number_x)
num_11 = Number(voxel_number_y)
sdivide = DivideSurface(Surface=srf, UCount="30", VCount="30")  # -> simplify(Points), Normals, Parameters
pshift = ShiftPaths(Data=sdivide.Points, Offset="-1")
panel_19 = Panel("MORPH BETWEEN SURFACES")
flip_10 = FlipMatrix(Data=pshift)
dom_3 = ConstructDomain(DomainStart=0, DomainEnd=1)
pline = PolyLine(Vertices=flip_10, Closed=False)
range = Range(Domain=dom_3, Steps=num_9)
eval = EvaluateCurve(Curve=reparameterize(pline), Parameter=range)  # -> Point, Tangent, Angle
flip_11 = FlipMatrix(Data=eval.Point)
addition_10 = Addition(A="30", B="1")
srfgrid = SurfaceFromPoints(Points=flip_11, UCount=graft(addition_10), Interpolate=False)  # -> flatten(Surface)
toggle = BooleanToggle(False)
shift = ShiftList(List=srfgrid, Shift="1", Wrap=toggle)
shift_2 = ShiftList(List=srfgrid, Shift="-1", Wrap=toggle)
divide = DivideDomain²(Domain=shift_2, UCount=num_10, VCount=num_11)
divide_2 = DivideDomain²(Domain=shift, UCount=num_10, VCount=num_11)
blendbox = BlendBox(SurfaceA=graft(shift), DomainA=divide_2, SurfaceB=graft(shift_2), DomainB=divide)  # -> flatten(TwistedBox)
voxels_5 = Voxels(blendbox)  # Voxels to be filled with unit cells

lattice = Lattice()  # Lattice curves to filter
crv = Curve(flatten(lattice))
join = JoinCurves(Curves=crv, Preserve=False)
line = Line(join)
panel_20 = Panel("REMOVE FLOATING CURVES")
null = NullItem(Item=line)  # -> NullFlags, InvalidFlags, Description
cull_7 = CullPattern(List=join, CullPattern=null.NullFlags)
explode = Explode(Curve=cull_7, Recursive=True)  # -> flatten(Segments), Vertices
lattice_2 = Lattice(explode.Segments)  # Filtered lattice

panel_21 = Panel("""V1
OLD""")
remove_floating = RemoveFloating()
morph_between_surfaces = MorphBetweenSurfaces()
mesh_offset_value = MeshOffsetValue()  # -> voxels, quad_mesh, offset_quad_mesh
mesh_offset = MeshOffset()  # -> voxels, quad_mesh, offset_quad_mesh
voxelize = Voxelize()
mesh_offset_attractor = MeshOffsetAttractor()  # -> voxels, quad_mesh, offset_quad_mesh

# ----
# MESH OFFSET VALUE (parameter)
triangulated = Triangulated()  # True if mesh is triangulated. False if mesh is quads.
magnitude_max_3 = MagnitudeMax()  # Magnitude of the offset (maximum value)
influence_3 = Influence()  # Smoothed range of attractor influence (0-1)
values_2 = Values()  # Values that correspond to points (flattened)
magnitude_min_3 = MagnitudeMin()  # Magnitude of the offset (minimum value)
distance_influence_2 = DistanceInfluence()  # If true the distance between the points and voxels will affect the magnitude
points_2 = Points()  # List of points (flattened)
mesh_13 = Mesh()  # Mesh to offset
z_parameter = ZParameter()  # Range of numbers (0-1) for Z divisions
bool = Boolean(triangulated)
mesh_14 = Mesh(mesh_13)
num_12 = Number(influence_3)
bool_2 = Boolean(distance_influence_2)
num_13 = Number(values_2)
pt_3 = Point(points_2)
dom_4 = ConstructDomain(DomainStart=magnitude_min_3, DomainEnd=magnitude_max_3)
num_14 = Number(z_parameter)
cull_8 = CullPattern(List=mesh_14, CullPattern=bool)
not_2 = GateNot(A=bool)
weld_4 = WeldMesh(Mesh=cull_8, Angle=3.141592654)
demesh_13 = DeconstructMesh(Mesh=weld_4)  # -> Vertices, Faces, Colours, Normals
deface_10 = DeconstructFace(Face=demesh_13.Faces)  # -> CornerA, CornerB, CornerC, CornerD
item_36 = ListItem(List=demesh_13.Vertices, Index=deface_10.CornerB, Wrap=True)
item_37 = ListItem(List=demesh_13.Vertices, Index=deface_10.CornerC, Wrap=True)
item_38 = ListItem(List=demesh_13.Vertices, Index=deface_10.CornerA, Wrap=True)
addition_11 = Addition(A=item_38, B=item_36)
addition_12 = Addition(A=item_38, B=item_37)
addition_13 = Addition(A=item_36, B=item_37)
bcentric_4 = Barycentric(PointA=item_38, PointB=item_36, PointC=item_37, CoordinateU=1, CoordinateV=1, CoordinateW=1)
division_10 = Division(A=addition_11, B="2")
division_11 = Division(A=addition_13, B="2")
division_12 = Division(A=addition_12, B="2")
entwine_10 = Entwine(Branch00=item_38, Branch01=division_10, Branch02=bcentric_4, Branch03=division_12, FlattenInputs=True)
entwine_11 = Entwine(Branch00=item_36, Branch01=division_11, Branch02=bcentric_4, Branch03=division_10, FlattenInputs=True)
entwine_12 = Entwine(Branch00=item_37, Branch01=division_12, Branch02=bcentric_4, Branch03=division_11, FlattenInputs=True)
flip_12 = FlipMatrix(Data=entwine_10)
flip_13 = FlipMatrix(Data=entwine_12)
flip_14 = FlipMatrix(Data=entwine_11)
quad_10 = MeshQuad(CornerA=0, CornerB=1, CornerC=2, CornerD=3)
quad_11 = MeshQuad(CornerA=0, CornerB=1, CornerC=2, CornerD=3)
quad_12 = MeshQuad(CornerA=0, CornerB=1, CornerC=2, CornerD=3)
conmesh_13 = ConstructMesh(Vertices=flip_13, Faces=quad_10)
conmesh_14 = ConstructMesh(Vertices=flip_14, Faces=quad_11)
conmesh_15 = ConstructMesh(Vertices=flip_12, Faces=quad_12)
mjoin_4 = MeshJoin(Meshes=flatten([conmesh_15, conmesh_14, conmesh_13]))
cull_9 = CullPattern(List=mesh_14, CullPattern=not_2)
demesh_14 = DeconstructMesh(Mesh=[mjoin_4, cull_9])  # -> Vertices, Faces, Colours, Normals
meshcp_5 = MeshClosestPoint(Point=demesh_14.Vertices, Mesh=mesh_14)  # -> Point, Index, Parameter
cp_2 = ClosestPoint(Point=demesh_14.Vertices, Cloud=pt_3)  # -> ClosestPoint, CPIndex, Distance
bnd_4 = Bounds(Numbers=num_13)
meval_4 = MeshEval(Mesh=mesh_14, Parameter=meshcp_5.Parameter)  # -> Point, Normal, Colour
remap_4 = RemapNumbers(Value=num_13, Source=bnd_4, Target=dom_4)  # -> Mapped, Clipped
expression_16 = Expression(x=num_12, y=cp_2.Distance, Expression="-1*e^(-x*y)")
item_39 = ListItem(List=remap_4.Mapped, Index=cp_2.CPIndex, Wrap=True)
bnd_5 = Bounds(Numbers=flatten(expression_16))
not_3 = GateNot(A=bool_2)
remap_5 = RemapNumbers(Value=expression_16, Source=bnd_5, Target="1 to 0")  # -> Mapped, Clipped
multiplication_5 = Multiplication(A=item_39, B=remap_5.Mapped)
cull_10 = CullPattern(List=item_39, CullPattern=not_3)
cull_11 = CullPattern(List=multiplication_5, CullPattern=bool_2)
dom_5 = ConstructDomain(DomainStart=0, DomainEnd=flatten([cull_10, cull_11]))
remap_6 = RemapNumbers(Value=graft(num_14), Source=Domain(0, 1), Target=dom_5)  # -> simplify(Mapped), Clipped
amp_4 = Amplitude(Vector=meval_4.Normal, Amplitude=remap_6.Mapped)
move_4 = Move(Geometry=demesh_14.Vertices, Motion=amp_4)  # -> Geometry, Transform
toggle_2 = BooleanToggle(False)
conmesh_16 = ConstructMesh(Vertices=move_4.Geometry, Faces=demesh_14.Faces)  # -> flatten(Mesh)
shift_3 = ShiftList(List=flatten(conmesh_16), Shift="1", Wrap=toggle_2)
shift_4 = ShiftList(List=flatten(conmesh_16), Shift="-1", Wrap=toggle_2)
demesh_15 = DeconstructMesh(Mesh=shift_4)  # -> Vertices, Faces, Colours, Normals
demesh_16 = DeconstructMesh(Mesh=shift_3)  # -> Vertices, Faces, Colours, Normals
deface_11 = DeconstructFace(Face=demesh_15.Faces)  # -> CornerA, CornerB, CornerC, CornerD
deface_12 = DeconstructFace(Face=demesh_16.Faces)  # -> CornerA, CornerB, CornerC, CornerD
item_40 = ListItem(List=demesh_16.Vertices, Index=deface_12.CornerA, Wrap=True)
item_41 = ListItem(List=demesh_16.Vertices, Index=deface_12.CornerB, Wrap=True)
item_42 = ListItem(List=demesh_16.Vertices, Index=deface_12.CornerC, Wrap=True)
item_43 = ListItem(List=demesh_16.Vertices, Index=deface_12.CornerD, Wrap=True)
item_44 = ListItem(List=demesh_15.Vertices, Index=deface_11.CornerA, Wrap=True)
item_45 = ListItem(List=demesh_15.Vertices, Index=deface_11.CornerB, Wrap=True)
item_46 = ListItem(List=demesh_15.Vertices, Index=deface_11.CornerC, Wrap=True)
item_47 = ListItem(List=demesh_15.Vertices, Index=deface_11.CornerD, Wrap=True)
tbox_4 = TwistedBox(
    CornerA=item_40,
    CornerB=item_41,
    CornerC=item_42,
    CornerD=item_43,
    CornerE=item_44,
    CornerF=item_45,
    CornerG=item_46,
    CornerH=item_47)  # -> flatten(TwistedBox)
mesh_15 = Mesh(conmesh_16)
quad_meshes = QuadMeshes(mesh_15)  # Quad meshes generated from the input mesh
voxels_6 = Voxels(tbox_4)  # Voxels to be filled with unit cells

# ----
# MESH OFFSET ATTRACTOR (parameter)
triangulated_2 = Triangulated()  # True if mesh is triangulated. False if mesh is quads.
magnitude_min_4 = MagnitudeMin()  # Magnitude of the offset (minimum value)
magnitude_max_4 = MagnitudeMax()  # Magnitude of the offset (maximum value)
mesh_16 = Mesh()  # Mesh to offset
z_parameter_2 = ZParameter()  # Range of numbers (0-1) for Z divisions
influence_4 = Influence()  # Smoothed range of attractor influence (0-1)
attractor_2 = Attractor()  # Any geometry to use as attractor(s)
lower_limit_2 = LowerLimit()  # Smoothing of the surface closest to the attractor
bool_3 = Boolean(triangulated_2)
mesh_17 = Mesh(mesh_16)
num_15 = Number(influence_4)
geo_3 = Geometry(attractor_2)
num_16 = Number(z_parameter_2)
num_17 = Number(lower_limit_2)
num_18 = Number(magnitude_min_4)
num_19 = Number(magnitude_max_4)
cull_12 = CullPattern(List=mesh_17, CullPattern=bool_3)
dom_6 = ConstructDomain(DomainStart=num_18, DomainEnd=num_19)
weld_5 = WeldMesh(Mesh=cull_12, Angle=3.141592654)
demesh_17 = DeconstructMesh(Mesh=weld_5)  # -> Vertices, Faces, Colours, Normals
deface_13 = DeconstructFace(Face=demesh_17.Faces)  # -> CornerA, CornerB, CornerC, CornerD
item_48 = ListItem(List=demesh_17.Vertices, Index=deface_13.CornerB, Wrap=True)
item_49 = ListItem(List=demesh_17.Vertices, Index=deface_13.CornerC, Wrap=True)
item_50 = ListItem(List=demesh_17.Vertices, Index=deface_13.CornerA, Wrap=True)
addition_14 = Addition(A=item_50, B=item_48)
addition_15 = Addition(A=item_50, B=item_49)
addition_16 = Addition(A=item_48, B=item_49)
bcentric_5 = Barycentric(PointA=item_50, PointB=item_48, PointC=item_49, CoordinateU=1, CoordinateV=1, CoordinateW=1)
division_13 = Division(A=addition_14, B="2")
division_14 = Division(A=addition_16, B="2")
division_15 = Division(A=addition_15, B="2")
entwine_13 = Entwine(Branch00=item_50, Branch01=division_13, Branch02=bcentric_5, Branch03=division_15, FlattenInputs=True)
entwine_14 = Entwine(Branch00=item_48, Branch01=division_14, Branch02=bcentric_5, Branch03=division_13, FlattenInputs=True)
entwine_15 = Entwine(Branch00=item_49, Branch01=division_15, Branch02=bcentric_5, Branch03=division_14, FlattenInputs=True)
flip_15 = FlipMatrix(Data=entwine_13)
flip_16 = FlipMatrix(Data=entwine_15)
flip_17 = FlipMatrix(Data=entwine_14)
quad_13 = MeshQuad(CornerA=0, CornerB=1, CornerC=2, CornerD=3)
quad_14 = MeshQuad(CornerA=0, CornerB=1, CornerC=2, CornerD=3)
quad_15 = MeshQuad(CornerA=0, CornerB=1, CornerC=2, CornerD=3)
conmesh_17 = ConstructMesh(Vertices=flip_16, Faces=quad_13)
conmesh_18 = ConstructMesh(Vertices=flip_17, Faces=quad_14)
conmesh_19 = ConstructMesh(Vertices=flip_15, Faces=quad_15)
not_4 = GateNot(A=bool_3)
mjoin_5 = MeshJoin(Meshes=flatten([conmesh_19, conmesh_18, conmesh_17]))
cull_13 = CullPattern(List=mesh_17, CullPattern=not_4)
demesh_18 = DeconstructMesh(Mesh=[mjoin_5, cull_13])  # -> Vertices, Faces, Colours, Normals
meshcp_6 = MeshClosestPoint(Point=demesh_18.Vertices, Mesh=mesh_17)  # -> Point, Index, Parameter
pull_2 = PullPoint(Point=demesh_18.Vertices, Geometry=geo_3, ClosestOnly=True)  # -> ClosestPoint, Distance
lng_2 = ListLength(List=pull_2.Distance)
meval_5 = MeshEval(Mesh=mesh_17, Parameter=meshcp_6.Parameter)  # -> Point, Normal, Colour
smaller_2 = SmallerThan(FirstNumber=pull_2.Distance, SecondNumber=num_17)  # -> SmallerThan, OrEqualTo
series_5 = Series(Start=0, Step=1, Count=lng_2)
cull_14 = CullPattern(List=series_5, CullPattern=smaller_2.SmallerThan)
replace_2 = ReplaceItems(List=pull_2.Distance, Item="0", Indices=cull_14, Wrap=False)
expression_17 = Expression(x=num_15, y=replace_2, Expression="-1*e^(-x*y)")
bnd_6 = Bounds(Numbers=expression_17)
remap_7 = RemapNumbers(Value=expression_17, Source=bnd_6, Target=dom_6)  # -> Mapped, Clipped
dom_7 = ConstructDomain(DomainStart=0, DomainEnd=remap_7.Mapped)
remap_8 = RemapNumbers(Value=graft(num_16), Source=Domain(0, 1), Target=dom_7)  # -> simplify(Mapped), Clipped
amp_5 = Amplitude(Vector=meval_5.Normal, Amplitude=remap_8.Mapped)
move_5 = Move(Geometry=demesh_18.Vertices, Motion=amp_5)  # -> Geometry, Transform
toggle_3 = BooleanToggle(False)
conmesh_20 = ConstructMesh(Vertices=move_5.Geometry, Faces=demesh_18.Faces)  # -> flatten(Mesh)
shift_5 = ShiftList(List=flatten(conmesh_20), Shift="1", Wrap=toggle_3)
shift_6 = ShiftList(List=flatten(conmesh_20), Shift="-1", Wrap=toggle_3)
demesh_19 = DeconstructMesh(Mesh=shift_6)  # -> Vertices, Faces, Colours, Normals
demesh_20 = DeconstructMesh(Mesh=shift_5)  # -> Vertices, Faces, Colours, Normals
deface_14 = DeconstructFace(Face=demesh_19.Faces)  # -> CornerA, CornerB, CornerC, CornerD
deface_15 = DeconstructFace(Face=demesh_20.Faces)  # -> CornerA, CornerB, CornerC, CornerD
item_51 = ListItem(List=demesh_20.Vertices, Index=deface_15.CornerA, Wrap=True)
item_52 = ListItem(List=demesh_20.Vertices, Index=deface_15.CornerB, Wrap=True)
item_53 = ListItem(List=demesh_20.Vertices, Index=deface_15.CornerC, Wrap=True)
item_54 = ListItem(List=demesh_20.Vertices, Index=deface_15.CornerD, Wrap=True)
item_55 = ListItem(List=demesh_19.Vertices, Index=deface_14.CornerA, Wrap=True)
item_56 = ListItem(List=demesh_19.Vertices, Index=deface_14.CornerB, Wrap=True)
item_57 = ListItem(List=demesh_19.Vertices, Index=deface_14.CornerC, Wrap=True)
item_58 = ListItem(List=demesh_19.Vertices, Index=deface_14.CornerD, Wrap=True)
tbox_5 = TwistedBox(
    CornerA=item_51,
    CornerB=item_52,
    CornerC=item_53,
    CornerD=item_54,
    CornerE=item_55,
    CornerF=item_56,
    CornerG=item_57,
    CornerH=item_58)  # -> flatten(TwistedBox)
mesh_18 = Mesh(conmesh_20)
quad_meshes_2 = QuadMeshes(mesh_18)  # Quad meshes generated from the input mesh
voxels_7 = Voxels(tbox_5)  # Voxels to be filled with unit cells

plane = Plane()  # Base plane for voxels
geometry_2 = Geometry()  # Geometry to voxelize
x_parameter = XParameter()  # Range of numbers (0-1) for X divisions of the bounding box
y_parameter = YParameter()  # Range of numbers (0-1) for Y divisions of the bounding box
z_parameter_3 = ZParameter()  # Range of numbers (0-1) for Z divisions of the bounding box
fill_completely_2 = FillCompletely()  # If true, Voxels will fill entire volume. If false, only Voxels with their centroid within the volume will be kept.
mesh_19 = Mesh(geometry_2)
pln = Plane(plane)
num_20 = Number(y_parameter)
bool_4 = Boolean(fill_completely_2)
num_21 = Number(x_parameter)
num_22 = Number(z_parameter_3)
bbox_2 = BoundingBox(Content=mesh_19, Plane=pln)  # -> Box, Box_2
edges = BrepEdges(Brep=bbox_2.Box)  # -> Naked, Interior, NonManifold
crossref_2 = CrossReference(ListA=num_20, ListB=num_22, CrossMode=1)  # -> ListA, ListB
item_59 = ListItem(List=edges.Interior, Index="8", Wrap=True)
toggle_4 = BooleanToggle(False)
toggle_5 = BooleanToggle(True)
item_60 = ListItem(List=edges.Interior, Index="1", Wrap=True)
item_61 = ListItem(List=edges.Interior, Index="0", Wrap=True)
box_2 = EvaluateBox(Box=bbox_2.Box, UParameter=graft(num_21), VParameter=crossref_2.ListA, WParameter=crossref_2.ListB)  # -> Plane, Point, Include
len = Length(Curve=item_60)
len_2 = Length(Curve=item_61)
len_3 = Length(Curve=item_59)
dom_8 = ConstructDomain(DomainStart=0, DomainEnd=len)
dom_9 = ConstructDomain(DomainStart=0, DomainEnd=len_2)
dom_10 = ConstructDomain(DomainStart=0, DomainEnd=len_3)
remap_9 = RemapNumbers(Value=num_21, Source=Domain(0, 1), Target=dom_9)  # -> Mapped, Clipped
remap_10 = RemapNumbers(Value=num_20, Source=Domain(0, 1), Target=dom_8)  # -> Mapped, Clipped
remap_11 = RemapNumbers(Value=num_22, Source=Domain(0, 1), Target=dom_10)  # -> Mapped, Clipped
shift_7 = ShiftList(List=remap_10.Mapped, Shift="-1", Wrap=toggle_4)
shift_8 = ShiftList(List=remap_10.Mapped, Shift="1", Wrap=toggle_4)
shift_9 = ShiftList(List=remap_9.Mapped, Shift="-1", Wrap=toggle_4)
shift_10 = ShiftList(List=remap_9.Mapped, Shift="1", Wrap=toggle_4)
shift_11 = ShiftList(List=remap_11.Mapped, Shift="-1", Wrap=toggle_4)
shift_12 = ShiftList(List=remap_11.Mapped, Shift="1", Wrap=toggle_4)
subtraction = Subtraction(A=shift_8, B=shift_7)
subtraction_2 = Subtraction(A=shift_10, B=shift_9)
subtraction_3 = Subtraction(A=shift_12, B=shift_11)
division_16 = Division(A=subtraction, B="2")
division_17 = Division(A=subtraction_2, B="2")
division_18 = Division(A=subtraction_3, B="2")
shift_13 = ShiftList(List=division_16, Shift="1", Wrap=toggle_5)
neg = Negative(Value=division_16)
neg_2 = Negative(Value=division_17)
shift_14 = ShiftList(List=division_17, Shift="1", Wrap=toggle_5)
shift_15 = ShiftList(List=division_18, Shift="1", Wrap=toggle_5)
neg_3 = Negative(Value=division_18)
panel_29 = Panel("VOXELIZE (parameter)")
dom_11 = ConstructDomain(DomainStart=neg, DomainEnd=division_16)
dom_12 = ConstructDomain(DomainStart=neg, DomainEnd=shift_13)
dom_13 = ConstructDomain(DomainStart=neg_2, DomainEnd=division_17)
dom_14 = ConstructDomain(DomainStart=neg_2, DomainEnd=shift_14)
dom_15 = ConstructDomain(DomainStart=neg_3, DomainEnd=division_18)
dom_16 = ConstructDomain(DomainStart=neg_3, DomainEnd=shift_15)
rev_2 = ReverseList(List=dom_11)
rev_3 = ReverseList(List=dom_13)
shift_16 = ShiftList(List=dom_12, Shift="-1", Wrap=toggle_4)
shift_17 = ShiftList(List=dom_14, Shift="-1", Wrap=toggle_4)
rev_4 = ReverseList(List=dom_15)
shift_18 = ShiftList(List=dom_16, Shift="-1", Wrap=toggle_4)
item_62 = ListItem(List=dom_13, Index=0, Wrap=True)
item_63 = ListItem(List=dom_11, Index=0, Wrap=True)
item_64 = ListItem(List=rev_2, Index=0, Wrap=True)
item_65 = ListItem(List=rev_3, Index=0, Wrap=True)
item_66 = ListItem(List=dom_15, Index=0, Wrap=True)
item_67 = ListItem(List=rev_4, Index=0, Wrap=True)
entwine_16 = Entwine(Branch00=item_63, Branch01=shift_16, Branch02=item_64, FlattenInputs=True)  # -> flatten(Result)
entwine_17 = Entwine(Branch00=item_62, Branch01=shift_17, Branch02=item_65, FlattenInputs=True)  # -> flatten(Result)
entwine_18 = Entwine(Branch00=item_66, Branch01=shift_18, Branch02=item_67, FlattenInputs=True)  # -> flatten(Result)
sort_2 = SortList(Keys=flatten([subtraction_3, subtraction, subtraction_2]))  # -> Keys, ValuesA
crossref_3 = CrossReference(ListA=entwine_16, ListB=entwine_18, CrossMode=1)  # -> ListA, ListB
rev_5 = ReverseList(List=sort_2.Keys)
box_3 = DomainBox(Base=simplify(box_2.Plane), X=graft(entwine_17), Y=crossref_3.ListA, Z=crossref_3.ListB)
item_68 = ListItem(List=rev_5, Index=0, Wrap=True)
minc_2 = MeshInclusion(Mesh=mesh_19, Point=box_2.Plane, Strict=False)
cull_15 = CullPattern(List=box_3, CullPattern=minc_2)
meshcp_7 = MeshClosestPoint(Point=box_2.Plane, Mesh=mesh_19)  # -> Point, Index, Parameter
dist_2 = Distance(PointA=box_2.Plane, PointB=meshcp_7.Point)
expression_18 = Expression(a=item_68, d=dist_2, Expression="if(d<sqrt(2*(a/2)^2),True,False)")
cull_16 = CullPattern(List=box_3, CullPattern=expression_18)
cull_17 = CullPattern(List=cull_16, CullPattern=bool_4)
merge_2 = Merge(Data1=cull_15, Data2=cull_17)
voxels_8 = Voxels(merge_2)  # Voxels to be filled with unit cells

# ----
# Morph Between Meshes (parameter)
meshes = Meshes()  # Meshes to morph between (must have identical topology)
triangulated_3 = Triangulated()  # True if mesh is triangulated. False if mesh is quads.
z_parameter_4 = ZParameter()  # Range of numbers (0-1) for Z divisions
bool_5 = Boolean(triangulated_3)
mesh_20 = Mesh(meshes)
num_23 = Number(z_parameter_4)
not_5 = GateNot(A=bool_5)
cull_18 = CullPattern(List=mesh_20, CullPattern=bool_5)
weld_6 = WeldMesh(Mesh=cull_18, Angle=3.141592654)
demesh_21 = DeconstructMesh(Mesh=weld_6)  # -> Vertices, Faces, Colours, Normals
deface_16 = DeconstructFace(Face=demesh_21.Faces)  # -> CornerA, CornerB, CornerC, CornerD
item_69 = ListItem(List=demesh_21.Vertices, Index=deface_16.CornerA, Wrap=True)
item_70 = ListItem(List=demesh_21.Vertices, Index=deface_16.CornerC, Wrap=True)
item_71 = ListItem(List=demesh_21.Vertices, Index=deface_16.CornerB, Wrap=True)
addition_17 = Addition(A=item_69, B=item_71)
addition_18 = Addition(A=item_69, B=item_70)
addition_19 = Addition(A=item_71, B=item_70)
bcentric_6 = Barycentric(PointA=item_69, PointB=item_71, PointC=item_70, CoordinateU=1, CoordinateV=1, CoordinateW=1)
division_19 = Division(A=addition_17, B="2")
division_20 = Division(A=addition_19, B="2")
division_21 = Division(A=addition_18, B="2")
entwine_19 = Entwine(Branch00=item_69, Branch01=division_19, Branch02=bcentric_6, Branch03=division_21, FlattenInputs=True)
entwine_20 = Entwine(Branch00=item_71, Branch01=division_20, Branch02=bcentric_6, Branch03=division_19, FlattenInputs=True)
entwine_21 = Entwine(Branch00=item_70, Branch01=division_21, Branch02=bcentric_6, Branch03=division_20, FlattenInputs=True)
flip_18 = FlipMatrix(Data=entwine_20)
flip_19 = FlipMatrix(Data=entwine_19)
quad_16 = MeshQuad(CornerA=0, CornerB=1, CornerC=2, CornerD=3)
flip_20 = FlipMatrix(Data=entwine_21)
lng_3 = ListLength(List=demesh_21.Faces)  # -> flatten(Length)
conmesh_21 = ConstructMesh(Vertices=flip_19, Faces=quad_16)
conmesh_22 = ConstructMesh(Vertices=flip_20, Faces=quad_16)
conmesh_23 = ConstructMesh(Vertices=flip_18, Faces=quad_16)
item_72 = ListItem(List=lng_3, Index=0, Wrap=True)
trim = TrimTree(Tree=conmesh_21, Depth=1)
trim_2 = TrimTree(Tree=conmesh_23, Depth=1)
trim_3 = TrimTree(Tree=conmesh_22, Depth=1)
partition = PartitionList(List=trim_2, Size=item_72)
partition_2 = PartitionList(List=trim, Size=item_72)
partition_3 = PartitionList(List=trim_3, Size=item_72)
merge_3 = Merge(Data1=partition_2, Data2=partition, Data3=partition_3)
toggle_6 = BooleanToggle(True)
cull_19 = CullPattern(List=mesh_20, CullPattern=not_5)
mjoin_6 = MeshJoin(Meshes=merge_3)
clean = CleanTree(RemoveNulls=True, RemoveInvalid=True, RemoveEmpty=toggle_6, Tree=cull_19)
clean_2 = CleanTree(RemoveNulls=True, RemoveInvalid=True, RemoveEmpty=toggle_6, Tree=mjoin_6)
demesh_22 = DeconstructMesh(Mesh=simplify([clean_2, clean]))  # -> simplify(Vertices), Faces, Colours, Normals
flip_21 = FlipMatrix(Data=demesh_22.Vertices)
pline_2 = PolyLine(Vertices=flip_21, Closed=False)
eval_2 = EvaluateCurve(Curve=reparameterize(pline_2), Parameter=num_23)  # -> Point, Tangent, Angle
toggle_7 = BooleanToggle(False)
flip_22 = FlipMatrix(Data=eval_2.Point)
conmesh_24 = ConstructMesh(Vertices=flip_22, Faces=demesh_22.Faces)  # -> flatten(Mesh)
shift_19 = ShiftList(List=flatten(conmesh_24), Shift="1", Wrap=toggle_7)
shift_20 = ShiftList(List=flatten(conmesh_24), Shift="-1", Wrap=toggle_7)
demesh_23 = DeconstructMesh(Mesh=shift_20)  # -> Vertices, Faces, Colours, Normals
demesh_24 = DeconstructMesh(Mesh=shift_19)  # -> Vertices, Faces, Colours, Normals
deface_17 = DeconstructFace(Face=demesh_24.Faces)  # -> CornerA, CornerB, CornerC, CornerD
deface_18 = DeconstructFace(Face=demesh_23.Faces)  # -> CornerA, CornerB, CornerC, CornerD
item_73 = ListItem(List=demesh_24.Vertices, Index=deface_17.CornerA, Wrap=True)
item_74 = ListItem(List=demesh_24.Vertices, Index=deface_17.CornerB, Wrap=True)
item_75 = ListItem(List=demesh_24.Vertices, Index=deface_17.CornerC, Wrap=True)
item_76 = ListItem(List=demesh_24.Vertices, Index=deface_17.CornerD, Wrap=True)
item_77 = ListItem(List=demesh_23.Vertices, Index=deface_18.CornerA, Wrap=True)
item_78 = ListItem(List=demesh_23.Vertices, Index=deface_18.CornerB, Wrap=True)
item_79 = ListItem(List=demesh_23.Vertices, Index=deface_18.CornerC, Wrap=True)
item_80 = ListItem(List=demesh_23.Vertices, Index=deface_18.CornerD, Wrap=True)
tbox_6 = TwistedBox(
    CornerA=item_73,
    CornerB=item_74,
    CornerC=item_75,
    CornerD=item_76,
    CornerE=item_77,
    CornerF=item_78,
    CornerG=item_79,
    CornerH=item_80)  # -> flatten(TwistedBox)
mesh_21 = Mesh(conmesh_24)
quad_meshes_3 = QuadMeshes(mesh_21)  # Quad meshes generated from the input mesh
voxels_9 = Voxels(tbox_6)  # Voxels to be filled with unit cells

triangulated_4 = Triangulated()  # True if mesh is triangulated. False if mesh is quads.
mesh_22 = Mesh()  # Mesh to offset
distance_2 = Distance()  # Offset distance
z_parameter_5 = ZParameter()  # Range of numbers (0-1) for Z divisions
bool_6 = Boolean(triangulated_4)
mesh_23 = Mesh(mesh_22)
cull_20 = CullPattern(List=mesh_23, CullPattern=bool_6)
not_6 = GateNot(A=bool_6)
num_24 = Number(z_parameter_5)
num_25 = Number(distance_2)
weld_7 = WeldMesh(Mesh=cull_20, Angle=3.141592654)
demesh_25 = DeconstructMesh(Mesh=weld_7)  # -> Vertices, Faces, Colours, Normals
deface_19 = DeconstructFace(Face=demesh_25.Faces)  # -> CornerA, CornerB, CornerC, CornerD
item_81 = ListItem(List=demesh_25.Vertices, Index=deface_19.CornerA, Wrap=True)
item_82 = ListItem(List=demesh_25.Vertices, Index=deface_19.CornerC, Wrap=True)
item_83 = ListItem(List=demesh_25.Vertices, Index=deface_19.CornerB, Wrap=True)
addition_20 = Addition(A=item_81, B=item_83)
addition_21 = Addition(A=item_81, B=item_82)
addition_22 = Addition(A=item_83, B=item_82)
bcentric_7 = Barycentric(PointA=item_81, PointB=item_83, PointC=item_82, CoordinateU=1, CoordinateV=1, CoordinateW=1)
division_22 = Division(A=addition_20, B="2")
division_23 = Division(A=addition_22, B="2")
division_24 = Division(A=addition_21, B="2")
entwine_22 = Entwine(Branch00=item_81, Branch01=division_22, Branch02=bcentric_7, Branch03=division_24, FlattenInputs=True)
entwine_23 = Entwine(Branch00=item_83, Branch01=division_23, Branch02=bcentric_7, Branch03=division_22, FlattenInputs=True)
entwine_24 = Entwine(Branch00=item_82, Branch01=division_24, Branch02=bcentric_7, Branch03=division_23, FlattenInputs=True)
flip_23 = FlipMatrix(Data=entwine_22)
flip_24 = FlipMatrix(Data=entwine_24)
flip_25 = FlipMatrix(Data=entwine_23)
quad_17 = MeshQuad(CornerA=0, CornerB=1, CornerC=2, CornerD=3)
quad_18 = MeshQuad(CornerA=0, CornerB=1, CornerC=2, CornerD=3)
quad_19 = MeshQuad(CornerA=0, CornerB=1, CornerC=2, CornerD=3)
panel_44 = Panel("MESH OFFSET (parameter)")
conmesh_25 = ConstructMesh(Vertices=flip_24, Faces=quad_18)
conmesh_26 = ConstructMesh(Vertices=flip_25, Faces=quad_19)
conmesh_27 = ConstructMesh(Vertices=flip_23, Faces=quad_17)
mjoin_7 = MeshJoin(Meshes=flatten([conmesh_27, conmesh_26, conmesh_25]))
cull_21 = CullPattern(List=mesh_23, CullPattern=not_6)
demesh_26 = DeconstructMesh(Mesh=[cull_21, mjoin_7])  # -> Vertices, Faces, Colours, Normals
dom_17 = ConstructDomain(DomainStart=0, DomainEnd=num_25)
meshcp_8 = MeshClosestPoint(Point=demesh_26.Vertices, Mesh=mesh_23)  # -> Point, Index, Parameter
remap_12 = RemapNumbers(Value=num_24, Source=Domain(0, 1), Target=dom_17)  # -> Mapped, Clipped
meval_6 = MeshEval(Mesh=mesh_23, Parameter=meshcp_8.Parameter)  # -> Point, Normal, Colour
amp_6 = Amplitude(Vector=meval_6.Normal, Amplitude=graft(remap_12.Mapped))
toggle_8 = BooleanToggle(False)
move_6 = Move(Geometry=demesh_26.Vertices, Motion=amp_6)  # -> Geometry, Transform
conmesh_28 = ConstructMesh(Vertices=move_6.Geometry, Faces=demesh_26.Faces)  # -> flatten(Mesh)
shift_21 = ShiftList(List=flatten(conmesh_28), Shift="1", Wrap=toggle_8)
shift_22 = ShiftList(List=flatten(conmesh_28), Shift="-1", Wrap=toggle_8)
demesh_27 = DeconstructMesh(Mesh=shift_22)  # -> Vertices, Faces, Colours, Normals
demesh_28 = DeconstructMesh(Mesh=shift_21)  # -> Vertices, Faces, Colours, Normals
deface_20 = DeconstructFace(Face=demesh_28.Faces)  # -> CornerA, CornerB, CornerC, CornerD
deface_21 = DeconstructFace(Face=demesh_27.Faces)  # -> CornerA, CornerB, CornerC, CornerD
item_84 = ListItem(List=demesh_28.Vertices, Index=deface_20.CornerA, Wrap=True)
item_85 = ListItem(List=demesh_28.Vertices, Index=deface_20.CornerB, Wrap=True)
item_86 = ListItem(List=demesh_28.Vertices, Index=deface_20.CornerC, Wrap=True)
item_87 = ListItem(List=demesh_28.Vertices, Index=deface_20.CornerD, Wrap=True)
item_88 = ListItem(List=demesh_27.Vertices, Index=deface_21.CornerA, Wrap=True)
item_89 = ListItem(List=demesh_27.Vertices, Index=deface_21.CornerB, Wrap=True)
item_90 = ListItem(List=demesh_27.Vertices, Index=deface_21.CornerC, Wrap=True)
item_91 = ListItem(List=demesh_27.Vertices, Index=deface_21.CornerD, Wrap=True)
tbox_7 = TwistedBox(
    CornerA=item_84,
    CornerB=item_85,
    CornerC=item_86,
    CornerD=item_87,
    CornerE=item_88,
    CornerF=item_89,
    CornerG=item_90,
    CornerH=item_91)  # -> flatten(TwistedBox)
mesh_24 = Mesh(conmesh_28)
quad_meshes_4 = QuadMeshes(mesh_24)  # Quad meshes generated from the input mesh
voxels_10 = Voxels(tbox_7)  # Voxels to be filled with unit cells

geometry_3 = Geometry()  # Geometry to conform to
curve = Curve()  # Curve to voxelize
division_paramter = DivisionParamter()  # Parameter for Voxel Divisions (0-1)
periodic = Periodic()  # Is curve closed? (Boolean)
radius_paramter = RadiusParamter()  # Parameter for pipe radius (0-1)
radius_domain = RadiusDomain()  # Domain of pipe radius (Domain)
distance_3 = Distance()  # Distance from surface (number)
thickness_paramter = ThicknessParamter()  # Parameter for pipe thickness (0-1)
rotation = Rotation()  # Rotation in degrees (number)
thickness_domain = ThicknessDomain()  # Domain of pipe thickness (Domain)
sides = Sides()  # Number of sides of pipe (number)
crv_2 = Curve(reparameterize(curve))
bool_7 = Boolean(periodic)
num_26 = Number(division_paramter)
num_27 = Number(radius_paramter)
num_28 = Number(distance_3)
geo_4 = Geometry(geometry_3)
domain = Domain(radius_domain)
num_29 = Number(rotation)
num_30 = Number(thickness_paramter)
num_31 = Number(sides)
domain_2 = Domain(thickness_domain)
lng_4 = ListLength(List=num_26)
multiplication_6 = Multiplication(A=lng_4, B="2")
divide_3 = DivideCurve(Curve=crv_2, Count=multiplication_6, Kinks=False)  # -> Points, Tangents, Parameters
intcrv = Interpolate(Vertices=divide_3.Points, Degree=3, Periodic=bool_7, KnotStyle=1)  # -> Curve, Length, Domain
pframe = PerpFrame(Curve=reparameterize(intcrv.Curve), Parameter=num_26)
mesh_25 = Mesh(geo_4)
pln_2 = Plane(pframe)
meshcp_9 = MeshClosestPoint(Point=pln_2, Mesh=mesh_25)  # -> Point, Index, Parameter
deplane = DeconstructPlane(Plane=pln_2)  # -> Origin, XAxis, YAxis, ZAxis
meval_7 = MeshEval(Mesh=mesh_25, Parameter=meshcp_9.Parameter)  # -> Point, Normal, Colour
panel_45 = Panel("Conformal Pipe Parameter")
line_2 = LineSDL(Start=deplane.Origin, Direction=deplane.XAxis, Length="10")
line_3 = LineSDL(Start=deplane.Origin, Direction=meval_7.Normal, Length="10")
angle = Angle(VectorA=line_2, VectorB=line_3, Plane=pln_2)  # -> Angle, Reflex
prot = RotatePlane(Plane=pln_2, Angle=angle.Angle)
amp_7 = Amplitude(Vector=meval_7.Normal, Amplitude=num_28)
move_7 = Move(Geometry=prot, Motion=amp_7)  # -> Geometry, Transform
rad = Radians(Degrees=num_29)
remap_13 = RemapNumbers(Value=num_27, Source=Domain(0, 1), Target=domain)  # -> Mapped, Clipped
remap_14 = RemapNumbers(Value=num_30, Source=Domain(0, 1), Target=domain_2)  # -> Mapped, Clipped
prot_2 = RotatePlane(Plane=move_7.Geometry, Angle=rad)
polygon = Polygon(Plane=prot_2, Radius=remap_13.Mapped, Segments=num_31, FilletRadius=0)  # -> Polygon, Length
offset = Offset(Curve=polygon.Polygon, Distance=remap_14.Mapped, Plane=prot_2, Corners=1)
disc = Discontinuity(Curve=offset, Level=1)  # -> simplify(Points), Parameters
disc_2 = Discontinuity(Curve=polygon.Polygon, Level=1)  # -> simplify(Points), Parameters
toggle_9 = BooleanToggle(False)
toggle_10 = BooleanToggle(True)
flip_26 = FlipMatrix(Data=disc_2.Points)
flip_27 = FlipMatrix(Data=disc.Points)
shift_23 = ShiftList(List=flip_26, Shift="1", Wrap=toggle_9)
shift_24 = ShiftList(List=flip_27, Shift="-1", Wrap=toggle_9)
shift_25 = ShiftList(List=flip_26, Shift="-1", Wrap=toggle_9)
shift_26 = ShiftList(List=flip_27, Shift="1", Wrap=toggle_9)
flip_28 = FlipMatrix(Data=shift_23)
flip_29 = FlipMatrix(Data=shift_24)
flip_30 = FlipMatrix(Data=shift_26)
flip_31 = FlipMatrix(Data=shift_25)
shift_27 = ShiftList(List=flip_30, Shift="1", Wrap=toggle_10)
shift_28 = ShiftList(List=flip_29, Shift="1", Wrap=toggle_10)
shift_29 = ShiftList(List=flip_28, Shift="1", Wrap=toggle_10)
shift_30 = ShiftList(List=flip_31, Shift="1", Wrap=toggle_10)
tbox_8 = TwistedBox(
    CornerA=flip_29,
    CornerB=shift_28,
    CornerC=shift_27,
    CornerD=flip_30,
    CornerE=flip_31,
    CornerF=shift_30,
    CornerG=shift_29,
    CornerH=flip_28)
voxels_11 = Voxels(tbox_8)  # Voxels to be filled with unit cells

voxel_size_x_2 = VoxelSizeX()  # Voxel size int the X direction
voxel_size_y_2 = VoxelSizeY()  # Voxel size int the Y direction
voxel_size_z_2 = VoxelSizeZ()  # Voxel size int the Z direction
plane_2 = Plane()  # Base plane for voxels
geometry_4 = Geometry()  # Geometry to voxelize
fill_completely_3 = FillCompletely()  # If true, Voxels will fill entire volume. If false, only Voxels with their centroid within the volume will be kept.
mesh_26 = Mesh(geometry_4)
pln_3 = Plane(plane_2)
bool_8 = Boolean(fill_completely_3)
num_32 = Number(voxel_size_x_2)
num_33 = Number(voxel_size_y_2)
num_34 = Number(voxel_size_z_2)
bbox_3 = BoundingBox(Content=mesh_26, Plane=pln_3)  # -> Box, Box_2
edges_2 = BrepEdges(Brep=bbox_3.Box)  # -> Naked, Interior, NonManifold
item_92 = ListItem(List=edges_2.Interior, Index="8", Wrap=True)
item_93 = ListItem(List=edges_2.Interior, Index="1", Wrap=True)
item_94 = ListItem(List=edges_2.Interior, Index="0", Wrap=True)
divlength = DivideLength(Curve=reparameterize(item_93), Length=num_33)  # -> Points, Tangents, Parameters
divlength_2 = DivideLength(Curve=reparameterize(item_94), Length=num_32)  # -> Points, Tangents, Parameters
divlength_3 = DivideLength(Curve=reparameterize(item_92), Length=num_34)  # -> Points, Tangents, Parameters
reldif = RelativeDifferences(Values=divlength.Parameters)
reldif_2 = RelativeDifferences(Values=divlength_2.Parameters)
reldif_3 = RelativeDifferences(Values=divlength_3.Parameters)
item_95 = ListItem(List=reverse(divlength.Parameters), Index=0, Wrap=True)
item_96 = ListItem(List=reverse(reldif), Index=0, Wrap=True)
item_97 = ListItem(List=reverse(divlength_2.Parameters), Index=0, Wrap=True)
item_98 = ListItem(List=reverse(reldif_2), Index=0, Wrap=True)
item_99 = ListItem(List=reverse(divlength_3.Parameters), Index=0, Wrap=True)
item_100 = ListItem(List=reverse(reldif_3), Index=0, Wrap=True)
addition_23 = Addition(A=item_96, B=item_95)
addition_24 = Addition(A=item_98, B=item_97)
addition_25 = Addition(A=item_100, B=item_99)
merge_4 = Merge(Data1=divlength.Parameters, Data2=addition_23)
merge_5 = Merge(Data1=divlength_2.Parameters, Data2=addition_24)
merge_6 = Merge(Data1=divlength_3.Parameters, Data2=addition_25)
crossref_4 = CrossReference(ListA=merge_4, ListB=merge_6, CrossMode=1)  # -> ListA, ListB
box_4 = EvaluateBox(Box=bbox_3.Box, UParameter=graft(merge_5), VParameter=crossref_4.ListA, WParameter=crossref_4.ListB)  # -> Plane, Point, Include
panel_46 = Panel("Voxelize")
division_25 = Division(A=num_34, B="2")
division_26 = Division(A=num_33, B="2")
division_27 = Division(A=num_32, B="2")
neg_4 = Negative(Value=division_25)
neg_5 = Negative(Value=division_26)
neg_6 = Negative(Value=division_27)
dom_18 = ConstructDomain(DomainStart=neg_4, DomainEnd=division_25)
dom_19 = ConstructDomain(DomainStart=neg_5, DomainEnd=division_26)
dom_20 = ConstructDomain(DomainStart=neg_6, DomainEnd=division_27)
crossref_5 = CrossReference(ListA=dom_19, ListB=dom_18, CrossMode=1)  # -> ListA, ListB
box_5 = DomainBox(Base=simplify(box_4.Plane), X=graft(dom_20), Y=crossref_5.ListA, Z=crossref_5.ListB)
minc_3 = MeshInclusion(Mesh=mesh_26, Point=box_4.Plane, Strict=False)
sort_3 = SortList(Keys=[num_32, num_33, num_34])  # -> Keys, ValuesA
cull_22 = CullPattern(List=box_5, CullPattern=minc_3)
meshcp_10 = MeshClosestPoint(Point=box_4.Plane, Mesh=mesh_26)  # -> Point, Index, Parameter
dist_3 = Distance(PointA=box_4.Plane, PointB=meshcp_10.Point)
expression_19 = Expression(a=sort_3.Keys, d=dist_3, Expression="if(d<sqrt(2*(a/2)^2),True,False)")
cull_23 = CullPattern(List=box_5, CullPattern=expression_19)
cull_24 = CullPattern(List=cull_23, CullPattern=bool_8)
merge_7 = Merge(Data1=cull_22, Data2=cull_24)
voxels_12 = Voxels(merge_7)  # Voxels to be filled with unit cells

geometry_5 = Geometry()  # Geometry to conform to
curve_2 = Curve()  # Curve to voxelize
length = Length()  # Length of Voxels
periodic_2 = Periodic()  # Is curve closed? (Boolean)
thickness = Thickness()  # Thickness of pipe (number)
distance_4 = Distance()  # Distance from surface (number)
radius = Radius()  # Inner radius of pipe (number)
rotation_2 = Rotation()  # Rotation in degrees (number)
sides_2 = Sides()  # Number of sides of pipe (number)
crv_3 = Curve(reparameterize(curve_2))
num_35 = Number(distance_4)
num_36 = Number(length)
num_37 = Number(thickness)
bool_9 = Boolean(periodic_2)
num_38 = Number(radius)
num_39 = Number(rotation_2)
geo_5 = Geometry(geometry_5)
num_40 = Number(sides_2)
divide_4 = DivideCurve(Curve=crv_3, Count="2000", Kinks=False)  # -> Points, Tangents, Parameters
intcrv_2 = Interpolate(Vertices=divide_4.Points, Degree=3, Periodic=False, KnotStyle=1)  # -> Curve, Length, Domain
divdist = DivideDistance(Curve=reparameterize(intcrv_2.Curve), Distance=num_36)  # -> Points, Tangents, Parameters
ins = InsertItems(List=reverse(divdist.Parameters), Item="0", Indices="0", Wrap=Toggle(True))  # -> reverse(List)
entwine_25 = Entwine(Branch00=divdist.Parameters, Branch01=ins, FlattenInputs=True)  # -> simplify(Result)
branch = TreeBranch(Tree=entwine_25, Path=bool_9, MaintainPaths=True)
mesh_27 = Mesh(geo_5)
pframe_2 = PerpFrame(Curve=reparameterize(intcrv_2.Curve), Parameter=branch)
pln_4 = Plane(pframe_2)
meshcp_11 = MeshClosestPoint(Point=pln_4, Mesh=mesh_27)  # -> Point, Index, Parameter
deplane_2 = DeconstructPlane(Plane=pln_4)  # -> Origin, XAxis, YAxis, ZAxis
meval_8 = MeshEval(Mesh=mesh_27, Parameter=meshcp_11.Parameter)  # -> Point, Normal, Colour
panel_47 = Panel("Conformal Pipe Distance")
line_4 = LineSDL(Start=deplane_2.Origin, Direction=deplane_2.XAxis, Length="10")
line_5 = LineSDL(Start=deplane_2.Origin, Direction=meval_8.Normal, Length="10")
angle_2 = Angle(VectorA=line_4, VectorB=line_5, Plane=pln_4)  # -> Angle, Reflex
prot_3 = RotatePlane(Plane=pln_4, Angle=angle_2.Angle)
amp_8 = Amplitude(Vector=meval_8.Normal, Amplitude=num_35)
move_8 = Move(Geometry=prot_3, Motion=amp_8)  # -> Geometry, Transform
rad_2 = Radians(Degrees=num_39)
prot_4 = RotatePlane(Plane=move_8.Geometry, Angle=rad_2)
polygon_2 = Polygon(Plane=prot_4, Radius=num_38, Segments=num_40, FilletRadius=0)  # -> Polygon, Length
offset_2 = Offset(Curve=polygon_2.Polygon, Distance=num_37, Plane=prot_4, Corners=1)
disc_3 = Discontinuity(Curve=offset_2, Level=1)  # -> simplify(Points), Parameters
disc_4 = Discontinuity(Curve=polygon_2.Polygon, Level=1)  # -> simplify(Points), Parameters
toggle_11 = BooleanToggle(False)
toggle_12 = BooleanToggle(True)
flip_32 = FlipMatrix(Data=disc_4.Points)
flip_33 = FlipMatrix(Data=disc_3.Points)
shift_31 = ShiftList(List=flip_32, Shift="1", Wrap=toggle_11)
shift_32 = ShiftList(List=flip_33, Shift="-1", Wrap=toggle_11)
shift_33 = ShiftList(List=flip_32, Shift="-1", Wrap=toggle_11)
shift_34 = ShiftList(List=flip_33, Shift="1", Wrap=toggle_11)
flip_34 = FlipMatrix(Data=shift_31)
flip_35 = FlipMatrix(Data=shift_32)
flip_36 = FlipMatrix(Data=shift_34)
flip_37 = FlipMatrix(Data=shift_33)
shift_35 = ShiftList(List=flip_36, Shift="1", Wrap=toggle_12)
shift_36 = ShiftList(List=flip_35, Shift="1", Wrap=toggle_12)
shift_37 = ShiftList(List=flip_34, Shift="1", Wrap=toggle_12)
shift_38 = ShiftList(List=flip_37, Shift="1", Wrap=toggle_12)
tbox_9 = TwistedBox(
    CornerA=flip_35,
    CornerB=shift_36,
    CornerC=shift_35,
    CornerD=flip_36,
    CornerE=flip_37,
    CornerF=shift_38,
    CornerG=shift_37,
    CornerH=flip_34)
voxels_13 = Voxels(tbox_9)  # Voxels to be filled with unit cells

curve_3 = Curve()  # Curve to voxelize
geometry_6 = Geometry()  # Geometry to conform to
periodic_3 = Periodic()  # Is curve closed? (Boolean)
length_2 = Length()  # Length of Voxels
height = Height()  # Voxel Height
width = Width()  # Voxel Width
crv_4 = Curve(reparameterize(curve_3))
bool_10 = Boolean(periodic_3)
num_41 = Number(length_2)
geo_6 = Geometry(geometry_6)
num_42 = Number(height)
num_43 = Number(width)
divide_5 = DivideCurve(Curve=reparameterize(crv_4), Count="2000", Kinks=False)  # -> Points, Tangents, Parameters
intcrv_3 = Interpolate(Vertices=divide_5.Points, Degree=3, Periodic=False, KnotStyle=1)  # -> Curve, Length, Domain
divdist_2 = DivideDistance(Curve=reparameterize(intcrv_3.Curve), Distance=num_41)  # -> Points, Tangents, Parameters
ins_2 = InsertItems(List=reverse(divdist_2.Parameters), Item="0", Indices="0", Wrap=Toggle(True))  # -> reverse(List)
entwine_26 = Entwine(Branch00=divdist_2.Parameters, Branch01=ins_2, FlattenInputs=True)  # -> simplify(Result)
branch_2 = TreeBranch(Tree=entwine_26, Path=bool_10, MaintainPaths=True)
mesh_28 = Mesh(geo_6)
pframe_3 = PerpFrame(Curve=reparameterize(intcrv_3.Curve), Parameter=branch_2)
pln_5 = Plane(pframe_3)
meshcp_12 = MeshClosestPoint(Point=pln_5, Mesh=mesh_28)  # -> Point, Index, Parameter
deplane_3 = DeconstructPlane(Plane=pln_5)  # -> Origin, XAxis, YAxis, ZAxis
meval_9 = MeshEval(Mesh=mesh_28, Parameter=meshcp_12.Parameter)  # -> Point, Normal, Colour
panel_48 = Panel("Conformal Rib Distance")
line_6 = LineSDL(Start=deplane_3.Origin, Direction=meval_9.Normal, Length="10")
line_7 = LineSDL(Start=deplane_3.Origin, Direction=deplane_3.XAxis, Length="10")
division_28 = Division(A=num_43, B="2")
angle_3 = Angle(VectorA=line_7, VectorB=line_6, Plane=pln_5)  # -> Angle, Reflex
neg_7 = Negative(Value=division_28)
prot_5 = RotatePlane(Plane=pln_5, Angle=angle_3.Angle)
dom_21 = ConstructDomain(DomainStart=neg_7, DomainEnd=division_28)
rectangle = Rectangle(Plane=prot_5, XSize=num_42, YSize=dom_21, Radius=0)  # -> Rectangle, Length
disc_5 = Discontinuity(Curve=rectangle.Rectangle, Level=1)  # -> simplify(Points), Parameters
toggle_13 = BooleanToggle(False)
flip_38 = FlipMatrix(Data=disc_5.Points)
shift_39 = ShiftList(List=flip_38, Shift="-1", Wrap=toggle_13)
shift_40 = ShiftList(List=flip_38, Shift="1", Wrap=toggle_13)
flip_39 = FlipMatrix(Data=shift_39)
flip_40 = FlipMatrix(Data=shift_40)
item_101 = ListItem(List=flip_39, Index="1", Wrap=True)
item_102 = ListItem(List=flip_40, Index="1", Wrap=True)
item_103 = ListItem(List=flip_39, Index="0", Wrap=True)
item_104 = ListItem(List=flip_39, Index="3", Wrap=True)
item_105 = ListItem(List=flip_40, Index="3", Wrap=True)
item_106 = ListItem(List=flip_39, Index="2", Wrap=True)
item_107 = ListItem(List=flip_40, Index="2", Wrap=True)
item_108 = ListItem(List=flip_40, Index="0", Wrap=True)
tbox_10 = TwistedBox(
    CornerA=item_103,
    CornerB=item_101,
    CornerC=item_106,
    CornerD=item_104,
    CornerE=item_108,
    CornerF=item_102,
    CornerG=item_107,
    CornerH=item_105)
voxels_14 = Voxels(tbox_10)  # Voxels to be filled with unit cells

width_paramter = WidthParamter()  # Parameter for Voxel width (0-1)
height_domain = HeightDomain()  # Domain of Voxel Height (Domain)
height_paramter = HeightParamter()  # Parameter for Voxel Height (0-1)
geometry_7 = Geometry()  # Geometry to conform to
curve_4 = Curve()  # Curve to voxelize
periodic_4 = Periodic()  # Is curve closed? (Boolean)
division_paramter_2 = DivisionParamter()  # Parameter for Voxel Divisions (0-1)
width_domain = WidthDomain()  # Domain of Voxel Width (Domain)
num_44 = Number(height_paramter)
crv_5 = Curve(reparameterize(curve_4))
domain_3 = Domain(height_domain)
bool_11 = Boolean(periodic_4)
geo_7 = Geometry(geometry_7)
num_45 = Number(width_paramter)
domain_4 = Domain(width_domain)
num_46 = Number(division_paramter_2)
lng_5 = ListLength(List=num_46)
multiplication_7 = Multiplication(A=lng_5, B="2")
divide_6 = DivideCurve(Curve=reparameterize(crv_5), Count=multiplication_7, Kinks=False)  # -> Points, Tangents, Parameters
intcrv_4 = Interpolate(Vertices=divide_6.Points, Degree=3, Periodic=bool_11, KnotStyle=1)  # -> Curve, Length, Domain
mesh_29 = Mesh(geo_7)
pframe_4 = PerpFrame(Curve=reparameterize(intcrv_4.Curve), Parameter=num_46)
pln_6 = Plane(pframe_4)
meshcp_13 = MeshClosestPoint(Point=pln_6, Mesh=mesh_29)  # -> Point, Index, Parameter
remap_15 = RemapNumbers(Value=num_45, Source=Domain(0, 1), Target=domain_4)  # -> Mapped, Clipped
remap_16 = RemapNumbers(Value=num_44, Source=Domain(0, 1), Target=domain_3)  # -> Mapped, Clipped
meval_10 = MeshEval(Mesh=mesh_29, Parameter=meshcp_13.Parameter)  # -> Point, Normal, Colour
deplane_4 = DeconstructPlane(Plane=pln_6)  # -> Origin, XAxis, YAxis, ZAxis
division_29 = Division(A=remap_15.Mapped, B="2")
neg_8 = Negative(Value=division_29)
panel_49 = Panel("Conformal Ribs Parameter")
dom_22 = ConstructDomain(DomainStart="0", DomainEnd=remap_16.Mapped)
line_8 = LineSDL(Start=deplane_4.Origin, Direction=meval_10.Normal, Length="10")
line_9 = LineSDL(Start=deplane_4.Origin, Direction=deplane_4.XAxis, Length="10")
dom_23 = ConstructDomain(DomainStart=neg_8, DomainEnd=division_29)
angle_4 = Angle(VectorA=line_9, VectorB=line_8, Plane=pln_6)  # -> Angle, Reflex
prot_6 = RotatePlane(Plane=pln_6, Angle=angle_4.Angle)
rectangle_2 = Rectangle(Plane=prot_6, XSize=dom_22, YSize=dom_23, Radius=0)  # -> Rectangle, Length
disc_6 = Discontinuity(Curve=rectangle_2.Rectangle, Level=1)  # -> simplify(Points), Parameters
toggle_14 = BooleanToggle(False)
flip_41 = FlipMatrix(Data=disc_6.Points)
shift_41 = ShiftList(List=flip_41, Shift="-1", Wrap=toggle_14)
shift_42 = ShiftList(List=flip_41, Shift="1", Wrap=toggle_14)
flip_42 = FlipMatrix(Data=shift_41)
flip_43 = FlipMatrix(Data=shift_42)
item_109 = ListItem(List=flip_42, Index="1", Wrap=True)
item_110 = ListItem(List=flip_43, Index="1", Wrap=True)
item_111 = ListItem(List=flip_42, Index="0", Wrap=True)
item_112 = ListItem(List=flip_42, Index="3", Wrap=True)
item_113 = ListItem(List=flip_43, Index="3", Wrap=True)
item_114 = ListItem(List=flip_42, Index="2", Wrap=True)
item_115 = ListItem(List=flip_43, Index="2", Wrap=True)
item_116 = ListItem(List=flip_43, Index="0", Wrap=True)
tbox_11 = TwistedBox(
    CornerA=item_111,
    CornerB=item_109,
    CornerC=item_114,
    CornerD=item_112,
    CornerE=item_116,
    CornerF=item_110,
    CornerG=item_115,
    CornerH=item_113)
voxels_15 = Voxels(tbox_11)  # Voxels to be filled with unit cells

# ----
# MORPH BETWEEN SURFACES (parameter)
x_parameter_2 = XParameter()  # Range of numbers (0-1) for X divisions
z_parameter_6 = ZParameter()  # Range of numbers (0-1) for Z divisions
surfaces_2 = Surfaces()  # At least 2 surfaces to morph voxels between
y_parameter_2 = YParameter()  # Range of numbers (0-1) for Y divisions
srf_2 = Surface(flatten(surfaces_2))
num_47 = Number(x_parameter_2)
num_48 = Number(y_parameter_2)
num_49 = Number(z_parameter_6)
pt_4 = ConstructPoint(XCoordinate=simplify(graft(num_47)), YCoordinate=simplify(num_48), ZCoordinate=0)  # -> simplify(Point)
lng_6 = ListLength(List=num_47)
num_50 = Number(lng_6)
evalsrf = EvaluateSurface(Surface=reparameterize(simplify(srf_2)), Point=simplify(graft(pt_4)))  # -> simplify(Point), Normal, Frame
pline_3 = PolyLine(Vertices=evalsrf.Point, Closed=False)
eval_3 = EvaluateCurve(Curve=reparameterize(pline_3), Parameter=num_49)  # -> Point, Tangent, Angle
path_mapper = PathMapper(eval_3.Point, source="{A;B}(i)", target="{B;A}(i)")
path_mapper_2 = PathMapper(path_mapper, source="{A;B}", target="{path_index}")
toggle_15 = BooleanToggle(False)
shift_43 = ShiftList(List=path_mapper_2, Shift="1", Wrap=toggle_15)
shift_44 = ShiftList(List=path_mapper_2, Shift="-1", Wrap=toggle_15)
flip_44 = FlipMatrix(Data=shift_43)
flip_45 = FlipMatrix(Data=shift_44)
partition_4 = PartitionList(List=flip_45, Size=num_50)
partition_5 = PartitionList(List=flip_44, Size=num_50)
shift_45 = ShiftList(List=partition_4, Shift="-1", Wrap=toggle_15)  # -> simplify(List)
shift_46 = ShiftList(List=partition_4, Shift="1", Wrap=toggle_15)  # -> simplify(List)
shift_47 = ShiftList(List=partition_5, Shift="1", Wrap=toggle_15)  # -> simplify(List)
shift_48 = ShiftList(List=partition_5, Shift="-1", Wrap=toggle_15)  # -> simplify(List)
path_mapper_3 = PathMapper(shift_46, source="{A;B}(i)", target="{A;i}(B)")
path_mapper_4 = PathMapper(shift_45, source="{A;B}(i)", target="{A;i}(B)")
path_mapper_5 = PathMapper(shift_47, source="{A;B}(i)", target="{A;i}(B)")
path_mapper_6 = PathMapper(shift_48, source="{A;B}(i)", target="{A;i}(B)")
shift_49 = ShiftList(List=path_mapper_4, Shift="-1", Wrap=toggle_15)
shift_50 = ShiftList(List=path_mapper_3, Shift="1", Wrap=toggle_15)
shift_51 = ShiftList(List=path_mapper_3, Shift="-1", Wrap=toggle_15)
shift_52 = ShiftList(List=path_mapper_6, Shift="-1", Wrap=toggle_15)
shift_53 = ShiftList(List=path_mapper_4, Shift="1", Wrap=toggle_15)
shift_54 = ShiftList(List=path_mapper_5, Shift="1", Wrap=toggle_15)
shift_55 = ShiftList(List=path_mapper_5, Shift="-1", Wrap=toggle_15)
shift_56 = ShiftList(List=path_mapper_6, Shift="1", Wrap=toggle_15)
tbox_12 = TwistedBox(
    CornerA=shift_53,
    CornerB=shift_49,
    CornerC=shift_51,
    CornerD=shift_50,
    CornerE=shift_56,
    CornerF=shift_52,
    CornerG=shift_55,
    CornerH=shift_54)
voxels_16 = Voxels(tbox_12)  # Voxels to be filled with unit cells

lower_limit_3 = LowerLimit()  # Smoothing of the surface closest to the attractor
attractor_3 = Attractor()  # Any geometry to use as attractor(s)
magnitude_min_5 = MagnitudeMin()  # Magnitude of the offset (minimum value)
magnitude_max_5 = MagnitudeMax()  # Magnitude of the offset (maximum value)
resolution_v = ResolutionV()  # Resolution of points in V direction
surface = Surface()  # Surface to offset
resolution_u = ResolutionU()  # Resolution of points in U direction
influence_5 = Influence()  # Smoothed range of attractor influence (0-1)
num_51 = Number(resolution_v)
geo_8 = Geometry(attractor_3)
num_52 = Number(lower_limit_3)
num_53 = Number(resolution_u)
num_54 = Number(influence_5)
srf_3 = Surface(surface)
num_55 = Number(magnitude_min_5)
num_56 = Number(magnitude_max_5)
series_6 = Series(Start=0, Step=1, Count=expr("x+1", num_51))
series_7 = Series(Start=0, Step=1, Count=expr("x+1", num_53))
sdivide_2 = DivideSurface(Surface=srf_3, UCount=num_53, VCount=num_51)  # -> Points, Normals, Parameters
crossref_6 = CrossReference(ListA=graft(series_7), ListB=series_6, CrossMode=1)  # -> ListA, ListB
panel_50 = Panel("SURFACE OFFSET ATTRACTOR")
pull_3 = PullPoint(Point=sdivide_2.Points, Geometry=geo_8, ClosestOnly=True)  # -> ClosestPoint, Distance
smaller_3 = SmallerThan(FirstNumber=pull_3.Distance, SecondNumber=num_52)  # -> SmallerThan, OrEqualTo
cull_25 = CullPattern(List=crossref_6.ListB, CullPattern=smaller_3.SmallerThan)
replace_3 = ReplaceItems(List=pull_3.Distance, Item="0", Indices=cull_25, Wrap=False)
expression_20 = Expression(x=num_54, y=replace_3, Expression="-1*e^(-x*y)")
bnd_7 = Bounds(Numbers=flatten(expression_20))
dom_24 = ConstructDomain(DomainStart=num_55, DomainEnd=num_56)
remap_17 = RemapNumbers(Value=expression_20, Source=bnd_7, Target=dom_24)  # -> Mapped, Clipped
amp_9 = Amplitude(Vector=sdivide_2.Normals, Amplitude=remap_17.Mapped)
move_9 = Move(Geometry=sdivide_2.Points, Motion=amp_9)  # -> Geometry, Transform
srfgrid_2 = SurfaceFromPoints(Points=flatten(move_9.Geometry), UCount=expr("x+1", num_53), Interpolate=False)
offest_surface = OffestSurface(srfgrid_2)  # Offset Surface

resolution_v_2 = ResolutionV()  # Resolution of points in V direction
surface_2 = Surface()  # Surface to offset
resolution_u_2 = ResolutionU()  # Resolution of points in U direction
points_3 = Points()  # List of points (flattened)
magnitude_max_6 = MagnitudeMax()  # Magnitude of the offset (maximum value)
influence_6 = Influence()  # Smoothed range of attractor influence (0-1)
values_3 = Values()  # Values that correspond to points (flattened)
magnitude_min_6 = MagnitudeMin()  # Magnitude of the offset (minimum value)
distance_influence_3 = DistanceInfluence()  # If true the distance between the points and voxels will affect the magnitude
sdivide_3 = DivideSurface(Surface=surface_2, UCount=resolution_u_2, VCount=resolution_v_2)  # -> Points, Normals, Parameters
pt_5 = Point(points_3)
num_57 = Number(values_3)
bnd_8 = Bounds(Numbers=num_57)
dom_25 = ConstructDomain(DomainStart=magnitude_min_6, DomainEnd=magnitude_max_6)
cp_3 = ClosestPoint(Point=sdivide_3.Points, Cloud=pt_5)  # -> ClosestPoint, CPIndex, Distance
remap_18 = RemapNumbers(Value=num_57, Source=bnd_8, Target=dom_25)  # -> Mapped, Clipped
expression_21 = Expression(x=influence_6, y=cp_3.Distance, Expression="-1*e^(-x*y)")
item_117 = ListItem(List=remap_18.Mapped, Index=cp_3.CPIndex, Wrap=True)
panel_51 = Panel("SURFACE OFFSET VALUE")
bnd_9 = Bounds(Numbers=flatten(expression_21))
remap_19 = RemapNumbers(Value=expression_21, Source=bnd_9, Target="1 to 0")  # -> Mapped, Clipped
not_7 = GateNot(A=distance_influence_3)
multiplication_8 = Multiplication(A=item_117, B=remap_19.Mapped)
cull_26 = CullPattern(List=item_117, CullPattern=not_7)
cull_27 = CullPattern(List=multiplication_8, CullPattern=distance_influence_3)
amp_10 = Amplitude(Vector=sdivide_3.Normals, Amplitude=[cull_27, cull_26])
move_10 = Move(Geometry=sdivide_3.Points, Motion=amp_10)  # -> Geometry, Transform
srfgrid_3 = SurfaceFromPoints(Points=flatten(move_10.Geometry), UCount=expr("x+1", resolution_u_2), Interpolate=False)
offest_surface_2 = OffestSurface(srfgrid_3)  # Offset Surface

magnitude_max_7 = MagnitudeMax()  # Magnitude of the morph (maximum value)
magnitude_min_7 = MagnitudeMin()  # Magnitude of the morph (minimum value)
influence_7 = Influence()  # Smoothed range of attractor influence (0-1)
distance_influence_4 = DistanceInfluence()  # If true the distance between the points and voxels will affect the magnitude
values_4 = Values()  # Values that correspond to points (flattened)
points_4 = Points()  # List of points (flattened)
voxels_17 = Voxels()  # Voxels to be filled with unit cells
pt_6 = Point(points_4)
num_58 = Number(values_4)
tbox_13 = TwistedBox(voxels_17)
dom_26 = ConstructDomain(DomainStart=magnitude_min_7, DomainEnd=magnitude_max_7)
bnd_10 = Bounds(Numbers=num_58)
debrep = DeconstructBrep(Brep=tbox_13)  # -> Faces, Edges, Vertices
cp_4 = ClosestPoint(Point=debrep.Vertices, Cloud=pt_6)  # -> ClosestPoint, CPIndex, Distance
remap_20 = RemapNumbers(Value=num_58, Source=bnd_10, Target=dom_26)  # -> Mapped, Clipped
expression_22 = Expression(x=influence_7, y=cp_4.Distance, Expression="-1*e^(-x*y)")
item_118 = ListItem(List=remap_20.Mapped, Index=cp_4.CPIndex, Wrap=True)
bnd_11 = Bounds(Numbers=flatten(expression_22))
panel_52 = Panel("VOXEL MORPH VALUE")
remap_21 = RemapNumbers(Value=expression_22, Source=bnd_11, Target="1 to 0")  # -> Mapped, Clipped
not_8 = GateNot(A=distance_influence_4)
ln = Line(StartPoint=debrep.Vertices, EndPoint=cp_4.ClosestPoint)
multiplication_9 = Multiplication(A=item_118, B=remap_21.Mapped)
cull_28 = CullPattern(List=item_118, CullPattern=not_8)
cull_29 = CullPattern(List=multiplication_9, CullPattern=distance_influence_4)
amp_11 = Amplitude(Vector=ln, Amplitude=[cull_29, cull_28])
move_11 = Move(Geometry=debrep.Vertices, Motion=amp_11)  # -> Geometry, Transform
item_119 = ListItem(List=move_11.Geometry, Index="0", Wrap=True)
item_120 = ListItem(List=move_11.Geometry, Index="1", Wrap=True)
item_121 = ListItem(List=move_11.Geometry, Index="2", Wrap=True)
item_122 = ListItem(List=move_11.Geometry, Index="3", Wrap=True)
item_123 = ListItem(List=move_11.Geometry, Index="4", Wrap=True)
item_124 = ListItem(List=move_11.Geometry, Index="6", Wrap=True)
item_125 = ListItem(List=move_11.Geometry, Index="5", Wrap=True)
item_126 = ListItem(List=move_11.Geometry, Index="7", Wrap=True)
tbox_14 = TwistedBox(
    CornerA=item_119,
    CornerB=item_120,
    CornerC=item_121,
    CornerD=item_122,
    CornerE=item_125,
    CornerF=item_123,
    CornerG=item_126,
    CornerH=item_124)
voxels_18 = Voxels(tbox_14)  # Voxels to be filled with unit cells

voxels_19 = Voxels()  # Voxels to be filled with unit cells
attractor_4 = Attractor()  # Any geometry to use as attractor(s)
influence_8 = Influence()  # Smoothed range of attractor influence (0-1)
tbox_15 = TwistedBox(voxels_19)
magnitude = Magnitude()  # Magnitude of the morph
geo_9 = Geometry(attractor_4)
debrep_2 = DeconstructBrep(Brep=tbox_15)  # -> Faces, Edges, Vertices
pull_4 = PullPoint(Point=debrep_2.Vertices, Geometry=geo_9, ClosestOnly=True)  # -> ClosestPoint, Distance
bnd_12 = Bounds(Numbers=flatten(pull_4.Distance))
panel_53 = Panel("VOXEL MORPH ATTRACTOR")
expression_23 = Expression(x=influence_8, y=pull_4.Distance, Expression="-1*e^(-x*y)")
dedomain = DeconstructDomain(Domain=bnd_12)  # -> Start, End
subtraction_4 = Subtraction(A=dedomain.Start, B=magnitude)
bnd_13 = Bounds(Numbers=flatten(expression_23))
dom_27 = ConstructDomain(DomainStart=subtraction_4, DomainEnd="0")
ln_2 = Line(StartPoint=debrep_2.Vertices, EndPoint=pull_4.ClosestPoint)
remap_22 = RemapNumbers(Value=expression_23, Source=bnd_13, Target=dom_27)  # -> Mapped, Clipped
amp_12 = Amplitude(Vector=ln_2, Amplitude=remap_22.Mapped)
move_12 = Move(Geometry=debrep_2.Vertices, Motion=amp_12)  # -> Geometry, Transform
item_127 = ListItem(List=move_12.Geometry, Index="0", Wrap=True)
item_128 = ListItem(List=move_12.Geometry, Index="1", Wrap=True)
item_129 = ListItem(List=move_12.Geometry, Index="2", Wrap=True)
item_130 = ListItem(List=move_12.Geometry, Index="3", Wrap=True)
item_131 = ListItem(List=move_12.Geometry, Index="4", Wrap=True)
item_132 = ListItem(List=move_12.Geometry, Index="6", Wrap=True)
item_133 = ListItem(List=move_12.Geometry, Index="5", Wrap=True)
item_134 = ListItem(List=move_12.Geometry, Index="7", Wrap=True)
tbox_16 = TwistedBox(
    CornerA=item_127,
    CornerB=item_128,
    CornerC=item_129,
    CornerD=item_130,
    CornerE=item_133,
    CornerF=item_131,
    CornerG=item_134,
    CornerH=item_132)
voxels_20 = Voxels(tbox_16)  # Voxels to be filled with unit cells

sov = SurfaceOffsetValue()
vmv = VoxelMorphValue()
soa = SurfaceOffsetAttractor()
vma = VoxelMorphAttractor()
mbs = MorphBetweenSurfaces_2()
crp = ConformalRibParameter()
crd = ConformalRibDistance()
vd = VoxelizeDistance()
cpp = ConformalPipeParameter()
mop = MeshOffestParameter()  # -> voxels, quad_meshes
cpd = ConformalPipeDistance()
moa = MeshOffsetAttractor_2()  # -> voxels, quad_meshes
vp = VoxelizeParameter()
mbm = MorphBetweenMeshes()  # -> voxels, quad_meshes
mov = MeshOffsetValue_2(z_parameter=[0, 1])  # -> voxels, quad_meshes

geometry_8 = Geometry()  # Geometry to fill
number_of_points = NumberOfPoints()  # The initial number of random points to fill the volume
use_attractor = UseAttractor()  # If true, points will be filtered by distance to attractor(s)
attractor_5 = Attractor()  # Any geometry to use as attractor(s)
magnitude_of_random_filtering = MagnitudeOfRandomFiltering()  # Magnitude of random filtering
number_of_filtered_points = NumberOfFilteredPoints()  # The number of points to filter
enable_voronoi = EnableVoronoi()  # If true, voronoi cells will be generated (can be very slow)
geo_10 = Geometry(geometry_8)
geo_11 = Geometry(attractor_5)
mesh_30 = Mesh(geo_10)
bbox_4 = BoundingBox(Content=mesh_30, Plane=PlaneXY(0, 0, 0))  # -> Box, Box_2
pop3d = Populate3D(Region=bbox_4.Box, Count=number_of_points, Seed=1)
dom_28 = ConstructDomain(DomainStart=expr("x*-1", magnitude_of_random_filtering), DomainEnd=magnitude_of_random_filtering)
pull_5 = PullPoint(Point=pop3d, Geometry=geo_11, ClosestOnly=True)  # -> ClosestPoint, Distance
lng_7 = ListLength(List=pop3d)
random = Random(Range=dom_28, Number=lng_7, Seed=2)
addition_26 = Addition(A=random, B=pull_5.Distance)
sort_4 = SortList(Keys=addition_26, ValuesA=pop3d)  # -> Keys, ValuesA
not_9 = GateNot(A=use_attractor)
panel_55 = Panel("VORONOI FILL")
subset = SubList(List=sort_4.ValuesA, Domain=number_of_filtered_points, Wrap=True)  # -> List, Index
cull_30 = CullPattern(List=pop3d, CullPattern=not_9)
cull_31 = CullPattern(List=subset.List, CullPattern=use_attractor)
pt_7 = Point(flatten([cull_31, cull_30]))
minc_4 = MeshInclusion(Mesh=mesh_30, Point=flatten(pt_7), Strict=False)
cull_32 = CullPattern(List=flatten(pt_7), CullPattern=minc_4)
cull_33 = CullPattern(List=cull_32, CullPattern=enable_voronoi)
voronoi³ = Voronoi3D(Points=flatten(cull_33), Box=bbox_4.Box)  # -> Cells, Boundary
edges_3 = BrepEdges(Brep=voronoi³.Cells)  # -> Naked, Interior, NonManifold
mmx = MeshMesh(MeshA=mesh_30, MeshB=voronoi³.Cells, UseMeshMeshFast=True)
explode_2 = Explode(Curve=flatten(mmx), Recursive=True)  # -> Segments, flatten(Vertices)
remove_duplicate_lines = RemoveDuplicateLines(lattice_l=flatten(edges_3.Interior))
remove_duplicate_lines_2 = RemoveDuplicateLines(lattice_l=flatten(explode_2.Segments))
preview_points = PreviewPoints(cull_32)  # Preview of points that will create the voronoi lattice
voronoi_lattice_skin = VoronoiLatticeSkin(remove_duplicate_lines_2)  # List of curves that make up the lattice skin
voronoi_lattice = VoronoiLattice(remove_duplicate_lines)  # List of curves that make up the lattice

unit_cell_shell = UnitCellShell()  # Unit cell to populate voxels
unit_cell_shell_2 = UnitCellShell()  # Unit cell to populate voxels
voxels_21 = Voxels()  # Voxels to be filled with unit cells
value = Value()  # Value from 0-1 corresponding to each voxel
tolerance = Tolerance()  # Tolerance for merging faces and vertices (number usually between 0.001 and 0.1)
geo_12 = Geometry(unit_cell_shell_2)
geo_13 = Geometry(unit_cell_shell)
num_59 = Number(value)
num_60 = Number(tolerance)
geo_14 = Geometry(voxels_21)
demesh_29 = DeconstructMesh(Mesh=geo_13)  # -> Vertices, Faces, Colours, Normals
demesh_30 = DeconstructMesh(Mesh=geo_12)  # -> Vertices, Faces, Colours, Normals
ln_3 = Line(StartPoint=demesh_29.Vertices, EndPoint=demesh_30.Vertices)
eval_4 = EvaluateCurve(Curve=reparameterize(graft(ln_3)), Parameter=num_59)  # -> simplify(Point), Tangent, Angle
flip_46 = FlipMatrix(Data=eval_4.Point)
conmesh_29 = ConstructMesh(Vertices=flip_46, Faces=demesh_29.Faces)
bbox_5 = BoundingBox(Content=conmesh_29, Plane=PlaneXY(0, 0, 0), UnionBox=True)  # -> Box, Box_2
morph = BoxMorph(Geometry=conmesh_29, Reference=bbox_5.Box, Target=simplify(graft(geo_14)))  # -> flatten(Geometry)
panel_56 = Panel("TWEEN SHELL FILL")
mjoin_8 = MeshJoin(Meshes=morph)
facen = FaceNormals(Mesh=mjoin_8)  # -> Centers, Normals
demesh_31 = DeconstructMesh(Mesh=mjoin_8)  # -> Vertices, Faces, Colours, Normals
cullpt_2 = CullDuplicates(Points=facen.Centers, Tolerance=num_60, CullMode=1)  # -> Points, Indices, Valence
item_135 = ListItem(List=demesh_31.Faces, Index=cullpt_2.Indices, Wrap=True)
conmesh_30 = ConstructMesh(Vertices=demesh_31.Vertices, Faces=item_135)
weld_8 = WeldMesh(Mesh=conmesh_30, Angle=3.141592654)
c_script = CSharpScript(M=weld_8, radius=num_60)  # -> out, A; inputs M: Mesh, radius: Double; same code as c_script
lattice_shell = LatticeShell(c_script.A)  # Joined mesh that makes up the lattice

distance_influence_5 = DistanceInfluence()  # If true the distance between the points and voxels will affect the magnitude
influence_9 = Influence()  # Smoothed range of attractor influence (0-1)
values_5 = Values()  # Values that correspond to points (flattened)
points_5 = Points()  # List of points (flattened)
voxels_22 = Voxels()  # Voxels to be filled with unit cells
brep = Brep(voxels_22)
num_61 = Number(values_5)
pt_8 = Point(points_5)
area = Area(Geometry=flatten(brep))  # -> Area, Centroid
cp_5 = ClosestPoint(Point=area.Centroid, Cloud=pt_8)  # -> ClosestPoint, CPIndex, Distance
item_136 = ListItem(List=num_61, Index=cp_5.CPIndex, Wrap=True)
panel_57 = Panel("CELL MORPH VALUE")
expression_24 = Expression(x=influence_9, y=cp_5.Distance, Expression="-1*e^(-x*y)")
bnd_14 = Bounds(Numbers=item_136)
remap_23 = RemapNumbers(Value=item_136, Source=bnd_14, Target=Domain(0, 1))  # -> Mapped, Clipped
bnd_15 = Bounds(Numbers=expression_24)
not_10 = GateNot(A=distance_influence_5)
remap_24 = RemapNumbers(Value=expression_24, Source=bnd_15, Target="1 to 0")  # -> Mapped, Clipped
cull_34 = CullPattern(List=remap_23.Mapped, CullPattern=not_10)
multiplication_10 = Multiplication(A=remap_23.Mapped, B=remap_24.Mapped)
cull_35 = CullPattern(List=multiplication_10, CullPattern=distance_influence_5)
num_62 = Number([cull_35, cull_34])
value_2 = Value(num_62)  # Values (0-1) for morph

attractor_6 = Attractor()  # Any geometry to use as attractor(s)
influence_10 = Influence()  # Smoothed range of attractor influence (0-1)
magnitude_min_8 = MagnitudeMin()  # Magnitude of the morph (minimum value)
magnitude_max_8 = MagnitudeMax()  # Magnitude of the morph (maximum value)
voxels_23 = Voxels()  # Voxels to be filled with unit cells
brep_2 = Brep(voxels_23)
geo_15 = Geometry(attractor_6)
volume = Volume(Geometry=flatten(brep_2))  # -> Volume, Centroid
pull_6 = PullPoint(Point=volume.Centroid, Geometry=geo_15, ClosestOnly=True)  # -> ClosestPoint, Distance
panel_58 = Panel("CELL MORPH ATTRACTOR")
expression_25 = Expression(x=influence_10, y=pull_6.Distance, Expression="-1*e^(-x*y)")
dom_29 = ConstructDomain(DomainStart=magnitude_min_8, DomainEnd=magnitude_max_8)
bnd_16 = Bounds(Numbers=expression_25)
remap_25 = RemapNumbers(Value=expression_25, Source=bnd_16, Target=dom_29)  # -> Mapped, Clipped
value_3 = Value(remap_25.Mapped)  # Values (0-1) for cell morph

unit_cell_shell_3 = UnitCellShell()  # Unit cell to populate voxels
tolerance_2 = Tolerance()  # Tolerance for merging faces and vertices (number usually between 0.001 and 0.1)
voxels_24 = Voxels()  # Voxels to be filled with unit cells
geo_16 = Geometry(unit_cell_shell_3)
bbox_6 = BoundingBox(Content=geo_16, Plane=PlaneXY(0, 0, 0), UnionBox=True)  # -> Box, Box_2
morph_2 = BoxMorph(Geometry=geo_16, Reference=bbox_6.Box, Target=graft(voxels_24))  # -> flatten(Geometry)
mjoin_9 = MeshJoin(Meshes=morph_2)
panel_59 = Panel("CELL SHELL FILL")
demesh_32 = DeconstructMesh(Mesh=mjoin_9)  # -> Vertices, Faces, Colours, Normals
facen_2 = FaceNormals(Mesh=mjoin_9)  # -> Centers, Normals
cullpt_3 = CullDuplicates(Points=facen_2.Centers, Tolerance=tolerance_2, CullMode=1)  # -> Points, Indices, Valence
item_137 = ListItem(List=demesh_32.Faces, Index=cullpt_3.Indices, Wrap=True)
conmesh_31 = ConstructMesh(Vertices=demesh_32.Vertices, Faces=item_137)
weld_9 = WeldMesh(Mesh=conmesh_31, Angle=3.141592654)
c_script_2 = CSharpScript(M=weld_9, radius=tolerance_2)  # -> out, A; inputs M: Mesh, radius: Double; same code as c_script
lattice_shell_2 = LatticeShell(c_script_2.A)  # Joined mesh that makes up the lattice

unit_cell_1 = UnitCell1()  # Unit cell to populate voxels
unit_cell_2 = UnitCell2()  # Unit cell to populate voxels
voxels_25 = Voxels()  # Voxels to be filled with unit cells
value_4 = Value()  # Value from 0-1 corresponding to each voxel
num_63 = Number(value_4)
flip_47 = FlipCurve(Curve=unit_cell_1, Guide=unit_cell_2)  # -> Curve, Flag
tweencrv = TweenCurve(CurveA=flip_47.Curve, CurveB=unit_cell_2, Factor=graft(num_63), BlendType=0)
panel_60 = Panel("TWEEN CELL FILL")
bbox_7 = BoundingBox(Content=tweencrv, Plane=PlaneXY(0, 0, 0), UnionBox=True)  # -> Box, Box_2
morph_3 = BoxMorph(Geometry=tweencrv, Reference=bbox_7.Box, Target=graft(voxels_25))  # -> flatten(Geometry)
line_10 = Line(morph_3)
remove_duplicate_lines_3 = RemoveDuplicateLines(lattice_l=flatten(line_10))
lattice_3 = Lattice(remove_duplicate_lines_3)  # List of curves that make up the lattice

unit_cell = UnitCell()  # Unit cell to populate voxels
voxels_26 = Voxels()  # Voxels to be filled with unit cells
crv_6 = Curve(unit_cell)
bbox_8 = BoundingBox(Content=crv_6, Plane=PlaneXY(0, 0, 0), UnionBox=True)  # -> Box, Box_2
panel_61 = Panel("CELL FILL")
morph_4 = BoxMorph(Geometry=crv_6, Reference=bbox_8.Box, Target=graft(voxels_26))  # -> flatten(Geometry)
remove_duplicate_lines_4 = RemoveDuplicateLines(lattice_l=flatten(morph_4))
lattice_4 = Lattice(remove_duplicate_lines_4)  # List of curves that make up the lattice

crv_7 = Curve([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])
crv_8 = Curve([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])
crv_9 = Curve([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])
crv_10 = Curve([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])
crv_11 = Curve([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])
crv_12 = Curve([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])
crv_13 = Curve([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])
crv_14 = Curve([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])
crv_15 = Curve([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])
crv_16 = Curve([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])
crv_17 = Curve([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])
crv_18 = Curve([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])
crv_19 = Curve([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])
mesh_31 = Mesh(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)
mesh_32 = Mesh(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)
mesh_33 = Mesh(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)
mesh_34 = Mesh(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)
mesh_35 = Mesh(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)
mesh_36 = Mesh(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)
crv_20 = Curve([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])
crv_21 = Curve([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])
mesh_37 = Mesh(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)
mesh_38 = Mesh(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)
geo_17 = Geometry([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])
mesh_39 = Mesh([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])
mesh_40 = Mesh([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])
crv_22 = Curve([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])
crv_23 = Curve([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])
crv_24 = Curve([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])
geo_18 = Geometry([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])
panel_62 = Panel("CELL TYPES")
entwine_27 = Entwine(
    Branch00=crv_7,
    Branch01=crv_8,
    Branch02=crv_9,
    Branch03=crv_22,
    Branch04=crv_10,
    Branch05=crv_23,
    Branch06=crv_11,
    Branch07=crv_12,
    Branch08=crv_24,
    Branch09=crv_13,
    Branch010=crv_14,
    Branch011=crv_15,
    Branch012=crv_16,
    Branch013=crv_17,
    Branch014=crv_18,
    Branch015=crv_19,
    Branch016=mesh_31,
    Branch017=mesh_32,
    Branch018=mesh_33,
    Branch019=mesh_34,
    Branch020=mesh_35,
    Branch021=mesh_36,
    Branch022=crv_20,
    Branch023=crv_21,
    Branch024=mesh_37,
    Branch025=mesh_38,
    Branch026=geo_17,
    Branch027=mesh_39,
    Branch028=geo_18,
    Branch029=mesh_40,
    FlattenInputs=True)  # -> simplify(Result)
unit_cell_selector = UnitCellSelector()
branch_3 = TreeBranch(Tree=entwine_27, Path=unit_cell_selector, MaintainPaths=True)
unit_cell_3 = UnitCell(branch_3)  # Single unit cell to populate voxels

panel_63 = Panel("CELL SELECTOR")
unit_cell_selector_2 = CellSelector({"Prim. Cubic": 0, "BC": 1, "BC Cubic": 2, "FC Cubic": 3, "Edge Octa.": 4, "Vertex Octa.": 5, "NaCl": 6, "Star Tet.": 7, "BC Star Tet.": 8, "Octa. Tet.": 9, "Dodecahedron": 10, "Trunc. Octa.": 11, "Tetrahedral": 12, "Auxetic": 13, "BC1 (tween)": 14, "BC2 (tween)": 15, "Octa. (shell)": 16, "Dodeca. (shell)": 17, "Trunc. Octa. (shell)": 18, "Gyroid (shell)": 19, "Cubic Center (shell)": 20, "Cubic Face (shell)": 21, "LH Square": 22, "LH Round": 23, "LH Square (shell)": 24, "LH Auxetic (shell)": 25, "MC Tri": 26, "MS Tri (shell)": 27, "MC Quad": 28, "MS Quad (shell)": 29}, selected="BC")

panel_64 = Panel("POPULATE")
clf = CellLatticeFill()
ct = CellType()
tcf = TweenCellFill()
cma = CellMorphAttractor()
csf = CellShellFill()
cmv = CellMorphValue()
tsf = TweenShellFIll()
vf = VoronoiFill()  # -> voronoi_lattice, voronoi_lattice_skin, preview_points

# ----
# MORPH LATTICE TO SKIN
geometry_9 = Geometry()  # Geometry to morph to
lattice_5 = Lattice()  # Lattice to morph to skin
geometry_10 = Geometry()  # Geometry to morph to
max_distance = MaxDistance()  # Maximum distance from geometry
max_distance_2 = MaxDistance()  # Maximum distance to moprh
geo_19 = Geometry(geometry_10)
crv_25 = Curve(lattice_5)
geo_20 = Geometry(geometry_9)
cp_6 = ControlPoints(Curve=crv_25)  # -> simplify(Points), Weights, Knots
pull_7 = PullPoint(Point=cp_6.Points, Geometry=geo_20, ClosestOnly=True)  # -> ClosestPoint, Distance
smaller_4 = SmallerThan(FirstNumber=pull_7.Distance, SecondNumber=max_distance)  # -> SmallerThan, OrEqualTo
not_11 = GateNot(A=smaller_4.SmallerThan)
cull_36 = CullPattern(List=cp_6.Points, CullPattern=smaller_4.SmallerThan)
cull_37 = CullPattern(List=cp_6.Points, CullPattern=not_11)
pull_8 = PullPoint(Point=cull_36, Geometry=geo_19, ClosestOnly=True)  # -> ClosestPoint, Distance
smaller_5 = SmallerThan(FirstNumber=pull_8.Distance, SecondNumber=max_distance_2)  # -> SmallerThan, OrEqualTo
not_12 = GateNot(A=smaller_5.SmallerThan)
cull_38 = CullPattern(List=pull_8.ClosestPoint, CullPattern=smaller_5.SmallerThan)
cull_39 = CullPattern(List=cull_36, CullPattern=not_12)
merge_8 = Merge(Data1=cull_37, Data2=cull_39, Data3=cull_38)
item_138 = ListItem(List=merge_8, Index=0, Wrap=True)  # -> Item1, Item, Item1_2
ln_4 = Line(StartPoint=item_138.Item1, EndPoint=item_138.Item)
remove_duplicate_lines_5 = RemoveDuplicateLines(lattice_l=flatten(ln_4))
len_4 = Length(Curve=remove_duplicate_lines_5)
larger = LargerThan(FirstNumber=len_4, SecondNumber=0)  # -> LargerThan, OrEqualTo
cull_40 = CullPattern(List=remove_duplicate_lines_5, CullPattern=larger.LargerThan)
crv_26 = Curve(cull_40)
lattice_6 = Lattice(crv_26)  # Morphed lattice

lattice_7 = Lattice()  # Lattice curves to filter
flip_48 = Flip()  # If true curves under valence number are removed. If false curves over valence number are removed.
valence_number = ValenceNumber()  # The number of connections each curve has
num_64 = Number(valence_number)
crv_27 = Curve(lattice_7)
bool_12 = Boolean(flip_48)
cp_7 = ControlPoints(Curve=crv_27)  # -> Points, Weights, Knots
cps = ClosestPoints(Point=cp_7.Points, Cloud=flatten(cp_7.Points), Count=expr("x+1", num_64))  # -> ClosestPoint, CPIndex, simplify(Distance)
panel_65 = Panel("REMOVE BY VALENCE")
trim_4 = TrimTree(Tree=cps.Distance, Depth=1)
not_13 = GateNot(A=bool_12)
ma = MassAddition(Input=trim_4)  # -> Result, PartialResults
smaller_6 = SmallerThan(FirstNumber=ma.Result, SecondNumber="0")  # -> SmallerThan, OrEqualTo
not_14 = GateNot(A=smaller_6.OrEqualTo)
cull_41 = CullPattern(List=smaller_6.OrEqualTo, CullPattern=bool_12)
cull_42 = CullPattern(List=not_14, CullPattern=not_13)
cull_43 = CullPattern(List=graft(crv_27), CullPattern=[cull_42, cull_41])  # -> flatten(List)
lattice_8 = Lattice(cull_43)  # Filtered lattice

max_distance_3 = MaxDistance()  # Maximum distance to merge
lattice_9 = Lattice()  # Lattice to merge
crv_28 = Curve(lattice_9)
num_65 = Number(max_distance_3)
cp_8 = ControlPoints(Curve=crv_28)  # -> Points, Weights, Knots
cullpt_4 = CullDuplicates(Points=flatten(cp_8.Points), Tolerance=num_65, CullMode=3)  # -> Points, Indices, Valence
fsim = FindSimilarMember(Data=cp_8.Points, Set=cullpt_4.Points)  # -> Hit, Index
panel_66 = Panel("MERGE CURVES")
pline_4 = PolyLine(Vertices=fsim.Hit, Closed=False)  # -> flatten(Polyline)
len_5 = Length(Curve=pline_4)
larger_2 = LargerThan(FirstNumber=len_5, SecondNumber="0")  # -> LargerThan, OrEqualTo
cull_44 = CullPattern(List=pline_4, CullPattern=larger_2.LargerThan)
lattice_10 = Lattice(cull_44)  # Merged lattice

geometry_11 = Geometry()  # Geometry to trim with (closed brep or mesh)
lattice_11 = Lattice()  # Lattice curves to trim
geo_21 = Geometry(geometry_11)
crv_29 = Curve(lattice_11)
mesh_41 = Mesh(geo_21)
mcx = MeshCurve(Mesh=mesh_41, Curve=crv_29)  # -> Points, Faces
null_2 = NullItem(Item=mcx.Points)  # -> NullFlags, InvalidFlags, Description
crv_cp = CurveClosestPoint(Point=mcx.Points, Curve=graft(crv_29))  # -> Point, Parameter, Distance
panel_67 = Panel("TRIM LATTICE")
cull_45 = CullPattern(List=graft(crv_29), CullPattern=null_2.NullFlags)
shatter = Shatter(Curve=graft(crv_29), Parameters=crv_cp.Parameter)
curvepoint = PointOnCurve(cull_45, parameter=0.5)
curvepoint_2 = PointOnCurve(shatter, parameter=0.5)
minc_5 = MeshInclusion(Mesh=mesh_41, Point=curvepoint, Strict=False)
minc_6 = MeshInclusion(Mesh=mesh_41, Point=curvepoint_2, Strict=False)
cull_46 = CullPattern(List=shatter, CullPattern=minc_6)
cull_47 = CullPattern(List=cull_45, CullPattern=minc_5)
crv_30 = Curve(flatten(cull_46))
crv_31 = Curve(flatten(cull_47))
unrimmed_lattice = UnrimmedLattice(crv_31)  # Lattice curves that have not been trimmed (Typically removes curves with valence 1)
trimmed_lattice = TrimmedLattice(crv_30)  # Lattice curves that have been trimmed

lattice_b = LatticeB()  # Second lattice to make connections between
lattice_a = LatticeA()  # First lattice to make connections between
number_of_connections = NumberOfConnections()  # Number of Connections
max_distance_4 = MaxDistance()  # Maximum distance between connections
crv_32 = Curve(lattice_a)
crv_33 = Curve(lattice_b)
cp_9 = ControlPoints(Curve=crv_32)  # -> Points, Weights, Knots
cp_10 = ControlPoints(Curve=crv_33)  # -> Points, Weights, Knots
cullpt_5 = CullDuplicates(Points=flatten(cp_9.Points), Tolerance=0.1, CullMode=1)  # -> Points, Indices, Valence
cullpt_6 = CullDuplicates(Points=flatten(cp_10.Points), Tolerance=0.1, CullMode=1)  # -> Points, Indices, Valence
panel_68 = Panel("LATTICE CONNECTIONS")
cps_2 = ClosestPoints(Point=cullpt_5.Points, Cloud=cullpt_6.Points, Count=number_of_connections)  # -> ClosestPoint, CPIndex, Distance
smaller_7 = SmallerThan(FirstNumber=cps_2.Distance, SecondNumber=max_distance_4)  # -> SmallerThan, OrEqualTo
cull_48 = CullPattern(List=cps_2.ClosestPoint, CullPattern=smaller_7.SmallerThan)
ln_5 = Line(StartPoint=graft(cullpt_5.Points), EndPoint=cull_48)
lattice_12 = Lattice(ln_5)  # Lattice connections

# ----
# MORPH SHELL TO SKIN
lattice_shell_3 = LatticeShell()  # Lattice shell to moprh
geometry_12 = Geometry()  # Geometry to morph to
max_distance_5 = MaxDistance()  # Maximum distance from geometry
mesh_42 = Mesh(lattice_shell_3)
geo_22 = Geometry(geometry_12)
mesh_43 = Mesh(geo_22)
demesh_33 = DeconstructMesh(Mesh=mesh_42)  # -> Vertices, Faces, Colours, Normals
pull_9 = PullPoint(Point=demesh_33.Vertices, Geometry=mesh_43, ClosestOnly=True)  # -> ClosestPoint, Distance
lng_8 = ListLength(List=demesh_33.Vertices)
smaller_8 = SmallerThan(FirstNumber=pull_9.Distance, SecondNumber=max_distance_5)  # -> SmallerThan, OrEqualTo
series_8 = Series(Start=0, Step=1, Count=lng_8)
cull_49 = CullPattern(List=pull_9.ClosestPoint, CullPattern=smaller_8.SmallerThan)
cull_50 = CullPattern(List=series_8, CullPattern=smaller_8.SmallerThan)
replace_4 = ReplaceItems(List=demesh_33.Vertices, Item=cull_49, Indices=cull_50, Wrap=False)
conmesh_32 = ConstructMesh(Vertices=replace_4, Faces=demesh_33.Faces)
trimmed_lattice_shell = TrimmedLatticeShell(conmesh_32)  # Trimmed lattice shell

lattice_13 = Lattice()  # Lattice curves to filter
crv_34 = Curve(flatten(lattice_13))
join_2 = JoinCurves(Curves=crv_34, Preserve=False)
cp_11 = ControlPoints(Curve=join_2)  # -> Points, Weights, Knots
lng_9 = ListLength(List=cp_11.Points)
larger_3 = LargerThan(FirstNumber=lng_9, SecondNumber="3")  # -> flatten(LargerThan), OrEqualTo
cull_51 = CullPattern(List=join_2, CullPattern=larger_3.LargerThan)
explode_3 = Explode(Curve=cull_51, Recursive=True)  # -> flatten(Segments), Vertices
lattice_14 = Lattice(explode_3.Segments)  # Filtered lattice

tolerance_3 = Tolerance()  # Tolerance for merging curves (number usually between 0.001 and 0.1)
lattice_15 = Lattice()  # Lattice curves to filter
crv_35 = Curve(lattice_15)
curvepoint_3 = PointOnCurve(crv_35, parameter=0.5)
panel_70 = Panel("REMOVE DUPLICATE CURVES")
cullpt_7 = CullDuplicates(Points=curvepoint_3, Tolerance=tolerance_3, CullMode=1)  # -> Points, Indices, Valence
item_139 = ListItem(List=crv_35, Index=cullpt_7.Indices, Wrap=True)
lattice_16 = Lattice(item_139)  # Filtered lattice

geometry_13 = Geometry()  # Geometry to trim with (closed brep or mesh)
lattice_shell_4 = LatticeShell()  # Lattice shell to trim
geo_23 = Geometry(geometry_13)
mjoin_10 = MeshJoin(Meshes=flatten(lattice_shell_4))
mesh_44 = Mesh(geo_23)
weld_10 = WeldMesh(Mesh=mjoin_10, Angle=3.141592654)
panel_71 = Panel("TRIM SHELL")
demesh_34 = DeconstructMesh(Mesh=weld_10)  # -> Vertices, Faces, Colours, Normals
minc_7 = MeshInclusion(Mesh=mesh_44, Point=demesh_34.Vertices, Strict=False)
not_15 = GateNot(A=minc_7)
cullv = CullVertices(Mesh=weld_10, Pattern=not_15, Shrink=True)
trimmed_lattice_shell_2 = TrimmedLatticeShell(cullv)  # Trimmed lattice shell

lattice_17 = Lattice()  # Lattice curves to filter
length_3 = Length()  # Minimum lenth of lattice curves
crv_36 = Curve(lattice_17)
len_6 = Length(Curve=crv_36)
panel_72 = Panel("REMOVE SHORT")
larger_4 = LargerThan(FirstNumber=len_6, SecondNumber=length_3)  # -> LargerThan, OrEqualTo
cull_52 = CullPattern(List=crv_36, CullPattern=larger_4.LargerThan)
lattice_18 = Lattice(cull_52)  # Filtered lattice

panel_73 = Panel("MODIFY")
rs = RemoveShort()
rd = RemoveDuplicateCurves(tolerance=0.1)
rv = RemoveByValence()
mc = MergeCurves()
rf = RemoveFloating_2()
mss = MorphShellToSkin()
ts = TrimShell()
lc = LatticeConnections()
tl = TrimLattice()  # -> trimmed_lattice, unrimmed_lattice
mls = MorphLatticeToSkin()

lattice_shell_5 = LatticeShell()  # Lattice shell to thicken
points_6 = Points()  # List of points (flattened)
values_6 = Values()  # Values that correspond to points (flattened)
distance_influence_6 = DistanceInfluence()  # If true the distance between the points and voxels will affect the magnitude
influence_11 = Influence()  # Smoothed range of attractor influence (0-1)
magnitude_min_9 = MagnitudeMin()  # Lattice shell thickness (minimum value)
magnitude_max_9 = MagnitudeMax()  # Lattice shell thickness (maximum value)
mesh_45 = Mesh(lattice_shell_5)
num_66 = Number(values_6)
pt_9 = Point(points_6)
demesh_35 = DeconstructMesh(Mesh=mesh_45)  # -> Vertices, Faces, Colours, Normals
cp_12 = ClosestPoint(Point=demesh_35.Vertices, Cloud=pt_9)  # -> ClosestPoint, CPIndex, Distance
item_140 = ListItem(List=num_66, Index=cp_12.CPIndex, Wrap=True)
expression_26 = Expression(x=influence_11, y=cp_12.Distance, Expression="-1*e^(-x*y)")
dom_30 = ConstructDomain(DomainStart=magnitude_min_9, DomainEnd=magnitude_max_9)
bnd_17 = Bounds(Numbers=item_140)
panel_74 = Panel("SHELL THICKNESS VALUE")
remap_26 = RemapNumbers(Value=item_140, Source=bnd_17, Target=dom_30)  # -> Mapped, Clipped
bnd_18 = Bounds(Numbers=expression_26)
not_16 = GateNot(A=distance_influence_6)
remap_27 = RemapNumbers(Value=expression_26, Source=bnd_18, Target="1 to 0")  # -> Mapped, Clipped
multiplication_11 = Multiplication(A=remap_26.Mapped, B=remap_27.Mapped)
cull_53 = CullPattern(List=remap_26.Mapped, CullPattern=not_16)
cull_54 = CullPattern(List=multiplication_11, CullPattern=distance_influence_6)
bnd_19 = Bounds(Numbers=cull_54)
remap_28 = RemapNumbers(Value=cull_54, Source=bnd_19, Target=dom_30)  # -> Mapped, Clipped
num_67 = Number([remap_28.Mapped, cull_53])
value_5 = Value(num_67)  # Values for shell thickness (mesh vertices)

lattice_19 = Lattice()  # Lattice to thicken
points_7 = Points()  # List of points (flattened)
values_7 = Values()  # Values that correspond to points (flattened)
distance_influence_7 = DistanceInfluence()  # If true the distance between the points and voxels will affect the magnitude
influence_12 = Influence()  # Smoothed range of attractor influence (0-1)
magnitude_min_10 = MagnitudeMin()  # Lattice beam thickness (minimum value)
magnitude_max_10 = MagnitudeMax()  # Lattice beam thickness (maximum value)
crv_37 = Curve(lattice_19)
curvepoint_4 = PointOnCurve(crv_37, parameter=0.5)
num_68 = Number(values_7)
pt_10 = Point(points_7)
cp_13 = ClosestPoint(Point=curvepoint_4, Cloud=pt_10)  # -> ClosestPoint, CPIndex, Distance
dom_31 = ConstructDomain(DomainStart=magnitude_min_10, DomainEnd=magnitude_max_10)
item_141 = ListItem(List=num_68, Index=cp_13.CPIndex, Wrap=True)
panel_75 = Panel("LATTICE THICKNESS VALUE")
expression_27 = Expression(x=influence_12, y=cp_13.Distance, Expression="-1*e^(-x*y)")
bnd_20 = Bounds(Numbers=item_141)
remap_29 = RemapNumbers(Value=item_141, Source=bnd_20, Target=dom_31)  # -> Mapped, Clipped
not_17 = GateNot(A=distance_influence_7)
bnd_21 = Bounds(Numbers=expression_27)
remap_30 = RemapNumbers(Value=expression_27, Source=bnd_21, Target="1 to 0")  # -> Mapped, Clipped
cull_55 = CullPattern(List=remap_29.Mapped, CullPattern=not_17)
multiplication_12 = Multiplication(A=remap_29.Mapped, B=remap_30.Mapped)
cull_56 = CullPattern(List=multiplication_12, CullPattern=distance_influence_7)
bnd_22 = Bounds(Numbers=cull_56)
remap_31 = RemapNumbers(Value=cull_56, Source=bnd_22, Target=dom_31)  # -> Mapped, Clipped
num_69 = Number([remap_31.Mapped, cull_55])
value_6 = Value(num_69)  # Values for beam thickness

lattice_20 = Lattice()  # Lattice to thicken
attractor_7 = Attractor()  # Any geometry to use as attractor(s)
influence_13 = Influence()  # Smoothed range of attractor influence (0-1)
magnitude_min_11 = MagnitudeMin()  # Lattice beam thickness (minimum value)
magnitude_max_11 = MagnitudeMax()  # Lattice beam thickness (maximum value)
crv_38 = Curve(lattice_20)
geo_24 = Geometry(attractor_7)
curvepoint_5 = PointOnCurve(crv_38, parameter=0.5)
pull_10 = PullPoint(Point=curvepoint_5, Geometry=geo_24, ClosestOnly=True)  # -> ClosestPoint, Distance
panel_76 = Panel("LATTICE THICKNESS ATTRACTOR")
expression_28 = Expression(x=influence_13, y=pull_10.Distance, Expression="-1*e^(-x*y)")
dom_32 = ConstructDomain(DomainStart=magnitude_min_11, DomainEnd=magnitude_max_11)
bnd_23 = Bounds(Numbers=expression_28)
dedomain_2 = DeconstructDomain(Domain=bnd_23)  # -> Start, End
dom_33 = ConstructDomain(DomainStart=dedomain_2.End, DomainEnd=dedomain_2.Start)
remap_32 = RemapNumbers(Value=expression_28, Source=dom_33, Target=dom_32)  # -> Mapped, Clipped
value_7 = Value(remap_32.Mapped)  # Values for beam thickness

lattice_shell_6 = LatticeShell()  # Lattice shell to thicken
attractor_8 = Attractor()  # Any geometry to use as attractor(s)
influence_14 = Influence()  # Smoothed range of attractor influence (0-1)
magnitude_min_12 = MagnitudeMin()  # Lattice shell thickness (minimum value)
magnitude_max_12 = MagnitudeMax()  # Lattice shell thickness (maximum value)
mesh_46 = Mesh(lattice_shell_6)
geo_25 = Geometry(attractor_8)
demesh_36 = DeconstructMesh(Mesh=mesh_46)  # -> Vertices, Faces, Colours, Normals
pull_11 = PullPoint(Point=demesh_36.Vertices, Geometry=geo_25, ClosestOnly=True)  # -> ClosestPoint, Distance
panel_77 = Panel("SHELL THICKNESS ATTRACTOR")
expression_29 = Expression(x=influence_14, y=pull_11.Distance, Expression="-1*e^(-x*y)")
dom_34 = ConstructDomain(DomainStart=magnitude_min_12, DomainEnd=magnitude_max_12)
bnd_24 = Bounds(Numbers=expression_29)
dedomain_3 = DeconstructDomain(Domain=bnd_24)  # -> Start, End
dom_35 = ConstructDomain(DomainStart=dedomain_3.End, DomainEnd=dedomain_3.Start)
remap_33 = RemapNumbers(Value=expression_29, Source=dom_35, Target=dom_34)  # -> Mapped, Clipped
value_8 = Value(remap_33.Mapped)  # Values for shell thickness (mesh vertices)

panel_78 = Panel("THICKEN")
lta = LatticeThicknessAttractor()
sta = ShellThicknessAttractor()
stv = ShellThicknessValue()
ltv = LatticeThicknessValue()

u_divisions = UDivisions()  # Divisions in the U direction
curve1 = Curve1()  # Curve to loft between
curve2 = Curve2()  # Curve to loft between
v_divisions = VDivisions()  # Divisions in the V direction
influence_15 = Influence()  # Influence from surface curvature (0-1)
voxel_height = VoxelHeight()  # Height of voxels on surface
crv_39 = Curve(curve1)
crv_40 = Curve(curve2)
num_70 = Number(u_divisions)
num_71 = Number(v_divisions)
num_72 = Number(influence_15)
num_73 = Number(voxel_height)
divide_7 = DivideCurve(Curve=crv_40, Count=num_70, Kinks=False)  # -> simplify(Points), Tangents, simplify(Parameters)
divide_8 = DivideCurve(Curve=crv_39, Count=num_70, Kinks=False)  # -> simplify(Points), Tangents, simplify(Parameters)
toggle_16 = BooleanToggle(False)
intcrv_5 = Interpolate(Vertices=divide_8.Points, Degree=3, Periodic=False, KnotStyle=1)  # -> Curve, Length, Domain
shift_57 = ShiftList(List=divide_8.Points, Shift="-1", Wrap=toggle_16)
intcrv_6 = Interpolate(Vertices=divide_7.Points, Degree=3, Periodic=False, KnotStyle=1)  # -> Curve, Length, Domain
shift_58 = ShiftList(List=divide_7.Points, Shift="-1", Wrap=toggle_16)
shift_59 = ShiftList(List=divide_8.Points, Shift="1", Wrap=toggle_16)
shift_60 = ShiftList(List=divide_7.Points, Shift="1", Wrap=toggle_16)
loft = Loft(
    Curves=[intcrv_5.Curve, intcrv_6.Curve],
    Options={Adjust=False, Closed=False, LoftEnds=0, LoftSimp=0, LoftType=0, Rebuild=10, Refit=0.01})
entwine_28 = Entwine(Branch00=shift_57, Branch01=shift_59, Branch02=shift_60, Branch03=shift_58, FlattenInputs=True)  # -> simplify(Result)
sdivide_4 = DivideSurface(Surface=reparameterize(loft), UCount=num_71, VCount=num_70)  # -> Points, Normals, simplify(Parameters)
flip_49 = FlipMatrix(Data=entwine_28)
curvature = SurfaceCurvature(Surface=reparameterize(loft), Point=sdivide_4.Parameters)  # -> Frame, Gaussian, Mean
conmesh_33 = ConstructMesh(Vertices=flip_49, Faces={A=0, B=1, C=2, D=3})
abs = Absolute(Value=curvature.Gaussian)
abs_2 = Absolute(Value=curvature.Mean)
mjoin_11 = MeshJoin(Meshes=flatten(conmesh_33))
num_74 = Number(simplify(graft(abs_2)))
num_75 = Number(simplify(graft(abs)))
weld_11 = WeldMesh(Mesh=mjoin_11, Angle=3.141592654)
num_76 = Number("1")
bnd_25 = Bounds(Numbers=flatten(num_74))
bnd_26 = Bounds(Numbers=flatten(num_75))
unroller = Unroller(Strip=weld_11, Unroll=num_76)
remap_34 = RemapNumbers(Value=num_74, Source=bnd_25, Target=Domain(0, 1))  # -> Mapped, Clipped
remap_35 = RemapNumbers(Value=num_75, Source=bnd_26, Target=Domain(0, 1))  # -> Mapped, Clipped
weld_12 = WeldMesh(Mesh=unroller, Angle=3.141592654)
addition_27 = Addition(A=remap_35.Mapped, B=remap_34.Mapped)
faceb = FaceBoundaries(Mesh=weld_12)
bnd_27 = Bounds(Numbers=flatten(addition_27))
dom_36 = ConstructDomain(DomainStart="1", DomainEnd=num_72)
explode_4 = Explode(Curve=faceb, Recursive=True)  # -> Segments, Vertices
remap_36 = RemapNumbers(Value=addition_27, Source=bnd_27, Target=dom_36)  # -> Mapped, Clipped
item_142 = ListItem(List=explode_4.Segments, Index="0", Wrap=True)
item_143 = ListItem(List=explode_4.Segments, Index="2", Wrap=True)
trim_5 = TrimTree(Tree=remap_36.Mapped, Depth=1)
item_144 = ListItem(List=flatten(item_142), Index=0, Wrap=True)
replace_5 = ReplaceItems(List=trim_5, Item="0", Indices="0", Wrap=False)
ma_2 = MassAddition(Input=replace_5)  # -> Result, PartialResults
flip_50 = FlipCurve(Curve=flatten(item_142), Guide=item_144)  # -> Curve, Flag
flip_51 = FlipCurve(Curve=flatten(item_143), Guide=item_144)  # -> Curve, Flag
bnd_28 = Bounds(Numbers=ma_2.PartialResults)
cp_14 = ControlPoints(Curve=flip_50.Curve)  # -> Points, Weights, Knots
cp_15 = ControlPoints(Curve=flip_51.Curve)  # -> Points, Weights, Knots
remap_37 = RemapNumbers(Value=ma_2.PartialResults, Source=bnd_28, Target=Domain(0, 1))  # -> Mapped, Clipped
pdecon = Deconstruct(Point=sdivide_4.Parameters)  # -> XComponent, YComponent, ZComponent
cullpt_8 = CullDuplicates(Points=flatten(cp_15.Points), Tolerance=0.1, CullMode=3)  # -> Points, Indices, Valence
cullpt_9 = CullDuplicates(Points=flatten(cp_14.Points), Tolerance=0.1, CullMode=3)  # -> Points, Indices, Valence
pt_11 = ConstructPoint(XCoordinate=pdecon.XComponent, YCoordinate=remap_37.Mapped, ZCoordinate=pdecon.ZComponent)  # -> simplify(Point)
loft_opt = LoftOptions(Closed=False, Adjust=Toggle(True), Rebuild=num_70, Refit=0, Type=0)
pline_5 = PolyLine(Vertices=flatten(cullpt_8.Points), Closed=False)
pline_6 = PolyLine(Vertices=flatten(cullpt_9.Points), Closed=False)
evalsrf_2 = EvaluateSurface(Surface=reparameterize(loft), Point=pt_11)  # -> Point, Normal, Frame
loft_2 = Loft(Curves=[pline_6, pline_5], Options=loft_opt)
pt_12 = Point(evalsrf_2.Point)
panel_79 = Panel("""Lattice Hinges
(requires Kangaroo)""")
srf_cp = SurfaceClosestPoint(Point=pt_12, Surface=reparameterize(loft))  # -> Point, UVPoint, Distance
evalsrf_3 = EvaluateSurface(Surface=reparameterize(loft_2), Point=srf_cp.UVPoint)  # -> Point, Normal, Frame
vec = Vector(evalsrf_2.Normal)
pt_13 = Point(evalsrf_2.Point)
vec_2 = Vector(evalsrf_3.Normal)
amp_13 = Amplitude(Vector=vec, Amplitude=num_73)
pt_14 = Point(evalsrf_3.Point)
amp_14 = Amplitude(Vector=vec_2, Amplitude=num_73)
move_13 = Move(Geometry=pt_13, Motion=amp_13)  # -> Geometry, Transform
move_14 = Move(Geometry=pt_14, Motion=amp_14)  # -> Geometry, Transform
toggle_17 = BooleanToggle(False)
flip_52 = FlipMatrix(Data=pt_13)
toggle_18 = BooleanToggle(False)
flip_53 = FlipMatrix(Data=pt_13)
flip_54 = FlipMatrix(Data=move_13.Geometry)
flip_55 = FlipMatrix(Data=move_13.Geometry)
toggle_19 = BooleanToggle(False)
flip_56 = FlipMatrix(Data=move_14.Geometry)
flip_57 = FlipMatrix(Data=move_14.Geometry)
toggle_20 = BooleanToggle(False)
flip_58 = FlipMatrix(Data=pt_14)
flip_59 = FlipMatrix(Data=pt_14)
shift_61 = ShiftList(List=flip_52, Shift="1", Wrap=toggle_18)
shift_62 = ShiftList(List=flip_53, Shift="-1", Wrap=toggle_18)
shift_63 = ShiftList(List=flip_54, Shift="-1", Wrap=toggle_17)
shift_64 = ShiftList(List=flip_55, Shift="1", Wrap=toggle_17)
shift_65 = ShiftList(List=flip_56, Shift="1", Wrap=toggle_19)
shift_66 = ShiftList(List=flip_57, Shift="-1", Wrap=toggle_19)
shift_67 = ShiftList(List=flip_58, Shift="-1", Wrap=toggle_20)
shift_68 = ShiftList(List=flip_59, Shift="1", Wrap=toggle_20)
flip_60 = FlipMatrix(Data=shift_61)  # -> simplify(Data)
flip_61 = FlipMatrix(Data=shift_63)  # -> simplify(Data)
flip_62 = FlipMatrix(Data=shift_62)  # -> simplify(Data)
flip_63 = FlipMatrix(Data=shift_64)  # -> simplify(Data)
flip_64 = FlipMatrix(Data=shift_65)  # -> simplify(Data)
flip_65 = FlipMatrix(Data=shift_66)  # -> simplify(Data)
flip_66 = FlipMatrix(Data=shift_67)  # -> simplify(Data)
flip_67 = FlipMatrix(Data=shift_68)  # -> simplify(Data)
shift_69 = ShiftList(List=flip_60, Shift="1", Wrap=toggle_18)  # -> simplify(List)
shift_70 = ShiftList(List=flip_60, Shift="-1", Wrap=toggle_18)  # -> simplify(List)
shift_71 = ShiftList(List=flip_62, Shift="1", Wrap=toggle_18)  # -> simplify(List)
shift_72 = ShiftList(List=flip_62, Shift="-1", Wrap=toggle_18)  # -> simplify(List)
shift_73 = ShiftList(List=flip_63, Shift="1", Wrap=toggle_17)  # -> simplify(List)
shift_74 = ShiftList(List=flip_61, Shift="1", Wrap=toggle_17)  # -> simplify(List)
shift_75 = ShiftList(List=flip_61, Shift="-1", Wrap=toggle_17)  # -> simplify(List)
shift_76 = ShiftList(List=flip_63, Shift="-1", Wrap=toggle_17)  # -> simplify(List)
shift_77 = ShiftList(List=flip_65, Shift="-1", Wrap=toggle_19)  # -> simplify(List)
shift_78 = ShiftList(List=flip_65, Shift="1", Wrap=toggle_19)  # -> simplify(List)
shift_79 = ShiftList(List=flip_64, Shift="-1", Wrap=toggle_19)  # -> simplify(List)
shift_80 = ShiftList(List=flip_66, Shift="-1", Wrap=toggle_20)  # -> simplify(List)
shift_81 = ShiftList(List=flip_66, Shift="1", Wrap=toggle_20)  # -> simplify(List)
shift_82 = ShiftList(List=flip_64, Shift="1", Wrap=toggle_19)  # -> simplify(List)
shift_83 = ShiftList(List=flip_67, Shift="-1", Wrap=toggle_20)  # -> simplify(List)
shift_84 = ShiftList(List=flip_67, Shift="1", Wrap=toggle_20)  # -> simplify(List)
srf4pt = _4PointSurface(CornerA=shift_80, CornerB=shift_81, CornerC=shift_84, CornerD=shift_83)  # -> flatten(Surface)
tbox_17 = TwistedBox(
    CornerA=shift_80,
    CornerB=shift_81,
    CornerC=shift_84,
    CornerD=shift_83,
    CornerE=shift_77,
    CornerF=shift_78,
    CornerG=shift_82,
    CornerH=shift_79)  # -> flatten(TwistedBox)
srf4pt_2 = _4PointSurface(CornerA=shift_72, CornerB=shift_71, CornerC=shift_69, CornerD=shift_70)  # -> flatten(Surface)
tbox_18 = TwistedBox(
    CornerA=shift_72,
    CornerB=shift_71,
    CornerC=shift_69,
    CornerD=shift_70,
    CornerE=shift_75,
    CornerF=shift_74,
    CornerG=shift_73,
    CornerH=shift_76)  # -> flatten(TwistedBox)
num_77 = Number(trim_5)
toggle_21 = BooleanToggle(False)
flip_68 = FlipMatrix(Data=num_77)
flip_69 = FlipMatrix(Data=num_77)
shift_85 = ShiftList(List=flip_68, Shift="1", Wrap=toggle_21)
shift_86 = ShiftList(List=flip_69, Shift="-1", Wrap=toggle_21)
flip_70 = FlipMatrix(Data=shift_85)  # -> simplify(Data)
flip_71 = FlipMatrix(Data=shift_86)  # -> simplify(Data)
shift_87 = ShiftList(List=flip_71, Shift="1", Wrap=toggle_21)  # -> simplify(List)
shift_88 = ShiftList(List=flip_70, Shift="1", Wrap=toggle_21)  # -> simplify(List)
shift_89 = ShiftList(List=flip_70, Shift="-1", Wrap=toggle_21)  # -> simplify(List)
shift_90 = ShiftList(List=flip_71, Shift="-1", Wrap=toggle_21)  # -> simplify(List)
entwine_29 = Entwine(
    Branch00=graft(shift_90),
    Branch01=graft(shift_87),
    Branch02=graft(shift_89),
    Branch03=graft(shift_88),
    FlattenInputs=True)
flip_72 = FlipMatrix(Data=entwine_29)
ma_3 = MassAddition(Input=flip_72)  # -> Result, PartialResults
bnd_29 = Bounds(Numbers=flatten(ma_3.Result))
remap_38 = RemapNumbers(Value=ma_3.Result, Source=bnd_29, Target=Domain(0, 1))  # -> flatten(Mapped), Clipped
tbox_19 = TwistedBox(tbox_17)
tbox_20 = TwistedBox(tbox_18)
srf_4 = Surface(srf4pt_2)
srf_5 = Surface(srf4pt)
num_78 = Number(remap_38.Mapped)
srf_6 = Surface(loft_2)
voxels_rolled = VoxelsRolled(tbox_20)  # Voxels of the rolled surface (for preview)
voxels_unrolled = VoxelsUnrolled(tbox_19)  # Voxels of the unrolled surface (for mapping)
panels_rolled = PanelsRolled(srf_4)  # Panels of the rolled surface (for preview)
panel_values = PanelValues(num_78)  # Values measuring curvature (0-1)
unrolled_surface = UnrolledSurface(srf_6)  # The unrolled surface
panels_unrolled = PanelsUnrolled(srf_5)  # Panels of the unrolled surface (for mapping)

parameter_1b = Parameter1b()  # Number (0-1)
parameter_2d = Parameter2d()  # Number (0-1)
tolerance_4 = Tolerance()  # Tolerance for merging faces and vertices (number usually between 0.001 and 0.1)
parameter_1c = Parameter1c()  # Number (0-1)
parameter_1d = Parameter1d()  # Number (0-1)
parameter_2c = Parameter2c()  # Number (0-1)
parameter_1a = Parameter1a()  # Number (0-1)
mesh_face = MeshFace()  # Mesh faces (exploded as single meshes)
parameter_2b = Parameter2b()  # Number (0-1)
parameter_2a = Parameter2a()  # Number (0-1)
num_79 = Number(tolerance_4)
t1 = Number(parameter_2a)
t1_2 = Number(parameter_2d)
t1_3 = Number(parameter_2c)
t1_4 = Number(parameter_1a)
t1_5 = Number(parameter_2b)
mesh_47 = Mesh(mesh_face)
t1_6 = Number(parameter_1c)
t1_7 = Number(parameter_1d)
t1_8 = Number(parameter_1b)
polygon_3 = Polygon(Plane=PlaneXY(0, 0, 0), Radius="3", Segments="4", FilletRadius=0)  # -> Polygon, Length
merge_9 = Merge(Data1=t1, Data2=t1_5, Data3=t1_3, Data4=t1_2)
merge_10 = Merge(Data1=t1_4, Data2=t1_8, Data3=t1_6, Data4=t1_7)
crv_41 = Curve(polygon_3.Polygon)
item_145 = ListItem(List=merge_10, Index=0, Wrap=True)  # -> flatten(Item)
shift_91 = ShiftList(List=merge_9, Shift="-1", Wrap=True)
shift_92 = ShiftList(List=merge_10, Shift="-1", Wrap=True)
explode_5 = Explode(Curve=crv_41, Recursive=True)  # -> Segments, Vertices
pcen = PolygonCenter(Polyline=crv_41)  # -> CenterV, CenterE, CenterA
lng_10 = ListLength(List=item_145)
curvepoint_6 = PointOnCurve(explode_5.Segments, parameter=0.5)
division_30 = Division(A=shift_91, B="2")
cullpt_10 = CullDuplicates(Points=explode_5.Vertices, Tolerance=0.1, CullMode=3)  # -> Points, Indices, Valence
dup = DuplicateData(Data=graft(explode_5.Segments), Number=lng_10, Order=True)  # -> simplify(graft(Data))
subtraction_5 = Subtraction(A="1", B=division_30)
ln_6 = Line(StartPoint=pcen.CenterV, EndPoint=curvepoint_6)
merge_11 = Merge(Data1=graft(division_30), Data2=graft(subtraction_5))  # -> simplify(Result)
trim_6 = TrimTree(Tree=dup, Depth=1)
flip_73 = FlipMatrix(Data=trim_6)  # -> graft(Data)
eval_5 = EvaluateCurve(Curve=ln_6, Parameter=shift_92)  # -> simplify(Point), Tangent, Angle
eval_6 = EvaluateCurve(Curve=reparameterize(simplify(flip_73)), Parameter=merge_11)  # -> simplify(Point), Tangent, Angle
item_146 = ListItem(List=eval_5.Point, Index=0, Wrap=True)  # -> flatten(Item)
item_147 = ListItem(List=eval_6.Point, Index=0, Wrap=True)  # -> Item, Item1
lng_11 = ListLength(List=item_146)
item_148 = ListItem(List=curvepoint_6, Index=0, Wrap=True)  # -> Item, Item1, Item2, Item3
trim_7 = TrimTree(Tree=item_147.Item1, Depth=1)
trim_8 = TrimTree(Tree=item_147.Item, Depth=1)
dup_2 = DuplicateData(Data=item_148.Item1, Number=lng_11, Order=True)  # -> simplify(graft(Data))
dup_3 = DuplicateData(Data=item_148.Item2, Number=lng_11, Order=True)  # -> simplify(graft(Data))
dup_4 = DuplicateData(Data=item_148.Item, Number=lng_11, Order=True)  # -> simplify(graft(Data))
dup_5 = DuplicateData(Data=item_148.Item3, Number=lng_11, Order=True)  # -> simplify(graft(Data))
item_149 = ListItem(List=trim_8, Index=0, Wrap=True)  # -> Item, Item1, Item2, Item3
item_150 = ListItem(List=eval_5.Point, Index=0, Wrap=True)  # -> Item, Item1, Item2, Item3
item_151 = ListItem(List=trim_7, Index=0, Wrap=True)  # -> Item, Item1, Item2, Item3
quad_20 = MeshQuad(CornerA=0, CornerB=1, CornerC=2, CornerD=3)
conmesh_34 = ConstructMesh(Vertices=[item_150.Item2, item_150.Item3, dup_5], Faces={A=0, B=1, C=2, D=2})
conmesh_35 = ConstructMesh(Vertices=[item_150.Item1, dup_2, item_151.Item1], Faces={A=0, B=1, C=2, D=2})
conmesh_36 = ConstructMesh(Vertices=[dup_2, item_150.Item, item_149.Item1], Faces={A=0, B=1, C=2, D=2})
conmesh_37 = ConstructMesh(Vertices=[dup_4, item_150.Item, item_151.Item], Faces={A=0, B=1, C=2, D=2})
conmesh_38 = ConstructMesh(Vertices=[dup_3, item_150.Item2, item_151.Item2], Faces={A=0, B=1, C=2, D=2})
conmesh_39 = ConstructMesh(Vertices=[item_151.Item3, dup_5, item_150.Item3], Faces={A=0, B=1, C=2, D=2})
conmesh_40 = ConstructMesh(Vertices=[dup_3, item_150.Item1, item_149.Item2], Faces={A=0, B=1, C=2, D=2})
conmesh_41 = ConstructMesh(Vertices=[item_150.Item2, item_149.Item3, dup_5], Faces={A=0, B=1, C=2, D=2})
conmesh_42 = ConstructMesh(Vertices=[item_150.Item, item_150.Item3, dup_4], Faces={A=0, B=1, C=2, D=2})
conmesh_43 = ConstructMesh(Vertices=[dup_2, item_150.Item, item_150.Item1], Faces={A=0, B=1, C=2, D=2})
conmesh_44 = ConstructMesh(Vertices=eval_5.Point, Faces=quad_20)
conmesh_45 = ConstructMesh(Vertices=[dup_3, item_150.Item2, item_150.Item1], Faces={A=0, B=1, C=2, D=2})
conmesh_46 = ConstructMesh(Vertices=[item_150.Item3, item_149.Item, dup_4], Faces={A=0, B=1, C=2, D=2})
merge_12 = Merge(
    Data1=conmesh_44,
    Data2=conmesh_42,
    Data3=conmesh_43,
    Data4=conmesh_45,
    Data5=conmesh_34,
    Data6=conmesh_37,
    Data7=conmesh_35,
    Data8=conmesh_38,
    Data9=conmesh_39,
    Data10=conmesh_41,
    Data11=conmesh_36,
    Data12=conmesh_40,
    Data13=conmesh_46)
mjoin_12 = MeshJoin(Meshes=merge_12)
unim = UnifyMesh(Mesh=mjoin_12)  # -> Result, Count
demesh_37 = DeconstructMesh(Mesh=unim.Result)  # -> Vertices, Faces, Colours, Normals
deface_22 = DeconstructFace(Face=demesh_37.Faces)  # -> CornerA, CornerB, CornerC, CornerD
item_152 = ListItem(List=demesh_37.Vertices, Index=deface_22.CornerA, Wrap=True)
item_153 = ListItem(List=demesh_37.Vertices, Index=deface_22.CornerB, Wrap=True)
cullpt_11 = CullDuplicates(Points=demesh_37.Vertices, Tolerance=num_79, CullMode=3)  # -> Points, Indices, Valence
item_154 = ListItem(List=demesh_37.Vertices, Index=deface_22.CornerC, Wrap=True)
item_155 = ListItem(List=demesh_37.Vertices, Index=deface_22.CornerD, Wrap=True)
fsim_2 = FindSimilarMember(Data=item_153, Set=cullpt_11.Points)  # -> Hit, Index
fsim_3 = FindSimilarMember(Data=item_154, Set=cullpt_11.Points)  # -> Hit, Index
fsim_4 = FindSimilarMember(Data=item_155, Set=cullpt_11.Points)  # -> Hit, Index
fsim_5 = FindSimilarMember(Data=item_152, Set=cullpt_11.Points)  # -> Hit, Index
quad_21 = MeshQuad(CornerA=fsim_5.Index, CornerB=fsim_2.Index, CornerC=fsim_3.Index, CornerD=fsim_4.Index)
conmesh_47 = ConstructMesh(Vertices=cullpt_11.Points, Faces=quad_21)  # -> simplify(Mesh)
conmesh_48 = ConstructMesh(Vertices=cullpt_10.Points, Faces={A=0, B=1, C=2, D=3})
weld_13 = WeldMesh(Mesh=conmesh_47, Angle=3.141592654)
mesh_48 = Mesh(weld_13)
mesh_49 = Mesh(conmesh_48)
crv_42 = Curve(crv_41)
demesh_38 = DeconstructMesh(Mesh=mesh_48)  # -> Vertices, Faces, Colours, Normals
meshcp_14 = MeshClosestPoint(Point=demesh_38.Vertices, Mesh=mesh_49)  # -> Point, Index, Parameter
meval_11 = MeshEval(Mesh=mesh_47, Parameter=meshcp_14.Parameter)  # -> Point, Normal, Colour
conmesh_49 = ConstructMesh(Vertices=meval_11.Point, Faces=demesh_38.Faces)
mjoin_13 = MeshJoin(Meshes=flatten(conmesh_49))
facen_3 = FaceNormals(Mesh=mjoin_13)  # -> Centers, Normals
demesh_39 = DeconstructMesh(Mesh=mjoin_13)  # -> Vertices, Faces, Colours, Normals
cullpt_12 = CullDuplicates(Points=facen_3.Centers, Tolerance=num_79, CullMode=1)  # -> Points, Indices, Valence
item_156 = ListItem(List=demesh_39.Faces, Index=cullpt_12.Indices, Wrap=True)
conmesh_50 = ConstructMesh(Vertices=demesh_39.Vertices, Faces=item_156)
weld_14 = WeldMesh(Mesh=conmesh_50, Angle=3.141592654)
c_script_3 = CSharpScript(M=weld_14, radius=num_79)  # -> out, A; inputs M: Mesh, radius: Double; same code as c_script
lattice_hinge_shell = LatticeHingeShell(c_script_3.A)  # Joined mesh that makes up the lattice hinge

mesh_face_2 = MeshFace()  # Mesh faces (exploded as single meshes)
parameter_2a_2 = Parameter2a()  # Number (0-1)
parameter_1b_2 = Parameter1b()  # Number (0-1)
tolerance_5 = Tolerance()  # Tolerance for merging faces and vertices (number usually between 0.001 and 0.1)
parameter_1c_2 = Parameter1c()  # Number (0-1)
parameter_2c_2 = Parameter2c()  # Number (0-1)
parameter_1a_2 = Parameter1a()  # Number (0-1)
parameter_2b_2 = Parameter2b()  # Number (0-1)
mesh_50 = Mesh(mesh_face_2)
t1_9 = Number(parameter_2a_2)
t1_10 = Number(parameter_2c_2)
t1_11 = Number(parameter_1a_2)
t1_12 = Number(parameter_2b_2)
t1_13 = Number(parameter_1c_2)
num_80 = Number(tolerance_5)
t1_14 = Number(parameter_1b_2)
polygon_4 = Polygon(Plane=PlaneXY(0, 0, 0), Radius="3", Segments="3", FilletRadius=0)  # -> Polygon, Length
merge_13 = Merge(Data1=t1_9, Data2=t1_12, Data3=t1_10)
merge_14 = Merge(Data1=t1_11, Data2=t1_14, Data3=t1_13)
crv_43 = Curve(polygon_4.Polygon)
item_157 = ListItem(List=merge_14, Index=0, Wrap=True)  # -> flatten(Item)
shift_93 = ShiftList(List=merge_13, Shift="-1", Wrap=True)
shift_94 = ShiftList(List=merge_14, Shift="-1", Wrap=True)
explode_6 = Explode(Curve=crv_43, Recursive=True)  # -> Segments, Vertices
pcen_2 = PolygonCenter(Polyline=crv_43)  # -> CenterV, CenterE, CenterA
lng_12 = ListLength(List=item_157)
curvepoint_7 = PointOnCurve(explode_6.Segments, parameter=0.5)
division_31 = Division(A=shift_93, B="2")
cullpt_13 = CullDuplicates(Points=explode_6.Vertices, Tolerance=0.1, CullMode=3)  # -> Points, Indices, Valence
dup_6 = DuplicateData(Data=graft(explode_6.Segments), Number=lng_12, Order=True)  # -> simplify(graft(Data))
subtraction_6 = Subtraction(A="1", B=division_31)
merge_15 = Merge(Data1=graft(division_31), Data2=graft(subtraction_6))  # -> simplify(Result)
ln_7 = Line(StartPoint=pcen_2.CenterV, EndPoint=curvepoint_7)
trim_9 = TrimTree(Tree=dup_6, Depth=1)
flip_74 = FlipMatrix(Data=trim_9)  # -> graft(Data)
eval_7 = EvaluateCurve(Curve=ln_7, Parameter=shift_94)  # -> simplify(Point), Tangent, Angle
eval_8 = EvaluateCurve(Curve=reparameterize(simplify(flip_74)), Parameter=merge_15)  # -> simplify(Point), Tangent, Angle
item_158 = ListItem(List=eval_7.Point, Index=0, Wrap=True)  # -> flatten(Item)
item_159 = ListItem(List=eval_8.Point, Index=0, Wrap=True)  # -> Item, Item1
lng_13 = ListLength(List=item_158)
trim_10 = TrimTree(Tree=item_159.Item1, Depth=1)
trim_11 = TrimTree(Tree=item_159.Item, Depth=1)
item_160 = ListItem(List=curvepoint_7, Index=0, Wrap=True)  # -> Item, Item1, Item2
item_161 = ListItem(List=trim_10, Index=0, Wrap=True)  # -> Item, Item1, Item2
item_162 = ListItem(List=trim_11, Index=0, Wrap=True)  # -> Item, Item1, Item2
item_163 = ListItem(List=eval_7.Point, Index=0, Wrap=True)  # -> Item, Item1, Item2
dup_7 = DuplicateData(Data=item_160.Item1, Number=lng_13, Order=True)  # -> simplify(graft(Data))
dup_8 = DuplicateData(Data=item_160.Item, Number=lng_13, Order=True)  # -> simplify(graft(Data))
dup_9 = DuplicateData(Data=item_160.Item2, Number=lng_13, Order=True)  # -> simplify(graft(Data))
conmesh_51 = ConstructMesh(Vertices=[dup_8, item_163.Item, item_163.Item2], Faces={A=0, B=1, C=2, D=2})
conmesh_52 = ConstructMesh(Vertices=[dup_7, item_163.Item, item_163.Item1], Faces={A=0, B=1, C=2, D=2})
conmesh_53 = ConstructMesh(Vertices=[dup_9, item_163.Item2, item_163.Item1], Faces={A=0, B=1, C=2, D=2})
conmesh_54 = ConstructMesh(Vertices=[dup_8, item_163.Item, item_161.Item], Faces={A=0, B=1, C=2, D=2})
conmesh_55 = ConstructMesh(Vertices=eval_7.Point, Faces={A=0, B=1, C=2, D=2})
conmesh_56 = ConstructMesh(Vertices=[item_163.Item1, dup_7, item_161.Item1], Faces={A=0, B=1, C=2, D=2})
conmesh_57 = ConstructMesh(Vertices=[dup_7, item_163.Item, item_162.Item1], Faces={A=0, B=1, C=2, D=2})
conmesh_58 = ConstructMesh(Vertices=[dup_9, item_163.Item2, item_161.Item2], Faces={A=0, B=1, C=2, D=2})
conmesh_59 = ConstructMesh(Vertices=[dup_8, item_163.Item2, item_162.Item], Faces={A=0, B=1, C=2, D=2})
conmesh_60 = ConstructMesh(Vertices=[dup_9, item_163.Item1, item_162.Item2], Faces={A=0, B=1, C=2, D=2})
merge_16 = Merge(
    Data1=conmesh_55,
    Data2=conmesh_51,
    Data3=conmesh_52,
    Data4=conmesh_53,
    Data5=conmesh_54,
    Data6=conmesh_56,
    Data7=conmesh_58,
    Data8=conmesh_59,
    Data9=conmesh_57,
    Data10=conmesh_60)
mjoin_14 = MeshJoin(Meshes=merge_16)
unim_2 = UnifyMesh(Mesh=mjoin_14)  # -> Result, Count
demesh_40 = DeconstructMesh(Mesh=unim_2.Result)  # -> Vertices, Faces, Colours, Normals
deface_23 = DeconstructFace(Face=demesh_40.Faces)  # -> CornerA, CornerB, CornerC, CornerD
item_164 = ListItem(List=demesh_40.Vertices, Index=deface_23.CornerC, Wrap=True)
item_165 = ListItem(List=demesh_40.Vertices, Index=deface_23.CornerA, Wrap=True)
item_166 = ListItem(List=demesh_40.Vertices, Index=deface_23.CornerB, Wrap=True)
cullpt_14 = CullDuplicates(Points=demesh_40.Vertices, Tolerance=0.1, CullMode=3)  # -> Points, Indices, Valence
fsim_6 = FindSimilarMember(Data=item_166, Set=cullpt_14.Points)  # -> Hit, Index
fsim_7 = FindSimilarMember(Data=item_165, Set=cullpt_14.Points)  # -> Hit, Index
fsim_8 = FindSimilarMember(Data=item_164, Set=cullpt_14.Points)  # -> Hit, Index
triangle = MeshTriangle(CornerA=fsim_7.Index, CornerB=fsim_6.Index, CornerC=fsim_8.Index)
triangle_2 = MeshTriangle(CornerA=0, CornerB=1, CornerC=2)
conmesh_61 = ConstructMesh(Vertices=cullpt_14.Points, Faces=triangle)  # -> simplify(Mesh)
conmesh_62 = ConstructMesh(Vertices=cullpt_13.Points, Faces=triangle_2)
weld_15 = WeldMesh(Mesh=conmesh_61, Angle=3.141592654)
mesh_51 = Mesh(weld_15)
mesh_52 = Mesh(conmesh_62)
crv_44 = Curve(crv_43)
demesh_41 = DeconstructMesh(Mesh=mesh_51)  # -> Vertices, Faces, Colours, Normals
meshcp_15 = MeshClosestPoint(Point=demesh_41.Vertices, Mesh=mesh_52)  # -> Point, Index, Parameter
meval_12 = MeshEval(Mesh=mesh_50, Parameter=meshcp_15.Parameter)  # -> Point, Normal, Colour
conmesh_63 = ConstructMesh(Vertices=meval_12.Point, Faces=demesh_41.Faces)
mjoin_15 = MeshJoin(Meshes=flatten(conmesh_63))
facen_4 = FaceNormals(Mesh=mjoin_15)  # -> Centers, Normals
demesh_42 = DeconstructMesh(Mesh=mjoin_15)  # -> Vertices, Faces, Colours, Normals
cullpt_15 = CullDuplicates(Points=facen_4.Centers, Tolerance=num_80, CullMode=1)  # -> Points, Indices, Valence
item_167 = ListItem(List=demesh_42.Faces, Index=cullpt_15.Indices, Wrap=True)
conmesh_64 = ConstructMesh(Vertices=demesh_42.Vertices, Faces=item_167)
weld_16 = WeldMesh(Mesh=conmesh_64, Angle=3.141592654)
c_script_4 = CSharpScript(M=weld_16, radius=num_80)  # -> out, A; inputs M: Mesh, radius: Double; same code as c_script
lattice_hinge_shell_2 = LatticeHingeShell(c_script_4.A)  # Joined mesh that makes up the lattice hinge

panel_80 = Panel("2D (WIP)")

# ----
# LATTICE HINGE TWEEN SHELL FILL
tolerance_6 = Tolerance()  # Tolerance for merging faces and vertices (number usually between 0.001 and 0.1)
value_9 = Value()  # Value from 0-1 corresponding to each voxel
unit_cell_shell_4 = UnitCellShell()  # Unit cell to populate voxels
voxels_27 = Voxels()  # Voxels to be filled with unit cells
unit_cell_shell_5 = UnitCellShell()  # Unit cell to populate voxels
geo_26 = Geometry(flatten(voxels_27))
geo_27 = Geometry(unit_cell_shell_5)
num_81 = Number(tolerance_6)
geo_28 = Geometry(unit_cell_shell_4)
num_82 = Number(value_9)
demesh_43 = DeconstructMesh(Mesh=geo_28)  # -> Vertices, Faces, Colours, Normals
demesh_44 = DeconstructMesh(Mesh=geo_27)  # -> Vertices, Faces, Colours, Normals
ln_8 = Line(StartPoint=demesh_43.Vertices, EndPoint=demesh_44.Vertices)
eval_9 = EvaluateCurve(Curve=reparameterize(graft(ln_8)), Parameter=num_82)  # -> simplify(Point), Tangent, Angle
flip_75 = FlipMatrix(Data=eval_9.Point)
conmesh_65 = ConstructMesh(Vertices=flip_75, Faces=demesh_43.Faces)  # -> simplify(Mesh)
demesh_45 = DeconstructMesh(Mesh=conmesh_65)  # -> Vertices, Faces, Colours, Normals
avr = Average(Input=demesh_45.Vertices)
avr_2 = Average(Input=demesh_45.Normals)
move_15 = Move(Geometry=avr, Motion=avr_2)  # -> simplify(Geometry), Transform
merge_17 = Merge(Data1=conmesh_65, Data2=move_15.Geometry)
bbox_9 = BoundingBox(Content=merge_17, Plane=PlaneXY(0, 0, 0), UnionBox=True)  # -> simplify(Box), Box_2
morph_5 = BoxMorph(Geometry=conmesh_65, Reference=bbox_9.Box, Target=simplify(graft(geo_26)))  # -> flatten(Geometry)
mjoin_16 = MeshJoin(Meshes=morph_5)
demesh_46 = DeconstructMesh(Mesh=mjoin_16)  # -> Vertices, Faces, Colours, Normals
facen_5 = FaceNormals(Mesh=mjoin_16)  # -> Centers, Normals
cullpt_16 = CullDuplicates(Points=facen_5.Centers, Tolerance=num_81, CullMode=1)  # -> Points, Indices, Valence
item_168 = ListItem(List=demesh_46.Faces, Index=cullpt_16.Indices, Wrap=True)
conmesh_66 = ConstructMesh(Vertices=demesh_46.Vertices, Faces=item_168)
weld_17 = WeldMesh(Mesh=conmesh_66, Angle=3.141592654)
c_script_5 = CSharpScript(M=weld_17, radius=num_81)  # -> out, A; inputs M: Mesh, radius: Double; same code as c_script
lattice_hinge_shell_3 = LatticeHingeShell(c_script_5.A)  # Joined mesh that makes up the lattice hinge

# ----
# Mesh Tween Shell Fill
value_10 = Value()  # Value from 0-1 corresponding to each voxel
mesh_shell_2 = MeshShell2()  # Shell Unit cell to map to mesh faces
mesh_face_3 = MeshFace()  # Mesh faces (exploded as single meshes)
tolerance_7 = Tolerance()  # Tolerance for merging faces and vertices (number usually between 0.001 and 0.1)
mesh_shell_1 = MeshShell1()  # Shell Unit cell to map to mesh faces
num_83 = Number(value_10)
geo_29 = Geometry(mesh_shell_2)
mesh_53 = Mesh(mesh_face_3)
geo_30 = Geometry(mesh_shell_1)
num_84 = Number(tolerance_7)
item_169 = ListItem(List=geo_29, Index=0, Wrap=True)  # -> Item, Item1
item_170 = ListItem(List=geo_30, Index=0, Wrap=True)  # -> Item, Item1
mesh_54 = Mesh(item_169.Item1)
mesh_55 = Mesh(item_169.Item)
mesh_56 = Mesh(item_170.Item)
mesh_57 = Mesh(item_170.Item1)
demesh_47 = DeconstructMesh(Mesh=mesh_55)  # -> Vertices, Faces, Colours, Normals
demesh_48 = DeconstructMesh(Mesh=mesh_56)  # -> Vertices, Faces, Colours, Normals
ln_9 = Line(StartPoint=demesh_48.Vertices, EndPoint=demesh_47.Vertices)
eval_10 = EvaluateCurve(Curve=ln_9, Parameter=num_83)  # -> simplify(Point), Tangent, Angle
meshcp_16 = MeshClosestPoint(Point=eval_10.Point, Mesh=mesh_57)  # -> Point, Index, Parameter
meval_13 = MeshEval(Mesh=mesh_53, Parameter=meshcp_16.Parameter)  # -> Point, Normal, Colour
conmesh_67 = ConstructMesh(Vertices=meval_13.Point, Faces=demesh_47.Faces)
mjoin_17 = MeshJoin(Meshes=conmesh_67)
facen_6 = FaceNormals(Mesh=mjoin_17)  # -> Centers, Normals
demesh_49 = DeconstructMesh(Mesh=mjoin_17)  # -> Vertices, Faces, Colours, Normals
cullpt_17 = CullDuplicates(Points=facen_6.Centers, Tolerance=num_84, CullMode=1)  # -> Points, Indices, Valence
item_171 = ListItem(List=demesh_49.Faces, Index=cullpt_17.Indices, Wrap=True)
conmesh_68 = ConstructMesh(Vertices=demesh_49.Vertices, Faces=item_171)
weld_18 = WeldMesh(Mesh=conmesh_68, Angle=3.141592654)
c_script_6 = CSharpScript(M=weld_18, radius=num_84)  # -> out, A; inputs M: Mesh, radius: Double; same code as c_script
lattice_hinge_shell_4 = LatticeHingeShell(c_script_6.A)  # Joined mesh that makes up the lattice hinge

mesh_face_4 = MeshFace()  # Mesh faces (exploded as single meshes)
tolerance_8 = Tolerance()  # Tolerance for merging faces and vertices (number usually between 0.001 and 0.1)
mesh_shell = MeshShell()  # Shell Unit cell to map to mesh faces
mesh_58 = Mesh(mesh_face_4)
geo_31 = Geometry(mesh_shell)
num_85 = Number(tolerance_8)
item_172 = ListItem(List=geo_31, Index=0, Wrap=True)  # -> Item, Item1
mesh_59 = Mesh(item_172.Item)
mesh_60 = Mesh(item_172.Item1)
demesh_50 = DeconstructMesh(Mesh=mesh_59)  # -> Vertices, Faces, Colours, Normals
meshcp_17 = MeshClosestPoint(Point=demesh_50.Vertices, Mesh=mesh_60)  # -> Point, Index, Parameter
panel_81 = Panel("Mesh Shell Fill")
meval_14 = MeshEval(Mesh=mesh_58, Parameter=meshcp_17.Parameter)  # -> Point, Normal, Colour
conmesh_69 = ConstructMesh(Vertices=meval_14.Point, Faces=demesh_50.Faces)
mjoin_18 = MeshJoin(Meshes=conmesh_69)
facen_7 = FaceNormals(Mesh=mjoin_18)  # -> Centers, Normals
demesh_51 = DeconstructMesh(Mesh=mjoin_18)  # -> Vertices, Faces, Colours, Normals
cullpt_18 = CullDuplicates(Points=facen_7.Centers, Tolerance=num_85, CullMode=1)  # -> Points, Indices, Valence
item_173 = ListItem(List=demesh_51.Faces, Index=cullpt_18.Indices, Wrap=True)
conmesh_70 = ConstructMesh(Vertices=demesh_51.Vertices, Faces=item_173)
weld_19 = WeldMesh(Mesh=conmesh_70, Angle=3.141592654)
c_script_7 = CSharpScript(M=weld_19, radius=num_85)  # -> out, A; inputs M: Mesh, radius: Double; same code as c_script
lattice_hinge_shell_5 = LatticeHingeShell(c_script_7.A)  # Joined mesh that makes up the lattice hinge

# ----
# LATTICE HINGE SHELL FILL
unit_cell_shell_6 = UnitCellShell()  # Unit cell to populate voxels
voxels_28 = Voxels()  # Voxels to be filled with unit cells
tolerance_9 = Tolerance()  # Tolerance for merging faces and vertices (number usually between 0.001 and 0.1)
geo_32 = Geometry(unit_cell_shell_6)
geo_33 = Geometry(voxels_28)
num_86 = Number(tolerance_9)
mesh_61 = Mesh(geo_32)
demesh_52 = DeconstructMesh(Mesh=mesh_61)  # -> Vertices, Faces, Colours, Normals
avr_3 = Average(Input=demesh_52.Vertices)
avr_4 = Average(Input=demesh_52.Normals)
move_16 = Move(Geometry=avr_3, Motion=avr_4)  # -> simplify(Geometry), Transform
merge_18 = Merge(Data1=mesh_61, Data2=move_16.Geometry)  # -> flatten(Result)
bbox_10 = BoundingBox(Content=merge_18, Plane=PlaneXY(0, 0, 0), UnionBox=True)  # -> simplify(Box), Box_2
morph_6 = BoxMorph(Geometry=mesh_61, Reference=bbox_10.Box, Target=flatten(geo_33))
mjoin_19 = MeshJoin(Meshes=morph_6)
facen_8 = FaceNormals(Mesh=mjoin_19)  # -> Centers, Normals
demesh_53 = DeconstructMesh(Mesh=mjoin_19)  # -> Vertices, Faces, Colours, Normals
cullpt_19 = CullDuplicates(Points=facen_8.Centers, Tolerance=num_86, CullMode=1)  # -> Points, Indices, Valence
item_174 = ListItem(List=demesh_53.Faces, Index=cullpt_19.Indices, Wrap=True)
conmesh_71 = ConstructMesh(Vertices=demesh_53.Vertices, Faces=item_174)
weld_20 = WeldMesh(Mesh=conmesh_71, Angle=3.141592654)
c_script_8 = CSharpScript(M=weld_20, radius=num_86)  # -> out, A; inputs M: Mesh, radius: Double; same code as c_script
lattice_hinge_shell_6 = LatticeHingeShell(c_script_8.A)  # Joined mesh that makes up the lattice hinge

mesh_cell = MeshCell()  # Lattice Unit cell to map to mesh faces
mesh_face_5 = MeshFace()  # Mesh faces (exploded as single meshes)
geo_34 = Geometry(mesh_cell)
toggle_22 = BooleanToggle(True)
crv_45 = Curve(flatten(geo_34))
mesh_62 = Mesh(geo_34)
clean_3 = CleanTree(RemoveNulls=toggle_22, RemoveInvalid=toggle_22, RemoveEmpty=toggle_22, Tree=mesh_62)
clean_4 = CleanTree(RemoveNulls=toggle_22, RemoveInvalid=toggle_22, RemoveEmpty=toggle_22, Tree=crv_45)
mesh_63 = Mesh(mesh_face_5)
cp_16 = ControlPoints(Curve=clean_4)  # -> Points, Weights, Knots
meshcp_18 = MeshClosestPoint(Point=cp_16.Points, Mesh=clean_3)  # -> Point, Index, Parameter
panel_82 = Panel("Mesh Cell Fill")
meval_15 = MeshEval(Mesh=flatten(mesh_63), Parameter=simplify(graft(meshcp_18.Parameter)))  # -> simplify(Point), Normal, Colour
path_mapper_7 = PathMapper(meval_15.Point, source="{A;B}(i)", target="{A;i}(B)")
pline_7 = PolyLine(Vertices=path_mapper_7, Closed=False)
trim_12 = TrimTree(Tree=pline_7, Depth=1)
flip_76 = FlipMatrix(Data=trim_12)
join_3 = JoinCurves(Curves=flip_76, Preserve=False)
lattice_hinge = LatticeHinge(join_3)  # Joined curves that makes up the lattice hinge

# ----
# Mesh Tween Cell Fill
value_11 = Value()  # Value from 0-1 corresponding to each voxel
mesh_cell_1 = MeshCell1()  # Lattice Unit cell to map to mesh faces
mesh_face_6 = MeshFace()  # Mesh faces (exploded as single meshes)
mesh_cell_2 = MeshCell2()  # Lattice Unit cell to map to mesh faces
geo_35 = Geometry(mesh_cell_1)
mesh_64 = Mesh(mesh_face_6)
geo_36 = Geometry(mesh_cell_2)
num_87 = Number(value_11)
toggle_23 = BooleanToggle(True)
crv_46 = Curve(geo_35)
crv_47 = Curve(geo_36)
mesh_65 = Mesh(geo_35)
clean_5 = CleanTree(RemoveNulls=toggle_23, RemoveInvalid=toggle_23, RemoveEmpty=toggle_23, Tree=crv_46)
clean_6 = CleanTree(RemoveNulls=toggle_23, RemoveInvalid=toggle_23, RemoveEmpty=toggle_23, Tree=crv_47)
clean_7 = CleanTree(RemoveNulls=toggle_23, RemoveInvalid=toggle_23, RemoveEmpty=toggle_23, Tree=mesh_65)
tweencrv_2 = TweenCurve(CurveA=flatten(clean_5), CurveB=flatten(clean_6), Factor=graft(num_87), BlendType=0)
cp_17 = ControlPoints(Curve=tweencrv_2)  # -> Points, Weights, Knots
meshcp_19 = MeshClosestPoint(Point=cp_17.Points, Mesh=clean_7)  # -> Point, Index, Parameter
trim_13 = TrimTree(Tree=meshcp_19.Parameter, Depth=1)
crossref_7 = CrossReference(ListA=trim_13, ListB=mesh_64, CrossMode=1)  # -> ListA, ListB
meval_16 = MeshEval(Mesh=crossref_7.ListB, Parameter=simplify(crossref_7.ListA))  # -> Point, Normal, Colour
dispatch = Dispatch(List=meval_16.Point, DispatchPattern=[True, False])  # -> ListA, ListB
ln_10 = Line(StartPoint=dispatch.ListA, EndPoint=dispatch.ListB)
join_4 = JoinCurves(Curves=ln_10, Preserve=False)
lattice_hinge_2 = LatticeHinge(join_4)  # Joined curves that makes up the lattice hinge

# ----
# TWEEN LATTICE HINGE CELL FILL
unit_cell_c_1 = UnitCellC1()  # Unit cell to populate Lattice Hinge panels
unit_cell_c_2 = UnitCellC2()  # Unit cell to populate Lattice Hinge panels
value_12 = Value()  # Value from 0-1 corresponding to each panel
panels = Panels()  # Panels to be filled with unit cells
num_88 = Number(value_12)
srf_7 = Surface(panels)
crv_48 = Curve(unit_cell_c_2)
crv_49 = Curve(unit_cell_c_1)
tweencrv_3 = TweenCurve(CurveA=graft(crv_49), CurveB=graft(crv_48), Factor=flatten(num_88), BlendType=0)
flip_77 = FlipMatrix(Data=tweencrv_3)
bbox_11 = BoundingBox(Content=flip_77, Plane=PlaneXY(0, 0, 0), UnionBox=True)  # -> Box, Box_2
map_srf = MapToSurface(Curve=flip_77, Source=bbox_11.Box, Target=graft(srf_7))
remove_duplicate_lines_6 = RemoveDuplicateLines(lattice_l=flatten(map_srf))
join_5 = JoinCurves(Curves=remove_duplicate_lines_6, Preserve=False)
lattice_hinge_3 = LatticeHinge(join_5)  # List of curves that make up the lattice hinge

# ----
# LATTICE HINGE CELL FILL
unit_cell_c = UnitCellC()  # Unit cell to populate Lattice Hinge panels
panels_2 = Panels()  # Panels to be filled with unit cells
crv_50 = Curve(unit_cell_c)
srf_8 = Surface(panels_2)
bbox_12 = BoundingBox(Content=crv_50, Plane=PlaneXY(0, 0, 0), UnionBox=True)  # -> Box, Box_2
map_srf_2 = MapToSurface(Curve=crv_50, Source=bbox_12.Box, Target=graft(srf_8))  # -> flatten(Curve)
remove_duplicate_lines_7 = RemoveDuplicateLines(lattice_l=flatten(map_srf_2))
join_6 = JoinCurves(Curves=remove_duplicate_lines_7, Preserve=False)
lattice_hinge_4 = LatticeHinge(join_6)  # List of curves that make up the lattice hinge

lht = LatticeHingeTweenCellFill()
lhc = LatticeHingeCellFill()
lh = LatticeHinge()  # -> voxels_rolled, voxels_unrolled, panels_rolled, panels_unrolled, panel_values, unrolled_surface
lhc_s = LatticeHingeShellFill()
lht_s = LatticeHingeTweenShellFill()
mts = MeshTweenShellFill()
mtc = MeshTweenCellFill()
mcf = MeshCellFill()
mht = MeshHingeCellTri()
msf = MeshShellFIll()
mhq = CrystallonV2MeshHingeCellQuad()
mf = MeshFlatten()  # -> iterations, flattened_mesh, mesh_faces, ratio_cp, cp_lines, ratio_ci, ci_lines, ratio_cf, cf_lines, ratio_average

# ----
# *BEAM SECTION,MATERIAL=EL,ELSET=Eall,OFFSET1=-0.5,SECTION=RECT
filename = Filename()  # Name of file (also NSET, ELSET, etc)
lattice_curves = LatticeCurves()  # Lattice curves to create B32 elements
cross_section = CrossSection()  # True if CIRC, false if RECT
tolerance_10 = Tolerance()  # Tolerance for combining nodes
height_2 = Height()  # Height of cross section
width_2 = Width()  # Width of cross section
txt = Text(filename)
line_11 = Line(lattice_curves)
bool_13 = Boolean(cross_section)
num_89 = Number(width_2)
num_90 = Number(height_2)
num_91 = Number(tolerance_10)
lt = LatticeTopology(lattice_beams=line_11, tolerance=num_91)  # -> nodes, line_point_connections, point_line_connections
item_175 = ListItem(List=lt.nodes, Index=lt.line_point_connections, Wrap=True)
avr_5 = Average(Input=item_175)
entwine_30 = Entwine(Branch00=lt.nodes, Branch01=avr_5, FlattenInputs=True)  # -> flatten(Result)
item_176 = ListItem(List=item_175, Index=0, Wrap=True)
pline_8 = PolyLine(Vertices=item_175, Closed=False)  # -> flatten(Polyline)
end = EndPoints(Curve=pline_8)  # -> Start, End
lng_14 = ListLength(List=flatten(item_176))
lng_15 = ListLength(List=entwine_30)
lng_16 = ListLength(List=lt.nodes)
lng_17 = ListLength(List=flatten(avr_5))
pl = PlaneNormal(Origin=end.End, ZAxis=pline_8)
Z = UnitZ(Factor=1)
series_9 = Series(Start=0, Step=1, Count=lng_15)
devec_5 = DeconstructVector(Vector=entwine_30)  # -> XComponent, YComponent, ZComponent
series_10 = Series(Start=0, Step=1, Count=lng_14)  # -> graft(Series)
item_177 = ListItem(List=lt.line_point_connections, Index=0, Wrap=True)  # -> Item, Item1
series_11 = Series(Start=lng_16, Step=1, Count=lng_17)
align = AlignPlane(Plane=pl, Direction=Z)  # -> Plane, Angle
addition_28 = Addition(A=series_9, B=1)
devec_6 = DeconstructVector(Vector=align.Plane)  # -> XComponent, YComponent, ZComponent
addition_29 = Addition(A=series_10, B=1)
addition_30 = Addition(A=series_11, B=1)  # -> graft(Result)
addition_31 = Addition(A=item_177.Item, B=1)
addition_32 = Addition(A=item_177.Item1, B=1)
p_n_c = PickNChoose(Pattern=bool_13, Stream0="RECT", Stream1="CIRC")
panel_83 = Panel("B32")
format = Expression(x=txt, y=p_n_c, Expression="Format(\"*BEAM SECTION,MATERIAL=M{0},ELSET=E{0},SECTION={1}\", x, y)")
format_2 = Expression(
    x=addition_29,
    y=addition_31,
    z=graft(devec_6.XComponent),
    u=graft(devec_6.YComponent),
    v=graft(devec_6.ZComponent),
    Expression="Format(\" {0}, {1}, {2}, {3}, {4}\", x, y, Round (z, 3), Round (u, 3), Round (v, 3))")
format_3 = Expression(
    x=addition_28,
    y=devec_5.XComponent,
    z=devec_5.YComponent,
    u=devec_5.ZComponent,
    Expression="Format(\" {0}, {1}, {2}, {3}\", x, Round (y, 3), Round (z, 3), Round (u, 3))")
format_4 = Expression(x=num_89, y=num_90, Expression="Format(\"{0},{1}\", x, y)")
panel_84 = Panel("*ELEMENT,TYPE=B32,ELSET=EAll")
format_5 = Expression(x=txt, Expression="Format(\"*ELEMENT,TYPE=B32,ELSET=E{0}\", x)")
format_6 = Expression(x=addition_29, y=addition_31, z=addition_30, u=addition_32, Expression="Format(\"{0}, {1}, {2}, {3}\", x, y, z, u)")
format_7 = Expression(x=txt, Expression="Format(\"*NODE,NSET=N{0}\", x)")
panel_85 = Panel("""** NORMAL = Element,Node,X,Y,Z
*NORMAL""")
format_8 = Expression(x=txt, Expression="Format(\"**FILENAME = {0}\", x)")
entwine_31 = Entwine(
    Branch00="**INP GENERATOR - CRYSTALLON ",
    Branch01=format_8,
    Branch02=format_7,
    Branch03=format_3,
    Branch04=format_5,
    Branch05=format_6,
    Branch06=panel_85,
    Branch07=format_2,
    Branch08=format,
    Branch010=format_4,
    FlattenInputs=True)  # -> flatten(Result)
inp_output = INPOutput(entwine_31)  # output text

mesh_triangulated = MeshTriangulated()  # Triangulated mesh to create C3D6 elements
thickness_2 = Thickness()  # Thickness (offset) of elements
filename_2 = Filename()  # Name of file (also NSET, ELSET, etc)
mesh_66 = Mesh(mesh_triangulated)
num_92 = Number(thickness_2)
demesh_54 = DeconstructMesh(Mesh=mesh_66)  # -> Vertices, Faces, Colours, Normals
txt_2 = Text(filename_2)
amp_15 = Amplitude(Vector=demesh_54.Normals, Amplitude=num_92)
move_17 = Move(Geometry=demesh_54.Vertices, Motion=amp_15)  # -> Geometry, Transform
conmesh_72 = ConstructMesh(Vertices=move_17.Geometry, Faces=demesh_54.Faces)
demesh_55 = DeconstructMesh(Mesh=conmesh_72)  # -> Vertices, Faces, Colours, Normals
deface_24 = DeconstructFace(Face=demesh_54.Faces)  # -> CornerA, CornerB, CornerC, CornerD
lng_18 = ListLength(List=demesh_55.Vertices)
merge_19 = Merge(Data1=demesh_54.Vertices, Data2=demesh_55.Vertices)  # -> flatten(Result)
lng_19 = ListLength(List=merge_19)
devec_7 = DeconstructVector(Vector=merge_19)  # -> XComponent, YComponent, ZComponent
lng_20 = ListLength(List=flatten(deface_24.CornerA))
series_12 = Series(Start=0, Step=1, Count=lng_19)
series_13 = Series(Start=0, Step=1, Count=lng_20)
addition_33 = Addition(A=deface_24.CornerA, B=lng_18)
addition_34 = Addition(A=deface_24.CornerC, B=lng_18)
addition_35 = Addition(A=deface_24.CornerB, B=lng_18)
addition_36 = Addition(A=series_12, B=1)
addition_37 = Addition(A=series_13, B=1)  # -> graft(Result)
addition_38 = Addition(A=deface_24.CornerA, B=1)  # -> graft(Result)
addition_39 = Addition(A=deface_24.CornerB, B=1)  # -> graft(Result)
addition_40 = Addition(A=deface_24.CornerC, B=1)  # -> graft(Result)
addition_41 = Addition(A=addition_33, B=1)  # -> graft(Result)
addition_42 = Addition(A=addition_35, B=1)  # -> graft(Result)
addition_43 = Addition(A=addition_34, B=1)  # -> graft(Result)
panel_86 = Panel("C3D6")
format_9 = Expression(
    x=addition_36,
    y=devec_7.XComponent,
    z=devec_7.YComponent,
    u=devec_7.ZComponent,
    Expression="Format(\" {0}, {1}, {2}, {3}\", x, Round (y, 3), Round (z, 3), Round (u, 3))")
format_10 = Expression(
    x=addition_37,
    y=addition_38,
    z=addition_39,
    u=addition_40,
    v=addition_41,
    w=addition_42,
    a=addition_43,
    Expression="Format(\"{0}, {1}, {2}, {3}, {4}, {5}, {6}\", x, y, z, u, v, w, a)")
format_11 = Expression(x=txt_2, Expression="Format(\"*ELEMENT,TYPE=C3D6,ELSET=E{0}\", x)")
format_12 = Expression(x=txt_2, Expression="Format(\"*NODE,NSET=N{0}\", x)")
format_13 = Expression(x=txt_2, Expression="Format(\"**FILENAME = {0}\", x)")
entwine_32 = Entwine(
    Branch00="**INP GENERATOR - CRYSTALLON ",
    Branch01=format_13,
    Branch02=format_12,
    Branch03=format_9,
    Branch04=format_11,
    Branch05=format_10,
    FlattenInputs=True)  # -> flatten(Result)
inp_output_2 = INPOutput(entwine_32)  # output text

mesh_quads = MeshQuads()  # Quad mesh to create C3D8 elements
thickness_3 = Thickness()  # Thickness (offset) of elements
filename_3 = Filename()  # Name of file (also NSET, ELSET, etc)
mesh_67 = Mesh(mesh_quads)
num_93 = Number(thickness_3)
demesh_56 = DeconstructMesh(Mesh=mesh_67)  # -> Vertices, Faces, Colours, Normals
txt_3 = Text(filename_3)
amp_16 = Amplitude(Vector=demesh_56.Normals, Amplitude=num_93)
move_18 = Move(Geometry=demesh_56.Vertices, Motion=amp_16)  # -> Geometry, Transform
conmesh_73 = ConstructMesh(Vertices=move_18.Geometry, Faces=demesh_56.Faces)
demesh_57 = DeconstructMesh(Mesh=conmesh_73)  # -> Vertices, Faces, Colours, Normals
merge_20 = Merge(Data1=demesh_56.Vertices, Data2=demesh_57.Vertices)  # -> flatten(Result)
deface_25 = DeconstructFace(Face=demesh_56.Faces)  # -> CornerA, CornerB, CornerC, CornerD
lng_21 = ListLength(List=demesh_57.Vertices)
lng_22 = ListLength(List=merge_20)
devec_8 = DeconstructVector(Vector=merge_20)  # -> XComponent, YComponent, ZComponent
lng_23 = ListLength(List=flatten(deface_25.CornerA))
series_14 = Series(Start=0, Step=1, Count=lng_22)
series_15 = Series(Start=0, Step=1, Count=lng_23)
addition_44 = Addition(A=deface_25.CornerA, B=lng_21)
addition_45 = Addition(A=deface_25.CornerC, B=lng_21)
addition_46 = Addition(A=deface_25.CornerD, B=lng_21)
addition_47 = Addition(A=deface_25.CornerB, B=lng_21)
addition_48 = Addition(A=series_14, B=1)
addition_49 = Addition(A=addition_44, B=1)  # -> graft(Result)
addition_50 = Addition(A=series_15, B=1)  # -> graft(Result)
addition_51 = Addition(A=deface_25.CornerA, B=1)  # -> graft(Result)
addition_52 = Addition(A=deface_25.CornerB, B=1)  # -> graft(Result)
addition_53 = Addition(A=deface_25.CornerC, B=1)  # -> graft(Result)
addition_54 = Addition(A=deface_25.CornerD, B=1)  # -> graft(Result)
addition_55 = Addition(A=addition_47, B=1)  # -> graft(Result)
addition_56 = Addition(A=addition_45, B=1)  # -> graft(Result)
addition_57 = Addition(A=addition_46, B=1)  # -> graft(Result)
format_14 = Expression(
    x=addition_48,
    y=devec_8.XComponent,
    z=devec_8.YComponent,
    u=devec_8.ZComponent,
    Expression="Format(\" {0}, {1}, {2}, {3}\", x, Round (y, 3), Round (z, 3), Round (u, 3))")
panel_87 = Panel("C3D8")
format_15 = Expression(
    x=addition_50,
    y=addition_51,
    z=addition_52,
    u=addition_53,
    v=addition_54,
    w=addition_49,
    a=addition_55,
    b=addition_56,
    c=addition_57,
    Expression="Format(\"{0}, {1}, {2}, {3}, {4}, {5}, {6}, {7}, {8}\", x, y, z, u, v, w, a, b, c)")
format_16 = Expression(x=txt_3, Expression="Format(\"*ELEMENT,TYPE=C3D8,ELSET=E{0}\", x)")
format_17 = Expression(x=txt_3, Expression="Format(\"*NODE,NSET=N{0}\", x)")
format_18 = Expression(x=txt_3, Expression="Format(\"**FILENAME = {0}\", x)")
entwine_33 = Entwine(
    Branch00="**INP GENERATOR - CRYSTALLON ",
    Branch01=format_18,
    Branch02=format_17,
    Branch03=format_14,
    Branch04=format_16,
    Branch05=format_15,
    FlattenInputs=True)  # -> flatten(Result)
inp_output_3 = INPOutput(entwine_33)  # output text

lattice_shell_quads = LatticeShellQuads()  # Lattice shell to create S4 elements
thickness_4 = Thickness()  # Thickness of cross section
filename_4 = Filename()  # Name of file (also NSET, ELSET, etc)
panel_88 = Panel("shelltest")
mesh_68 = Mesh(lattice_shell_quads)
num_94 = Number(thickness_4)
demesh_58 = DeconstructMesh(Mesh=mesh_68)  # -> Vertices, Faces, Colours, Normals
txt_4 = Text(filename_4)
deface_26 = DeconstructFace(Face=demesh_58.Faces)  # -> CornerA, CornerB, CornerC, CornerD
devec_9 = DeconstructVector(Vector=demesh_58.Vertices)  # -> XComponent, YComponent, ZComponent
lng_24 = ListLength(List=demesh_58.Vertices)
series_16 = Series(Start=0, Step=1, Count=lng_24)
lng_25 = ListLength(List=flatten(deface_26.CornerA))
addition_58 = Addition(A=series_16, B=1)
series_17 = Series(Start=0, Step=1, Count=lng_25)
addition_59 = Addition(A=series_17, B=1)  # -> graft(Result)
addition_60 = Addition(A=deface_26.CornerA, B=1)  # -> graft(Result)
addition_61 = Addition(A=deface_26.CornerB, B=1)  # -> graft(Result)
addition_62 = Addition(A=deface_26.CornerC, B=1)  # -> graft(Result)
addition_63 = Addition(A=deface_26.CornerD, B=1)  # -> graft(Result)
panel_89 = Panel("S4")
format_19 = Expression(
    x=addition_58,
    y=devec_9.XComponent,
    z=devec_9.YComponent,
    u=devec_9.ZComponent,
    Expression="Format(\" {0}, {1}, {2}, {3}\", x, Round (y, 3), Round (z, 3), Round (u, 3))")
format_20 = Expression(x=txt_4, Expression="Format(\"*SHELL SECTION,MATERIAL=M{0},ELSET=E{0}\", x)")
format_21 = Expression(
    x=addition_59,
    y=addition_60,
    z=addition_61,
    u=addition_62,
    v=addition_63,
    Expression="Format(\"{0}, {1}, {2}, {3}, {4}\", x, y, z, u, v)")
format_22 = Expression(x=txt_4, Expression="Format(\"*ELEMENT,TYPE=S4,ELSET=E{0}\", x)")
format_23 = Expression(x=txt_4, Expression="Format(\"*NODE,NSET=N{0}\", x)")
format_24 = Expression(x=txt_4, Expression="Format(\"**FILENAME = {0}\", x)")
entwine_34 = Entwine(
    Branch00="**INP GENERATOR - CRYSTALLON ",
    Branch01=format_24,
    Branch02=format_23,
    Branch03=format_19,
    Branch04=format_22,
    Branch05=format_21,
    Branch06=format_20,
    Branch07=num_94,
    FlattenInputs=True)  # -> flatten(Result)
inp_output_4 = INPOutput(entwine_34)  # output text

tolerance_11 = Tolerance()  # Tolerance to merge points
lattice_beams = LatticeBeams()  # Lattice Curves
radius_2 = Radius()  # A list of radii that corresponds with the lattice beams
crv_51 = Curve(lattice_beams)
id = ID()  # graph ID (number)
type = Type()  # Cross Section (rnd)
name = Name()  # File Name
units = Units()  # Units (in/mm)
num_95 = Number(tolerance_11)
num_96 = Number(radius_2)
cp_18 = ControlPoints(Curve=crv_51)  # -> Points, Weights, Knots
num_97 = Number(num_95)
cullpt_20 = CullDuplicates(Points=flatten(cp_18.Points), Tolerance=num_97, CullMode=3)  # -> Points, Indices, Valence
cp_19 = ClosestPoint(Point=cullpt_20.Points, Cloud=cp_18.Points)  # -> ClosestPoint, CPIndex, Distance
flip_78 = FlipMatrix(Data=cp_19.Distance)
smaller_9 = SmallerThan(FirstNumber=flip_78, SecondNumber=num_95)  # -> SmallerThan, OrEqualTo
cull_57 = CullPattern(List=flatten(num_96), CullPattern=smaller_9.OrEqualTo)
fsim_9 = FindSimilarMember(Data=cp_18.Points, Set=cullpt_20.Points)  # -> Hit, Index
lng_26 = ListLength(List=cullpt_20.Points)
avr_6 = Average(Input=cull_57)  # -> flatten(ArithmeticMean)
devec_10 = DeconstructVector(Vector=cullpt_20.Points)  # -> XComponent, YComponent, ZComponent
series_18 = Series(Start=0, Step=1, Count=lng_26)
format_25 = Expression(
    x=series_18,
    y=devec_10.XComponent,
    z=devec_10.YComponent,
    u=devec_10.ZComponent,
    v=avr_6,
    Expression="Format(\"                <node id='{0}' x='{1}' y='{2}' z='{3}' r='{4}'/>\", x, Round (y, 3), Round (z, 3), Round (u, 3), Round (v, 3))")
lng_27 = ListLength(List=flatten(crv_51))
item_178 = ListItem(List=fsim_9.Index, Index="0", Wrap=True)  # -> Item, Item1
series_19 = Series(Start=0, Step=1, Count=lng_27)  # -> graft(Series)
format_26 = Expression(
    x=series_19,
    y=item_178.Item,
    z=item_178.Item1,
    Expression="Format(\"                <beam id='{0}' n1='{1}' n2='{2}'/>\", x, y, z)")
format_27 = Expression(x=id, y=name, z=units, u=type, Expression="Format(\"<graph id='{0}' name='{1}' units='{2}' type='{3}'>\", x, y, z, u)")
panel_90 = Panel("""<?xml version="1.0" encoding="UTF-8"?>
<!--Generator: Grasshopper , LTCX export module , Aaron Porterfield. -->""")
rep = ReplaceText(Text=format_27, Find="'", Replace="\"", RecursiveReplace=False)
rep_2 = ReplaceText(Text=format_26, Find="'", Replace="\"", RecursiveReplace=False)
rep_3 = ReplaceText(Text=format_25, Find="'", Replace="\"", RecursiveReplace=False)
entwine_35 = Entwine(
    Branch00=panel_90,
    Branch01=rep,
    Branch02="\t<nodegroup>",
    Branch03=rep_3,
    Branch04="\t</nodegroup>",
    Branch05="\t<beamgroup>",
    Branch06=rep_2,
    Branch07="\t</beamgroup>",
    Branch08="</graph>",
    FlattenInputs=True)  # -> flatten(Result)
ltcx_output = LTCXOutput(entwine_35)  # output text

lattice_shell_triangles = LatticeShellTriangles()  # Lattice shell to create S3 elements
thickness_5 = Thickness()  # Thickness of cross section
filename_5 = Filename()  # Name of file (also NSET, ELSET, etc)
mesh_69 = Mesh(lattice_shell_triangles)
num_98 = Number(thickness_5)
demesh_59 = DeconstructMesh(Mesh=mesh_69)  # -> Vertices, Faces, Colours, Normals
txt_5 = Text(filename_5)
deface_27 = DeconstructFace(Face=demesh_59.Faces)  # -> CornerA, CornerB, CornerC, CornerD
devec_11 = DeconstructVector(Vector=demesh_59.Vertices)  # -> XComponent, YComponent, ZComponent
lng_28 = ListLength(List=demesh_59.Vertices)
series_20 = Series(Start=0, Step=1, Count=lng_28)
lng_29 = ListLength(List=flatten(deface_27.CornerA))
addition_64 = Addition(A=series_20, B=1)
series_21 = Series(Start=0, Step=1, Count=lng_29)
addition_65 = Addition(A=series_21, B=1)  # -> graft(Result)
addition_66 = Addition(A=deface_27.CornerA, B=1)  # -> graft(Result)
addition_67 = Addition(A=deface_27.CornerB, B=1)  # -> graft(Result)
addition_68 = Addition(A=deface_27.CornerC, B=1)  # -> graft(Result)
panel_91 = Panel("S3")
format_28 = Expression(
    x=addition_64,
    y=devec_11.XComponent,
    z=devec_11.YComponent,
    u=devec_11.ZComponent,
    Expression="Format(\" {0}, {1}, {2}, {3}\", x, Round (y, 3), Round (z, 3), Round (u, 3))")
format_29 = Expression(x=txt_5, Expression="Format(\"*SHELL SECTION,MATERIAL=M{0},ELSET=E{0}\", x)")
format_30 = Expression(x=txt_5, Expression="Format(\"*ELEMENT,TYPE=S3,ELSET=E{0}\", x)")
format_31 = Expression(x=addition_65, y=addition_66, z=addition_67, u=addition_68, Expression="Format(\"{0}, {1}, {2}, {3}\", x, y, z, u)")
format_32 = Expression(x=txt_5, Expression="Format(\"*NODE,NSET=N{0}\", x)")
format_33 = Expression(x=txt_5, Expression="Format(\"**FILENAME = {0}\", x)")
entwine_36 = Entwine(
    Branch00="**INP GENERATOR - CRYSTALLON ",
    Branch01=format_33,
    Branch02=format_32,
    Branch03=format_28,
    Branch04=format_30,
    Branch05=format_31,
    Branch06=format_29,
    Branch07=num_98,
    FlattenInputs=True)  # -> flatten(Result)
inp_output_5 = INPOutput(entwine_36)  # output text

# ----
# C3D4
# 
# REQUIRES TETRINO OR OTHER TETRAHEDRAL MESHER
# 
# https://www.food4rhino.com/app/tetrino
indices = Indices()  # Indices of tetrahedrons ("I" output of Tetgen)
filename_6 = Filename()  # Name of file (also NSET, ELSET, etc)
points_8 = Points()  # Points of tetrahedral mesh ("P" output of Tetgen)
pt_15 = Point(points_8)
int = Integer(indices)
txt_6 = Text(filename_6)
item_179 = ListItem(List=int, Index=0, Wrap=True)  # -> flatten(Item), Item1, Item2, Item3
lng_30 = ListLength(List=pt_15)
devec_12 = DeconstructVector(Vector=pt_15)  # -> XComponent, YComponent, ZComponent
series_22 = Series(Start=0, Step=1, Count=lng_30)
lng_31 = ListLength(List=flatten(item_179.Item))
series_23 = Series(Start=0, Step=1, Count=lng_31)
addition_69 = Addition(A=series_22, B=1)
addition_70 = Addition(A=series_23, B=1)  # -> graft(Result)
addition_71 = Addition(A=item_179.Item, B=1)  # -> graft(Result)
addition_72 = Addition(A=item_179.Item1, B=1)  # -> graft(Result)
addition_73 = Addition(A=item_179.Item2, B=1)  # -> graft(Result)
addition_74 = Addition(A=item_179.Item3, B=1)  # -> graft(Result)
format_34 = Expression(
    x=addition_69,
    y=devec_12.XComponent,
    z=devec_12.YComponent,
    u=devec_12.ZComponent,
    Expression="Format(\" {0}, {1}, {2}, {3}\", x, Round (y, 3), Round (z, 3), Round (u, 3))")
format_35 = Expression(
    x=addition_70,
    y=addition_71,
    z=addition_72,
    u=addition_73,
    v=addition_74,
    Expression="Format(\"{0}, {1}, {2}, {3}, {4}\", x, y, z, u, v)")
format_36 = Expression(x=txt_6, Expression="Format(\"*ELEMENT,TYPE=C3D4,ELSET=E{0}\", x)")
format_37 = Expression(x=txt_6, Expression="Format(\"*NODE,NSET=N{0}\", x)")
format_38 = Expression(x=txt_6, Expression="Format(\"**FILENAME = {0}\", x)")
entwine_37 = Entwine(
    Branch00="**INP GENERATOR - CRYSTALLON ",
    Branch01=format_38,
    Branch02=format_37,
    Branch03=format_34,
    Branch04=format_36,
    Branch05=format_35,
    FlattenInputs=True)  # -> flatten(Result)
inp_output_6 = INPOutput(entwine_37)  # output text

tolerance_12 = Tolerance()  # Tolerance to merge points
lattice_beams_2 = LatticeBeams()  # Lattice Curves
num_99 = Number(tolerance_12)
crv_52 = Curve(lattice_beams_2)
cp_20 = ControlPoints(Curve=crv_52)  # -> simplify(Points), Weights, Knots
cullpt_21 = CullDuplicates(Points=flatten(cp_20.Points), Tolerance=num_99, CullMode=3)  # -> Points, Indices, Valence
sort_pt = SortPoints(Points=cullpt_21.Points)  # -> Points, Indices
lng_32 = ListLength(List=crv_52)
lng_33 = ListLength(List=sort_pt.Points)
fsim_10 = FindSimilarMember(Data=cp_20.Points, Set=sort_pt.Points)  # -> Hit, simplify(Index)
series_24 = Series(Start=0, Step=1, Count=lng_32)  # -> simplify(Series)
series_25 = Series(Start=0, Step=1, Count=lng_33)  # -> simplify(Series)
panel_92 = Panel("LATTICE TOPOLOGY")
num_100 = Number(fsim_10.Index)
pt_16 = Point(sort_pt.Points)
equals = Equality(FirstNumber=series_25, SecondNumber=graft(num_100))  # -> Equality, Inequality
flip_79 = FlipMatrix(Data=equals.Equality)
partition_6 = PartitionList(List=flip_79, Size="2")  # -> simplify(Chunks)
item_180 = ListItem(List=partition_6, Index=0, Wrap=True)  # -> Item, Item1
or = GateOr(A=item_180.Item, B=item_180.Item1)
trim_14 = TrimTree(Tree=or, Depth=1)
cull_58 = CullPattern(List=series_24, CullPattern=trim_14)  # -> simplify(List)
nodes = Nodes(pt_16)  # Unique points in the network
line_point_connections = LinePointConnections(num_100)  # Index of points that make up each beam
point_line_connections = PointLineConnections(cull_58)  # For each point, lists the index of each line connected to it

ltcx_file = LTCXFile()  # File path of .ltcx file
enable_beams = EnableBeams()  # Enable beam curves (boolean)
bool_14 = Boolean(enable_beams)
file = ReadFile(F=ltcx_file, PerLineParse=True)  # -> C; same code as file
fsim_11 = FindSimilarMember(Data="</beamgroup>", Set=file)  # -> Hit, Index
panel_93 = Panel(file)
fsim_12 = FindSimilarMember(Data="<beamgroup>", Set=file)  # -> Hit, Index
fsim_13 = FindSimilarMember(Data="<nodegroup>", Set=file)  # -> Hit, Index
fsim_14 = FindSimilarMember(Data="</nodegroup>", Set=file)  # -> Hit, Index
subtraction_7 = Subtraction(A=fsim_11.Index, B=fsim_12.Index)
subtraction_8 = Subtraction(A=fsim_14.Index, B=fsim_13.Index)
series_26 = Series(Start=expr("x+1", fsim_12.Index), Step=1, Count=expr("x-1", subtraction_7))
series_27 = Series(Start=expr("x+1", fsim_13.Index), Step=1, Count=expr("x-1", subtraction_8))
item_181 = ListItem(List=file, Index=series_26, Wrap=True)
item_182 = ListItem(List=file, Index=series_27, Wrap=True)
split = TextSplit(Text=item_181, Separators="\"\"")
split_2 = TextSplit(Text=item_182, Separators="\"\"")
panel_94 = Panel("LTCX Parser")
dispatch_2 = Dispatch(List=split, DispatchPattern=[True, False])  # -> ListA, ListB
dispatch_3 = Dispatch(List=split_2, DispatchPattern=[True, False])  # -> ListA, ListB
item_183 = ListItem(List=dispatch_2.ListB, Index="0", Wrap=True)
item_184 = ListItem(List=dispatch_2.ListB, Index="1", Wrap=True)
item_185 = ListItem(List=dispatch_3.ListB, Index="0", Wrap=True)
item_186 = ListItem(List=dispatch_3.ListB, Index="1", Wrap=True)
item_187 = ListItem(List=dispatch_2.ListB, Index="2", Wrap=True)
item_188 = ListItem(List=dispatch_3.ListB, Index="2", Wrap=True)
item_189 = ListItem(List=dispatch_3.ListB, Index="3", Wrap=True)
item_190 = ListItem(List=dispatch_3.ListB, Index="4", Wrap=True)
pt_17 = ConstructPoint(XCoordinate=item_186, YCoordinate=item_188, ZCoordinate=item_189)  # -> flatten(Point)
end_2 = Panel(item_187)
start = Panel(item_184)
beam_id = Panel(item_183)
radius_3 = Panel(item_190)
node_id = Panel(item_185)
num_101 = Number(flatten(item_190))
pt_18 = Point(pt_17)
merge_21 = Merge(Data1=item_184, Data2=item_187)  # -> simplify(Result)
item_191 = ListItem(List=item_190, Index=item_187, Wrap=True)
item_192 = ListItem(List=item_190, Index=item_184, Wrap=True)
item_193 = ListItem(List=pt_17, Index=item_184, Wrap=True)
item_194 = ListItem(List=pt_17, Index=item_187, Wrap=True)
num_102 = Number(item_192)
cull_59 = CullPattern(List=item_194, CullPattern=bool_14)
num_103 = Number(item_191)
node_radius = NodeRadius(num_101)  # Radius at node (number)
node = Node(pt_18)  # Nodes (point)
ln_11 = Line(StartPoint=item_193, EndPoint=cull_59)
line_point_connections_2 = LinePointConnections(merge_21)  # Index of points that make up each beam
avr_7 = Average(Input=[num_102, num_103])
line_12 = Line(ln_11)
beam_radius = BeamRadius(avr_7)  # Beam radius (average of two nodes)
beam_curves = BeamCurves(line_12)  # Connections between nodes (line)

panel_95 = Panel("UTILITIES")
lt_2 = LatticeTopology_2()  # -> nodes, line_point_connections, point_line_connections
lxi = LTCXParser()  # -> node, node_radius, line_point_connections, beam_curves, beam_radius
b32 = INPB32()
s4 = INPS4()
s3 = INPS3()
lxo = LTCXWriter()
c3d4 = INPC3D4()
c3d6 = INPC3D6()
c3d8 = INPC3D8()

# ----
# Mesh Flatten
# 
# Requires Kangaroo2
# https://www.food4rhino.com/app/kangaroo-physics
# Thanks to Daniel Piker
# 
# https://www.grasshopper3d.com/group/kangaroo/forum/topics/relaxation-to-flat-geometry
mesh_70 = Mesh()  # Mesh to flatten
plane_3 = Plane()  # Plane to flatten mesh to
threshold = Threshold()  # Threshold for Kangaroo Solver (~1e-7)
max_iterations = MaxIterations()  # Max iterations for Kangaroo Solver
num_104 = Number(threshold)
mesh_71 = Mesh(mesh_70)
num_105 = Number(max_iterations)
pln_7 = Plane(plane_3)
bool_15 = Boolean()
bool_16 = Boolean()
tri = Triangulate(Mesh=mesh_71)  # -> Mesh, Count
demesh_60 = DeconstructMesh(Mesh=mesh_71)  # -> Vertices, Faces, Colours, Normals
hingepoints = HingePoints(Mesh=tri.Mesh)  # -> _1, _2, _3, _4
avr_8 = Average(Input=demesh_60.Vertices)
foldangle = FoldAngle(P1=hingepoints._1, P2=hingepoints._2, P3=hingepoints._3, P4=hingepoints._4)
padjust = AdjustPlane(Plane=avr_8, Normal=pln_7)
edgelengths = EdgeLengths(Mesh=tri.Mesh, LengthFactor=1, Strength=1)
smooth = Smooth(M=tri.Mesh, Strength=1)
multiplication_13 = Multiplication(A=foldangle, B="0")
onplane = OnPlane(Points=demesh_60.Vertices, Plane=padjust, Strength="10")
show = Show(G=mesh_71)
hinge = Hinge(
    FoldStart=hingepoints._1,
    FoldEnd=hingepoints._2,
    Tip1=hingepoints._3,
    Tip2=hingepoints._4,
    RestAngle=multiplication_13,
    Strength="3")
entwine_38 = Entwine(Branch00=show, Branch01=[onplane, edgelengths, smooth, hinge], FlattenInputs=True)
zombiesolver = ZombieSolver(GoalObjects=entwine_38, Threshold=num_104, Tolerance=0.01, MaxIterations=num_105)  # -> I, V, O
solver = Solver(GoalObjects=entwine_38, Reset=bool_15, Threshold=num_104, Tolerance=0.01, On=bool_16)  # -> I, V, O; disabled
mesh_72 = Mesh(zombiesolver.O)
clean_8 = CleanTree(RemoveNulls=True, RemoveInvalid=True, RemoveEmpty=Toggle(True), Tree=mesh_72)
mesh_73 = Mesh(mesh_71)
mesh_74 = Mesh(clean_8)
mesh_75 = Mesh(mesh_73)
mesh_76 = Mesh(mesh_74)
mesh_77 = Mesh(mesh_74)
facen_9 = FaceNormals(Mesh=mesh_75)  # -> Centers, Normals
demesh_61 = DeconstructMesh(Mesh=mesh_76)  # -> Vertices, Faces, Colours, Normals
facen_10 = FaceNormals(Mesh=mesh_77)  # -> Centers, Normals
conmesh_74 = ConstructMesh(Vertices=demesh_61.Vertices, Faces=graft(demesh_61.Faces))  # -> simplify(Mesh)
mesh_78 = Mesh(mesh_74)
mesh_79 = Mesh(conmesh_74)
num_106 = Number(zombiesolver.I)
flattened_mesh = FlattenedMesh(mesh_78)  # Flattened Mesh
mesh_faces = MeshFaces(mesh_79)  # Faces of the flattened mesh
iterations = Iterations(num_106)  # Iterations of kangaroo solver

faceb_2 = FaceBoundaries(Mesh=mesh_73)
faceb_3 = FaceBoundaries(Mesh=mesh_74)
explode_7 = Explode(Curve=faceb_3, Recursive=True)  # -> Segments, Vertices
explode_8 = Explode(Curve=faceb_2, Recursive=True)  # -> Segments, Vertices
len_7 = Length(Curve=explode_7.Segments)
len_8 = Length(Curve=explode_8.Segments)
division_32 = Division(A=len_7, B=len_8)  # -> simplify(Result)

curvepoint_8 = PointOnCurve(explode_8.Segments, parameter=0.5)
curvepoint_9 = PointOnCurve(explode_7.Segments, parameter=0.5)
ln_12 = Line(StartPoint=curvepoint_9, EndPoint=graft(facen_10.Centers))
ln_13 = Line(StartPoint=curvepoint_8, EndPoint=graft(facen_9.Centers))
len_9 = Length(Curve=ln_12)
len_10 = Length(Curve=ln_13)
division_33 = Division(A=len_9, B=len_10)  # -> simplify(Result)

cullpt_22 = CullDuplicates(Points=explode_8.Vertices, Tolerance=0.1, CullMode=1)  # -> Points, Indices, Valence
cullpt_23 = CullDuplicates(Points=explode_7.Vertices, Tolerance=0.1, CullMode=1)  # -> Points, Indices, Valence
ln_14 = Line(StartPoint=cullpt_22.Points, EndPoint=graft(facen_9.Centers))
ln_15 = Line(StartPoint=cullpt_23.Points, EndPoint=graft(facen_10.Centers))
len_11 = Length(Curve=ln_15)
len_12 = Length(Curve=ln_14)
division_34 = Division(A=len_11, B=len_12)  # -> simplify(Result)

num_107 = Number(division_34)
line_13 = Line(ln_15)
ci_ratio = Panel(num_107)

num_108 = Number(division_33)
line_14 = Line(ln_12)
cf_ratio = Panel(num_108)

num_109 = Number(division_32)
line_15 = Line(explode_7.Segments)
cp_ratio = Panel(num_109)

merge_22 = Merge(Data1=num_109, Data2=num_107, Data3=num_108)
avr_9 = Average(Input=merge_22)
num_110 = Number(avr_9)
average_ratio = Panel(num_110)

ratio_cp = RatioCP(num_109)  # Ratio of strain on face edges (cP)
cp_lines = CPLines(line_15)  # Lines for preview
ratio_cf = RatioCF(num_108)  # Ratio of strain on face centered lines (cF)
cf_lines = CFLines(line_14)  # Lines for preview
ratio_ci = RatioCI(num_107)  # Ratio of strain on body centered lines (cI)
ci_lines = CILines(line_13)  # Lines for preview
ratio_average = RatioAverage(num_110)  # Average ratio of strain per face

# ==== cluster RemoveDuplicateLines
lattice_l = ClusterInput()
crv = Curve(lattice_l)
curvepoint = PointOnCurve(crv, parameter=0.5)
cullpt = CullDuplicates(Points=curvepoint, Tolerance=".001", CullMode=1)  # -> Points, Indices, Valence
item = ListItem(List=crv, Index=cullpt.Indices, Wrap=True)
lattice = ClusterOutput(item)

# ==== cluster CellLatticeFill: Fill voxels with lattice unit cells

unit_cell = ClusterInput()  # Unit cell to populate voxels
voxels = ClusterInput()  # Voxels to be filled with unit cells
crv = Curve(unit_cell)
bbox = BoundingBox(Content=crv, Plane=PlaneXY(0, 0, 0), UnionBox=True)  # -> Box, Box_2
# CRYSTALLON V2.0 -- Lattice structure tools for Grasshopper3D
# 
# Copyright (C) 2019  Aaron Porterfield
# 
# www.fequalsf.com
# info@fequalsf.com
# 
#     This program is free software: you can redistribute it and/or modify
#     it under the terms of the GNU General Public License as published by
#     the Free Software Foundation, either version 3 of the License, or any later version.
# 
#     This program is distributed in the hope that it will be useful,
#     but WITHOUT ANY WARRANTY; without even the implied warranty of
#     MERCHANTABILITY or FITNESS FOR A PARTICULAR PURPOSE.  See the
#     GNU General Public License for more details.
# 
#     You should have received a copy of the GNU General Public License
#     along with this program.  If not, see <http://www.gnu.org/licenses/>.
panel = Panel("CELL FILL")
morph = BoxMorph(Geometry=crv, Reference=bbox.Box, Target=graft(voxels))  # -> flatten(Geometry)
remove_duplicate_lines = RemoveDuplicateLines(lattice_l=flatten(morph))
lattice = ClusterOutput(remove_duplicate_lines)  # List of curves that make up the lattice

# ==== cluster CellMorphAttractor: Morph unit cells with attractor(s)

voxels = ClusterInput()  # Voxels to be filled with unit cells
attractor = ClusterInput()  # Any geometry to use as attractor(s)
influence = ClusterInput()  # Smoothed range of attractor influence (0-1)
magnitude_min = ClusterInput()  # Magnitude of the morph (minimum value)
magnitude_max = ClusterInput()  # Magnitude of the morph (maximum value)
brep = Brep(voxels)
geo = Geometry(attractor)
volume = Volume(Geometry=flatten(brep))  # -> Volume, Centroid
pull = PullPoint(Point=volume.Centroid, Geometry=geo, ClosestOnly=True)  # -> ClosestPoint, Distance
panel = Panel("CELL MORPH ATTRACTOR")
expression = Expression(x=influence, y=pull.Distance, Expression="-1*e^(-x*y)")
dom = ConstructDomain(DomainStart=magnitude_min, DomainEnd=magnitude_max)
bnd = Bounds(Numbers=expression)
remap = RemapNumbers(Value=expression, Source=bnd, Target=dom)  # -> Mapped, Clipped
value = ClusterOutput(remap.Mapped)  # Values (0-1) for cell morph

# ==== cluster CellMorphValue: Morph unit cells with a point cloud and corrosponding values

distance_influence = ClusterInput()  # If true the distance between the points and voxels will affect the magnitude
influence = ClusterInput()  # Smoothed range of attractor influence (0-1)
values = ClusterInput()  # Values that correspond to points (flattened)
points = ClusterInput()  # List of points (flattened)
voxels = ClusterInput()  # Voxels to be filled with unit cells
brep = Brep(voxels)
num = Number(values)
pt = Point(points)
area = Area(Geometry=flatten(brep))  # -> Area, Centroid
cp = ClosestPoint(Point=area.Centroid, Cloud=pt)  # -> ClosestPoint, CPIndex, Distance
item = ListItem(List=num, Index=cp.CPIndex, Wrap=True)
panel = Panel("CELL MORPH VALUE")
expression = Expression(x=influence, y=cp.Distance, Expression="-1*e^(-x*y)")
bnd = Bounds(Numbers=item)
remap = RemapNumbers(Value=item, Source=bnd, Target=Domain(0, 1))  # -> Mapped, Clipped
bnd_2 = Bounds(Numbers=expression)
not = GateNot(A=distance_influence)
remap_2 = RemapNumbers(Value=expression, Source=bnd_2, Target="1 to 0")  # -> Mapped, Clipped
cull = CullPattern(List=remap.Mapped, CullPattern=not)
multiplication = Multiplication(A=remap.Mapped, B=remap_2.Mapped)
cull_2 = CullPattern(List=multiplication, CullPattern=distance_influence)
num_2 = Number([cull_2, cull])
value = ClusterOutput(num_2)  # Values (0-1) for morph

# ==== cluster VoronoiFill: Fill a volume with randomized voronoi cells

geometry = ClusterInput()  # Geometry to fill
number_of_points = ClusterInput()  # The initial number of random points to fill the volume
use_attractor = ClusterInput()  # If true, points will be filtered by distance to attractor(s)
attractor = ClusterInput()  # Any geometry to use as attractor(s)
magnitude_of_random_filtering = ClusterInput()  # Magnitude of random filtering
number_of_filtered_points = ClusterInput()  # The number of points to filter
enable_voronoi = ClusterInput()  # If true, voronoi cells will be generated (can be very slow)
geo = Geometry(geometry)
geo_2 = Geometry(attractor)
mesh = Mesh(geo)
bbox = BoundingBox(Content=mesh, Plane=PlaneXY(0, 0, 0))  # -> Box, Box_2
pop3d = Populate3D(Region=bbox.Box, Count=number_of_points, Seed=1)
dom = ConstructDomain(DomainStart=expr("x*-1", magnitude_of_random_filtering), DomainEnd=magnitude_of_random_filtering)
pull = PullPoint(Point=pop3d, Geometry=geo_2, ClosestOnly=True)  # -> ClosestPoint, Distance
lng = ListLength(List=pop3d)
random = Random(Range=dom, Number=lng, Seed=2)
addition = Addition(A=random, B=pull.Distance)
sort = SortList(Keys=addition, ValuesA=pop3d)  # -> Keys, ValuesA
not = GateNot(A=use_attractor)
panel = Panel("VORONOI FILL")
subset = SubList(List=sort.ValuesA, Domain=number_of_filtered_points, Wrap=True)  # -> List, Index
cull = CullPattern(List=pop3d, CullPattern=not)
cull_2 = CullPattern(List=subset.List, CullPattern=use_attractor)
pt = Point(flatten([cull_2, cull]))
minc = MeshInclusion(Mesh=mesh, Point=flatten(pt), Strict=False)
cull_3 = CullPattern(List=flatten(pt), CullPattern=minc)
cull_4 = CullPattern(List=cull_3, CullPattern=enable_voronoi)
voronoi³ = Voronoi3D(Points=flatten(cull_4), Box=bbox.Box)  # -> Cells, Boundary
edges = BrepEdges(Brep=voronoi³.Cells)  # -> Naked, Interior, NonManifold
mmx = MeshMesh(MeshA=mesh, MeshB=voronoi³.Cells, UseMeshMeshFast=True)
explode = Explode(Curve=flatten(mmx), Recursive=True)  # -> Segments, flatten(Vertices)
remove_duplicate_lines = RemoveDuplicateLines(lattice_l=flatten(edges.Interior))
remove_duplicate_lines_2 = RemoveDuplicateLines(lattice_l=flatten(explode.Segments))
preview_points = ClusterOutput(cull_3)  # Preview of points that will create the voronoi lattice
voronoi_lattice_skin = ClusterOutput(remove_duplicate_lines_2)  # List of curves that make up the lattice skin
voronoi_lattice = ClusterOutput(remove_duplicate_lines)  # List of curves that make up the lattice

# ==== cluster TrimLattice: Trim lattice with a closed volume

geometry = ClusterInput()  # Geometry to trim with (closed brep or mesh)
lattice = ClusterInput()  # Lattice curves to trim
geo = Geometry(geometry)
crv = Curve(lattice)
mesh = Mesh(geo)
mcx = MeshCurve(Mesh=mesh, Curve=crv)  # -> Points, Faces
null = NullItem(Item=mcx.Points)  # -> NullFlags, InvalidFlags, Description
crv_cp = CurveClosestPoint(Point=mcx.Points, Curve=graft(crv))  # -> Point, Parameter, Distance
panel = Panel("TRIM LATTICE")
cull = CullPattern(List=graft(crv), CullPattern=null.NullFlags)
shatter = Shatter(Curve=graft(crv), Parameters=crv_cp.Parameter)
curvepoint = PointOnCurve(cull, parameter=0.5)
curvepoint_2 = PointOnCurve(shatter, parameter=0.5)
minc = MeshInclusion(Mesh=mesh, Point=curvepoint, Strict=False)
minc_2 = MeshInclusion(Mesh=mesh, Point=curvepoint_2, Strict=False)
cull_2 = CullPattern(List=shatter, CullPattern=minc_2)
cull_3 = CullPattern(List=cull, CullPattern=minc)
crv_2 = Curve(flatten(cull_2))
crv_3 = Curve(flatten(cull_3))
unrimmed_lattice = ClusterOutput(crv_3)  # Lattice curves that have not been trimmed (Typically removes curves with valence 1)
trimmed_lattice = ClusterOutput(crv_2)  # Lattice curves that have been trimmed

# ==== cluster RemoveShort: Remove curves by length

lattice = ClusterInput()  # Lattice curves to filter
length = ClusterInput()  # Minimum lenth of lattice curves
crv = Curve(lattice)
len = Length(Curve=crv)
panel = Panel("REMOVE SHORT LINES")
larger = LargerThan(FirstNumber=len, SecondNumber=length)  # -> LargerThan, OrEqualTo
cull = CullPattern(List=crv, CullPattern=larger.LargerThan)
lattice_2 = ClusterOutput(cull)  # Filtered lattice

# ==== cluster TrimShell: Trim shell lattice with a closed volume

lattice_shell = ClusterInput()  # Lattice shell to trim
geometry = ClusterInput()  # Geometry to trim with (closed brep or mesh)
geo = Geometry(geometry)
mjoin = MeshJoin(Meshes=flatten(lattice_shell))
mesh = Mesh(geo)
weld = WeldMesh(Mesh=mjoin, Angle=3.141592654)
panel = Panel("TRIM SHELL")
demesh = DeconstructMesh(Mesh=weld)  # -> Vertices, Faces, Colours, Normals
minc = MeshInclusion(Mesh=mesh, Point=demesh.Vertices, Strict=False)
not = GateNot(A=minc)
cullv = CullVertices(Mesh=weld, Pattern=not, Shrink=True)
trimmed_lattice_shell = ClusterOutput(cullv)  # Trimmed lattice shell

# ==== cluster LatticeConnections: Create connections between two lattices

lattice_b = ClusterInput()  # Second lattice to make connections between
lattice_a = ClusterInput()  # First lattice to make connections between
number_of_connections = ClusterInput()  # Number of Connections
max_distance = ClusterInput()  # Maximum distance between connections
crv = Curve(lattice_a)
crv_2 = Curve(lattice_b)
cp = ControlPoints(Curve=crv)  # -> Points, Weights, Knots
cp_2 = ControlPoints(Curve=crv_2)  # -> Points, Weights, Knots
cullpt = CullDuplicates(Points=flatten(cp.Points), Tolerance=0.1, CullMode=1)  # -> Points, Indices, Valence
cullpt_2 = CullDuplicates(Points=flatten(cp_2.Points), Tolerance=0.1, CullMode=1)  # -> Points, Indices, Valence
panel = Panel("LATTICE CONNECTIONS")
cps = ClosestPoints(Point=cullpt.Points, Cloud=cullpt_2.Points, Count=number_of_connections)  # -> ClosestPoint, CPIndex, Distance
smaller = SmallerThan(FirstNumber=cps.Distance, SecondNumber=max_distance)  # -> SmallerThan, OrEqualTo
cull = CullPattern(List=cps.ClosestPoint, CullPattern=smaller.SmallerThan)
ln = Line(StartPoint=graft(cullpt.Points), EndPoint=cull)
lattice = ClusterOutput(ln)  # Lattice connections

# ==== cluster MorphLatticeToSkin: Morph lattice to connect to skin

geometry = ClusterInput()  # Geometry to morph to
lattice = ClusterInput()  # Lattice to morph to skin
geometry_2 = ClusterInput()  # Geometry to morph to
max_distance = ClusterInput()  # Maximum distance from geometry
max_distance_2 = ClusterInput()  # Maximum distance to moprh
geo = Geometry(geometry_2)
crv = Curve(lattice)
geo_2 = Geometry(geometry)
cp = ControlPoints(Curve=crv)  # -> simplify(Points), Weights, Knots
pull = PullPoint(Point=cp.Points, Geometry=geo_2, ClosestOnly=True)  # -> ClosestPoint, Distance
smaller = SmallerThan(FirstNumber=pull.Distance, SecondNumber=max_distance)  # -> SmallerThan, OrEqualTo
not = GateNot(A=smaller.SmallerThan)
cull = CullPattern(List=cp.Points, CullPattern=smaller.SmallerThan)
cull_2 = CullPattern(List=cp.Points, CullPattern=not)  # -> simplify(List)
pull_2 = PullPoint(Point=cull, Geometry=geo, ClosestOnly=True)  # -> simplify(ClosestPoint), simplify(Distance)
smaller_2 = SmallerThan(FirstNumber=pull_2.Distance, SecondNumber=max_distance_2)  # -> SmallerThan, OrEqualTo
not_2 = GateNot(A=smaller_2.SmallerThan)
panel = Panel("MORPH TO SKIN")
cull_3 = CullPattern(List=pull_2.ClosestPoint, CullPattern=smaller_2.SmallerThan)  # -> simplify(List)
cull_4 = CullPattern(List=cull, CullPattern=not_2)  # -> simplify(List)
merge = Merge(Data1=cull_2, Data2=cull_4, Data3=cull_3)
item = ListItem(List=merge, Index=0, Wrap=True)  # -> Item1, Item, Item1_2
ln = Line(StartPoint=item.Item1, EndPoint=item.Item)
remove_duplicate_lines = RemoveDuplicateLines(lattice_l=flatten(ln))
len = Length(Curve=remove_duplicate_lines)
larger = LargerThan(FirstNumber=len, SecondNumber=0)  # -> LargerThan, OrEqualTo
cull_5 = CullPattern(List=remove_duplicate_lines, CullPattern=larger.LargerThan)
crv_2 = Curve(cull_5)
lattice_2 = ClusterOutput(crv_2)  # Morphed lattice

# ==== cluster MorphShellToSkin: Morph shell lattice to connect to skin

# ----
# MORPH SHELL TO SKIN
lattice_shell = ClusterInput()  # Lattice shell to moprh
geometry = ClusterInput()  # Geometry to morph to
max_distance = ClusterInput()  # Maximum distance from geometry
mesh = Mesh(lattice_shell)
geo = Geometry(geometry)
mesh_2 = Mesh(geo)
demesh = DeconstructMesh(Mesh=mesh)  # -> Vertices, Faces, Colours, Normals
pull = PullPoint(Point=demesh.Vertices, Geometry=mesh_2, ClosestOnly=True)  # -> ClosestPoint, Distance
lng = ListLength(List=demesh.Vertices)
smaller = SmallerThan(FirstNumber=pull.Distance, SecondNumber=max_distance)  # -> SmallerThan, OrEqualTo
series = Series(Start=0, Step=1, Count=lng)
cull = CullPattern(List=pull.ClosestPoint, CullPattern=smaller.SmallerThan)
cull_2 = CullPattern(List=series, CullPattern=smaller.SmallerThan)
replace = ReplaceItems(List=demesh.Vertices, Item=cull, Indices=cull_2, Wrap=False)
conmesh = ConstructMesh(Vertices=replace, Faces=demesh.Faces)
trimmed_lattice_shell = ClusterOutput(conmesh)  # Trimmed lattice shell

# ==== cluster LatticeThicknessAttractor: Apply thickness values to lattice curves with attractor(s)

lattice = ClusterInput()  # Lattice to thicken
attractor = ClusterInput()  # Any geometry to use as attractor(s)
influence = ClusterInput()  # Smoothed range of attractor influence (0-1)
magnitude_min = ClusterInput()  # Lattice beam thickness (minimum value)
magnitude_max = ClusterInput()  # Lattice beam thickness (maximum value)
crv = Curve(lattice)
geo = Geometry(attractor)
curvepoint = PointOnCurve(crv, parameter=0.5)
pull = PullPoint(Point=curvepoint, Geometry=geo, ClosestOnly=True)  # -> ClosestPoint, Distance
panel = Panel("THICKNESS ATTRACTOR")
expression = Expression(x=influence, y=pull.Distance, Expression="-1*e^(-x*y)")
dom = ConstructDomain(DomainStart=magnitude_min, DomainEnd=magnitude_max)
bnd = Bounds(Numbers=expression)
dedomain = DeconstructDomain(Domain=bnd)  # -> Start, End
dom_2 = ConstructDomain(DomainStart=dedomain.End, DomainEnd=dedomain.Start)
remap = RemapNumbers(Value=expression, Source=dom_2, Target=dom)  # -> Mapped, Clipped
value = ClusterOutput(remap.Mapped)  # Values for beam thickness

# ==== cluster LatticeThicknessValue: Apply thickness values to lattice curves with a point cloud and corrosponding values

lattice = ClusterInput()  # Lattice to thicken
points = ClusterInput()  # List of points (flattened)
values = ClusterInput()  # Values that correspond to points (flattened)
distance_influence = ClusterInput()  # If true the distance between the points and voxels will affect the magnitude
influence = ClusterInput()  # Smoothed range of attractor influence (0-1)
magnitude_min = ClusterInput()  # Lattice beam thickness (minimum value)
magnitude_max = ClusterInput()  # Lattice beam thickness (maximum value)
crv = Curve(lattice)
curvepoint = PointOnCurve(crv, parameter=0.5)
num = Number(values)
pt = Point(points)
cp = ClosestPoint(Point=curvepoint, Cloud=pt)  # -> ClosestPoint, CPIndex, Distance
dom = ConstructDomain(DomainStart=magnitude_min, DomainEnd=magnitude_max)
item = ListItem(List=num, Index=cp.CPIndex, Wrap=True)
panel = Panel("THICKNESS VALUE")
expression = Expression(x=influence, y=cp.Distance, Expression="-1*e^(-x*y)")
bnd = Bounds(Numbers=item)
remap = RemapNumbers(Value=item, Source=bnd, Target=dom)  # -> Mapped, Clipped
not = GateNot(A=distance_influence)
bnd_2 = Bounds(Numbers=expression)
remap_2 = RemapNumbers(Value=expression, Source=bnd_2, Target="1 to 0")  # -> Mapped, Clipped
cull = CullPattern(List=remap.Mapped, CullPattern=not)
multiplication = Multiplication(A=remap.Mapped, B=remap_2.Mapped)
cull_2 = CullPattern(List=multiplication, CullPattern=distance_influence)
bnd_3 = Bounds(Numbers=cull_2)
remap_3 = RemapNumbers(Value=cull_2, Source=bnd_3, Target=dom)  # -> Mapped, Clipped
num_2 = Number([remap_3.Mapped, cull])
value = ClusterOutput(num_2)  # Values for beam thickness

# ==== cluster ShellThicknessValue: Apply thickness values to shell vertices with a point cloud and corrosponding values

lattice_shell = ClusterInput()  # Lattice shell to thicken
points = ClusterInput()  # List of points (flattened)
values = ClusterInput()  # Values that correspond to points (flattened)
distance_influence = ClusterInput()  # If true the distance between the points and voxels will affect the magnitude
influence = ClusterInput()  # Smoothed range of attractor influence (0-1)
magnitude_min = ClusterInput()  # Lattice shell thickness (minimum value)
magnitude_max = ClusterInput()  # Lattice shell thickness (maximum value)
mesh = Mesh(lattice_shell)
num = Number(values)
pt = Point(points)
demesh = DeconstructMesh(Mesh=mesh)  # -> Vertices, Faces, Colours, Normals
cp = ClosestPoint(Point=demesh.Vertices, Cloud=pt)  # -> ClosestPoint, CPIndex, Distance
item = ListItem(List=num, Index=cp.CPIndex, Wrap=True)
expression = Expression(x=influence, y=cp.Distance, Expression="-1*e^(-x*y)")
dom = ConstructDomain(DomainStart=magnitude_min, DomainEnd=magnitude_max)
bnd = Bounds(Numbers=item)
panel = Panel("SHELL THICKNESS VALUE")
remap = RemapNumbers(Value=item, Source=bnd, Target=dom)  # -> Mapped, Clipped
bnd_2 = Bounds(Numbers=expression)
not = GateNot(A=distance_influence)
remap_2 = RemapNumbers(Value=expression, Source=bnd_2, Target="1 to 0")  # -> Mapped, Clipped
multiplication = Multiplication(A=remap.Mapped, B=remap_2.Mapped)
cull = CullPattern(List=remap.Mapped, CullPattern=not)
cull_2 = CullPattern(List=multiplication, CullPattern=distance_influence)
bnd_3 = Bounds(Numbers=cull_2)
remap_3 = RemapNumbers(Value=cull_2, Source=bnd_3, Target=dom)  # -> Mapped, Clipped
num_2 = Number([remap_3.Mapped, cull])
value = ClusterOutput(num_2)  # Values for shell thickness (mesh vertices)

# ==== cluster ShellThicknessAttractor: Apply thickness values to shell vertices with attractor(s)

lattice_shell = ClusterInput()  # Lattice shell to thicken
attractor = ClusterInput()  # Any geometry to use as attractor(s)
influence = ClusterInput()  # Smoothed range of attractor influence (0-1)
magnitude_min = ClusterInput()  # Lattice shell thickness (minimum value)
magnitude_max = ClusterInput()  # Lattice shell thickness (maximum value)
mesh = Mesh(lattice_shell)
geo = Geometry(attractor)
demesh = DeconstructMesh(Mesh=mesh)  # -> Vertices, Faces, Colours, Normals
pull = PullPoint(Point=demesh.Vertices, Geometry=geo, ClosestOnly=True)  # -> ClosestPoint, Distance
panel = Panel("SHELL THICKNESS ATTRACTOR")
expression = Expression(x=influence, y=pull.Distance, Expression="-1*e^(-x*y)")
dom = ConstructDomain(DomainStart=magnitude_min, DomainEnd=magnitude_max)
bnd = Bounds(Numbers=expression)
dedomain = DeconstructDomain(Domain=bnd)  # -> Start, End
dom_2 = ConstructDomain(DomainStart=dedomain.End, DomainEnd=dedomain.Start)
remap = RemapNumbers(Value=expression, Source=dom_2, Target=dom)  # -> Mapped, Clipped
value = ClusterOutput(remap.Mapped)  # Values for shell thickness (mesh vertices)

# ==== cluster MeshOffset: Offset mesh triangles into voxels

distance = ClusterInput()  # Offset distance
mesh = ClusterInput()  # Mesh to offset
mesh_2 = Mesh(mesh)
weld = WeldMesh(Mesh=mesh_2, Angle=3.141592654)
demesh = DeconstructMesh(Mesh=weld)  # -> Vertices, Faces, Colours, Normals
deface = DeconstructFace(Face=demesh.Faces)  # -> CornerA, CornerB, CornerC, CornerD
item = ListItem(List=demesh.Vertices, Index=deface.CornerB, Wrap=True)
item_2 = ListItem(List=demesh.Vertices, Index=deface.CornerC, Wrap=True)
panel = Panel("0")
item_3 = ListItem(List=demesh.Vertices, Index=deface.CornerA, Wrap=True)
panel_2 = Panel("1")
panel_3 = Panel("2")
addition = Addition(A=item_3, B=item)
addition_2 = Addition(A=item_3, B=item_2)
addition_3 = Addition(A=item, B=item_2)
bcentric = Barycentric(PointA=item_3, PointB=item, PointC=item_2, CoordinateU=1, CoordinateV=1, CoordinateW=1)
panel_4 = Panel("A")
panel_5 = Panel("B")
panel_6 = Panel("C")
division = Division(A=addition, B="2")
division_2 = Division(A=addition_3, B="2")
division_3 = Division(A=addition_2, B="2")
panel_7 = Panel("Z")
entwine = Entwine(Branch00=item_3, Branch01=division, Branch02=bcentric, Branch03=division_3, FlattenInputs=True)
entwine_2 = Entwine(Branch00=item, Branch01=division_2, Branch02=bcentric, Branch03=division, FlattenInputs=True)
entwine_3 = Entwine(Branch00=item_2, Branch01=division_3, Branch02=bcentric, Branch03=division_2, FlattenInputs=True)
flip = FlipMatrix(Data=entwine)
flip_2 = FlipMatrix(Data=entwine_3)
flip_3 = FlipMatrix(Data=entwine_2)
quad = MeshQuad(CornerA=0, CornerB=1, CornerC=2, CornerD=3)
quad_2 = MeshQuad(CornerA=0, CornerB=1, CornerC=2, CornerD=3)
quad_3 = MeshQuad(CornerA=0, CornerB=1, CornerC=2, CornerD=3)
# CRYSTALLON V1.0 -- Lattice structure tools for Grasshopper3D
# 
# Copyright (C) 2018  Aaron Porterfield
# 
# www.studiofathom.com
# www.fequalsf.com
# 
#     This program is free software: you can redistribute it and/or modify
#     it under the terms of the GNU General Public License as published by
#     the Free Software Foundation, either version 3 of the License, or any later version.
# 
#     This program is distributed in the hope that it will be useful,
#     but WITHOUT ANY WARRANTY; without even the implied warranty of
#     MERCHANTABILITY or FITNESS FOR A PARTICULAR PURPOSE.  See the
#     GNU General Public License for more details.
# 
#     You should have received a copy of the GNU General Public License
#     along with this program.  If not, see <http://www.gnu.org/licenses/>.
panel_8 = Panel("MESH OFFSET")
conmesh = ConstructMesh(Vertices=flip_2, Faces=quad)
conmesh_2 = ConstructMesh(Vertices=flip_3, Faces=quad_2)
conmesh_3 = ConstructMesh(Vertices=flip, Faces=quad_3)
mjoin = MeshJoin(Meshes=flatten([conmesh_3, conmesh_2, conmesh]))
demesh_2 = DeconstructMesh(Mesh=mjoin)  # -> Vertices, Faces, Colours, Normals
meshcp = MeshClosestPoint(Point=demesh_2.Vertices, Mesh=weld)  # -> Point, Index, Parameter
meval = MeshEval(Mesh=weld, Parameter=meshcp.Parameter)  # -> Point, Normal, Colour
amp = Amplitude(Vector=meval.Normal, Amplitude=distance)
move = Move(Geometry=demesh_2.Vertices, Motion=amp)  # -> Geometry, Transform
conmesh_4 = ConstructMesh(Vertices=move.Geometry, Faces=demesh_2.Faces)
demesh_3 = DeconstructMesh(Mesh=mjoin)  # -> Vertices, Faces, Colours, Normals
demesh_4 = DeconstructMesh(Mesh=conmesh_4)  # -> Vertices, Faces, Colours, Normals
deface_2 = DeconstructFace(Face=demesh_3.Faces)  # -> CornerA, CornerB, CornerC, CornerD
deface_3 = DeconstructFace(Face=demesh_4.Faces)  # -> CornerA, CornerB, CornerC, CornerD
item_4 = ListItem(List=demesh_4.Vertices, Index=deface_3.CornerA, Wrap=True)
item_5 = ListItem(List=demesh_4.Vertices, Index=deface_3.CornerB, Wrap=True)
item_6 = ListItem(List=demesh_4.Vertices, Index=deface_3.CornerC, Wrap=True)
item_7 = ListItem(List=demesh_4.Vertices, Index=deface_3.CornerD, Wrap=True)
item_8 = ListItem(List=demesh_3.Vertices, Index=deface_2.CornerA, Wrap=True)
item_9 = ListItem(List=demesh_3.Vertices, Index=deface_2.CornerB, Wrap=True)
item_10 = ListItem(List=demesh_3.Vertices, Index=deface_2.CornerC, Wrap=True)
item_11 = ListItem(List=demesh_3.Vertices, Index=deface_2.CornerD, Wrap=True)
tbox = TwistedBox(
    CornerA=item_4,
    CornerB=item_5,
    CornerC=item_6,
    CornerD=item_7,
    CornerE=item_8,
    CornerF=item_9,
    CornerG=item_10,
    CornerH=item_11)
mesh_3 = Mesh(mjoin)
mesh_4 = Mesh(conmesh_4)
quad_mesh = ClusterOutput(mesh_4)  # Quad mesh generated from the input mesh
offset_quad_mesh = ClusterOutput(mesh_3)  # Offset quad mesh generated from the input mesh
voxels = ClusterOutput(tbox)  # Voxels to be filled with unit cells

# ==== cluster VoxelMorphValue: Morph voxels with a point cloud and corrosponding values

voxels = ClusterInput()  # Voxels to be filled with unit cells
points = ClusterInput()  # List of points (flattened)
values = ClusterInput()  # Values that correspond to points (flattened)
distance_influence = ClusterInput()  # If true the distance between the points and voxels will affect the magnitude
influence = ClusterInput()  # Smoothed range of attractor influence (0-1)
magnitude_min = ClusterInput()  # Magnitude of the morph (minimum value)
magnitude_max = ClusterInput()  # Magnitude of the morph (maximum value)
tbox = TwistedBox(voxels)
pt = Point(points)
num = Number(values)
debrep = DeconstructBrep(Brep=tbox)  # -> Faces, Edges, Vertices
cp = ClosestPoint(Point=debrep.Vertices, Cloud=pt)  # -> ClosestPoint, CPIndex, Distance
dom = ConstructDomain(DomainStart=magnitude_min, DomainEnd=magnitude_max)
remap = RemapNumbers(Value=num, Source=Domain(0, 1), Target=dom)  # -> Mapped, Clipped
expression = Expression(x=influence, y=cp.Distance, Expression="-1*e^(-x*y)")
item = ListItem(List=remap.Mapped, Index=cp.CPIndex, Wrap=True)
panel = Panel("VOXEL MORPH VALUE")
bnd = Bounds(Numbers=flatten(expression))
ln = Line(StartPoint=debrep.Vertices, EndPoint=cp.ClosestPoint)
remap_2 = RemapNumbers(Value=expression, Source=bnd, Target="1 to 0")  # -> Mapped, Clipped
not = GateNot(A=distance_influence)
multiplication = Multiplication(A=item, B=remap_2.Mapped)
cull = CullPattern(List=multiplication, CullPattern=distance_influence)
cull_2 = CullPattern(List=item, CullPattern=not)
amp = Amplitude(Vector=ln, Amplitude=[cull, cull_2])
move = Move(Geometry=debrep.Vertices, Motion=amp)  # -> Geometry, Transform
item_2 = ListItem(List=move.Geometry, Index="0", Wrap=True)
item_3 = ListItem(List=move.Geometry, Index="1", Wrap=True)
item_4 = ListItem(List=move.Geometry, Index="2", Wrap=True)
item_5 = ListItem(List=move.Geometry, Index="3", Wrap=True)
item_6 = ListItem(List=move.Geometry, Index="4", Wrap=True)
item_7 = ListItem(List=move.Geometry, Index="6", Wrap=True)
item_8 = ListItem(List=move.Geometry, Index="5", Wrap=True)
item_9 = ListItem(List=move.Geometry, Index="7", Wrap=True)
tbox_2 = TwistedBox(
    CornerA=item_2,
    CornerB=item_3,
    CornerC=item_4,
    CornerD=item_5,
    CornerE=item_8,
    CornerF=item_6,
    CornerG=item_9,
    CornerH=item_7)
voxels_2 = ClusterOutput(tbox_2)  # Voxels to be filled with unit cells

# ==== cluster VoxelMorphAttractor: Morph voxels with attractor(s)

voxels = ClusterInput()  # Voxels to be filled with unit cells
attractor = ClusterInput()  # Any geometry to use as attractor(s)
influence = ClusterInput()  # Smoothed range of attractor influence (0-1)
tbox = TwistedBox(voxels)
magnitude = ClusterInput()  # Magnitude of the morph
geo = Geometry(attractor)
debrep = DeconstructBrep(Brep=tbox)  # -> Faces, Edges, Vertices
pull = PullPoint(Point=debrep.Vertices, Geometry=geo, ClosestOnly=True)  # -> ClosestPoint, Distance
bnd = Bounds(Numbers=flatten(pull.Distance))
panel = Panel("VOXEL MORPH ATTRACTOR")
expression = Expression(x=influence, y=pull.Distance, Expression="-1*e^(-x*y)")
dedomain = DeconstructDomain(Domain=bnd)  # -> Start, End
subtraction = Subtraction(A=dedomain.Start, B=magnitude)
bnd_2 = Bounds(Numbers=flatten(expression))
dom = ConstructDomain(DomainStart=subtraction, DomainEnd="0")
ln = Line(StartPoint=debrep.Vertices, EndPoint=pull.ClosestPoint)
remap = RemapNumbers(Value=expression, Source=bnd_2, Target=dom)  # -> Mapped, Clipped
amp = Amplitude(Vector=ln, Amplitude=remap.Mapped)
move = Move(Geometry=debrep.Vertices, Motion=amp)  # -> Geometry, Transform
item = ListItem(List=move.Geometry, Index="0", Wrap=True)
item_2 = ListItem(List=move.Geometry, Index="1", Wrap=True)
item_3 = ListItem(List=move.Geometry, Index="2", Wrap=True)
item_4 = ListItem(List=move.Geometry, Index="3", Wrap=True)
item_5 = ListItem(List=move.Geometry, Index="4", Wrap=True)
item_6 = ListItem(List=move.Geometry, Index="6", Wrap=True)
item_7 = ListItem(List=move.Geometry, Index="5", Wrap=True)
item_8 = ListItem(List=move.Geometry, Index="7", Wrap=True)
tbox_2 = TwistedBox(
    CornerA=item,
    CornerB=item_2,
    CornerC=item_3,
    CornerD=item_4,
    CornerE=item_7,
    CornerF=item_5,
    CornerG=item_8,
    CornerH=item_6)
voxels_2 = ClusterOutput(tbox_2)  # Voxels to be filled with unit cells

# ==== cluster Voxelize: Fill a volume with uniform sized voxels

geometry = ClusterInput()  # Geometry to voxelize
voxel_size_x = ClusterInput()  # Voxel size int the X direction
voxel_size_y = ClusterInput()  # Voxel size int the Y direction
voxel_size_z = ClusterInput()  # Voxel size int the Z direction
fill_completely = ClusterInput()  # If true, Voxels will fill entire volume. If false, only Voxels with their centroid within the volume will be kept.
geo = Geometry(geometry)
num = Number(voxel_size_x)
num_2 = Number(voxel_size_y)
num_3 = Number(voxel_size_z)
bbox = BoundingBox(Content=geo, Plane=PlaneXY(0, 0, 0))  # -> Box, Box_2
boxprop = BoxProperties(Box=bbox.Box)  # -> Center, Diagonal, Area, Volume, Degeneracy
one_over_x = OneOverX(Value=num_2)
one_over_x_2 = OneOverX(Value=num)
one_over_x_3 = OneOverX(Value=num_3)
devec = DeconstructVector(Vector=boxprop.Center)  # -> XComponent, YComponent, ZComponent
multiplication = Multiplication(A=boxprop.Diagonal, B=one_over_x)
multiplication_2 = Multiplication(A=boxprop.Diagonal, B=one_over_x_2)
multiplication_3 = Multiplication(A=boxprop.Diagonal, B=one_over_x_3)
devec_2 = DeconstructVector(Vector=multiplication)  # -> XComponent, YComponent, ZComponent
devec_3 = DeconstructVector(Vector=multiplication_2)  # -> XComponent, YComponent, ZComponent
devec_4 = DeconstructVector(Vector=multiplication_3)  # -> XComponent, YComponent, ZComponent
expression = Expression(z=devec_4.ZComponent, Expression="ceiling(z)")
expression_2 = Expression(x=devec_3.XComponent, Expression="ceiling(x)")
expression_3 = Expression(y=devec_2.YComponent, Expression="ceiling(y)")
expression_4 = Expression(x=expression_2, u=num, a=devec.XComponent, Expression="-u*x/2+a")
expression_5 = Expression(y=expression_3, u=num_2, b=devec.YComponent, Expression="-u*y/2+b")
expression_6 = Expression(y=expression, u=num_3, b=devec.ZComponent, Expression="-u*y/2+b")
expression_7 = Expression(x=expression_2, Expression="x+1")
expression_8 = Expression(z=expression, Expression="z+1")
expression_9 = Expression(y=expression_3, Expression="y+1")
series = Series(Start=expression_4, Step=num, Count=expression_7)
series_2 = Series(Start=expression_6, Step=num_3, Count=expression_8)
series_3 = Series(Start=expression_5, Step=num_2, Count=expression_9)
panel = Panel("VOXELIZE")
crossref = CrossReference(ListA=series, ListB=series_3, ListC=series_2, CrossMode=1)  # -> ListA, ListB, ListC
sort = SortList(Keys=[num, num_2, num_3])  # -> Keys, ValuesA
rev = ReverseList(List=sort.Keys)
pt = ConstructPoint(XCoordinate=crossref.ListA, YCoordinate=crossref.ListB, ZCoordinate=crossref.ListC)
item = ListItem(List=rev, Index=0, Wrap=True)
minc = MeshInclusion(Mesh=geo, Point=pt, Strict=False)
meshcp = MeshClosestPoint(Point=pt, Mesh=geo)  # -> Point, Index, Parameter
dist = Distance(PointA=pt, PointB=meshcp.Point)
expression_10 = Expression(a=item, d=dist, Expression="if(d<sqrt(2*(a/2)^2),True,False)")
cull = CullPattern(List=pt, CullPattern=minc)
cull_2 = CullPattern(List=pt, CullPattern=expression_10)
cull_3 = CullPattern(List=cull_2, CullPattern=fill_completely)
merge = Merge(Data1=cull, Data2=cull_3)
expression_11 = Expression(x=num_2, Expression="x/2")
expression_12 = Expression(x=num, Expression="x/2")
expression_13 = Expression(x=num_3, Expression="x/2")
cullpt = CullDuplicates(Points=merge, Tolerance=".001", CullMode=3)  # -> Points, Indices, Valence
box = CenterBox(Base=cullpt.Points, X=expression_12, Y=expression_11, Z=expression_13)
voxels = ClusterOutput(box)  # Voxels to be filled with unit cells

# ==== cluster RemoveFloating: Remove disconnected curves

lattice = ClusterInput()  # Lattice curves to filter
crv = Curve(flatten(lattice))
join = JoinCurves(Curves=crv, Preserve=False)
line = Line(join)
panel = Panel("REMOVE FLOATING CURVES")
null = NullItem(Item=line)  # -> NullFlags, InvalidFlags, Description
cull = CullPattern(List=join, CullPattern=null.NullFlags)
explode = Explode(Curve=cull, Recursive=True)  # -> flatten(Segments), Vertices
lattice_2 = ClusterOutput(explode.Segments)  # Filtered lattice

# ==== cluster MorphBetweenSurfaces: Conformal fill of voxels between two or more surfaces

surfaces = ClusterInput()  # At least 2 surfaces to morph voxels between
voxel_number_x = ClusterInput()  # Number of Voxels in the X direction
voxel_number_y = ClusterInput()  # Number of Voxels in the Y direction
voxel_number_z = ClusterInput()  # Number of Voxels in the Z direction
srf = Surface(flatten(surfaces))
num = Number(voxel_number_z)
num_2 = Number(voxel_number_x)
num_3 = Number(voxel_number_y)
sdivide = DivideSurface(Surface=srf, UCount="30", VCount="30")  # -> simplify(Points), Normals, Parameters
pshift = ShiftPaths(Data=sdivide.Points, Offset="-1")
panel = Panel("MORPH BETWEEN SURFACES")
flip = FlipMatrix(Data=pshift)
dom = ConstructDomain(DomainStart=0, DomainEnd=1)
pline = PolyLine(Vertices=flip, Closed=False)
range = Range(Domain=dom, Steps=num)
eval = EvaluateCurve(Curve=reparameterize(pline), Parameter=range)  # -> Point, Tangent, Angle
flip_2 = FlipMatrix(Data=eval.Point)
addition = Addition(A="30", B="1")
srfgrid = SurfaceFromPoints(Points=flip_2, UCount=graft(addition), Interpolate=False)  # -> flatten(Surface)
toggle = BooleanToggle(False)
shift = ShiftList(List=srfgrid, Shift="1", Wrap=toggle)
shift_2 = ShiftList(List=srfgrid, Shift="-1", Wrap=toggle)
divide = DivideDomain²(Domain=shift, UCount=num_2, VCount=num_3)
divide_2 = DivideDomain²(Domain=shift_2, UCount=num_2, VCount=num_3)
blendbox = BlendBox(SurfaceA=graft(shift), DomainA=divide, SurfaceB=graft(shift_2), DomainB=divide_2)  # -> flatten(TwistedBox)
voxels = ClusterOutput(blendbox)  # Voxels to be filled with unit cells

# ==== cluster MeshOffsetValue: Offset mesh triangles into voxels with a point cloud and corrosponding values

magnitude_max = ClusterInput()  # Magnitude of the offset (maximum value)
influence = ClusterInput()  # Smoothed range of attractor influence (0-1)
values = ClusterInput()  # Values that correspond to points (flattened)
magnitude_min = ClusterInput()  # Magnitude of the offset (minimum value)
distance_influence = ClusterInput()  # If true the distance between the points and voxels will affect the magnitude
points = ClusterInput()  # List of points (flattened)
mesh = ClusterInput()  # Mesh to offset
mesh_2 = Mesh(mesh)
weld = WeldMesh(Mesh=mesh_2, Angle=3.141592654)
demesh = DeconstructMesh(Mesh=weld)  # -> Vertices, Faces, Colours, Normals
deface = DeconstructFace(Face=demesh.Faces)  # -> CornerA, CornerB, CornerC, CornerD
item = ListItem(List=demesh.Vertices, Index=deface.CornerB, Wrap=True)
item_2 = ListItem(List=demesh.Vertices, Index=deface.CornerC, Wrap=True)
panel = Panel("0")
item_3 = ListItem(List=demesh.Vertices, Index=deface.CornerA, Wrap=True)
panel_2 = Panel("1")
panel_3 = Panel("2")
addition = Addition(A=item_3, B=item)
addition_2 = Addition(A=item_3, B=item_2)
addition_3 = Addition(A=item, B=item_2)
bcentric = Barycentric(PointA=item_3, PointB=item, PointC=item_2, CoordinateU=1, CoordinateV=1, CoordinateW=1)
panel_4 = Panel("A")
panel_5 = Panel("B")
panel_6 = Panel("C")
division = Division(A=addition, B="2")
division_2 = Division(A=addition_3, B="2")
division_3 = Division(A=addition_2, B="2")
panel_7 = Panel("Z")
entwine = Entwine(Branch00=item_3, Branch01=division, Branch02=bcentric, Branch03=division_3, FlattenInputs=True)
entwine_2 = Entwine(Branch00=item, Branch01=division_2, Branch02=bcentric, Branch03=division, FlattenInputs=True)
entwine_3 = Entwine(Branch00=item_2, Branch01=division_3, Branch02=bcentric, Branch03=division_2, FlattenInputs=True)
flip = FlipMatrix(Data=entwine)
flip_2 = FlipMatrix(Data=entwine_3)
flip_3 = FlipMatrix(Data=entwine_2)
quad = MeshQuad(CornerA=0, CornerB=1, CornerC=2, CornerD=3)
quad_2 = MeshQuad(CornerA=0, CornerB=1, CornerC=2, CornerD=3)
quad_3 = MeshQuad(CornerA=0, CornerB=1, CornerC=2, CornerD=3)
panel_8 = Panel("MESH OFFSET VALUE")
conmesh = ConstructMesh(Vertices=flip_2, Faces=quad)
pt = Point(points)
conmesh_2 = ConstructMesh(Vertices=flip_3, Faces=quad_2)
conmesh_3 = ConstructMesh(Vertices=flip, Faces=quad_3)
num = Number(values)
bnd = Bounds(Numbers=num)
dom = ConstructDomain(DomainStart=magnitude_min, DomainEnd=magnitude_max)
mjoin = MeshJoin(Meshes=flatten([conmesh_3, conmesh, conmesh_2]))
remap = RemapNumbers(Value=num, Source=bnd, Target=dom)  # -> Mapped, Clipped
demesh_2 = DeconstructMesh(Mesh=mjoin)  # -> Vertices, Faces, Colours, Normals
cp = ClosestPoint(Point=demesh_2.Vertices, Cloud=pt)  # -> ClosestPoint, CPIndex, Distance
expression = Expression(x=influence, y=cp.Distance, Expression="-1*e^(-x*y)")
item_4 = ListItem(List=remap.Mapped, Index=cp.CPIndex, Wrap=True)
meshcp = MeshClosestPoint(Point=demesh_2.Vertices, Mesh=weld)  # -> Point, Index, Parameter
bnd_2 = Bounds(Numbers=flatten(expression))
meval = MeshEval(Mesh=weld, Parameter=meshcp.Parameter)  # -> Point, Normal, Colour
remap_2 = RemapNumbers(Value=expression, Source=bnd_2, Target="1 to 0")  # -> Mapped, Clipped
not = GateNot(A=distance_influence)
multiplication = Multiplication(A=item_4, B=remap_2.Mapped)
demesh_3 = DeconstructMesh(Mesh=mjoin)  # -> Vertices, Faces, Colours, Normals
cull = CullPattern(List=multiplication, CullPattern=distance_influence)
cull_2 = CullPattern(List=item_4, CullPattern=not)
amp = Amplitude(Vector=meval.Normal, Amplitude=[cull, cull_2])
move = Move(Geometry=demesh_2.Vertices, Motion=amp)  # -> Geometry, Transform
conmesh_4 = ConstructMesh(Vertices=move.Geometry, Faces=demesh_2.Faces)
demesh_4 = DeconstructMesh(Mesh=conmesh_4)  # -> Vertices, Faces, Colours, Normals
deface_2 = DeconstructFace(Face=demesh_3.Faces)  # -> CornerA, CornerB, CornerC, CornerD
deface_3 = DeconstructFace(Face=demesh_4.Faces)  # -> CornerA, CornerB, CornerC, CornerD
item_5 = ListItem(List=demesh_4.Vertices, Index=deface_3.CornerA, Wrap=True)
item_6 = ListItem(List=demesh_4.Vertices, Index=deface_3.CornerB, Wrap=True)
item_7 = ListItem(List=demesh_4.Vertices, Index=deface_3.CornerC, Wrap=True)
item_8 = ListItem(List=demesh_4.Vertices, Index=deface_3.CornerD, Wrap=True)
item_9 = ListItem(List=demesh_3.Vertices, Index=deface_2.CornerA, Wrap=True)
item_10 = ListItem(List=demesh_3.Vertices, Index=deface_2.CornerB, Wrap=True)
item_11 = ListItem(List=demesh_3.Vertices, Index=deface_2.CornerC, Wrap=True)
item_12 = ListItem(List=demesh_3.Vertices, Index=deface_2.CornerD, Wrap=True)
tbox = TwistedBox(
    CornerA=item_5,
    CornerB=item_6,
    CornerC=item_7,
    CornerD=item_8,
    CornerE=item_9,
    CornerF=item_10,
    CornerG=item_11,
    CornerH=item_12)
mesh_3 = Mesh(mjoin)
mesh_4 = Mesh(conmesh_4)
voxels = ClusterOutput(tbox)  # Voxels to be filled with unit cells
quad_mesh = ClusterOutput(mesh_4)  # Quad mesh generated from the input mesh
offset_quad_mesh = ClusterOutput(mesh_3)  # Offset quad mesh generated from the input mesh

# ==== cluster SurfaceOffsetValue: Offset a surface with a point cloud and corrosponding values

resolution_v = ClusterInput()  # Resolution of points in V direction
surface = ClusterInput()  # Surface to offset
resolution_u = ClusterInput()  # Resolution of points in U direction
points = ClusterInput()  # List of points (flattened)
magnitude_max = ClusterInput()  # Magnitude of the offset (maximum value)
influence = ClusterInput()  # Smoothed range of attractor influence (0-1)
values = ClusterInput()  # Values that correspond to points (flattened)
magnitude_min = ClusterInput()  # Magnitude of the offset (minimum value)
distance_influence = ClusterInput()  # If true the distance between the points and voxels will affect the magnitude
sdivide = DivideSurface(Surface=surface, UCount=resolution_u, VCount=resolution_v)  # -> Points, Normals, Parameters
pt = Point(points)
num = Number(values)
bnd = Bounds(Numbers=num)
dom = ConstructDomain(DomainStart=magnitude_min, DomainEnd=magnitude_max)
cp = ClosestPoint(Point=sdivide.Points, Cloud=pt)  # -> ClosestPoint, CPIndex, Distance
remap = RemapNumbers(Value=num, Source=bnd, Target=dom)  # -> Mapped, Clipped
expression = Expression(x=influence, y=cp.Distance, Expression="-1*e^(-x*y)")
item = ListItem(List=remap.Mapped, Index=cp.CPIndex, Wrap=True)
panel = Panel("SURFACE OFFSET VALUE")
bnd_2 = Bounds(Numbers=flatten(expression))
remap_2 = RemapNumbers(Value=expression, Source=bnd_2, Target="1 to 0")  # -> Mapped, Clipped
not = GateNot(A=distance_influence)
multiplication = Multiplication(A=item, B=remap_2.Mapped)
cull = CullPattern(List=item, CullPattern=not)
cull_2 = CullPattern(List=multiplication, CullPattern=distance_influence)
amp = Amplitude(Vector=sdivide.Normals, Amplitude=[cull_2, cull])
move = Move(Geometry=sdivide.Points, Motion=amp)  # -> Geometry, Transform
srfgrid = SurfaceFromPoints(Points=flatten(move.Geometry), UCount=expr("x+1", resolution_u), Interpolate=False)
offest_surface = ClusterOutput(srfgrid)  # Offset Surface

# ==== cluster SurfaceOffsetAttractor: Offset a surface with attractor(s)

lower_limit = ClusterInput()  # Smoothing of the surface closest to the attractor
attractor = ClusterInput()  # Any geometry to use as attractor(s)
magnitude_min = ClusterInput()  # Magnitude of the offset (minimum value)
magnitude_max = ClusterInput()  # Magnitude of the offset (maximum value)
resolution_v = ClusterInput()  # Resolution of points in V direction
surface = ClusterInput()  # Surface to offset
resolution_u = ClusterInput()  # Resolution of points in U direction
influence = ClusterInput()  # Smoothed range of attractor influence (0-1)
geo = Geometry(attractor)
num = Number(resolution_v)
num_2 = Number(lower_limit)
num_3 = Number(resolution_u)
num_4 = Number(influence)
srf = Surface(surface)
num_5 = Number(magnitude_min)
num_6 = Number(magnitude_max)
series = Series(Start=0, Step=1, Count=expr("x+1", num))
series_2 = Series(Start=0, Step=1, Count=expr("x+1", num_3))
sdivide = DivideSurface(Surface=srf, UCount=num_3, VCount=num)  # -> Points, Normals, Parameters
crossref = CrossReference(ListA=graft(series_2), ListB=series, CrossMode=1)  # -> ListA, ListB
panel = Panel("SURFACE OFFSET ATTRACTOR")
pull = PullPoint(Point=sdivide.Points, Geometry=geo, ClosestOnly=True)  # -> ClosestPoint, Distance
smaller = SmallerThan(FirstNumber=pull.Distance, SecondNumber=num_2)  # -> SmallerThan, OrEqualTo
cull = CullPattern(List=crossref.ListB, CullPattern=smaller.SmallerThan)
replace = ReplaceItems(List=pull.Distance, Item="0", Indices=cull, Wrap=False)
expression = Expression(x=num_4, y=replace, Expression="-1*e^(-x*y)")
bnd = Bounds(Numbers=flatten(expression))
dom = ConstructDomain(DomainStart=num_5, DomainEnd=num_6)
remap = RemapNumbers(Value=expression, Source=bnd, Target=dom)  # -> Mapped, Clipped
amp = Amplitude(Vector=sdivide.Normals, Amplitude=remap.Mapped)
move = Move(Geometry=sdivide.Points, Motion=amp)  # -> Geometry, Transform
srfgrid = SurfaceFromPoints(Points=flatten(move.Geometry), UCount=expr("x+1", num_3), Interpolate=False)
offest_surface = ClusterOutput(srfgrid)  # Offset Surface

# ==== cluster MeshOffsetAttractor: Offset mesh triangles into voxels with attractor(s)

magnitude_min = ClusterInput()  # Magnitude of the offset (minimum value)
magnitude_max = ClusterInput()  # Magnitude of the offset (maximum value)
influence = ClusterInput()  # Smoothed range of attractor influence (0-1)
attractor = ClusterInput()  # Any geometry to use as attractor(s)
mesh = ClusterInput()  # Mesh to offset
lower_limit = ClusterInput()  # Smoothing of the surface closest to the attractor
num = Number(influence)
geo = Geometry(attractor)
mesh_2 = Mesh(mesh)
num_2 = Number(lower_limit)
num_3 = Number(magnitude_min)
num_4 = Number(magnitude_max)
weld = WeldMesh(Mesh=mesh_2, Angle=3.141592654)
dom = ConstructDomain(DomainStart=num_3, DomainEnd=num_4)
demesh = DeconstructMesh(Mesh=weld)  # -> Vertices, Faces, Colours, Normals
deface = DeconstructFace(Face=demesh.Faces)  # -> CornerA, CornerB, CornerC, CornerD
item = ListItem(List=demesh.Vertices, Index=deface.CornerB, Wrap=True)
item_2 = ListItem(List=demesh.Vertices, Index=deface.CornerC, Wrap=True)
item_3 = ListItem(List=demesh.Vertices, Index=deface.CornerA, Wrap=True)
addition = Addition(A=item_3, B=item)
addition_2 = Addition(A=item_3, B=item_2)
addition_3 = Addition(A=item, B=item_2)
bcentric = Barycentric(PointA=item_3, PointB=item, PointC=item_2, CoordinateU=1, CoordinateV=1, CoordinateW=1)
division = Division(A=addition, B="2")
division_2 = Division(A=addition_3, B="2")
division_3 = Division(A=addition_2, B="2")
entwine = Entwine(Branch00=item_3, Branch01=division, Branch02=bcentric, Branch03=division_3, FlattenInputs=True)
entwine_2 = Entwine(Branch00=item, Branch01=division_2, Branch02=bcentric, Branch03=division, FlattenInputs=True)
entwine_3 = Entwine(Branch00=item_2, Branch01=division_3, Branch02=bcentric, Branch03=division_2, FlattenInputs=True)
flip = FlipMatrix(Data=entwine)
flip_2 = FlipMatrix(Data=entwine_3)
flip_3 = FlipMatrix(Data=entwine_2)
quad = MeshQuad(CornerA=0, CornerB=1, CornerC=2, CornerD=3)
quad_2 = MeshQuad(CornerA=0, CornerB=1, CornerC=2, CornerD=3)
quad_3 = MeshQuad(CornerA=0, CornerB=1, CornerC=2, CornerD=3)
panel = Panel("MESH OFFSET ATTRACTOR")
conmesh = ConstructMesh(Vertices=flip_2, Faces=quad)
conmesh_2 = ConstructMesh(Vertices=flip_3, Faces=quad_2)
conmesh_3 = ConstructMesh(Vertices=flip, Faces=quad_3)
mjoin = MeshJoin(Meshes=flatten([conmesh_3, conmesh_2, conmesh]))
demesh_2 = DeconstructMesh(Mesh=mjoin)  # -> Vertices, Faces, Colours, Normals
meshcp = MeshClosestPoint(Point=demesh_2.Vertices, Mesh=weld)  # -> Point, Index, Parameter
pull = PullPoint(Point=demesh_2.Vertices, Geometry=geo, ClosestOnly=True)  # -> ClosestPoint, Distance
lng = ListLength(List=pull.Distance)
meval = MeshEval(Mesh=weld, Parameter=meshcp.Parameter)  # -> Point, Normal, Colour
series = Series(Start=0, Step=1, Count=lng)
smaller = SmallerThan(FirstNumber=pull.Distance, SecondNumber=num_2)  # -> SmallerThan, OrEqualTo
cull = CullPattern(List=series, CullPattern=smaller.SmallerThan)
replace = ReplaceItems(List=pull.Distance, Item="0", Indices=cull, Wrap=False)
expression = Expression(x=num, y=replace, Expression="-1*e^(-x*y)")
bnd = Bounds(Numbers=expression)
remap = RemapNumbers(Value=expression, Source=bnd, Target=dom)  # -> Mapped, Clipped
amp = Amplitude(Vector=meval.Normal, Amplitude=remap.Mapped)
move = Move(Geometry=demesh_2.Vertices, Motion=amp)  # -> Geometry, Transform
conmesh_4 = ConstructMesh(Vertices=move.Geometry, Faces=demesh_2.Faces)
demesh_3 = DeconstructMesh(Mesh=mjoin)  # -> Vertices, Faces, Colours, Normals
demesh_4 = DeconstructMesh(Mesh=conmesh_4)  # -> Vertices, Faces, Colours, Normals
deface_2 = DeconstructFace(Face=demesh_3.Faces)  # -> CornerA, CornerB, CornerC, CornerD
deface_3 = DeconstructFace(Face=demesh_4.Faces)  # -> CornerA, CornerB, CornerC, CornerD
item_4 = ListItem(List=demesh_4.Vertices, Index=deface_3.CornerA, Wrap=True)
item_5 = ListItem(List=demesh_4.Vertices, Index=deface_3.CornerB, Wrap=True)
item_6 = ListItem(List=demesh_4.Vertices, Index=deface_3.CornerC, Wrap=True)
item_7 = ListItem(List=demesh_4.Vertices, Index=deface_3.CornerD, Wrap=True)
item_8 = ListItem(List=demesh_3.Vertices, Index=deface_2.CornerA, Wrap=True)
item_9 = ListItem(List=demesh_3.Vertices, Index=deface_2.CornerB, Wrap=True)
item_10 = ListItem(List=demesh_3.Vertices, Index=deface_2.CornerC, Wrap=True)
item_11 = ListItem(List=demesh_3.Vertices, Index=deface_2.CornerD, Wrap=True)
tbox = TwistedBox(
    CornerA=item_4,
    CornerB=item_5,
    CornerC=item_6,
    CornerD=item_7,
    CornerE=item_8,
    CornerF=item_9,
    CornerG=item_10,
    CornerH=item_11)
mesh_3 = Mesh(conmesh_4)
mesh_4 = Mesh(mjoin)
voxels = ClusterOutput(tbox)  # Voxels to be filled with unit cells
quad_mesh = ClusterOutput(mesh_3)  # Quad mesh generated from the input mesh
offset_quad_mesh = ClusterOutput(mesh_4)  # Offset quad mesh generated from the input mesh

# ==== cluster MergeCurves: Merge endpoints of curves by distance.

max_distance = ClusterInput()  # Maximum distance to merge
lattice = ClusterInput()  # Lattice to merge
crv = Curve(lattice)
num = Number(max_distance)
cp = ControlPoints(Curve=crv)  # -> Points, Weights, Knots
cullpt = CullDuplicates(Points=flatten(cp.Points), Tolerance=num, CullMode=3)  # -> Points, Indices, Valence
fsim = FindSimilarMember(Data=cp.Points, Set=cullpt.Points)  # -> Hit, Index
panel = Panel("MERGE CURVES")
pline = PolyLine(Vertices=fsim.Hit, Closed=False)  # -> flatten(Polyline)
len = Length(Curve=pline)
larger = LargerThan(FirstNumber=len, SecondNumber="0")  # -> LargerThan, OrEqualTo
cull = CullPattern(List=pline, CullPattern=larger.LargerThan)
lattice_2 = ClusterOutput(cull)  # Merged lattice

# ==== cluster TweenCellFill: Fill voxels with morphed lattice unit cells

unit_cell_2 = ClusterInput()  # Unit cell to populate voxels
unit_cell_1 = ClusterInput()  # Unit cell to populate voxels
value = ClusterInput()  # Value from 0-1 corresponding to each voxel
voxels = ClusterInput()  # Voxels to be filled with unit cells
num = Number(value)
flip = FlipCurve(Curve=unit_cell_1, Guide=unit_cell_2)  # -> Curve, Flag
tweencrv = TweenCurve(CurveA=flip.Curve, CurveB=unit_cell_2, Factor=graft(num), BlendType=0)
panel = Panel("TWEEN CELL FILL")
bbox = BoundingBox(Content=tweencrv, Plane=PlaneXY(0, 0, 0), UnionBox=True)  # -> Box, Box_2
morph = BoxMorph(Geometry=tweencrv, Reference=bbox.Box, Target=graft(voxels))  # -> flatten(Geometry)
line = Line(morph)
remove_duplicate_lines = RemoveDuplicateLines(lattice_l=flatten(line))
lattice = ClusterOutput(remove_duplicate_lines)  # List of curves that make up the lattice

# ==== cluster RemoveFloating_2: Remove floating curves with no connections

lattice = ClusterInput()  # Lattice curves to filter
crv = Curve(flatten(lattice))
join = JoinCurves(Curves=crv, Preserve=False)
cp = ControlPoints(Curve=join)  # -> Points, Weights, Knots
panel = Panel("REMOVE FLOATING CURVES")
lng = ListLength(List=cp.Points)
larger = LargerThan(FirstNumber=lng, SecondNumber="3")  # -> flatten(LargerThan), OrEqualTo
cull = CullPattern(List=join, CullPattern=larger.LargerThan)
explode = Explode(Curve=cull, Recursive=True)  # -> flatten(Segments), Vertices
lattice_2 = ClusterOutput(explode.Segments)  # Filtered lattice

# ==== cluster VoxelizeParameter: Fill a volume with varying sized voxels

plane = ClusterInput()  # Base plane for voxels
geometry = ClusterInput()  # Geometry to voxelize
x_parameter = ClusterInput()  # Range of numbers (0-1) for X divisions of the bounding box
y_parameter = ClusterInput()  # Range of numbers (0-1) for Y divisions of the bounding box
z_parameter = ClusterInput()  # Range of numbers (0-1) for Z divisions of the bounding box
fill_completely = ClusterInput()  # If true, Voxels will fill entire volume. If false, only Voxels with their centroid within the volume will be kept.
mesh = Mesh(geometry)
pln = Plane(plane)
num = Number(y_parameter)
bool = Boolean(fill_completely)
num_2 = Number(x_parameter)
num_3 = Number(z_parameter)
bbox = BoundingBox(Content=mesh, Plane=pln)  # -> Box, Box_2
edges = BrepEdges(Brep=bbox.Box)  # -> Naked, Interior, NonManifold
crossref = CrossReference(ListA=num, ListB=num_3, CrossMode=1)  # -> ListA, ListB
item = ListItem(List=edges.Interior, Index="8", Wrap=True)
toggle = BooleanToggle(False)
toggle_2 = BooleanToggle(True)
item_2 = ListItem(List=edges.Interior, Index="1", Wrap=True)
item_3 = ListItem(List=edges.Interior, Index="0", Wrap=True)
box = EvaluateBox(Box=bbox.Box, UParameter=graft(num_2), VParameter=crossref.ListA, WParameter=crossref.ListB)  # -> Plane, Point, Include
len = Length(Curve=item_2)
len_2 = Length(Curve=item_3)
len_3 = Length(Curve=item)
dom = ConstructDomain(DomainStart=0, DomainEnd=len)
dom_2 = ConstructDomain(DomainStart=0, DomainEnd=len_2)
dom_3 = ConstructDomain(DomainStart=0, DomainEnd=len_3)
remap = RemapNumbers(Value=num, Source=Domain(0, 1), Target=dom)  # -> Mapped, Clipped
remap_2 = RemapNumbers(Value=num_2, Source=Domain(0, 1), Target=dom_2)  # -> Mapped, Clipped
remap_3 = RemapNumbers(Value=num_3, Source=Domain(0, 1), Target=dom_3)  # -> Mapped, Clipped
shift = ShiftList(List=remap.Mapped, Shift="-1", Wrap=toggle)
shift_2 = ShiftList(List=remap.Mapped, Shift="1", Wrap=toggle)
shift_3 = ShiftList(List=remap_2.Mapped, Shift="-1", Wrap=toggle)
shift_4 = ShiftList(List=remap_2.Mapped, Shift="1", Wrap=toggle)
shift_5 = ShiftList(List=remap_3.Mapped, Shift="-1", Wrap=toggle)
shift_6 = ShiftList(List=remap_3.Mapped, Shift="1", Wrap=toggle)
subtraction = Subtraction(A=shift_2, B=shift)
subtraction_2 = Subtraction(A=shift_4, B=shift_3)
subtraction_3 = Subtraction(A=shift_6, B=shift_5)
division = Division(A=subtraction, B="2")
division_2 = Division(A=subtraction_2, B="2")
division_3 = Division(A=subtraction_3, B="2")
shift_7 = ShiftList(List=division, Shift="1", Wrap=toggle_2)
neg = Negative(Value=division)
neg_2 = Negative(Value=division_2)
shift_8 = ShiftList(List=division_2, Shift="1", Wrap=toggle_2)
shift_9 = ShiftList(List=division_3, Shift="1", Wrap=toggle_2)
neg_3 = Negative(Value=division_3)
panel = Panel("VOXELIZE (parameter)")
dom_4 = ConstructDomain(DomainStart=neg, DomainEnd=division)
dom_5 = ConstructDomain(DomainStart=neg, DomainEnd=shift_7)
dom_6 = ConstructDomain(DomainStart=neg_2, DomainEnd=division_2)
dom_7 = ConstructDomain(DomainStart=neg_2, DomainEnd=shift_8)
dom_8 = ConstructDomain(DomainStart=neg_3, DomainEnd=division_3)
dom_9 = ConstructDomain(DomainStart=neg_3, DomainEnd=shift_9)
rev = ReverseList(List=dom_4)
rev_2 = ReverseList(List=dom_6)
shift_10 = ShiftList(List=dom_5, Shift="-1", Wrap=toggle)
shift_11 = ShiftList(List=dom_7, Shift="-1", Wrap=toggle)
rev_3 = ReverseList(List=dom_8)
item_4 = ListItem(List=dom_4, Index=0, Wrap=True)
shift_12 = ShiftList(List=dom_9, Shift="-1", Wrap=toggle)
item_5 = ListItem(List=dom_6, Index=0, Wrap=True)
item_6 = ListItem(List=rev, Index=0, Wrap=True)
item_7 = ListItem(List=rev_2, Index=0, Wrap=True)
item_8 = ListItem(List=dom_8, Index=0, Wrap=True)
item_9 = ListItem(List=rev_3, Index=0, Wrap=True)
entwine = Entwine(Branch00=item_4, Branch01=shift_10, Branch02=item_6, FlattenInputs=True)  # -> flatten(Result)
entwine_2 = Entwine(Branch00=item_5, Branch01=shift_11, Branch02=item_7, FlattenInputs=True)  # -> flatten(Result)
entwine_3 = Entwine(Branch00=item_8, Branch01=shift_12, Branch02=item_9, FlattenInputs=True)  # -> flatten(Result)
sort = SortList(Keys=flatten([subtraction_3, subtraction, subtraction_2]))  # -> Keys, ValuesA
crossref_2 = CrossReference(ListA=entwine, ListB=entwine_3, CrossMode=1)  # -> ListA, ListB
rev_4 = ReverseList(List=sort.Keys)
box_2 = DomainBox(Base=simplify(box.Plane), X=graft(entwine_2), Y=crossref_2.ListA, Z=crossref_2.ListB)
item_10 = ListItem(List=rev_4, Index=0, Wrap=True)
minc = MeshInclusion(Mesh=mesh, Point=box.Plane, Strict=False)
cull = CullPattern(List=box_2, CullPattern=minc)
meshcp = MeshClosestPoint(Point=box.Plane, Mesh=mesh)  # -> Point, Index, Parameter
dist = Distance(PointA=box.Plane, PointB=meshcp.Point)
expression = Expression(a=item_10, d=dist, Expression="if(d<sqrt(2*(a/2)^2),True,False)")
cull_2 = CullPattern(List=box_2, CullPattern=expression)
cull_3 = CullPattern(List=cull_2, CullPattern=bool)
merge = Merge(Data1=cull, Data2=cull_3)
voxels = ClusterOutput(merge)  # Voxels to be filled with unit cells

# ==== cluster MorphBetweenSurfaces_2: Conformal fill of voxels between two or more surfaces

x_parameter = ClusterInput()  # Range of numbers (0-1) for X divisions
z_parameter = ClusterInput()  # Range of numbers (0-1) for Z divisions
surfaces = ClusterInput()  # At least 2 surfaces to morph voxels between
y_parameter = ClusterInput()  # Range of numbers (0-1) for Y divisions
srf = Surface(flatten(surfaces))
num = Number(y_parameter)
num_2 = Number(x_parameter)
num_3 = Number(z_parameter)
pt = ConstructPoint(XCoordinate=simplify(graft(num_2)), YCoordinate=simplify(num), ZCoordinate=0)  # -> simplify(Point)
lng = ListLength(List=num_2)
num_4 = Number(lng)
evalsrf = EvaluateSurface(Surface=reparameterize(simplify(srf)), Point=simplify(graft(pt)))  # -> simplify(Point), Normal, Frame
pline = PolyLine(Vertices=evalsrf.Point, Closed=False)
eval = EvaluateCurve(Curve=reparameterize(pline), Parameter=num_3)  # -> Point, Tangent, Angle
path_mapper = PathMapper(eval.Point, source="{A;B}(i)", target="{B;A}(i)")
path_mapper_2 = PathMapper(path_mapper, source="{A;B}", target="{path_index}")
toggle = BooleanToggle(False)
shift = ShiftList(List=path_mapper_2, Shift="1", Wrap=toggle)
shift_2 = ShiftList(List=path_mapper_2, Shift="-1", Wrap=toggle)
flip = FlipMatrix(Data=shift)
flip_2 = FlipMatrix(Data=shift_2)
partition = PartitionList(List=flip_2, Size=num_4)
partition_2 = PartitionList(List=flip, Size=num_4)
shift_3 = ShiftList(List=partition, Shift="-1", Wrap=toggle)  # -> simplify(List)
shift_4 = ShiftList(List=partition, Shift="1", Wrap=toggle)  # -> simplify(List)
shift_5 = ShiftList(List=partition_2, Shift="1", Wrap=toggle)  # -> simplify(List)
shift_6 = ShiftList(List=partition_2, Shift="-1", Wrap=toggle)  # -> simplify(List)
path_mapper_3 = PathMapper(shift_4, source="{A;B}(i)", target="{A;i}(B)")
path_mapper_4 = PathMapper(shift_3, source="{A;B}(i)", target="{A;i}(B)")
path_mapper_5 = PathMapper(shift_5, source="{A;B}(i)", target="{A;i}(B)")
path_mapper_6 = PathMapper(shift_6, source="{A;B}(i)", target="{A;i}(B)")
shift_7 = ShiftList(List=path_mapper_4, Shift="-1", Wrap=toggle)
shift_8 = ShiftList(List=path_mapper_3, Shift="1", Wrap=toggle)
shift_9 = ShiftList(List=path_mapper_3, Shift="-1", Wrap=toggle)
shift_10 = ShiftList(List=path_mapper_6, Shift="-1", Wrap=toggle)
shift_11 = ShiftList(List=path_mapper_4, Shift="1", Wrap=toggle)
shift_12 = ShiftList(List=path_mapper_5, Shift="1", Wrap=toggle)
shift_13 = ShiftList(List=path_mapper_5, Shift="-1", Wrap=toggle)
shift_14 = ShiftList(List=path_mapper_6, Shift="1", Wrap=toggle)
tbox = TwistedBox(
    CornerA=shift_11,
    CornerB=shift_7,
    CornerC=shift_9,
    CornerD=shift_8,
    CornerE=shift_14,
    CornerF=shift_10,
    CornerG=shift_13,
    CornerH=shift_12)
voxels = ClusterOutput(tbox)  # Voxels to be filled with unit cells

# ==== cluster LTCXParser: Reads a LTCX file and outputs beams and radii

ltcx_file = ClusterInput()  # File path of .ltcx file
enable_beams = ClusterInput()  # Enable beam curves (boolean)
bool = Boolean(enable_beams)
file = ReadFile(F=ltcx_file, PerLineParse=True)  # -> C
#   port F: Uri of file to read
# ---------- file: VB line parser ----------
    action = GH_LineParserAction.Include
    Return line

    'Parse the line and return some data that represents the line.
    'If the line cannot be parsed, you can return Nothing and
    'assign a different action.
    'The default implementation is to just return the line itself.
    'If you return types that implement IGH_Goo, this component
    'will work substantially faster.
# ---------- end file ----------
fsim = FindSimilarMember(Data="</beamgroup>", Set=file)  # -> Hit, Index
panel = Panel(file)
fsim_2 = FindSimilarMember(Data="<beamgroup>", Set=file)  # -> Hit, Index
fsim_3 = FindSimilarMember(Data="<nodegroup>", Set=file)  # -> Hit, Index
fsim_4 = FindSimilarMember(Data="</nodegroup>", Set=file)  # -> Hit, Index
subtraction = Subtraction(A=fsim.Index, B=fsim_2.Index)
subtraction_2 = Subtraction(A=fsim_4.Index, B=fsim_3.Index)
series = Series(Start=expr("x+1", fsim_2.Index), Step=1, Count=expr("x-1", subtraction))
series_2 = Series(Start=expr("x+1", fsim_3.Index), Step=1, Count=expr("x-1", subtraction_2))
item = ListItem(List=file, Index=series, Wrap=True)
item_2 = ListItem(List=file, Index=series_2, Wrap=True)
split = TextSplit(Text=item, Separators="\"\"")
split_2 = TextSplit(Text=item_2, Separators="\"\"")
panel_2 = Panel("LTCX Parser")
dispatch = Dispatch(List=split, DispatchPattern=[True, False])  # -> ListA, ListB
dispatch_2 = Dispatch(List=split_2, DispatchPattern=[True, False])  # -> ListA, ListB
item_3 = ListItem(List=dispatch.ListB, Index="0", Wrap=True)
item_4 = ListItem(List=dispatch.ListB, Index="1", Wrap=True)
item_5 = ListItem(List=dispatch_2.ListB, Index="0", Wrap=True)
item_6 = ListItem(List=dispatch_2.ListB, Index="1", Wrap=True)
item_7 = ListItem(List=dispatch.ListB, Index="2", Wrap=True)
item_8 = ListItem(List=dispatch_2.ListB, Index="2", Wrap=True)
item_9 = ListItem(List=dispatch_2.ListB, Index="3", Wrap=True)
item_10 = ListItem(List=dispatch_2.ListB, Index="4", Wrap=True)
node_id = Panel(item_5)
pt = ConstructPoint(XCoordinate=item_6, YCoordinate=item_8, ZCoordinate=item_9)  # -> flatten(Point)
end = Panel(item_7)
start = Panel(item_4)
beam_id = Panel(item_3)
radius = Panel(item_10)
num = Number(flatten(item_10))
pt_2 = Point(pt)
merge = Merge(Data1=item_4, Data2=item_7)  # -> simplify(Result)
item_11 = ListItem(List=item_10, Index=item_7, Wrap=True)
item_12 = ListItem(List=item_10, Index=item_4, Wrap=True)
item_13 = ListItem(List=pt, Index=item_4, Wrap=True)
item_14 = ListItem(List=pt, Index=item_7, Wrap=True)
num_2 = Number(item_12)
cull = CullPattern(List=item_14, CullPattern=bool)
num_3 = Number(item_11)
node_radius = ClusterOutput(num)  # Radius at node (number)
node = ClusterOutput(pt_2)  # Nodes (point)
ln = Line(StartPoint=item_13, EndPoint=cull)
line_point_connections = ClusterOutput(merge)  # Index of points that make up each beam
avr = Average(Input=[num_2, num_3])
line = Line(ln)
beam_radius = ClusterOutput(avr)  # Beam radius (average of two nodes)
beam_curves = ClusterOutput(line)  # Connections between nodes (line)

# ==== cluster ConformalRibParameter: Create a row of varying length voxels along a cuve on a surface

width_paramter = ClusterInput()  # Parameter for Voxel width (0-1)
height_domain = ClusterInput()  # Domain of Voxel Height (Domain)
height_paramter = ClusterInput()  # Parameter for Voxel Height (0-1)
geometry = ClusterInput()  # Geometry to conform to
curve = ClusterInput()  # Curve to voxelize
periodic = ClusterInput()  # Is curve closed? (Boolean)
division_paramter = ClusterInput()  # Parameter for Voxel Divisions (0-1)
width_domain = ClusterInput()  # Domain of Voxel Width (Domain)
crv = Curve(reparameterize(curve))
bool = Boolean(periodic)
domain = Domain(height_domain)
num = Number(height_paramter)
geo = Geometry(geometry)
num_2 = Number(division_paramter)
num_3 = Number(width_paramter)
domain_2 = Domain(width_domain)
lng = ListLength(List=num_2)
multiplication = Multiplication(A=lng, B="2")
divide = DivideCurve(Curve=reparameterize(crv), Count=multiplication, Kinks=False)  # -> Points, Tangents, Parameters
intcrv = Interpolate(Vertices=divide.Points, Degree=3, Periodic=bool, KnotStyle=1)  # -> Curve, Length, Domain
mesh = Mesh(geo)
pframe = PerpFrame(Curve=reparameterize(intcrv.Curve), Parameter=num_2)
pln = Plane(pframe)
meshcp = MeshClosestPoint(Point=pln, Mesh=mesh)  # -> Point, Index, Parameter
remap = RemapNumbers(Value=num_3, Source=Domain(0, 1), Target=domain_2)  # -> Mapped, Clipped
remap_2 = RemapNumbers(Value=num, Source=Domain(0, 1), Target=domain)  # -> Mapped, Clipped
meval = MeshEval(Mesh=mesh, Parameter=meshcp.Parameter)  # -> Point, Normal, Colour
deplane = DeconstructPlane(Plane=pln)  # -> Origin, XAxis, YAxis, ZAxis
division = Division(A=remap.Mapped, B="2")
neg = Negative(Value=division)
panel = Panel("Surface Conformal Ribs")
dom = ConstructDomain(DomainStart="0", DomainEnd=remap_2.Mapped)
line = LineSDL(Start=deplane.Origin, Direction=meval.Normal, Length="10")
line_2 = LineSDL(Start=deplane.Origin, Direction=deplane.XAxis, Length="10")
dom_2 = ConstructDomain(DomainStart=neg, DomainEnd=division)
angle = Angle(VectorA=line_2, VectorB=line, Plane=pln)  # -> Angle, Reflex
prot = RotatePlane(Plane=pln, Angle=angle.Angle)
rectangle = Rectangle(Plane=prot, XSize=dom, YSize=dom_2, Radius=0)  # -> Rectangle, Length
disc = Discontinuity(Curve=rectangle.Rectangle, Level=1)  # -> simplify(Points), Parameters
toggle = BooleanToggle(False)
flip = FlipMatrix(Data=disc.Points)
shift = ShiftList(List=flip, Shift="-1", Wrap=toggle)
shift_2 = ShiftList(List=flip, Shift="1", Wrap=toggle)
flip_2 = FlipMatrix(Data=shift)
flip_3 = FlipMatrix(Data=shift_2)
item = ListItem(List=flip_2, Index="1", Wrap=True)
item_2 = ListItem(List=flip_3, Index="1", Wrap=True)
item_3 = ListItem(List=flip_2, Index="0", Wrap=True)
item_4 = ListItem(List=flip_2, Index="3", Wrap=True)
item_5 = ListItem(List=flip_3, Index="3", Wrap=True)
item_6 = ListItem(List=flip_2, Index="2", Wrap=True)
item_7 = ListItem(List=flip_3, Index="2", Wrap=True)
item_8 = ListItem(List=flip_3, Index="0", Wrap=True)
tbox = TwistedBox(
    CornerA=item_3,
    CornerB=item,
    CornerC=item_6,
    CornerD=item_4,
    CornerE=item_8,
    CornerF=item_2,
    CornerG=item_7,
    CornerH=item_5)
voxels = ClusterOutput(tbox)  # Voxels to be filled with unit cells

# ==== cluster VoxelizeDistance: Fill a volume with equal sized voxels

voxel_size_x = ClusterInput()  # Voxel size int the X direction
voxel_size_y = ClusterInput()  # Voxel size int the Y direction
voxel_size_z = ClusterInput()  # Voxel size int the Z direction
plane = ClusterInput()  # Base plane for voxels
geometry = ClusterInput()  # Geometry to voxelize
fill_completely = ClusterInput()  # If true, Voxels will fill entire volume. If false, only Voxels with their centroid within the volume will be kept.
mesh = Mesh(geometry)
pln = Plane(plane)
num = Number(voxel_size_x)
num_2 = Number(voxel_size_y)
num_3 = Number(voxel_size_z)
bool = Boolean(fill_completely)
bbox = BoundingBox(Content=mesh, Plane=pln)  # -> Box, Box_2
edges = BrepEdges(Brep=bbox.Box)  # -> Naked, Interior, NonManifold
item = ListItem(List=edges.Interior, Index="8", Wrap=True)
item_2 = ListItem(List=edges.Interior, Index="1", Wrap=True)
item_3 = ListItem(List=edges.Interior, Index="0", Wrap=True)
divlength = DivideLength(Curve=reparameterize(item_2), Length=num_2)  # -> Points, Tangents, Parameters
divlength_2 = DivideLength(Curve=reparameterize(item_3), Length=num)  # -> Points, Tangents, Parameters
divlength_3 = DivideLength(Curve=reparameterize(item), Length=num_3)  # -> Points, Tangents, Parameters
reldif = RelativeDifferences(Values=divlength.Parameters)
reldif_2 = RelativeDifferences(Values=divlength_2.Parameters)
reldif_3 = RelativeDifferences(Values=divlength_3.Parameters)
item_4 = ListItem(List=reverse(divlength.Parameters), Index=0, Wrap=True)
item_5 = ListItem(List=reverse(reldif), Index=0, Wrap=True)
item_6 = ListItem(List=reverse(divlength_2.Parameters), Index=0, Wrap=True)
item_7 = ListItem(List=reverse(reldif_2), Index=0, Wrap=True)
item_8 = ListItem(List=reverse(divlength_3.Parameters), Index=0, Wrap=True)
item_9 = ListItem(List=reverse(reldif_3), Index=0, Wrap=True)
addition = Addition(A=item_5, B=item_4)
addition_2 = Addition(A=item_7, B=item_6)
addition_3 = Addition(A=item_9, B=item_8)
merge = Merge(Data1=divlength.Parameters, Data2=addition)
merge_2 = Merge(Data1=divlength_2.Parameters, Data2=addition_2)
merge_3 = Merge(Data1=divlength_3.Parameters, Data2=addition_3)
crossref = CrossReference(ListA=merge, ListB=merge_3, CrossMode=1)  # -> ListA, ListB
box = EvaluateBox(Box=bbox.Box, UParameter=graft(merge_2), VParameter=crossref.ListA, WParameter=crossref.ListB)  # -> Plane, Point, Include
panel = Panel("Voxelize")
division = Division(A=num_3, B="2")
division_2 = Division(A=num_2, B="2")
division_3 = Division(A=num, B="2")
neg = Negative(Value=division)
neg_2 = Negative(Value=division_2)
neg_3 = Negative(Value=division_3)
dom = ConstructDomain(DomainStart=neg, DomainEnd=division)
dom_2 = ConstructDomain(DomainStart=neg_2, DomainEnd=division_2)
dom_3 = ConstructDomain(DomainStart=neg_3, DomainEnd=division_3)
crossref_2 = CrossReference(ListA=dom_2, ListB=dom, CrossMode=1)  # -> ListA, ListB
box_2 = DomainBox(Base=simplify(box.Plane), X=graft(dom_3), Y=crossref_2.ListA, Z=crossref_2.ListB)
minc = MeshInclusion(Mesh=mesh, Point=box.Plane, Strict=False)
sort = SortList(Keys=[num, num_2, num_3])  # -> Keys, ValuesA
cull = CullPattern(List=box_2, CullPattern=minc)
meshcp = MeshClosestPoint(Point=box.Plane, Mesh=mesh)  # -> Point, Index, Parameter
dist = Distance(PointA=box.Plane, PointB=meshcp.Point)
expression = Expression(a=sort.Keys, d=dist, Expression="if(d<sqrt(2*(a/2)^2),True,False)")
cull_2 = CullPattern(List=box_2, CullPattern=expression)
cull_3 = CullPattern(List=cull_2, CullPattern=bool)
merge_4 = Merge(Data1=cull, Data2=cull_3)
voxels = ClusterOutput(merge_4)  # Voxels to be filled with unit cells

# ==== cluster MeshOffestParameter: Offset a mesh a uniform distance

triangulated = ClusterInput()  # True if mesh is triangulated. False if mesh is quads.
mesh = ClusterInput()  # Mesh to offset
distance = ClusterInput()  # Offset distance
z_parameter = ClusterInput()  # Range of numbers (0-1) for Z divisions
bool = Boolean(triangulated)
mesh_2 = Mesh(mesh)
not = GateNot(A=bool)
cull = CullPattern(List=mesh_2, CullPattern=bool)
num = Number(z_parameter)
num_2 = Number(distance)
weld = WeldMesh(Mesh=cull, Angle=3.141592654)
demesh = DeconstructMesh(Mesh=weld)  # -> Vertices, Faces, Colours, Normals
deface = DeconstructFace(Face=demesh.Faces)  # -> CornerA, CornerB, CornerC, CornerD
item = ListItem(List=demesh.Vertices, Index=deface.CornerA, Wrap=True)
item_2 = ListItem(List=demesh.Vertices, Index=deface.CornerC, Wrap=True)
item_3 = ListItem(List=demesh.Vertices, Index=deface.CornerB, Wrap=True)
panel = Panel("0")
panel_2 = Panel("1")
panel_3 = Panel("2")
addition = Addition(A=item, B=item_3)
addition_2 = Addition(A=item, B=item_2)
addition_3 = Addition(A=item_3, B=item_2)
bcentric = Barycentric(PointA=item, PointB=item_3, PointC=item_2, CoordinateU=1, CoordinateV=1, CoordinateW=1)
panel_4 = Panel("A")
panel_5 = Panel("B")
panel_6 = Panel("C")
division = Division(A=addition, B="2")
division_2 = Division(A=addition_3, B="2")
division_3 = Division(A=addition_2, B="2")
panel_7 = Panel("Z")
entwine = Entwine(Branch00=item, Branch01=division, Branch02=bcentric, Branch03=division_3, FlattenInputs=True)
entwine_2 = Entwine(Branch00=item_3, Branch01=division_2, Branch02=bcentric, Branch03=division, FlattenInputs=True)
entwine_3 = Entwine(Branch00=item_2, Branch01=division_3, Branch02=bcentric, Branch03=division_2, FlattenInputs=True)
flip = FlipMatrix(Data=entwine)
flip_2 = FlipMatrix(Data=entwine_3)
flip_3 = FlipMatrix(Data=entwine_2)
quad = MeshQuad(CornerA=0, CornerB=1, CornerC=2, CornerD=3)
quad_2 = MeshQuad(CornerA=0, CornerB=1, CornerC=2, CornerD=3)
quad_3 = MeshQuad(CornerA=0, CornerB=1, CornerC=2, CornerD=3)
panel_8 = Panel("MESH OFFSET (parameter)")
conmesh = ConstructMesh(Vertices=flip_2, Faces=quad_2)
conmesh_2 = ConstructMesh(Vertices=flip_3, Faces=quad_3)
conmesh_3 = ConstructMesh(Vertices=flip, Faces=quad)
mjoin = MeshJoin(Meshes=flatten([conmesh_3, conmesh_2, conmesh]))
cull_2 = CullPattern(List=mesh_2, CullPattern=not)
demesh_2 = DeconstructMesh(Mesh=[cull_2, mjoin])  # -> Vertices, Faces, Colours, Normals
dom = ConstructDomain(DomainStart=0, DomainEnd=num_2)
meshcp = MeshClosestPoint(Point=demesh_2.Vertices, Mesh=mesh_2)  # -> Point, Index, Parameter
remap = RemapNumbers(Value=num, Source=Domain(0, 1), Target=dom)  # -> Mapped, Clipped
meval = MeshEval(Mesh=mesh_2, Parameter=meshcp.Parameter)  # -> Point, Normal, Colour
amp = Amplitude(Vector=meval.Normal, Amplitude=graft(remap.Mapped))
toggle = BooleanToggle(False)
move = Move(Geometry=demesh_2.Vertices, Motion=amp)  # -> Geometry, Transform
conmesh_4 = ConstructMesh(Vertices=move.Geometry, Faces=demesh_2.Faces)  # -> flatten(Mesh)
shift = ShiftList(List=flatten(conmesh_4), Shift="1", Wrap=toggle)
shift_2 = ShiftList(List=flatten(conmesh_4), Shift="-1", Wrap=toggle)
demesh_3 = DeconstructMesh(Mesh=shift_2)  # -> Vertices, Faces, Colours, Normals
demesh_4 = DeconstructMesh(Mesh=shift)  # -> Vertices, Faces, Colours, Normals
deface_2 = DeconstructFace(Face=demesh_4.Faces)  # -> CornerA, CornerB, CornerC, CornerD
deface_3 = DeconstructFace(Face=demesh_3.Faces)  # -> CornerA, CornerB, CornerC, CornerD
item_4 = ListItem(List=demesh_4.Vertices, Index=deface_2.CornerA, Wrap=True)
item_5 = ListItem(List=demesh_4.Vertices, Index=deface_2.CornerB, Wrap=True)
item_6 = ListItem(List=demesh_4.Vertices, Index=deface_2.CornerC, Wrap=True)
item_7 = ListItem(List=demesh_4.Vertices, Index=deface_2.CornerD, Wrap=True)
item_8 = ListItem(List=demesh_3.Vertices, Index=deface_3.CornerA, Wrap=True)
item_9 = ListItem(List=demesh_3.Vertices, Index=deface_3.CornerB, Wrap=True)
item_10 = ListItem(List=demesh_3.Vertices, Index=deface_3.CornerC, Wrap=True)
item_11 = ListItem(List=demesh_3.Vertices, Index=deface_3.CornerD, Wrap=True)
tbox = TwistedBox(
    CornerA=item_4,
    CornerB=item_5,
    CornerC=item_6,
    CornerD=item_7,
    CornerE=item_8,
    CornerF=item_9,
    CornerG=item_10,
    CornerH=item_11)  # -> flatten(TwistedBox)
mesh_3 = Mesh(conmesh_4)
quad_meshes = ClusterOutput(mesh_3)  # Quad meshes generated from the input mesh
voxels = ClusterOutput(tbox)  # Voxels to be filled with unit cells

# ==== cluster MeshOffsetValue_2: Offset a mesh using a set of points and values

# ----
# MESH OFFSET VALUE (parameter)
triangulated = ClusterInput()  # True if mesh is triangulated. False if mesh is quads.
magnitude_max = ClusterInput()  # Magnitude of the offset (maximum value)
influence = ClusterInput()  # Smoothed range of attractor influence (0-1)
values = ClusterInput()  # Values that correspond to points (flattened)
magnitude_min = ClusterInput()  # Magnitude of the offset (minimum value)
distance_influence = ClusterInput()  # If true the distance between the points and voxels will affect the magnitude
points = ClusterInput()  # List of points (flattened)
mesh = ClusterInput()  # Mesh to offset
z_parameter = ClusterInput()  # Range of numbers (0-1) for Z divisions
bool = Boolean(triangulated)
mesh_2 = Mesh(mesh)
num = Number(influence)
bool_2 = Boolean(distance_influence)
pt = Point(points)
num_2 = Number(values)
dom = ConstructDomain(DomainStart=magnitude_min, DomainEnd=magnitude_max)
num_3 = Number(z_parameter)
cull = CullPattern(List=mesh_2, CullPattern=bool)
not = GateNot(A=bool)
weld = WeldMesh(Mesh=cull, Angle=3.141592654)
demesh = DeconstructMesh(Mesh=weld)  # -> Vertices, Faces, Colours, Normals
deface = DeconstructFace(Face=demesh.Faces)  # -> CornerA, CornerB, CornerC, CornerD
item = ListItem(List=demesh.Vertices, Index=deface.CornerB, Wrap=True)
item_2 = ListItem(List=demesh.Vertices, Index=deface.CornerC, Wrap=True)
item_3 = ListItem(List=demesh.Vertices, Index=deface.CornerA, Wrap=True)
panel = Panel("0")
panel_2 = Panel("1")
panel_3 = Panel("2")
addition = Addition(A=item_3, B=item)
addition_2 = Addition(A=item_3, B=item_2)
addition_3 = Addition(A=item, B=item_2)
bcentric = Barycentric(PointA=item_3, PointB=item, PointC=item_2, CoordinateU=1, CoordinateV=1, CoordinateW=1)
panel_4 = Panel("A")
division = Division(A=addition, B="2")
panel_5 = Panel("B")
panel_6 = Panel("C")
division_2 = Division(A=addition_3, B="2")
division_3 = Division(A=addition_2, B="2")
panel_7 = Panel("Z")
entwine = Entwine(Branch00=item_3, Branch01=division, Branch02=bcentric, Branch03=division_3, FlattenInputs=True)
entwine_2 = Entwine(Branch00=item, Branch01=division_2, Branch02=bcentric, Branch03=division, FlattenInputs=True)
entwine_3 = Entwine(Branch00=item_2, Branch01=division_3, Branch02=bcentric, Branch03=division_2, FlattenInputs=True)
flip = FlipMatrix(Data=entwine)
flip_2 = FlipMatrix(Data=entwine_3)
flip_3 = FlipMatrix(Data=entwine_2)
quad = MeshQuad(CornerA=0, CornerB=1, CornerC=2, CornerD=3)
quad_2 = MeshQuad(CornerA=0, CornerB=1, CornerC=2, CornerD=3)
quad_3 = MeshQuad(CornerA=0, CornerB=1, CornerC=2, CornerD=3)
conmesh = ConstructMesh(Vertices=flip_2, Faces=quad)
conmesh_2 = ConstructMesh(Vertices=flip_3, Faces=quad_2)
conmesh_3 = ConstructMesh(Vertices=flip, Faces=quad_3)
mjoin = MeshJoin(Meshes=flatten([conmesh_3, conmesh_2, conmesh]))
cull_2 = CullPattern(List=mesh_2, CullPattern=not)
demesh_2 = DeconstructMesh(Mesh=[mjoin, cull_2])  # -> Vertices, Faces, Colours, Normals
meshcp = MeshClosestPoint(Point=demesh_2.Vertices, Mesh=mesh_2)  # -> Point, Index, Parameter
cp = ClosestPoint(Point=demesh_2.Vertices, Cloud=pt)  # -> ClosestPoint, CPIndex, Distance
bnd = Bounds(Numbers=num_2)
meval = MeshEval(Mesh=mesh_2, Parameter=meshcp.Parameter)  # -> Point, Normal, Colour
remap = RemapNumbers(Value=num_2, Source=bnd, Target=dom)  # -> Mapped, Clipped
expression = Expression(x=num, y=cp.Distance, Expression="-1*e^(-x*y)")
item_4 = ListItem(List=remap.Mapped, Index=cp.CPIndex, Wrap=True)
bnd_2 = Bounds(Numbers=flatten(expression))
not_2 = GateNot(A=bool_2)
remap_2 = RemapNumbers(Value=expression, Source=bnd_2, Target="1 to 0")  # -> Mapped, Clipped
multiplication = Multiplication(A=item_4, B=remap_2.Mapped)
cull_3 = CullPattern(List=item_4, CullPattern=not_2)
cull_4 = CullPattern(List=multiplication, CullPattern=bool_2)
dom_2 = ConstructDomain(DomainStart=0, DomainEnd=flatten([cull_3, cull_4]))
remap_3 = RemapNumbers(Value=graft(num_3), Source=Domain(0, 1), Target=dom_2)  # -> simplify(Mapped), Clipped
amp = Amplitude(Vector=meval.Normal, Amplitude=remap_3.Mapped)
move = Move(Geometry=demesh_2.Vertices, Motion=amp)  # -> Geometry, Transform
toggle = BooleanToggle(False)
conmesh_4 = ConstructMesh(Vertices=move.Geometry, Faces=demesh_2.Faces)  # -> flatten(Mesh)
shift = ShiftList(List=flatten(conmesh_4), Shift="1", Wrap=toggle)
shift_2 = ShiftList(List=flatten(conmesh_4), Shift="-1", Wrap=toggle)
demesh_3 = DeconstructMesh(Mesh=shift_2)  # -> Vertices, Faces, Colours, Normals
demesh_4 = DeconstructMesh(Mesh=shift)  # -> Vertices, Faces, Colours, Normals
deface_2 = DeconstructFace(Face=demesh_3.Faces)  # -> CornerA, CornerB, CornerC, CornerD
deface_3 = DeconstructFace(Face=demesh_4.Faces)  # -> CornerA, CornerB, CornerC, CornerD
item_5 = ListItem(List=demesh_4.Vertices, Index=deface_3.CornerA, Wrap=True)
item_6 = ListItem(List=demesh_4.Vertices, Index=deface_3.CornerB, Wrap=True)
item_7 = ListItem(List=demesh_4.Vertices, Index=deface_3.CornerC, Wrap=True)
item_8 = ListItem(List=demesh_4.Vertices, Index=deface_3.CornerD, Wrap=True)
item_9 = ListItem(List=demesh_3.Vertices, Index=deface_2.CornerA, Wrap=True)
item_10 = ListItem(List=demesh_3.Vertices, Index=deface_2.CornerB, Wrap=True)
item_11 = ListItem(List=demesh_3.Vertices, Index=deface_2.CornerC, Wrap=True)
item_12 = ListItem(List=demesh_3.Vertices, Index=deface_2.CornerD, Wrap=True)
tbox = TwistedBox(
    CornerA=item_5,
    CornerB=item_6,
    CornerC=item_7,
    CornerD=item_8,
    CornerE=item_9,
    CornerF=item_10,
    CornerG=item_11,
    CornerH=item_12)  # -> flatten(TwistedBox)
mesh_3 = Mesh(conmesh_4)
quad_meshes = ClusterOutput(mesh_3)  # Quad meshes generated from the input mesh
voxels = ClusterOutput(tbox)  # Voxels to be filled with unit cells

# ==== cluster MeshOffsetAttractor_2: Offset a mesh using an attractor

# ----
# MESH OFFSET ATTRACTOR (parameter)
triangulated = ClusterInput()  # True if mesh is triangulated. False if mesh is quads.
magnitude_min = ClusterInput()  # Magnitude of the offset (minimum value)
magnitude_max = ClusterInput()  # Magnitude of the offset (maximum value)
mesh = ClusterInput()  # Mesh to offset
z_parameter = ClusterInput()  # Range of numbers (0-1) for Z divisions
influence = ClusterInput()  # Smoothed range of attractor influence (0-1)
attractor = ClusterInput()  # Any geometry to use as attractor(s)
lower_limit = ClusterInput()  # Smoothing of the surface closest to the attractor
bool = Boolean(triangulated)
mesh_2 = Mesh(mesh)
num = Number(influence)
geo = Geometry(attractor)
num_2 = Number(z_parameter)
num_3 = Number(lower_limit)
num_4 = Number(magnitude_min)
num_5 = Number(magnitude_max)
cull = CullPattern(List=mesh_2, CullPattern=bool)
dom = ConstructDomain(DomainStart=num_4, DomainEnd=num_5)
weld = WeldMesh(Mesh=cull, Angle=3.141592654)
demesh = DeconstructMesh(Mesh=weld)  # -> Vertices, Faces, Colours, Normals
deface = DeconstructFace(Face=demesh.Faces)  # -> CornerA, CornerB, CornerC, CornerD
item = ListItem(List=demesh.Vertices, Index=deface.CornerB, Wrap=True)
item_2 = ListItem(List=demesh.Vertices, Index=deface.CornerC, Wrap=True)
item_3 = ListItem(List=demesh.Vertices, Index=deface.CornerA, Wrap=True)
addition = Addition(A=item_3, B=item)
addition_2 = Addition(A=item_3, B=item_2)
addition_3 = Addition(A=item, B=item_2)
bcentric = Barycentric(PointA=item_3, PointB=item, PointC=item_2, CoordinateU=1, CoordinateV=1, CoordinateW=1)
division = Division(A=addition, B="2")
division_2 = Division(A=addition_3, B="2")
division_3 = Division(A=addition_2, B="2")
entwine = Entwine(Branch00=item_3, Branch01=division, Branch02=bcentric, Branch03=division_3, FlattenInputs=True)
entwine_2 = Entwine(Branch00=item, Branch01=division_2, Branch02=bcentric, Branch03=division, FlattenInputs=True)
entwine_3 = Entwine(Branch00=item_2, Branch01=division_3, Branch02=bcentric, Branch03=division_2, FlattenInputs=True)
flip = FlipMatrix(Data=entwine)
flip_2 = FlipMatrix(Data=entwine_3)
flip_3 = FlipMatrix(Data=entwine_2)
quad = MeshQuad(CornerA=0, CornerB=1, CornerC=2, CornerD=3)
quad_2 = MeshQuad(CornerA=0, CornerB=1, CornerC=2, CornerD=3)
quad_3 = MeshQuad(CornerA=0, CornerB=1, CornerC=2, CornerD=3)
conmesh = ConstructMesh(Vertices=flip_2, Faces=quad)
conmesh_2 = ConstructMesh(Vertices=flip_3, Faces=quad_2)
conmesh_3 = ConstructMesh(Vertices=flip, Faces=quad_3)
not = GateNot(A=bool)
mjoin = MeshJoin(Meshes=flatten([conmesh_3, conmesh_2, conmesh]))
cull_2 = CullPattern(List=mesh_2, CullPattern=not)
demesh_2 = DeconstructMesh(Mesh=[mjoin, cull_2])  # -> Vertices, Faces, Colours, Normals
meshcp = MeshClosestPoint(Point=demesh_2.Vertices, Mesh=mesh_2)  # -> Point, Index, Parameter
pull = PullPoint(Point=demesh_2.Vertices, Geometry=geo, ClosestOnly=True)  # -> ClosestPoint, Distance
lng = ListLength(List=pull.Distance)
meval = MeshEval(Mesh=mesh_2, Parameter=meshcp.Parameter)  # -> Point, Normal, Colour
smaller = SmallerThan(FirstNumber=pull.Distance, SecondNumber=num_3)  # -> SmallerThan, OrEqualTo
series = Series(Start=0, Step=1, Count=lng)
cull_3 = CullPattern(List=series, CullPattern=smaller.SmallerThan)
replace = ReplaceItems(List=pull.Distance, Item="0", Indices=cull_3, Wrap=False)
expression = Expression(x=num, y=replace, Expression="-1*e^(-x*y)")
bnd = Bounds(Numbers=expression)
remap = RemapNumbers(Value=expression, Source=bnd, Target=dom)  # -> Mapped, Clipped
dom_2 = ConstructDomain(DomainStart=0, DomainEnd=remap.Mapped)
remap_2 = RemapNumbers(Value=graft(num_2), Source=Domain(0, 1), Target=dom_2)  # -> simplify(Mapped), Clipped
amp = Amplitude(Vector=meval.Normal, Amplitude=remap_2.Mapped)
move = Move(Geometry=demesh_2.Vertices, Motion=amp)  # -> Geometry, Transform
toggle = BooleanToggle(False)
conmesh_4 = ConstructMesh(Vertices=move.Geometry, Faces=demesh_2.Faces)  # -> flatten(Mesh)
shift = ShiftList(List=flatten(conmesh_4), Shift="1", Wrap=toggle)
shift_2 = ShiftList(List=flatten(conmesh_4), Shift="-1", Wrap=toggle)
demesh_3 = DeconstructMesh(Mesh=shift_2)  # -> Vertices, Faces, Colours, Normals
demesh_4 = DeconstructMesh(Mesh=shift)  # -> Vertices, Faces, Colours, Normals
deface_2 = DeconstructFace(Face=demesh_3.Faces)  # -> CornerA, CornerB, CornerC, CornerD
deface_3 = DeconstructFace(Face=demesh_4.Faces)  # -> CornerA, CornerB, CornerC, CornerD
item_4 = ListItem(List=demesh_4.Vertices, Index=deface_3.CornerA, Wrap=True)
item_5 = ListItem(List=demesh_4.Vertices, Index=deface_3.CornerB, Wrap=True)
item_6 = ListItem(List=demesh_4.Vertices, Index=deface_3.CornerC, Wrap=True)
item_7 = ListItem(List=demesh_4.Vertices, Index=deface_3.CornerD, Wrap=True)
item_8 = ListItem(List=demesh_3.Vertices, Index=deface_2.CornerA, Wrap=True)
item_9 = ListItem(List=demesh_3.Vertices, Index=deface_2.CornerB, Wrap=True)
item_10 = ListItem(List=demesh_3.Vertices, Index=deface_2.CornerC, Wrap=True)
item_11 = ListItem(List=demesh_3.Vertices, Index=deface_2.CornerD, Wrap=True)
tbox = TwistedBox(
    CornerA=item_4,
    CornerB=item_5,
    CornerC=item_6,
    CornerD=item_7,
    CornerE=item_8,
    CornerF=item_9,
    CornerG=item_10,
    CornerH=item_11)  # -> flatten(TwistedBox)
mesh_3 = Mesh(conmesh_4)
quad_meshes = ClusterOutput(mesh_3)  # Quad meshes generated from the input mesh
voxels = ClusterOutput(tbox)  # Voxels to be filled with unit cells

# ==== cluster MorphBetweenMeshes: Create voxels between the faces of meshes with matching topology

# ----
# Morph Between Meshes (parameter)
meshes = ClusterInput()  # Meshes to morph between (must have identical topology)
triangulated = ClusterInput()  # True if mesh is triangulated. False if mesh is quads.
z_parameter = ClusterInput()  # Range of numbers (0-1) for Z divisions
bool = Boolean(triangulated)
mesh = Mesh(meshes)
num = Number(z_parameter)
not = GateNot(A=bool)
cull = CullPattern(List=mesh, CullPattern=bool)
weld = WeldMesh(Mesh=cull, Angle=3.141592654)
demesh = DeconstructMesh(Mesh=weld)  # -> Vertices, Faces, Colours, Normals
deface = DeconstructFace(Face=demesh.Faces)  # -> CornerA, CornerB, CornerC, CornerD
item = ListItem(List=demesh.Vertices, Index=deface.CornerA, Wrap=True)
item_2 = ListItem(List=demesh.Vertices, Index=deface.CornerC, Wrap=True)
item_3 = ListItem(List=demesh.Vertices, Index=deface.CornerB, Wrap=True)
panel = Panel("0")
panel_2 = Panel("1")
panel_3 = Panel("2")
addition = Addition(A=item, B=item_3)
addition_2 = Addition(A=item, B=item_2)
addition_3 = Addition(A=item_3, B=item_2)
bcentric = Barycentric(PointA=item, PointB=item_3, PointC=item_2, CoordinateU=1, CoordinateV=1, CoordinateW=1)
panel_4 = Panel("A")
panel_5 = Panel("B")
panel_6 = Panel("C")
division = Division(A=addition, B="2")
division_2 = Division(A=addition_3, B="2")
division_3 = Division(A=addition_2, B="2")
panel_7 = Panel("Z")
entwine = Entwine(Branch00=item, Branch01=division, Branch02=bcentric, Branch03=division_3, FlattenInputs=True)
entwine_2 = Entwine(Branch00=item_3, Branch01=division_2, Branch02=bcentric, Branch03=division, FlattenInputs=True)
entwine_3 = Entwine(Branch00=item_2, Branch01=division_3, Branch02=bcentric, Branch03=division_2, FlattenInputs=True)
flip = FlipMatrix(Data=entwine_2)
flip_2 = FlipMatrix(Data=entwine)
quad = MeshQuad(CornerA=0, CornerB=1, CornerC=2, CornerD=3)
flip_3 = FlipMatrix(Data=entwine_3)
lng = ListLength(List=demesh.Faces)  # -> flatten(Length)
conmesh = ConstructMesh(Vertices=flip_2, Faces=quad)
conmesh_2 = ConstructMesh(Vertices=flip_3, Faces=quad)
conmesh_3 = ConstructMesh(Vertices=flip, Faces=quad)
item_4 = ListItem(List=lng, Index=0, Wrap=True)
trim = TrimTree(Tree=conmesh, Depth=1)
trim_2 = TrimTree(Tree=conmesh_3, Depth=1)
trim_3 = TrimTree(Tree=conmesh_2, Depth=1)
partition = PartitionList(List=trim_2, Size=item_4)
partition_2 = PartitionList(List=trim, Size=item_4)
partition_3 = PartitionList(List=trim_3, Size=item_4)
merge = Merge(Data1=partition_2, Data2=partition, Data3=partition_3)
toggle = BooleanToggle(True)
cull_2 = CullPattern(List=mesh, CullPattern=not)
mjoin = MeshJoin(Meshes=merge)
clean = CleanTree(RemoveNulls=True, RemoveInvalid=True, RemoveEmpty=toggle, Tree=cull_2)
clean_2 = CleanTree(RemoveNulls=True, RemoveInvalid=True, RemoveEmpty=toggle, Tree=mjoin)
demesh_2 = DeconstructMesh(Mesh=simplify([clean_2, clean]))  # -> simplify(Vertices), Faces, Colours, Normals
flip_4 = FlipMatrix(Data=demesh_2.Vertices)
pline = PolyLine(Vertices=flip_4, Closed=False)
eval = EvaluateCurve(Curve=reparameterize(pline), Parameter=num)  # -> Point, Tangent, Angle
toggle_2 = BooleanToggle(False)
flip_5 = FlipMatrix(Data=eval.Point)
conmesh_4 = ConstructMesh(Vertices=flip_5, Faces=demesh_2.Faces)  # -> flatten(Mesh)
shift = ShiftList(List=flatten(conmesh_4), Shift="1", Wrap=toggle_2)
shift_2 = ShiftList(List=flatten(conmesh_4), Shift="-1", Wrap=toggle_2)
demesh_3 = DeconstructMesh(Mesh=shift_2)  # -> Vertices, Faces, Colours, Normals
demesh_4 = DeconstructMesh(Mesh=shift)  # -> Vertices, Faces, Colours, Normals
deface_2 = DeconstructFace(Face=demesh_4.Faces)  # -> CornerA, CornerB, CornerC, CornerD
deface_3 = DeconstructFace(Face=demesh_3.Faces)  # -> CornerA, CornerB, CornerC, CornerD
item_5 = ListItem(List=demesh_4.Vertices, Index=deface_2.CornerA, Wrap=True)
item_6 = ListItem(List=demesh_4.Vertices, Index=deface_2.CornerB, Wrap=True)
item_7 = ListItem(List=demesh_4.Vertices, Index=deface_2.CornerC, Wrap=True)
item_8 = ListItem(List=demesh_4.Vertices, Index=deface_2.CornerD, Wrap=True)
item_9 = ListItem(List=demesh_3.Vertices, Index=deface_3.CornerA, Wrap=True)
item_10 = ListItem(List=demesh_3.Vertices, Index=deface_3.CornerB, Wrap=True)
item_11 = ListItem(List=demesh_3.Vertices, Index=deface_3.CornerC, Wrap=True)
item_12 = ListItem(List=demesh_3.Vertices, Index=deface_3.CornerD, Wrap=True)
tbox = TwistedBox(
    CornerA=item_5,
    CornerB=item_6,
    CornerC=item_7,
    CornerD=item_8,
    CornerE=item_9,
    CornerF=item_10,
    CornerG=item_11,
    CornerH=item_12)  # -> flatten(TwistedBox)
mesh_2 = Mesh(conmesh_4)
quad_meshes = ClusterOutput(mesh_2)  # Quad meshes generated from the input mesh
voxels = ClusterOutput(tbox)  # Voxels to be filled with unit cells

# ==== cluster CellShellFill: Fill voxels with shell unit cells

unit_cell_shell = ClusterInput()  # Unit cell to populate voxels
tolerance = ClusterInput()  # Tolerance for merging faces and vertices (number usually between 0.001 and 0.1)
voxels = ClusterInput()  # Voxels to be filled with unit cells
geo = Geometry(unit_cell_shell)
bbox = BoundingBox(Content=geo, Plane=PlaneXY(0, 0, 0), UnionBox=True)  # -> Box, Box_2
morph = BoxMorph(Geometry=geo, Reference=bbox.Box, Target=graft(voxels))  # -> flatten(Geometry)
mjoin = MeshJoin(Meshes=morph)
panel = Panel("CELL SHELL FILL")
demesh = DeconstructMesh(Mesh=mjoin)  # -> Vertices, Faces, Colours, Normals
facen = FaceNormals(Mesh=mjoin)  # -> Centers, Normals
cullpt = CullDuplicates(Points=facen.Centers, Tolerance=tolerance, CullMode=1)  # -> Points, Indices, Valence
item = ListItem(List=demesh.Faces, Index=cullpt.Indices, Wrap=True)
conmesh = ConstructMesh(Vertices=demesh.Vertices, Faces=item)
weld = WeldMesh(Mesh=conmesh, Angle=3.141592654)
c_script = CSharpScript(M=weld, radius=tolerance)  # -> out, A; inputs M: Mesh, radius: Double
# ---------- c_script: C# usings ----------
using System.IO;
using System.Linq;
using System.Data;
using System.Drawing;
using System.Reflection;
using System.Windows.Forms;
using System.Xml;
using System.Xml.Linq;
using System.Runtime.InteropServices;

using Rhino.DocObjects;
using Rhino.Collections;
using GH_IO;
using GH_IO.Serialization;
# ---------- c_script: C# ----------
    Component.Message = "Weld Mesh - RTree";


    //Store naked mesh vertices and their ids
    List<Point3f> pts = new List<Point3f>();
    bool[] flag = M.GetNakedEdgePointStatus();

    allPointsFound = new List<List<int>>();

    //History is need to stop searching rtee
    //When all point groups are found
    history.Clear();

    //Create Rtree
    RTree tree = new RTree();

    for(int i = 0; i < flag.Length; i++){
      if(flag[i]){
        tree.Insert(M.Vertices[i], i);
        pts.Add(M.Vertices[i]);
      }
    }

    //Search RTree
    for(int i = 0; i < pts.Count; i++){
      tempIDList = new List<int>();
      tree.Search(new Sphere(pts[i], radius), method);

      if(tempIDList.Count > 1)
        allPointsFound.Add(tempIDList);

      if(history.Count == M.Vertices.Count)
        break;
    }

    //Now move found vertices to one of firs vertex position
    foreach(List<int> i in allPointsFound)
      for(int j = 1; j < i.Count; j++)
        M.Vertices[i[0]] = M.Vertices[i[j]];

    M.Vertices.CombineIdentical(true, true);


    A = M;
# ---------- c_script: C# additional code ----------
  //Rtree collections
  List<int> history = new List<int>();
  List<List<int>> allPointsFound;
  List<int> tempIDList;

  private void method(object sender, RTreeEventArgs e){
    if(!history.Contains(e.Id)){
      tempIDList.Add(e.Id);
      history.Add(e.Id);
    }
  }
# ---------- end c_script ----------
lattice_shell = ClusterOutput(c_script.A)  # Joined mesh that makes up the lattice

# ==== cluster RemoveDuplicateCurves: Remove duplicate curves (that share the same midpoint)

tolerance = ClusterInput()  # Tolerance for merging curves (number usually between 0.001 and 0.1)
lattice = ClusterInput()  # Lattice curves to filter
crv = Curve(lattice)
curvepoint = PointOnCurve(crv, parameter=0.5)
panel = Panel("REMOVE DUPLICATE CURVES")
cullpt = CullDuplicates(Points=curvepoint, Tolerance=tolerance, CullMode=1)  # -> Points, Indices, Valence
item = ListItem(List=crv, Index=cullpt.Indices, Wrap=True)
lattice_2 = ClusterOutput(item)  # Filtered lattice

# ==== cluster RemoveByValence: Remove curves by number of connections

lattice = ClusterInput()  # Lattice curves to filter
flip = ClusterInput()  # If true curves under valence number are removed. If false curves over valence number are removed.
valence_number = ClusterInput()  # The number of connections each curve has
num = Number(valence_number)
crv = Curve(lattice)
bool = Boolean(flip)
cp = ControlPoints(Curve=crv)  # -> Points, Weights, Knots
cps = ClosestPoints(Point=cp.Points, Cloud=flatten(cp.Points), Count=expr("x+1", num))  # -> ClosestPoint, CPIndex, simplify(Distance)
panel = Panel("REMOVE BY VALENCE")
trim = TrimTree(Tree=cps.Distance, Depth=1)
not = GateNot(A=bool)
ma = MassAddition(Input=trim)  # -> Result, PartialResults
smaller = SmallerThan(FirstNumber=ma.Result, SecondNumber="0")  # -> SmallerThan, OrEqualTo
not_2 = GateNot(A=smaller.OrEqualTo)
cull = CullPattern(List=smaller.OrEqualTo, CullPattern=bool)
cull_2 = CullPattern(List=not_2, CullPattern=not)
cull_3 = CullPattern(List=graft(crv), CullPattern=[cull_2, cull])  # -> flatten(List)
lattice_2 = ClusterOutput(cull_3)  # Filtered lattice

# ==== cluster TweenShellFIll: Fill voxels with morphed shell unit cells

unit_cell_shell = ClusterInput()  # Unit cell to populate voxels
unit_cell_shell_2 = ClusterInput()  # Unit cell to populate voxels
voxels = ClusterInput()  # Voxels to be filled with unit cells
value = ClusterInput()  # Value from 0-1 corresponding to each voxel
tolerance = ClusterInput()  # Tolerance for merging faces and vertices (number usually between 0.001 and 0.1)
geo = Geometry(unit_cell_shell_2)
geo_2 = Geometry(unit_cell_shell)
num = Number(value)
num_2 = Number(tolerance)
geo_3 = Geometry(voxels)
demesh = DeconstructMesh(Mesh=geo_2)  # -> Vertices, Faces, Colours, Normals
demesh_2 = DeconstructMesh(Mesh=geo)  # -> Vertices, Faces, Colours, Normals
ln = Line(StartPoint=demesh.Vertices, EndPoint=demesh_2.Vertices)
eval = EvaluateCurve(Curve=reparameterize(graft(ln)), Parameter=num)  # -> simplify(Point), Tangent, Angle
flip = FlipMatrix(Data=eval.Point)
conmesh = ConstructMesh(Vertices=flip, Faces=demesh.Faces)
bbox = BoundingBox(Content=conmesh, Plane=PlaneXY(0, 0, 0), UnionBox=True)  # -> Box, Box_2
morph = BoxMorph(Geometry=conmesh, Reference=bbox.Box, Target=simplify(graft(geo_3)))  # -> flatten(Geometry)
panel = Panel("TWEEN SHELL FILL")
mjoin = MeshJoin(Meshes=morph)
demesh_3 = DeconstructMesh(Mesh=mjoin)  # -> Vertices, Faces, Colours, Normals
facen = FaceNormals(Mesh=mjoin)  # -> Centers, Normals
cullpt = CullDuplicates(Points=facen.Centers, Tolerance=num_2, CullMode=1)  # -> Points, Indices, Valence
item = ListItem(List=demesh_3.Faces, Index=cullpt.Indices, Wrap=True)
conmesh_2 = ConstructMesh(Vertices=demesh_3.Vertices, Faces=item)
weld = WeldMesh(Mesh=conmesh_2, Angle=3.141592654)
c_script = CSharpScript(M=weld, radius=num_2)  # -> out, A; inputs M: Mesh, radius: Double; same code as c_script
lattice_shell = ClusterOutput(c_script.A)  # Joined mesh that makes up the lattice

# ==== cluster LatticeTopology: Create a clean graph from a lattice with unique nodes and their connections

tolerance = ClusterInput()  # Tolerance to merge points
lattice_beams = ClusterInput()  # Lattice Curves
num = Number(tolerance)
crv = Curve(lattice_beams)
cp = ControlPoints(Curve=crv)  # -> simplify(Points), Weights, Knots
cullpt = CullDuplicates(Points=flatten(cp.Points), Tolerance=num, CullMode=3)  # -> Points, Indices, Valence
sort_pt = SortPoints(Points=cullpt.Points)  # -> Points, Indices
lng = ListLength(List=sort_pt.Points)
lng_2 = ListLength(List=crv)
fsim = FindSimilarMember(Data=cp.Points, Set=sort_pt.Points)  # -> Hit, simplify(Index)
series = Series(Start=0, Step=1, Count=lng_2)  # -> simplify(Series)
series_2 = Series(Start=0, Step=1, Count=lng)  # -> simplify(Series)
panel = Panel("LATTICE TOPOLOGY")
num_2 = Number(fsim.Index)
pt = Point(sort_pt.Points)
equals = Equality(FirstNumber=series_2, SecondNumber=graft(num_2))  # -> Equality, Inequality
flip = FlipMatrix(Data=equals.Equality)
partition = PartitionList(List=flip, Size="2")  # -> simplify(Chunks)
item = ListItem(List=partition, Index=0, Wrap=True)  # -> Item, Item1
or = GateOr(A=item.Item, B=item.Item1)
trim = TrimTree(Tree=or, Depth=1)
cull = CullPattern(List=series, CullPattern=trim)  # -> simplify(List)
nodes = ClusterOutput(pt)  # Unique points in the network
line_point_connections = ClusterOutput(num_2)  # Index of points that make up each beam
point_line_connections = ClusterOutput(cull)  # For each point, lists the index of each line connected to it

# ==== cluster INPB32: Create a B32 INP file from a lattice

# ----
# *BEAM SECTION,MATERIAL=EL,ELSET=Eall,OFFSET1=-0.5,SECTION=RECT
filename = ClusterInput()  # Name of file (also NSET, ELSET, etc)
lattice_curves = ClusterInput()  # Lattice curves to create B32 elements
cross_section = ClusterInput()  # True if CIRC, false if RECT
tolerance = ClusterInput()  # Tolerance for combining nodes
height = ClusterInput()  # Height of cross section
width = ClusterInput()  # Width of cross section
txt = Text(filename)
line = Line(lattice_curves)
bool = Boolean(cross_section)
num = Number(width)
num_2 = Number(height)
num_3 = Number(tolerance)
lattice_topology = LatticeTopology(lattice_beams=line, tolerance=num_3)  # -> nodes, line_point_connections, point_line_connections
item = ListItem(List=lattice_topology.nodes, Index=lattice_topology.line_point_connections, Wrap=True)
avr = Average(Input=item)
entwine = Entwine(Branch00=lattice_topology.nodes, Branch01=avr, FlattenInputs=True)  # -> flatten(Result)
item_2 = ListItem(List=item, Index=0, Wrap=True)
pline = PolyLine(Vertices=item, Closed=False)  # -> flatten(Polyline)
end = EndPoints(Curve=pline)  # -> Start, End
lng = ListLength(List=flatten(item_2))
lng_2 = ListLength(List=entwine)
lng_3 = ListLength(List=lattice_topology.nodes)
lng_4 = ListLength(List=flatten(avr))
pl = PlaneNormal(Origin=end.End, ZAxis=pline)
Z = UnitZ(Factor=1)
series = Series(Start=0, Step=1, Count=lng_2)
devec = DeconstructVector(Vector=entwine)  # -> XComponent, YComponent, ZComponent
series_2 = Series(Start=0, Step=1, Count=lng)  # -> graft(Series)
item_3 = ListItem(List=lattice_topology.line_point_connections, Index=0, Wrap=True)  # -> Item, Item1
series_3 = Series(Start=lng_3, Step=1, Count=lng_4)
align = AlignPlane(Plane=pl, Direction=Z)  # -> Plane, Angle
addition = Addition(A=series, B=1)
devec_2 = DeconstructVector(Vector=align.Plane)  # -> XComponent, YComponent, ZComponent
addition_2 = Addition(A=series_2, B=1)
addition_3 = Addition(A=series_3, B=1)  # -> graft(Result)
addition_4 = Addition(A=item_3.Item, B=1)
addition_5 = Addition(A=item_3.Item1, B=1)
p_n_c = PickNChoose(Pattern=bool, Stream0="RECT", Stream1="CIRC")
format = Expression(x=txt, y=p_n_c, Expression="Format(\"*BEAM SECTION,MATERIAL=M{0},ELSET=E{0},SECTION={1}\", x, y)")
format_2 = Expression(
    x=addition_2,
    y=addition_4,
    z=graft(devec_2.XComponent),
    u=graft(devec_2.YComponent),
    v=graft(devec_2.ZComponent),
    Expression="Format(\" {0}, {1}, {2}, {3}, {4}\", x, y, Round (z, 3), Round (u, 3), Round (v, 3))")
format_3 = Expression(
    x=addition,
    y=devec.XComponent,
    z=devec.YComponent,
    u=devec.ZComponent,
    Expression="Format(\" {0}, {1}, {2}, {3}\", x, Round (y, 3), Round (z, 3), Round (u, 3))")
format_4 = Expression(x=num, y=num_2, Expression="Format(\"{0},{1}\", x, y)")
panel = Panel("*ELEMENT,TYPE=B32,ELSET=EAll")
format_5 = Expression(x=txt, Expression="Format(\"*ELEMENT,TYPE=B32,ELSET=E{0}\", x)")
format_6 = Expression(x=addition_2, y=addition_4, z=addition_3, u=addition_5, Expression="Format(\"{0}, {1}, {2}, {3}\", x, y, z, u)")
format_7 = Expression(x=txt, Expression="Format(\"*NODE,NSET=N{0}\", x)")
panel_2 = Panel("""** NORMAL = Element,Node,X,Y,Z
*NORMAL""")
format_8 = Expression(x=txt, Expression="Format(\"**FILENAME = {0}\", x)")
entwine_2 = Entwine(
    Branch00="**INP GENERATOR - CRYSTALLON ",
    Branch01=format_8,
    Branch02=format_7,
    Branch03=format_3,
    Branch04=format_5,
    Branch05=format_6,
    Branch06=panel_2,
    Branch07=format_2,
    Branch08=format,
    Branch010=format_4,
    FlattenInputs=True)  # -> flatten(Result)
inp_output = ClusterOutput(entwine_2)  # output text

# ==== cluster INPS4: Create a S4 INP file from a quad based shell

lattice_shell_quads = ClusterInput()  # Lattice shell to create S4 elements
thickness = ClusterInput()  # Thickness of cross section
filename = ClusterInput()  # Name of file (also NSET, ELSET, etc)
panel = Panel("shelltest")
mesh = Mesh(lattice_shell_quads)
num = Number(thickness)
demesh = DeconstructMesh(Mesh=mesh)  # -> Vertices, Faces, Colours, Normals
txt = Text(filename)
deface = DeconstructFace(Face=demesh.Faces)  # -> CornerA, CornerB, CornerC, CornerD
devec = DeconstructVector(Vector=demesh.Vertices)  # -> XComponent, YComponent, ZComponent
lng = ListLength(List=demesh.Vertices)
series = Series(Start=0, Step=1, Count=lng)
lng_2 = ListLength(List=flatten(deface.CornerA))
addition = Addition(A=series, B=1)
series_2 = Series(Start=0, Step=1, Count=lng_2)
addition_2 = Addition(A=series_2, B=1)  # -> graft(Result)
addition_3 = Addition(A=deface.CornerA, B=1)  # -> graft(Result)
addition_4 = Addition(A=deface.CornerB, B=1)  # -> graft(Result)
addition_5 = Addition(A=deface.CornerC, B=1)  # -> graft(Result)
addition_6 = Addition(A=deface.CornerD, B=1)  # -> graft(Result)
panel_2 = Panel("S4")
format = Expression(
    x=addition,
    y=devec.XComponent,
    z=devec.YComponent,
    u=devec.ZComponent,
    Expression="Format(\" {0}, {1}, {2}, {3}\", x, Round (y, 3), Round (z, 3), Round (u, 3))")
format_2 = Expression(x=txt, Expression="Format(\"*SHELL SECTION,MATERIAL=M{0},ELSET=E{0}\", x)")
format_3 = Expression(
    x=addition_2,
    y=addition_3,
    z=addition_4,
    u=addition_5,
    v=addition_6,
    Expression="Format(\"{0}, {1}, {2}, {3}, {4}\", x, y, z, u, v)")
format_4 = Expression(x=txt, Expression="Format(\"*ELEMENT,TYPE=S4,ELSET=E{0}\", x)")
format_5 = Expression(x=txt, Expression="Format(\"*NODE,NSET=N{0}\", x)")
format_6 = Expression(x=txt, Expression="Format(\"**FILENAME = {0}\", x)")
entwine = Entwine(
    Branch00="**INP GENERATOR - CRYSTALLON ",
    Branch01=format_6,
    Branch02=format_5,
    Branch03=format,
    Branch04=format_4,
    Branch05=format_3,
    Branch06=format_2,
    Branch07=num,
    FlattenInputs=True)  # -> flatten(Result)
inp_output = ClusterOutput(entwine)  # output text

# ==== cluster INPS3: Create a S3 INP file from a triangle based shell

lattice_shell_triangles = ClusterInput()  # Lattice shell to create S3 elements
thickness = ClusterInput()  # Thickness of cross section
filename = ClusterInput()  # Name of file (also NSET, ELSET, etc)
mesh = Mesh(lattice_shell_triangles)
num = Number(thickness)
demesh = DeconstructMesh(Mesh=mesh)  # -> Vertices, Faces, Colours, Normals
txt = Text(filename)
deface = DeconstructFace(Face=demesh.Faces)  # -> CornerA, CornerB, CornerC, CornerD
devec = DeconstructVector(Vector=demesh.Vertices)  # -> XComponent, YComponent, ZComponent
lng = ListLength(List=demesh.Vertices)
series = Series(Start=0, Step=1, Count=lng)
lng_2 = ListLength(List=flatten(deface.CornerA))
addition = Addition(A=series, B=1)
series_2 = Series(Start=0, Step=1, Count=lng_2)
addition_2 = Addition(A=series_2, B=1)  # -> graft(Result)
addition_3 = Addition(A=deface.CornerA, B=1)  # -> graft(Result)
addition_4 = Addition(A=deface.CornerB, B=1)  # -> graft(Result)
addition_5 = Addition(A=deface.CornerC, B=1)  # -> graft(Result)
panel = Panel("S3")
format = Expression(
    x=addition,
    y=devec.XComponent,
    z=devec.YComponent,
    u=devec.ZComponent,
    Expression="Format(\" {0}, {1}, {2}, {3}\", x, Round (y, 3), Round (z, 3), Round (u, 3))")
format_2 = Expression(x=txt, Expression="Format(\"*SHELL SECTION,MATERIAL=M{0},ELSET=E{0}\", x)")
format_3 = Expression(x=txt, Expression="Format(\"*ELEMENT,TYPE=S3,ELSET=E{0}\", x)")
format_4 = Expression(x=addition_2, y=addition_3, z=addition_4, u=addition_5, Expression="Format(\"{0}, {1}, {2}, {3}\", x, y, z, u)")
format_5 = Expression(x=txt, Expression="Format(\"*NODE,NSET=N{0}\", x)")
format_6 = Expression(x=txt, Expression="Format(\"**FILENAME = {0}\", x)")
entwine = Entwine(
    Branch00="**INP GENERATOR - CRYSTALLON ",
    Branch01=format_6,
    Branch02=format_5,
    Branch03=format,
    Branch04=format_3,
    Branch05=format_4,
    Branch06=format_2,
    Branch07=num,
    FlattenInputs=True)  # -> flatten(Result)
inp_output = ClusterOutput(entwine)  # output text

# ==== cluster LatticeTopology_2: Creates a clean graph from a lattice with unique nodes and their connections

tolerance = ClusterInput()  # Tolerance to merge points
lattice_beams = ClusterInput()  # Lattice Curves
num = Number(tolerance)
crv = Curve(lattice_beams)
cp = ControlPoints(Curve=crv)  # -> simplify(Points), Weights, Knots
cullpt = CullDuplicates(Points=flatten(cp.Points), Tolerance=num, CullMode=3)  # -> Points, Indices, Valence
sort_pt = SortPoints(Points=cullpt.Points)  # -> Points, Indices
lng = ListLength(List=crv)
lng_2 = ListLength(List=sort_pt.Points)
fsim = FindSimilarMember(Data=cp.Points, Set=sort_pt.Points)  # -> Hit, simplify(Index)
series = Series(Start=0, Step=1, Count=lng)  # -> simplify(Series)
series_2 = Series(Start=0, Step=1, Count=lng_2)  # -> simplify(Series)
panel = Panel("LATTICE TOPOLOGY")
num_2 = Number(fsim.Index)
pt = Point(sort_pt.Points)
equals = Equality(FirstNumber=series_2, SecondNumber=graft(num_2))  # -> Equality, Inequality
flip = FlipMatrix(Data=equals.Equality)
partition = PartitionList(List=flip, Size="2")  # -> simplify(Chunks)
item = ListItem(List=partition, Index=0, Wrap=True)  # -> Item, Item1
or = GateOr(A=item.Item, B=item.Item1)
trim = TrimTree(Tree=or, Depth=1)
cull = CullPattern(List=series, CullPattern=trim)  # -> simplify(List)
nodes = ClusterOutput(pt)  # Unique points in the network
line_point_connections = ClusterOutput(num_2)  # Index of points that make up each beam
point_line_connections = ClusterOutput(cull)  # For each point, lists the index of each line connected to it

# ==== cluster LTCXWriter: Creates a LTCX output

radius = ClusterInput()  # A list of radii that corresponds with the lattice beams
tolerance = ClusterInput()  # Tolerance to merge points
lattice_beams = ClusterInput()  # Lattice Curves
crv = Curve(lattice_beams)
id = ClusterInput()  # graph ID (number)
num = Number(tolerance)
type = ClusterInput()  # Cross Section (rnd)
name = ClusterInput()  # File Name
units = ClusterInput()  # Units (in/mm)
num_2 = Number(radius)
cp = ControlPoints(Curve=crv)  # -> Points, Weights, Knots
num_3 = Number(num)
cullpt = CullDuplicates(Points=flatten(cp.Points), Tolerance=num_3, CullMode=3)  # -> Points, Indices, Valence
cp_2 = ClosestPoint(Point=cullpt.Points, Cloud=cp.Points)  # -> ClosestPoint, CPIndex, Distance
flip = FlipMatrix(Data=cp_2.Distance)
smaller = SmallerThan(FirstNumber=flip, SecondNumber=num)  # -> SmallerThan, OrEqualTo
cull = CullPattern(List=flatten(num_2), CullPattern=smaller.OrEqualTo)
fsim = FindSimilarMember(Data=cp.Points, Set=cullpt.Points)  # -> Hit, Index
lng = ListLength(List=cullpt.Points)
avr = Average(Input=cull)  # -> flatten(ArithmeticMean)
devec = DeconstructVector(Vector=cullpt.Points)  # -> XComponent, YComponent, ZComponent
series = Series(Start=0, Step=1, Count=lng)
format = Expression(
    x=series,
    y=devec.XComponent,
    z=devec.YComponent,
    u=devec.ZComponent,
    v=avr,
    Expression="Format(\"                <node id='{0}' x='{1}' y='{2}' z='{3}' r='{4}'/>\", x, Round (y, 3), Round (z, 3), Round (u, 3), Round (v, 3))")
lng_2 = ListLength(List=flatten(crv))
item = ListItem(List=fsim.Index, Index="0", Wrap=True)  # -> Item, Item1
series_2 = Series(Start=0, Step=1, Count=lng_2)  # -> graft(Series)
format_2 = Expression(
    x=series_2,
    y=item.Item,
    z=item.Item1,
    Expression="Format(\"                <beam id='{0}' n1='{1}' n2='{2}'/>\", x, y, z)")
format_3 = Expression(x=id, y=name, z=units, u=type, Expression="Format(\"<graph id='{0}' name='{1}' units='{2}' type='{3}'>\", x, y, z, u)")
panel = Panel("""<?xml version="1.0" encoding="UTF-8"?>
<!--Generator: Grasshopper , LTCX export module , Aaron Porterfield. -->""")
rep = ReplaceText(Text=format_3, Find="'", Replace="\"", RecursiveReplace=False)
rep_2 = ReplaceText(Text=format_2, Find="'", Replace="\"", RecursiveReplace=False)
rep_3 = ReplaceText(Text=format, Find="'", Replace="\"", RecursiveReplace=False)
entwine = Entwine(
    Branch00=panel,
    Branch01=rep,
    Branch02="\t<nodegroup>",
    Branch03=rep_3,
    Branch04="\t</nodegroup>",
    Branch05="\t<beamgroup>",
    Branch06=rep_2,
    Branch07="\t</beamgroup>",
    Branch08="</graph>",
    FlattenInputs=True)  # -> flatten(Result)
ltcx_output = ClusterOutput(entwine)  # output text

# ==== cluster INPC3D6: Creates a C3D6 INP file from a trianhulated mesh

mesh_triangulated = ClusterInput()  # Triangulated mesh to create C3D6 elements
thickness = ClusterInput()  # Thickness (offset) of elements
filename = ClusterInput()  # Name of file (also NSET, ELSET, etc)
mesh = Mesh(mesh_triangulated)
num = Number(thickness)
demesh = DeconstructMesh(Mesh=mesh)  # -> Vertices, Faces, Colours, Normals
txt = Text(filename)
amp = Amplitude(Vector=demesh.Normals, Amplitude=num)
move = Move(Geometry=demesh.Vertices, Motion=amp)  # -> Geometry, Transform
conmesh = ConstructMesh(Vertices=move.Geometry, Faces=demesh.Faces)
demesh_2 = DeconstructMesh(Mesh=conmesh)  # -> Vertices, Faces, Colours, Normals
deface = DeconstructFace(Face=demesh.Faces)  # -> CornerA, CornerB, CornerC, CornerD
lng = ListLength(List=demesh_2.Vertices)
merge = Merge(Data1=demesh.Vertices, Data2=demesh_2.Vertices)  # -> flatten(Result)
lng_2 = ListLength(List=merge)
devec = DeconstructVector(Vector=merge)  # -> XComponent, YComponent, ZComponent
lng_3 = ListLength(List=flatten(deface.CornerA))
series = Series(Start=0, Step=1, Count=lng_2)
series_2 = Series(Start=0, Step=1, Count=lng_3)
addition = Addition(A=deface.CornerA, B=lng)
addition_2 = Addition(A=deface.CornerC, B=lng)
addition_3 = Addition(A=deface.CornerB, B=lng)
addition_4 = Addition(A=series, B=1)
addition_5 = Addition(A=series_2, B=1)  # -> graft(Result)
addition_6 = Addition(A=deface.CornerA, B=1)  # -> graft(Result)
addition_7 = Addition(A=deface.CornerB, B=1)  # -> graft(Result)
addition_8 = Addition(A=deface.CornerC, B=1)  # -> graft(Result)
addition_9 = Addition(A=addition, B=1)  # -> graft(Result)
addition_10 = Addition(A=addition_3, B=1)  # -> graft(Result)
addition_11 = Addition(A=addition_2, B=1)  # -> graft(Result)
panel = Panel("C3D6")
format = Expression(
    x=addition_4,
    y=devec.XComponent,
    z=devec.YComponent,
    u=devec.ZComponent,
    Expression="Format(\" {0}, {1}, {2}, {3}\", x, Round (y, 3), Round (z, 3), Round (u, 3))")
format_2 = Expression(
    x=addition_5,
    y=addition_6,
    z=addition_7,
    u=addition_8,
    v=addition_9,
    w=addition_10,
    a=addition_11,
    Expression="Format(\"{0}, {1}, {2}, {3}, {4}, {5}, {6}\", x, y, z, u, v, w, a)")
format_3 = Expression(x=txt, Expression="Format(\"*ELEMENT,TYPE=C3D6,ELSET=E{0}\", x)")
format_4 = Expression(x=txt, Expression="Format(\"*NODE,NSET=N{0}\", x)")
format_5 = Expression(x=txt, Expression="Format(\"**FILENAME = {0}\", x)")
entwine = Entwine(
    Branch00="**INP GENERATOR - CRYSTALLON ",
    Branch01=format_5,
    Branch02=format_4,
    Branch03=format,
    Branch04=format_3,
    Branch05=format_2,
    FlattenInputs=True)  # -> flatten(Result)
inp_output = ClusterOutput(entwine)  # output text

# ==== cluster INPC3D8: Creates a C3D8 input file from a quad mesh

mesh_quads = ClusterInput()  # Quad mesh to create C3D8 elements
thickness = ClusterInput()  # Thickness (offset) of elements
filename = ClusterInput()  # Name of file (also NSET, ELSET, etc)
mesh = Mesh(mesh_quads)
num = Number(thickness)
demesh = DeconstructMesh(Mesh=mesh)  # -> Vertices, Faces, Colours, Normals
txt = Text(filename)
amp = Amplitude(Vector=demesh.Normals, Amplitude=num)
move = Move(Geometry=demesh.Vertices, Motion=amp)  # -> Geometry, Transform
conmesh = ConstructMesh(Vertices=move.Geometry, Faces=demesh.Faces)
demesh_2 = DeconstructMesh(Mesh=conmesh)  # -> Vertices, Faces, Colours, Normals
merge = Merge(Data1=demesh.Vertices, Data2=demesh_2.Vertices)  # -> flatten(Result)
deface = DeconstructFace(Face=demesh.Faces)  # -> CornerA, CornerB, CornerC, CornerD
lng = ListLength(List=demesh_2.Vertices)
lng_2 = ListLength(List=merge)
devec = DeconstructVector(Vector=merge)  # -> XComponent, YComponent, ZComponent
lng_3 = ListLength(List=flatten(deface.CornerA))
series = Series(Start=0, Step=1, Count=lng_2)
series_2 = Series(Start=0, Step=1, Count=lng_3)
addition = Addition(A=deface.CornerA, B=lng)
addition_2 = Addition(A=deface.CornerC, B=lng)
addition_3 = Addition(A=deface.CornerD, B=lng)
addition_4 = Addition(A=deface.CornerB, B=lng)
addition_5 = Addition(A=series, B=1)
addition_6 = Addition(A=addition, B=1)  # -> graft(Result)
addition_7 = Addition(A=series_2, B=1)  # -> graft(Result)
addition_8 = Addition(A=deface.CornerA, B=1)  # -> graft(Result)
addition_9 = Addition(A=deface.CornerB, B=1)  # -> graft(Result)
addition_10 = Addition(A=deface.CornerC, B=1)  # -> graft(Result)
addition_11 = Addition(A=deface.CornerD, B=1)  # -> graft(Result)
addition_12 = Addition(A=addition_4, B=1)  # -> graft(Result)
addition_13 = Addition(A=addition_2, B=1)  # -> graft(Result)
addition_14 = Addition(A=addition_3, B=1)  # -> graft(Result)
format = Expression(
    x=addition_5,
    y=devec.XComponent,
    z=devec.YComponent,
    u=devec.ZComponent,
    Expression="Format(\" {0}, {1}, {2}, {3}\", x, Round (y, 3), Round (z, 3), Round (u, 3))")
panel = Panel("C3D8")
format_2 = Expression(
    x=addition_7,
    y=addition_8,
    z=addition_9,
    u=addition_10,
    v=addition_11,
    w=addition_6,
    a=addition_12,
    b=addition_13,
    c=addition_14,
    Expression="Format(\"{0}, {1}, {2}, {3}, {4}, {5}, {6}, {7}, {8}\", x, y, z, u, v, w, a, b, c)")
format_3 = Expression(x=txt, Expression="Format(\"*ELEMENT,TYPE=C3D8,ELSET=E{0}\", x)")
format_4 = Expression(x=txt, Expression="Format(\"*NODE,NSET=N{0}\", x)")
format_5 = Expression(x=txt, Expression="Format(\"**FILENAME = {0}\", x)")
entwine = Entwine(
    Branch00="**INP GENERATOR - CRYSTALLON ",
    Branch01=format_5,
    Branch02=format_4,
    Branch03=format,
    Branch04=format_3,
    Branch05=format_2,
    FlattenInputs=True)  # -> flatten(Result)
inp_output = ClusterOutput(entwine)  # output text

# ==== cluster INPC3D4: Creates a C3D4 INP file from a tetrahedral mesh (requires Tetrino https://www.food4rhino.com/app/tetrino)

# ----
# C3D4
# 
# REQUIRES TETRINO OR OTHER TETRAHEDRAL MESHER
# 
# https://www.food4rhino.com/app/tetrino
indices = ClusterInput()  # Indices of tetrahedrons ("I" output of Tetgen)
filename = ClusterInput()  # Name of file (also NSET, ELSET, etc)
points = ClusterInput()  # Points of tetrahedral mesh ("P" output of Tetgen)
pt = Point(points)
int = Integer(indices)
txt = Text(filename)
item = ListItem(List=int, Index=0, Wrap=True)  # -> flatten(Item), Item1, Item2, Item3
lng = ListLength(List=pt)
devec = DeconstructVector(Vector=pt)  # -> XComponent, YComponent, ZComponent
series = Series(Start=0, Step=1, Count=lng)
lng_2 = ListLength(List=flatten(item.Item))
series_2 = Series(Start=0, Step=1, Count=lng_2)
addition = Addition(A=series, B=1)
addition_2 = Addition(A=series_2, B=1)  # -> graft(Result)
addition_3 = Addition(A=item.Item, B=1)  # -> graft(Result)
addition_4 = Addition(A=item.Item1, B=1)  # -> graft(Result)
addition_5 = Addition(A=item.Item2, B=1)  # -> graft(Result)
addition_6 = Addition(A=item.Item3, B=1)  # -> graft(Result)
format = Expression(
    x=addition,
    y=devec.XComponent,
    z=devec.YComponent,
    u=devec.ZComponent,
    Expression="Format(\" {0}, {1}, {2}, {3}\", x, Round (y, 3), Round (z, 3), Round (u, 3))")
format_2 = Expression(
    x=addition_2,
    y=addition_3,
    z=addition_4,
    u=addition_5,
    v=addition_6,
    Expression="Format(\"{0}, {1}, {2}, {3}, {4}\", x, y, z, u, v)")
format_3 = Expression(x=txt, Expression="Format(\"*ELEMENT,TYPE=C3D4,ELSET=E{0}\", x)")
format_4 = Expression(x=txt, Expression="Format(\"*NODE,NSET=N{0}\", x)")
format_5 = Expression(x=txt, Expression="Format(\"**FILENAME = {0}\", x)")
entwine = Entwine(
    Branch00="**INP GENERATOR - CRYSTALLON ",
    Branch01=format_5,
    Branch02=format_4,
    Branch03=format,
    Branch04=format_3,
    Branch05=format_2,
    FlattenInputs=True)  # -> flatten(Result)
inp_output = ClusterOutput(entwine)  # output text

# ==== cluster LatticeHinge: Create a ruled surface between two curves and unroll to apply kerf bending patterns (requires Kangaroo)

u_divisions = ClusterInput()  # Divisions in the U direction
curve1 = ClusterInput()  # Curve to loft between
curve2 = ClusterInput()  # Curve to loft between
v_divisions = ClusterInput()  # Divisions in the V direction
influence = ClusterInput()  # Influence from surface curvature (0-1)
voxel_height = ClusterInput()  # Height of voxels on surface
crv = Curve(curve1)
crv_2 = Curve(curve2)
num = Number(u_divisions)
num_2 = Number(v_divisions)
num_3 = Number(influence)
num_4 = Number(voxel_height)
divide = DivideCurve(Curve=crv_2, Count=num, Kinks=False)  # -> simplify(Points), Tangents, simplify(Parameters)
divide_2 = DivideCurve(Curve=crv, Count=num, Kinks=False)  # -> simplify(Points), Tangents, simplify(Parameters)
toggle = BooleanToggle(False)
intcrv = Interpolate(Vertices=divide_2.Points, Degree=3, Periodic=False, KnotStyle=1)  # -> Curve, Length, Domain
shift = ShiftList(List=divide_2.Points, Shift="-1", Wrap=toggle)
intcrv_2 = Interpolate(Vertices=divide.Points, Degree=3, Periodic=False, KnotStyle=1)  # -> Curve, Length, Domain
shift_2 = ShiftList(List=divide.Points, Shift="-1", Wrap=toggle)
shift_3 = ShiftList(List=divide_2.Points, Shift="1", Wrap=toggle)
shift_4 = ShiftList(List=divide.Points, Shift="1", Wrap=toggle)
loft = Loft(
    Curves=[intcrv.Curve, intcrv_2.Curve],
    Options={Adjust=False, Closed=False, LoftEnds=0, LoftSimp=0, LoftType=0, Rebuild=10, Refit=0.01})
entwine = Entwine(Branch00=shift, Branch01=shift_3, Branch02=shift_4, Branch03=shift_2, FlattenInputs=True)  # -> simplify(Result)
sdivide = DivideSurface(Surface=reparameterize(loft), UCount=num_2, VCount=num)  # -> Points, Normals, simplify(Parameters)
flip = FlipMatrix(Data=entwine)
curvature = SurfaceCurvature(Surface=reparameterize(loft), Point=sdivide.Parameters)  # -> Frame, Gaussian, Mean
conmesh = ConstructMesh(Vertices=flip, Faces={A=0, B=1, C=2, D=3})
abs = Absolute(Value=curvature.Gaussian)
abs_2 = Absolute(Value=curvature.Mean)
mjoin = MeshJoin(Meshes=flatten(conmesh))
num_5 = Number(simplify(graft(abs_2)))
num_6 = Number(simplify(graft(abs)))
num_7 = Number("1")
weld = WeldMesh(Mesh=mjoin, Angle=3.141592654)
bnd = Bounds(Numbers=flatten(num_5))
bnd_2 = Bounds(Numbers=flatten(num_6))
unroller = Unroller(Strip=weld, Unroll=num_7)
remap = RemapNumbers(Value=num_5, Source=bnd, Target=Domain(0, 1))  # -> Mapped, Clipped
remap_2 = RemapNumbers(Value=num_6, Source=bnd_2, Target=Domain(0, 1))  # -> Mapped, Clipped
weld_2 = WeldMesh(Mesh=unroller, Angle=3.141592654)
addition = Addition(A=remap_2.Mapped, B=remap.Mapped)
faceb = FaceBoundaries(Mesh=weld_2)
bnd_3 = Bounds(Numbers=flatten(addition))
dom = ConstructDomain(DomainStart="1", DomainEnd=num_3)
explode = Explode(Curve=faceb, Recursive=True)  # -> Segments, Vertices
remap_3 = RemapNumbers(Value=addition, Source=bnd_3, Target=dom)  # -> Mapped, Clipped
item = ListItem(List=explode.Segments, Index="0", Wrap=True)
item_2 = ListItem(List=explode.Segments, Index="2", Wrap=True)
trim = TrimTree(Tree=remap_3.Mapped, Depth=1)
item_3 = ListItem(List=flatten(item), Index=0, Wrap=True)
replace = ReplaceItems(List=trim, Item="0", Indices="0", Wrap=False)
ma = MassAddition(Input=replace)  # -> Result, PartialResults
flip_2 = FlipCurve(Curve=flatten(item), Guide=item_3)  # -> Curve, Flag
flip_3 = FlipCurve(Curve=flatten(item_2), Guide=item_3)  # -> Curve, Flag
bnd_4 = Bounds(Numbers=ma.PartialResults)
cp = ControlPoints(Curve=flip_2.Curve)  # -> Points, Weights, Knots
cp_2 = ControlPoints(Curve=flip_3.Curve)  # -> Points, Weights, Knots
remap_4 = RemapNumbers(Value=ma.PartialResults, Source=bnd_4, Target=Domain(0, 1))  # -> Mapped, Clipped
pdecon = Deconstruct(Point=sdivide.Parameters)  # -> XComponent, YComponent, ZComponent
cullpt = CullDuplicates(Points=flatten(cp_2.Points), Tolerance=0.1, CullMode=3)  # -> Points, Indices, Valence
cullpt_2 = CullDuplicates(Points=flatten(cp.Points), Tolerance=0.1, CullMode=3)  # -> Points, Indices, Valence
pt = ConstructPoint(XCoordinate=pdecon.XComponent, YCoordinate=remap_4.Mapped, ZCoordinate=pdecon.ZComponent)  # -> simplify(Point)
loft_opt = LoftOptions(Closed=False, Adjust=Toggle(True), Rebuild=num, Refit=0, Type=0)
pline = PolyLine(Vertices=flatten(cullpt.Points), Closed=False)
pline_2 = PolyLine(Vertices=flatten(cullpt_2.Points), Closed=False)
evalsrf = EvaluateSurface(Surface=reparameterize(loft), Point=pt)  # -> Point, Normal, Frame
loft_2 = Loft(Curves=[pline_2, pline], Options=loft_opt)
pt_2 = Point(evalsrf.Point)
panel = Panel("Lattice Hinges")
srf_cp = SurfaceClosestPoint(Point=pt_2, Surface=reparameterize(loft))  # -> Point, UVPoint, Distance
evalsrf_2 = EvaluateSurface(Surface=reparameterize(loft_2), Point=srf_cp.UVPoint)  # -> Point, Normal, Frame
vec = Vector(evalsrf.Normal)
pt_3 = Point(evalsrf.Point)
vec_2 = Vector(evalsrf_2.Normal)
amp = Amplitude(Vector=vec, Amplitude=num_4)
pt_4 = Point(evalsrf_2.Point)
amp_2 = Amplitude(Vector=vec_2, Amplitude=num_4)
move = Move(Geometry=pt_3, Motion=amp)  # -> Geometry, Transform
move_2 = Move(Geometry=pt_4, Motion=amp_2)  # -> Geometry, Transform
toggle_2 = BooleanToggle(False)
flip_4 = FlipMatrix(Data=pt_3)
toggle_3 = BooleanToggle(False)
flip_5 = FlipMatrix(Data=pt_3)
flip_6 = FlipMatrix(Data=move.Geometry)
flip_7 = FlipMatrix(Data=move.Geometry)
toggle_4 = BooleanToggle(False)
flip_8 = FlipMatrix(Data=move_2.Geometry)
flip_9 = FlipMatrix(Data=move_2.Geometry)
toggle_5 = BooleanToggle(False)
flip_10 = FlipMatrix(Data=pt_4)
flip_11 = FlipMatrix(Data=pt_4)
shift_5 = ShiftList(List=flip_4, Shift="1", Wrap=toggle_3)
shift_6 = ShiftList(List=flip_5, Shift="-1", Wrap=toggle_3)
shift_7 = ShiftList(List=flip_6, Shift="-1", Wrap=toggle_2)
shift_8 = ShiftList(List=flip_7, Shift="1", Wrap=toggle_2)
shift_9 = ShiftList(List=flip_8, Shift="1", Wrap=toggle_4)
shift_10 = ShiftList(List=flip_9, Shift="-1", Wrap=toggle_4)
shift_11 = ShiftList(List=flip_10, Shift="-1", Wrap=toggle_5)
shift_12 = ShiftList(List=flip_11, Shift="1", Wrap=toggle_5)
flip_12 = FlipMatrix(Data=shift_5)  # -> simplify(Data)
flip_13 = FlipMatrix(Data=shift_7)  # -> simplify(Data)
flip_14 = FlipMatrix(Data=shift_6)  # -> simplify(Data)
flip_15 = FlipMatrix(Data=shift_8)  # -> simplify(Data)
flip_16 = FlipMatrix(Data=shift_9)  # -> simplify(Data)
flip_17 = FlipMatrix(Data=shift_10)  # -> simplify(Data)
flip_18 = FlipMatrix(Data=shift_11)  # -> simplify(Data)
flip_19 = FlipMatrix(Data=shift_12)  # -> simplify(Data)
shift_13 = ShiftList(List=flip_12, Shift="1", Wrap=toggle_3)  # -> simplify(List)
shift_14 = ShiftList(List=flip_12, Shift="-1", Wrap=toggle_3)  # -> simplify(List)
shift_15 = ShiftList(List=flip_14, Shift="1", Wrap=toggle_3)  # -> simplify(List)
shift_16 = ShiftList(List=flip_14, Shift="-1", Wrap=toggle_3)  # -> simplify(List)
shift_17 = ShiftList(List=flip_15, Shift="1", Wrap=toggle_2)  # -> simplify(List)
shift_18 = ShiftList(List=flip_13, Shift="1", Wrap=toggle_2)  # -> simplify(List)
shift_19 = ShiftList(List=flip_13, Shift="-1", Wrap=toggle_2)  # -> simplify(List)
shift_20 = ShiftList(List=flip_15, Shift="-1", Wrap=toggle_2)  # -> simplify(List)
shift_21 = ShiftList(List=flip_17, Shift="-1", Wrap=toggle_4)  # -> simplify(List)
shift_22 = ShiftList(List=flip_17, Shift="1", Wrap=toggle_4)  # -> simplify(List)
shift_23 = ShiftList(List=flip_16, Shift="-1", Wrap=toggle_4)  # -> simplify(List)
shift_24 = ShiftList(List=flip_18, Shift="-1", Wrap=toggle_5)  # -> simplify(List)
shift_25 = ShiftList(List=flip_18, Shift="1", Wrap=toggle_5)  # -> simplify(List)
shift_26 = ShiftList(List=flip_16, Shift="1", Wrap=toggle_4)  # -> simplify(List)
shift_27 = ShiftList(List=flip_19, Shift="-1", Wrap=toggle_5)  # -> simplify(List)
shift_28 = ShiftList(List=flip_19, Shift="1", Wrap=toggle_5)  # -> simplify(List)
srf4pt = _4PointSurface(CornerA=shift_24, CornerB=shift_25, CornerC=shift_28, CornerD=shift_27)  # -> flatten(Surface)
tbox = TwistedBox(
    CornerA=shift_24,
    CornerB=shift_25,
    CornerC=shift_28,
    CornerD=shift_27,
    CornerE=shift_21,
    CornerF=shift_22,
    CornerG=shift_26,
    CornerH=shift_23)  # -> flatten(TwistedBox)
srf4pt_2 = _4PointSurface(CornerA=shift_16, CornerB=shift_15, CornerC=shift_13, CornerD=shift_14)  # -> flatten(Surface)
tbox_2 = TwistedBox(
    CornerA=shift_16,
    CornerB=shift_15,
    CornerC=shift_13,
    CornerD=shift_14,
    CornerE=shift_19,
    CornerF=shift_18,
    CornerG=shift_17,
    CornerH=shift_20)  # -> flatten(TwistedBox)
num_8 = Number(trim)
toggle_6 = BooleanToggle(False)
flip_20 = FlipMatrix(Data=num_8)
flip_21 = FlipMatrix(Data=num_8)
shift_29 = ShiftList(List=flip_20, Shift="1", Wrap=toggle_6)
shift_30 = ShiftList(List=flip_21, Shift="-1", Wrap=toggle_6)
flip_22 = FlipMatrix(Data=shift_29)  # -> simplify(Data)
flip_23 = FlipMatrix(Data=shift_30)  # -> simplify(Data)
shift_31 = ShiftList(List=flip_23, Shift="1", Wrap=toggle_6)  # -> simplify(List)
shift_32 = ShiftList(List=flip_22, Shift="1", Wrap=toggle_6)  # -> simplify(List)
shift_33 = ShiftList(List=flip_22, Shift="-1", Wrap=toggle_6)  # -> simplify(List)
shift_34 = ShiftList(List=flip_23, Shift="-1", Wrap=toggle_6)  # -> simplify(List)
entwine_2 = Entwine(
    Branch00=graft(shift_34),
    Branch01=graft(shift_31),
    Branch02=graft(shift_33),
    Branch03=graft(shift_32),
    FlattenInputs=True)
flip_24 = FlipMatrix(Data=entwine_2)
ma_2 = MassAddition(Input=flip_24)  # -> Result, PartialResults
bnd_5 = Bounds(Numbers=flatten(ma_2.Result))
remap_5 = RemapNumbers(Value=ma_2.Result, Source=bnd_5, Target=Domain(0, 1))  # -> flatten(Mapped), Clipped
tbox_3 = TwistedBox(tbox)
tbox_4 = TwistedBox(tbox_2)
srf = Surface(srf4pt_2)
srf_2 = Surface(srf4pt)
num_9 = Number(remap_5.Mapped)
srf_3 = Surface(loft_2)
voxels_rolled = ClusterOutput(tbox_4)  # Voxels of the rolled surface (for preview)
voxels_unrolled = ClusterOutput(tbox_3)  # Voxels of the unrolled surface (for mapping)
panels_rolled = ClusterOutput(srf)  # Panels of the rolled surface (for preview)
panel_values = ClusterOutput(num_9)  # Values measuring curvature (0-1)
unrolled_surface = ClusterOutput(srf_3)  # The unrolled surface
panels_unrolled = ClusterOutput(srf_2)  # Panels of the unrolled surface (for mapping)

# ==== cluster LatticeHingeCellFill: Populate lattice hinge panels with a curve based unit cell

# ----
# LATTICE HINGE CELL FILL
unit_cell_c = ClusterInput()  # Unit cell to populate Lattice Hinge panels
panels = ClusterInput()  # Panels to be filled with unit cells
crv = Curve(unit_cell_c)
srf = Surface(panels)
bbox = BoundingBox(Content=crv, Plane=PlaneXY(0, 0, 0), UnionBox=True)  # -> Box, Box_2
map_srf = MapToSurface(Curve=crv, Source=bbox.Box, Target=graft(srf))  # -> flatten(Curve)
remove_duplicate_lines = RemoveDuplicateLines(lattice_l=flatten(map_srf))
join = JoinCurves(Curves=remove_duplicate_lines, Preserve=False)
lattice_hinge = ClusterOutput(join)  # List of curves that make up the lattice hinge

# ==== cluster LatticeHingeTweenCellFill: Tween between lattice hinge panels with curve based unit cells

# ----
# TWEEN LATTICE HINGE CELL FILL
unit_cell_c_1 = ClusterInput()  # Unit cell to populate Lattice Hinge panels
unit_cell_c_2 = ClusterInput()  # Unit cell to populate Lattice Hinge panels
value = ClusterInput()  # Value from 0-1 corresponding to each panel
panels = ClusterInput()  # Panels to be filled with unit cells
num = Number(value)
srf = Surface(panels)
crv = Curve(unit_cell_c_2)
crv_2 = Curve(unit_cell_c_1)
tweencrv = TweenCurve(CurveA=graft(crv_2), CurveB=graft(crv), Factor=flatten(num), BlendType=0)
flip = FlipMatrix(Data=tweencrv)
bbox = BoundingBox(Content=flip, Plane=PlaneXY(0, 0, 0), UnionBox=True)  # -> Box, Box_2
map_srf = MapToSurface(Curve=flip, Source=bbox.Box, Target=graft(srf))
remove_duplicate_lines = RemoveDuplicateLines(lattice_l=flatten(map_srf))
join = JoinCurves(Curves=remove_duplicate_lines, Preserve=False)
lattice_hinge = ClusterOutput(join)  # List of curves that make up the lattice hinge

# ==== cluster LatticeHingeShellFill: Populate lattice hinge panels with a shell based unit cell

# ----
# LATTICE HINGE SHELL FILL
unit_cell_shell = ClusterInput()  # Unit cell to populate voxels
voxels = ClusterInput()  # Voxels to be filled with unit cells
tolerance = ClusterInput()  # Tolerance for merging faces and vertices (number usually between 0.001 and 0.1)
geo = Geometry(unit_cell_shell)
geo_2 = Geometry(voxels)
num = Number(tolerance)
mesh = Mesh(geo)
demesh = DeconstructMesh(Mesh=mesh)  # -> Vertices, Faces, Colours, Normals
avr = Average(Input=demesh.Vertices)
avr_2 = Average(Input=demesh.Normals)
move = Move(Geometry=avr, Motion=avr_2)  # -> simplify(Geometry), Transform
merge = Merge(Data1=mesh, Data2=move.Geometry)  # -> flatten(Result)
bbox = BoundingBox(Content=merge, Plane=PlaneXY(0, 0, 0), UnionBox=True)  # -> simplify(Box), Box_2
morph = BoxMorph(Geometry=mesh, Reference=bbox.Box, Target=flatten(geo_2))
mjoin = MeshJoin(Meshes=morph)
demesh_2 = DeconstructMesh(Mesh=mjoin)  # -> Vertices, Faces, Colours, Normals
facen = FaceNormals(Mesh=mjoin)  # -> Centers, Normals
cullpt = CullDuplicates(Points=facen.Centers, Tolerance=num, CullMode=1)  # -> Points, Indices, Valence
item = ListItem(List=demesh_2.Faces, Index=cullpt.Indices, Wrap=True)
conmesh = ConstructMesh(Vertices=demesh_2.Vertices, Faces=item)
weld = WeldMesh(Mesh=conmesh, Angle=3.141592654)
c_script = CSharpScript(M=weld, radius=num)  # -> out, A; inputs M: Mesh, radius: Double; same code as c_script
lattice_hinge_shell = ClusterOutput(c_script.A)  # Joined mesh that makes up the lattice hinge

# ==== cluster LatticeHingeTweenShellFill: Tween between lattice hinge panels with shell based unit cells

# ----
# LATTICE HINGE TWEEN SHELL FILL
tolerance = ClusterInput()  # Tolerance for merging faces and vertices (number usually between 0.001 and 0.1)
value = ClusterInput()  # Value from 0-1 corresponding to each voxel
unit_cell_shell = ClusterInput()  # Unit cell to populate voxels
voxels = ClusterInput()  # Voxels to be filled with unit cells
unit_cell_shell_2 = ClusterInput()  # Unit cell to populate voxels
geo = Geometry(flatten(voxels))
geo_2 = Geometry(unit_cell_shell_2)
num = Number(tolerance)
geo_3 = Geometry(unit_cell_shell)
num_2 = Number(value)
demesh = DeconstructMesh(Mesh=geo_3)  # -> Vertices, Faces, Colours, Normals
demesh_2 = DeconstructMesh(Mesh=geo_2)  # -> Vertices, Faces, Colours, Normals
ln = Line(StartPoint=demesh.Vertices, EndPoint=demesh_2.Vertices)
eval = EvaluateCurve(Curve=reparameterize(graft(ln)), Parameter=num_2)  # -> simplify(Point), Tangent, Angle
flip = FlipMatrix(Data=eval.Point)
conmesh = ConstructMesh(Vertices=flip, Faces=demesh.Faces)  # -> simplify(Mesh)
demesh_3 = DeconstructMesh(Mesh=conmesh)  # -> Vertices, Faces, Colours, Normals
avr = Average(Input=demesh_3.Vertices)
avr_2 = Average(Input=demesh_3.Normals)
move = Move(Geometry=avr, Motion=avr_2)  # -> simplify(Geometry), Transform
merge = Merge(Data1=conmesh, Data2=move.Geometry)
bbox = BoundingBox(Content=merge, Plane=PlaneXY(0, 0, 0), UnionBox=True)  # -> simplify(Box), Box_2
morph = BoxMorph(Geometry=conmesh, Reference=bbox.Box, Target=simplify(graft(geo)))  # -> flatten(Geometry)
mjoin = MeshJoin(Meshes=morph)
demesh_4 = DeconstructMesh(Mesh=mjoin)  # -> Vertices, Faces, Colours, Normals
facen = FaceNormals(Mesh=mjoin)  # -> Centers, Normals
cullpt = CullDuplicates(Points=facen.Centers, Tolerance=num, CullMode=1)  # -> Points, Indices, Valence
item = ListItem(List=demesh_4.Faces, Index=cullpt.Indices, Wrap=True)
conmesh_2 = ConstructMesh(Vertices=demesh_4.Vertices, Faces=item)
weld = WeldMesh(Mesh=conmesh_2, Angle=3.141592654)
c_script = CSharpScript(M=weld, radius=num)  # -> out, A; inputs M: Mesh, radius: Double; same code as c_script
lattice_hinge_shell = ClusterOutput(c_script.A)  # Joined mesh that makes up the lattice hinge

# ==== cluster MeshFlatten: Flatten a mesh surface and measure the strain per mesh face (requires Kangaroo2)

# ----
# Mesh Flatten
# 
# Requires Kangaroo2
# https://www.food4rhino.com/app/kangaroo-physics
# Thanks to Daniel Piker
# 
# https://www.grasshopper3d.com/group/kangaroo/forum/topics/relaxation-to-flat-geometry
mesh = ClusterInput()  # Mesh to flatten
plane = ClusterInput()  # Plane to flatten mesh to
threshold = ClusterInput()  # Threshold for Kangaroo Solver (~1e-7)
max_iterations = ClusterInput()  # Max iterations for Kangaroo Solver
num = Number(threshold)
mesh_2 = Mesh(mesh)
num_2 = Number(max_iterations)
pln = Plane(plane)
bool = Boolean()
bool_2 = Boolean()
tri = Triangulate(Mesh=mesh_2)  # -> Mesh, Count
demesh = DeconstructMesh(Mesh=mesh_2)  # -> Vertices, Faces, Colours, Normals
hingepoints = HingePoints(Mesh=tri.Mesh)  # -> _1, _2, _3, _4
avr = Average(Input=demesh.Vertices)
foldangle = FoldAngle(P1=hingepoints._1, P2=hingepoints._2, P3=hingepoints._3, P4=hingepoints._4)
padjust = AdjustPlane(Plane=avr, Normal=pln)
edgelengths = EdgeLengths(Mesh=tri.Mesh, LengthFactor=1, Strength=1)
smooth = Smooth(M=tri.Mesh, Strength=1)
multiplication = Multiplication(A=foldangle, B="0")
onplane = OnPlane(Points=demesh.Vertices, Plane=padjust, Strength="10")
show = Show(G=mesh_2)
hinge = Hinge(
    FoldStart=hingepoints._1,
    FoldEnd=hingepoints._2,
    Tip1=hingepoints._3,
    Tip2=hingepoints._4,
    RestAngle=multiplication,
    Strength="3")
entwine = Entwine(Branch00=show, Branch01=[onplane, edgelengths, smooth, hinge], FlattenInputs=True)
zombiesolver = ZombieSolver(GoalObjects=entwine, Threshold=num, Tolerance=0.01, MaxIterations=num_2)  # -> I, V, O
solver = Solver(GoalObjects=entwine, Reset=bool, Threshold=num, Tolerance=0.01, On=bool_2)  # -> I, V, O; disabled
mesh_3 = Mesh(zombiesolver.O)
clean = CleanTree(RemoveNulls=True, RemoveInvalid=True, RemoveEmpty=Toggle(True), Tree=mesh_3)
mesh_4 = Mesh(mesh_2)
mesh_5 = Mesh(clean)
mesh_6 = Mesh(mesh_4)
mesh_7 = Mesh(mesh_5)
mesh_8 = Mesh(mesh_5)
facen = FaceNormals(Mesh=mesh_6)  # -> Centers, Normals
demesh_2 = DeconstructMesh(Mesh=mesh_7)  # -> Vertices, Faces, Colours, Normals
facen_2 = FaceNormals(Mesh=mesh_8)  # -> Centers, Normals
conmesh = ConstructMesh(Vertices=demesh_2.Vertices, Faces=graft(demesh_2.Faces))  # -> simplify(Mesh)
mesh_9 = Mesh(mesh_5)
mesh_10 = Mesh(conmesh)
num_3 = Number(zombiesolver.I)
flattened_mesh = ClusterOutput(mesh_9)  # Flattened Mesh
mesh_faces = ClusterOutput(mesh_10)  # Faces of the flattened mesh
iterations = ClusterOutput(num_3)  # Iterations of kangaroo solver

faceb = FaceBoundaries(Mesh=mesh_4)
faceb_2 = FaceBoundaries(Mesh=mesh_5)
explode = Explode(Curve=faceb_2, Recursive=True)  # -> Segments, Vertices
explode_2 = Explode(Curve=faceb, Recursive=True)  # -> Segments, Vertices
len = Length(Curve=explode.Segments)
len_2 = Length(Curve=explode_2.Segments)
division = Division(A=len, B=len_2)  # -> simplify(Result)

curvepoint = PointOnCurve(explode_2.Segments, parameter=0.5)
curvepoint_2 = PointOnCurve(explode.Segments, parameter=0.5)
ln = Line(StartPoint=curvepoint_2, EndPoint=graft(facen_2.Centers))
ln_2 = Line(StartPoint=curvepoint, EndPoint=graft(facen.Centers))
len_3 = Length(Curve=ln)
len_4 = Length(Curve=ln_2)
division_2 = Division(A=len_3, B=len_4)  # -> simplify(Result)

cullpt = CullDuplicates(Points=explode_2.Vertices, Tolerance=0.1, CullMode=1)  # -> Points, Indices, Valence
cullpt_2 = CullDuplicates(Points=explode.Vertices, Tolerance=0.1, CullMode=1)  # -> Points, Indices, Valence
ln_3 = Line(StartPoint=cullpt.Points, EndPoint=graft(facen.Centers))
ln_4 = Line(StartPoint=cullpt_2.Points, EndPoint=graft(facen_2.Centers))
len_5 = Length(Curve=ln_4)
len_6 = Length(Curve=ln_3)
division_3 = Division(A=len_5, B=len_6)  # -> simplify(Result)

num_4 = Number(division_3)
line = Line(ln_4)
ci_ratio = Panel(num_4)

num_5 = Number(division_2)
line_2 = Line(ln)
cf_ratio = Panel(num_5)

num_6 = Number(division)
line_3 = Line(explode.Segments)
cp_ratio = Panel(num_6)

merge = Merge(Data1=num_6, Data2=num_4, Data3=num_5)
avr_2 = Average(Input=merge)
num_7 = Number(avr_2)
average_ratio = Panel(num_7)

ratio_cp = ClusterOutput(num_6)  # Ratio of strain on face edges (cP)
cp_lines = ClusterOutput(line_3)  # Lines for preview
ratio_cf = ClusterOutput(num_5)  # Ratio of strain on face centered lines (cF)
cf_lines = ClusterOutput(line_2)  # Lines for preview
ratio_ci = ClusterOutput(num_4)  # Ratio of strain on body centered lines (cI)
ci_lines = ClusterOutput(line)  # Lines for preview
ratio_average = ClusterOutput(num_7)  # Average ratio of strain per face

# ==== cluster MeshShellFIll: Map shell unit cells to mesh faces

mesh_face = ClusterInput()  # Mesh faces (exploded as single meshes)
tolerance = ClusterInput()  # Tolerance for merging faces and vertices (number usually between 0.001 and 0.1)
mesh_shell = ClusterInput()  # Shell Unit cell to map to mesh faces
mesh = Mesh(mesh_face)
geo = Geometry(mesh_shell)
num = Number(tolerance)
item = ListItem(List=geo, Index=0, Wrap=True)  # -> Item, Item1
mesh_2 = Mesh(item.Item)
mesh_3 = Mesh(item.Item1)
demesh = DeconstructMesh(Mesh=mesh_2)  # -> Vertices, Faces, Colours, Normals
meshcp = MeshClosestPoint(Point=demesh.Vertices, Mesh=mesh_3)  # -> Point, Index, Parameter
panel = Panel("Mesh Shell Fill")
meval = MeshEval(Mesh=mesh, Parameter=meshcp.Parameter)  # -> Point, Normal, Colour
conmesh = ConstructMesh(Vertices=meval.Point, Faces=demesh.Faces)
mjoin = MeshJoin(Meshes=conmesh)
facen = FaceNormals(Mesh=mjoin)  # -> Centers, Normals
demesh_2 = DeconstructMesh(Mesh=mjoin)  # -> Vertices, Faces, Colours, Normals
cullpt = CullDuplicates(Points=facen.Centers, Tolerance=num, CullMode=1)  # -> Points, Indices, Valence
item_2 = ListItem(List=demesh_2.Faces, Index=cullpt.Indices, Wrap=True)
conmesh_2 = ConstructMesh(Vertices=demesh_2.Vertices, Faces=item_2)
weld = WeldMesh(Mesh=conmesh_2, Angle=3.141592654)
c_script = CSharpScript(M=weld, radius=num)  # -> out, A; inputs M: Mesh, radius: Double; same code as c_script
lattice_hinge_shell = ClusterOutput(c_script.A)  # Joined mesh that makes up the lattice hinge

# ==== cluster MeshTweenShellFill: Tween between mesh shell unit cells on mesh faces

# ----
# Mesh Tween Shell Fill
value = ClusterInput()  # Value from 0-1 corresponding to each voxel
mesh_shell_2 = ClusterInput()  # Shell Unit cell to map to mesh faces
mesh_face = ClusterInput()  # Mesh faces (exploded as single meshes)
tolerance = ClusterInput()  # Tolerance for merging faces and vertices (number usually between 0.001 and 0.1)
mesh_shell_1 = ClusterInput()  # Shell Unit cell to map to mesh faces
num = Number(value)
geo = Geometry(mesh_shell_2)
mesh = Mesh(mesh_face)
geo_2 = Geometry(mesh_shell_1)
num_2 = Number(tolerance)
item = ListItem(List=geo, Index=0, Wrap=True)  # -> Item, Item1
item_2 = ListItem(List=geo_2, Index=0, Wrap=True)  # -> Item, Item1
mesh_2 = Mesh(item.Item1)
mesh_3 = Mesh(item.Item)
mesh_4 = Mesh(item_2.Item)
mesh_5 = Mesh(item_2.Item1)
demesh = DeconstructMesh(Mesh=mesh_3)  # -> Vertices, Faces, Colours, Normals
demesh_2 = DeconstructMesh(Mesh=mesh_4)  # -> Vertices, Faces, Colours, Normals
ln = Line(StartPoint=demesh_2.Vertices, EndPoint=demesh.Vertices)
eval = EvaluateCurve(Curve=ln, Parameter=num)  # -> simplify(Point), Tangent, Angle
meshcp = MeshClosestPoint(Point=eval.Point, Mesh=mesh_5)  # -> Point, Index, Parameter
meval = MeshEval(Mesh=mesh, Parameter=meshcp.Parameter)  # -> Point, Normal, Colour
conmesh = ConstructMesh(Vertices=meval.Point, Faces=demesh.Faces)
mjoin = MeshJoin(Meshes=conmesh)
facen = FaceNormals(Mesh=mjoin)  # -> Centers, Normals
demesh_3 = DeconstructMesh(Mesh=mjoin)  # -> Vertices, Faces, Colours, Normals
cullpt = CullDuplicates(Points=facen.Centers, Tolerance=num_2, CullMode=1)  # -> Points, Indices, Valence
item_3 = ListItem(List=demesh_3.Faces, Index=cullpt.Indices, Wrap=True)
conmesh_2 = ConstructMesh(Vertices=demesh_3.Vertices, Faces=item_3)
weld = WeldMesh(Mesh=conmesh_2, Angle=3.141592654)
c_script = CSharpScript(M=weld, radius=num_2)  # -> out, A; inputs M: Mesh, radius: Double; same code as c_script
lattice_hinge_shell = ClusterOutput(c_script.A)  # Joined mesh that makes up the lattice hinge

# ==== cluster MeshHingeCellTri: Map a triangle based parametric cell with two domains to mesh faces

mesh_face = ClusterInput()  # Mesh faces (exploded as single meshes)
parameter_2a = ClusterInput()  # Number (0-1)
parameter_1b = ClusterInput()  # Number (0-1)
tolerance = ClusterInput()  # Tolerance for merging faces and vertices (number usually between 0.001 and 0.1)
parameter_1c = ClusterInput()  # Number (0-1)
parameter_2c = ClusterInput()  # Number (0-1)
parameter_1a = ClusterInput()  # Number (0-1)
parameter_2b = ClusterInput()  # Number (0-1)
mesh = Mesh(mesh_face)
t1 = Number(parameter_2a)
t1_2 = Number(parameter_2c)
t1_3 = Number(parameter_1a)
t1_4 = Number(parameter_2b)
t1_5 = Number(parameter_1c)
num = Number(tolerance)
t1_6 = Number(parameter_1b)
polygon = Polygon(Plane=PlaneXY(0, 0, 0), Radius="3", Segments="3", FilletRadius=0)  # -> Polygon, Length
merge = Merge(Data1=t1, Data2=t1_4, Data3=t1_2)
merge_2 = Merge(Data1=t1_3, Data2=t1_6, Data3=t1_5)
crv = Curve(polygon.Polygon)
item = ListItem(List=merge_2, Index=0, Wrap=True)  # -> flatten(Item)
shift = ShiftList(List=merge, Shift="-1", Wrap=True)
shift_2 = ShiftList(List=merge_2, Shift="-1", Wrap=True)
explode = Explode(Curve=crv, Recursive=True)  # -> Segments, Vertices
pcen = PolygonCenter(Polyline=crv)  # -> CenterV, CenterE, CenterA
lng = ListLength(List=item)
curvepoint = PointOnCurve(explode.Segments, parameter=0.5)
division = Division(A=shift, B="2")
cullpt = CullDuplicates(Points=explode.Vertices, Tolerance=0.1, CullMode=3)  # -> Points, Indices, Valence
dup = DuplicateData(Data=graft(explode.Segments), Number=lng, Order=True)  # -> simplify(graft(Data))
subtraction = Subtraction(A="1", B=division)
merge_3 = Merge(Data1=graft(division), Data2=graft(subtraction))  # -> simplify(Result)
ln = Line(StartPoint=pcen.CenterV, EndPoint=curvepoint)
trim = TrimTree(Tree=dup, Depth=1)
flip = FlipMatrix(Data=trim)  # -> graft(Data)
eval = EvaluateCurve(Curve=ln, Parameter=shift_2)  # -> simplify(Point), Tangent, Angle
eval_2 = EvaluateCurve(Curve=reparameterize(simplify(flip)), Parameter=merge_3)  # -> simplify(Point), Tangent, Angle
item_2 = ListItem(List=eval.Point, Index=0, Wrap=True)  # -> flatten(Item)
item_3 = ListItem(List=eval_2.Point, Index=0, Wrap=True)  # -> Item, Item1
lng_2 = ListLength(List=item_2)
trim_2 = TrimTree(Tree=item_3.Item1, Depth=1)
trim_3 = TrimTree(Tree=item_3.Item, Depth=1)
item_4 = ListItem(List=curvepoint, Index=0, Wrap=True)  # -> Item, Item1, Item2
item_5 = ListItem(List=trim_2, Index=0, Wrap=True)  # -> Item, Item1, Item2
item_6 = ListItem(List=trim_3, Index=0, Wrap=True)  # -> Item, Item1, Item2
item_7 = ListItem(List=eval.Point, Index=0, Wrap=True)  # -> Item, Item1, Item2
dup_2 = DuplicateData(Data=item_4.Item1, Number=lng_2, Order=True)  # -> simplify(graft(Data))
dup_3 = DuplicateData(Data=item_4.Item, Number=lng_2, Order=True)  # -> simplify(graft(Data))
dup_4 = DuplicateData(Data=item_4.Item2, Number=lng_2, Order=True)  # -> simplify(graft(Data))
conmesh = ConstructMesh(Vertices=[dup_3, item_7.Item, item_7.Item2], Faces={A=0, B=1, C=2, D=2})
conmesh_2 = ConstructMesh(Vertices=[dup_2, item_7.Item, item_7.Item1], Faces={A=0, B=1, C=2, D=2})
conmesh_3 = ConstructMesh(Vertices=[dup_4, item_7.Item2, item_7.Item1], Faces={A=0, B=1, C=2, D=2})
conmesh_4 = ConstructMesh(Vertices=[dup_3, item_7.Item, item_5.Item], Faces={A=0, B=1, C=2, D=2})
conmesh_5 = ConstructMesh(Vertices=eval.Point, Faces={A=0, B=1, C=2, D=2})
conmesh_6 = ConstructMesh(Vertices=[item_7.Item1, dup_2, item_5.Item1], Faces={A=0, B=1, C=2, D=2})
conmesh_7 = ConstructMesh(Vertices=[dup_2, item_7.Item, item_6.Item1], Faces={A=0, B=1, C=2, D=2})
conmesh_8 = ConstructMesh(Vertices=[dup_4, item_7.Item2, item_5.Item2], Faces={A=0, B=1, C=2, D=2})
conmesh_9 = ConstructMesh(Vertices=[dup_3, item_7.Item2, item_6.Item], Faces={A=0, B=1, C=2, D=2})
conmesh_10 = ConstructMesh(Vertices=[dup_4, item_7.Item1, item_6.Item2], Faces={A=0, B=1, C=2, D=2})
merge_4 = Merge(
    Data1=conmesh_5,
    Data2=conmesh,
    Data3=conmesh_2,
    Data4=conmesh_3,
    Data5=conmesh_4,
    Data6=conmesh_6,
    Data7=conmesh_8,
    Data8=conmesh_9,
    Data9=conmesh_7,
    Data10=conmesh_10)
mjoin = MeshJoin(Meshes=merge_4)
unim = UnifyMesh(Mesh=mjoin)  # -> Result, Count
demesh = DeconstructMesh(Mesh=unim.Result)  # -> Vertices, Faces, Colours, Normals
deface = DeconstructFace(Face=demesh.Faces)  # -> CornerA, CornerB, CornerC, CornerD
item_8 = ListItem(List=demesh.Vertices, Index=deface.CornerC, Wrap=True)
item_9 = ListItem(List=demesh.Vertices, Index=deface.CornerA, Wrap=True)
item_10 = ListItem(List=demesh.Vertices, Index=deface.CornerB, Wrap=True)
cullpt_2 = CullDuplicates(Points=demesh.Vertices, Tolerance=0.1, CullMode=3)  # -> Points, Indices, Valence
fsim = FindSimilarMember(Data=item_10, Set=cullpt_2.Points)  # -> Hit, Index
fsim_2 = FindSimilarMember(Data=item_9, Set=cullpt_2.Points)  # -> Hit, Index
fsim_3 = FindSimilarMember(Data=item_8, Set=cullpt_2.Points)  # -> Hit, Index
triangle = MeshTriangle(CornerA=fsim_2.Index, CornerB=fsim.Index, CornerC=fsim_3.Index)
triangle_2 = MeshTriangle(CornerA=0, CornerB=1, CornerC=2)
conmesh_11 = ConstructMesh(Vertices=cullpt_2.Points, Faces=triangle)  # -> simplify(Mesh)
conmesh_12 = ConstructMesh(Vertices=cullpt.Points, Faces=triangle_2)
weld = WeldMesh(Mesh=conmesh_11, Angle=3.141592654)
mesh_2 = Mesh(weld)
mesh_3 = Mesh(conmesh_12)
crv_2 = Curve(crv)
demesh_2 = DeconstructMesh(Mesh=mesh_2)  # -> Vertices, Faces, Colours, Normals
meshcp = MeshClosestPoint(Point=demesh_2.Vertices, Mesh=mesh_3)  # -> Point, Index, Parameter
meval = MeshEval(Mesh=mesh, Parameter=meshcp.Parameter)  # -> Point, Normal, Colour
conmesh_13 = ConstructMesh(Vertices=meval.Point, Faces=demesh_2.Faces)
mjoin_2 = MeshJoin(Meshes=flatten(conmesh_13))
facen = FaceNormals(Mesh=mjoin_2)  # -> Centers, Normals
demesh_3 = DeconstructMesh(Mesh=mjoin_2)  # -> Vertices, Faces, Colours, Normals
cullpt_3 = CullDuplicates(Points=facen.Centers, Tolerance=num, CullMode=1)  # -> Points, Indices, Valence
item_11 = ListItem(List=demesh_3.Faces, Index=cullpt_3.Indices, Wrap=True)
conmesh_14 = ConstructMesh(Vertices=demesh_3.Vertices, Faces=item_11)
weld_2 = WeldMesh(Mesh=conmesh_14, Angle=3.141592654)
c_script = CSharpScript(M=weld_2, radius=num)  # -> out, A; inputs M: Mesh, radius: Double; same code as c_script
lattice_hinge_shell = ClusterOutput(c_script.A)  # Joined mesh that makes up the lattice hinge

# ==== cluster CrystallonV2MeshHingeCellQuad: Map a quad based parametric cell with two domains to mesh faces

parameter_1b = ClusterInput()  # Number (0-1)
parameter_2d = ClusterInput()  # Number (0-1)
tolerance = ClusterInput()  # Tolerance for merging faces and vertices (number usually between 0.001 and 0.1)
parameter_1c = ClusterInput()  # Number (0-1)
parameter_1d = ClusterInput()  # Number (0-1)
parameter_2c = ClusterInput()  # Number (0-1)
parameter_1a = ClusterInput()  # Number (0-1)
mesh_face = ClusterInput()  # Mesh faces (exploded as single meshes)
parameter_2b = ClusterInput()  # Number (0-1)
parameter_2a = ClusterInput()  # Number (0-1)
num = Number(tolerance)
t1 = Number(parameter_2a)
t1_2 = Number(parameter_2d)
t1_3 = Number(parameter_2c)
t1_4 = Number(parameter_1a)
t1_5 = Number(parameter_2b)
mesh = Mesh(mesh_face)
t1_6 = Number(parameter_1c)
t1_7 = Number(parameter_1d)
t1_8 = Number(parameter_1b)
polygon = Polygon(Plane=PlaneXY(0, 0, 0), Radius="3", Segments="4", FilletRadius=0)  # -> Polygon, Length
merge = Merge(Data1=t1, Data2=t1_5, Data3=t1_3, Data4=t1_2)
merge_2 = Merge(Data1=t1_4, Data2=t1_8, Data3=t1_6, Data4=t1_7)
crv = Curve(polygon.Polygon)
item = ListItem(List=merge_2, Index=0, Wrap=True)  # -> flatten(Item)
shift = ShiftList(List=merge, Shift="-1", Wrap=True)
shift_2 = ShiftList(List=merge_2, Shift="-1", Wrap=True)
explode = Explode(Curve=crv, Recursive=True)  # -> Segments, Vertices
pcen = PolygonCenter(Polyline=crv)  # -> CenterV, CenterE, CenterA
lng = ListLength(List=item)
curvepoint = PointOnCurve(explode.Segments, parameter=0.5)
division = Division(A=shift, B="2")
cullpt = CullDuplicates(Points=explode.Vertices, Tolerance=0.1, CullMode=3)  # -> Points, Indices, Valence
dup = DuplicateData(Data=graft(explode.Segments), Number=lng, Order=True)  # -> simplify(graft(Data))
subtraction = Subtraction(A="1", B=division)
ln = Line(StartPoint=pcen.CenterV, EndPoint=curvepoint)
merge_3 = Merge(Data1=graft(division), Data2=graft(subtraction))  # -> simplify(Result)
trim = TrimTree(Tree=dup, Depth=1)
flip = FlipMatrix(Data=trim)  # -> graft(Data)
eval = EvaluateCurve(Curve=ln, Parameter=shift_2)  # -> simplify(Point), Tangent, Angle
eval_2 = EvaluateCurve(Curve=reparameterize(simplify(flip)), Parameter=merge_3)  # -> simplify(Point), Tangent, Angle
item_2 = ListItem(List=eval.Point, Index=0, Wrap=True)  # -> flatten(Item)
item_3 = ListItem(List=eval_2.Point, Index=0, Wrap=True)  # -> Item, Item1
lng_2 = ListLength(List=item_2)
item_4 = ListItem(List=curvepoint, Index=0, Wrap=True)  # -> Item, Item1, Item2, Item3
trim_2 = TrimTree(Tree=item_3.Item1, Depth=1)
trim_3 = TrimTree(Tree=item_3.Item, Depth=1)
dup_2 = DuplicateData(Data=item_4.Item1, Number=lng_2, Order=True)  # -> simplify(graft(Data))
dup_3 = DuplicateData(Data=item_4.Item2, Number=lng_2, Order=True)  # -> simplify(graft(Data))
dup_4 = DuplicateData(Data=item_4.Item, Number=lng_2, Order=True)  # -> simplify(graft(Data))
dup_5 = DuplicateData(Data=item_4.Item3, Number=lng_2, Order=True)  # -> simplify(graft(Data))
item_5 = ListItem(List=trim_3, Index=0, Wrap=True)  # -> Item, Item1, Item2, Item3
item_6 = ListItem(List=eval.Point, Index=0, Wrap=True)  # -> Item, Item1, Item2, Item3
item_7 = ListItem(List=trim_2, Index=0, Wrap=True)  # -> Item, Item1, Item2, Item3
quad = MeshQuad(CornerA=0, CornerB=1, CornerC=2, CornerD=3)
conmesh = ConstructMesh(Vertices=[item_6.Item2, item_6.Item3, dup_5], Faces={A=0, B=1, C=2, D=2})
conmesh_2 = ConstructMesh(Vertices=[item_6.Item1, dup_2, item_7.Item1], Faces={A=0, B=1, C=2, D=2})
conmesh_3 = ConstructMesh(Vertices=[dup_2, item_6.Item, item_5.Item1], Faces={A=0, B=1, C=2, D=2})
conmesh_4 = ConstructMesh(Vertices=[dup_4, item_6.Item, item_7.Item], Faces={A=0, B=1, C=2, D=2})
conmesh_5 = ConstructMesh(Vertices=[dup_3, item_6.Item2, item_7.Item2], Faces={A=0, B=1, C=2, D=2})
conmesh_6 = ConstructMesh(Vertices=[item_7.Item3, dup_5, item_6.Item3], Faces={A=0, B=1, C=2, D=2})
conmesh_7 = ConstructMesh(Vertices=[dup_3, item_6.Item1, item_5.Item2], Faces={A=0, B=1, C=2, D=2})
conmesh_8 = ConstructMesh(Vertices=[item_6.Item2, item_5.Item3, dup_5], Faces={A=0, B=1, C=2, D=2})
conmesh_9 = ConstructMesh(Vertices=[item_6.Item, item_6.Item3, dup_4], Faces={A=0, B=1, C=2, D=2})
conmesh_10 = ConstructMesh(Vertices=[dup_2, item_6.Item, item_6.Item1], Faces={A=0, B=1, C=2, D=2})
conmesh_11 = ConstructMesh(Vertices=eval.Point, Faces=quad)
conmesh_12 = ConstructMesh(Vertices=[dup_3, item_6.Item2, item_6.Item1], Faces={A=0, B=1, C=2, D=2})
conmesh_13 = ConstructMesh(Vertices=[item_6.Item3, item_5.Item, dup_4], Faces={A=0, B=1, C=2, D=2})
merge_4 = Merge(
    Data1=conmesh_11,
    Data2=conmesh_9,
    Data3=conmesh_10,
    Data4=conmesh_12,
    Data5=conmesh,
    Data6=conmesh_4,
    Data7=conmesh_2,
    Data8=conmesh_5,
    Data9=conmesh_6,
    Data10=conmesh_8,
    Data11=conmesh_3,
    Data12=conmesh_7,
    Data13=conmesh_13)
mjoin = MeshJoin(Meshes=merge_4)
unim = UnifyMesh(Mesh=mjoin)  # -> Result, Count
demesh = DeconstructMesh(Mesh=unim.Result)  # -> Vertices, Faces, Colours, Normals
deface = DeconstructFace(Face=demesh.Faces)  # -> CornerA, CornerB, CornerC, CornerD
item_8 = ListItem(List=demesh.Vertices, Index=deface.CornerA, Wrap=True)
item_9 = ListItem(List=demesh.Vertices, Index=deface.CornerB, Wrap=True)
cullpt_2 = CullDuplicates(Points=demesh.Vertices, Tolerance=num, CullMode=3)  # -> Points, Indices, Valence
item_10 = ListItem(List=demesh.Vertices, Index=deface.CornerC, Wrap=True)
item_11 = ListItem(List=demesh.Vertices, Index=deface.CornerD, Wrap=True)
fsim = FindSimilarMember(Data=item_9, Set=cullpt_2.Points)  # -> Hit, Index
fsim_2 = FindSimilarMember(Data=item_10, Set=cullpt_2.Points)  # -> Hit, Index
fsim_3 = FindSimilarMember(Data=item_11, Set=cullpt_2.Points)  # -> Hit, Index
fsim_4 = FindSimilarMember(Data=item_8, Set=cullpt_2.Points)  # -> Hit, Index
quad_2 = MeshQuad(CornerA=fsim_4.Index, CornerB=fsim.Index, CornerC=fsim_2.Index, CornerD=fsim_3.Index)
conmesh_14 = ConstructMesh(Vertices=cullpt_2.Points, Faces=quad_2)  # -> simplify(Mesh)
conmesh_15 = ConstructMesh(Vertices=cullpt.Points, Faces={A=0, B=1, C=2, D=3})
weld = WeldMesh(Mesh=conmesh_14, Angle=3.141592654)
mesh_2 = Mesh(weld)
mesh_3 = Mesh(conmesh_15)
crv_2 = Curve(crv)
demesh_2 = DeconstructMesh(Mesh=mesh_2)  # -> Vertices, Faces, Colours, Normals
meshcp = MeshClosestPoint(Point=demesh_2.Vertices, Mesh=mesh_3)  # -> Point, Index, Parameter
meval = MeshEval(Mesh=mesh, Parameter=meshcp.Parameter)  # -> Point, Normal, Colour
conmesh_16 = ConstructMesh(Vertices=meval.Point, Faces=demesh_2.Faces)
mjoin_2 = MeshJoin(Meshes=flatten(conmesh_16))
facen = FaceNormals(Mesh=mjoin_2)  # -> Centers, Normals
demesh_3 = DeconstructMesh(Mesh=mjoin_2)  # -> Vertices, Faces, Colours, Normals
cullpt_3 = CullDuplicates(Points=facen.Centers, Tolerance=num, CullMode=1)  # -> Points, Indices, Valence
item_12 = ListItem(List=demesh_3.Faces, Index=cullpt_3.Indices, Wrap=True)
conmesh_17 = ConstructMesh(Vertices=demesh_3.Vertices, Faces=item_12)
weld_2 = WeldMesh(Mesh=conmesh_17, Angle=3.141592654)
c_script = CSharpScript(M=weld_2, radius=num)  # -> out, A; inputs M: Mesh, radius: Double; same code as c_script
lattice_hinge_shell = ClusterOutput(c_script.A)  # Joined mesh that makes up the lattice hinge

# ==== cluster CellType: A collection of pre-made unit cells

crv = Curve([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])
crv_2 = Curve([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])
crv_3 = Curve([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])
crv_4 = Curve([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])
crv_5 = Curve([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])
mesh = Mesh(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)
mesh_2 = Mesh(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)
mesh_3 = Mesh(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)
mesh_4 = Mesh([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])
crv_6 = Curve([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])
crv_7 = Curve([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])
crv_8 = Curve([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])
crv_9 = Curve([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])
crv_10 = Curve([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])
crv_11 = Curve([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])
crv_12 = Curve([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])
crv_13 = Curve([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])
crv_14 = Curve([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])
crv_15 = Curve([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])
crv_16 = Curve([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])
mesh_5 = Mesh(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)
mesh_6 = Mesh(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)
mesh_7 = Mesh(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)
mesh_8 = Mesh(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)
crv_17 = Curve([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])
crv_18 = Curve([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])
mesh_9 = Mesh(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)
geo = Geometry([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])
geo_2 = Geometry([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])
mesh_10 = Mesh([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])
panel = Panel("CELL TYPES")
entwine = Entwine(
    Branch00=crv_6,
    Branch01=crv_7,
    Branch02=crv,
    Branch03=crv_8,
    Branch04=crv_2,
    Branch05=crv_9,
    Branch06=crv_3,
    Branch07=crv_10,
    Branch08=crv_11,
    Branch09=crv_12,
    Branch010=crv_4,
    Branch011=crv_5,
    Branch012=crv_13,
    Branch013=crv_14,
    Branch014=crv_15,
    Branch015=crv_16,
    Branch016=mesh,
    Branch017=mesh_5,
    Branch018=mesh_6,
    Branch019=mesh_2,
    Branch020=mesh_7,
    Branch021=mesh_8,
    Branch022=crv_17,
    Branch023=crv_18,
    Branch024=mesh_9,
    Branch025=mesh_3,
    Branch026=geo,
    Branch027=mesh_4,
    Branch028=geo_2,
    Branch029=mesh_10,
    FlattenInputs=True)  # -> simplify(Result)
unit_cell_selector = ClusterInput()
branch = TreeBranch(Tree=entwine, Path=unit_cell_selector, MaintainPaths=True)
unit_cell = ClusterOutput(branch)  # Single unit cell to populate voxels

# ==== cluster MeshCellFill: Map Lattice unit cells to mesh faces

mesh_cell = ClusterInput()  # Lattice Unit cell to map to mesh faces
mesh_face = ClusterInput()  # Mesh faces (exploded as single meshes)
geo = Geometry(mesh_cell)
toggle = BooleanToggle(True)
crv = Curve(flatten(geo))
mesh = Mesh(geo)
clean = CleanTree(RemoveNulls=toggle, RemoveInvalid=toggle, RemoveEmpty=toggle, Tree=mesh)
clean_2 = CleanTree(RemoveNulls=toggle, RemoveInvalid=toggle, RemoveEmpty=toggle, Tree=crv)
mesh_2 = Mesh(mesh_face)
cp = ControlPoints(Curve=clean_2)  # -> Points, Weights, Knots
meshcp = MeshClosestPoint(Point=cp.Points, Mesh=clean)  # -> Point, Index, Parameter
panel = Panel("Mesh Cell Fill")
meval = MeshEval(Mesh=flatten(mesh_2), Parameter=simplify(graft(meshcp.Parameter)))  # -> simplify(Point), Normal, Colour
path_mapper = PathMapper(meval.Point, source="{A;B}(i)", target="{A;i}(B)")
pline = PolyLine(Vertices=path_mapper, Closed=False)
trim = TrimTree(Tree=pline, Depth=1)
flip = FlipMatrix(Data=trim)
join = JoinCurves(Curves=flip, Preserve=False)
lattice_hinge = ClusterOutput(join)  # Joined curves that makes up the lattice hinge

# ==== cluster MeshTweenCellFill: Tween between lattice unit cells on mesh faces

# ----
# Mesh Tween Cell Fill
value = ClusterInput()  # Value from 0-1 corresponding to each voxel
mesh_cell_1 = ClusterInput()  # Lattice Unit cell to map to mesh faces
mesh_face = ClusterInput()  # Mesh faces (exploded as single meshes)
mesh_cell_2 = ClusterInput()  # Lattice Unit cell to map to mesh faces
mesh = Mesh(mesh_face)
geo = Geometry(mesh_cell_1)
geo_2 = Geometry(mesh_cell_2)
num = Number(value)
toggle = BooleanToggle(True)
crv = Curve(geo)
crv_2 = Curve(geo_2)
mesh_2 = Mesh(geo)
clean = CleanTree(RemoveNulls=toggle, RemoveInvalid=toggle, RemoveEmpty=toggle, Tree=crv)
clean_2 = CleanTree(RemoveNulls=toggle, RemoveInvalid=toggle, RemoveEmpty=toggle, Tree=crv_2)
clean_3 = CleanTree(RemoveNulls=toggle, RemoveInvalid=toggle, RemoveEmpty=toggle, Tree=mesh_2)
tweencrv = TweenCurve(CurveA=flatten(clean), CurveB=flatten(clean_2), Factor=graft(num), BlendType=0)
cp = ControlPoints(Curve=tweencrv)  # -> Points, Weights, Knots
meshcp = MeshClosestPoint(Point=cp.Points, Mesh=clean_3)  # -> Point, Index, Parameter
trim = TrimTree(Tree=meshcp.Parameter, Depth=1)
crossref = CrossReference(ListA=trim, ListB=mesh, CrossMode=1)  # -> ListA, ListB
meval = MeshEval(Mesh=crossref.ListB, Parameter=simplify(crossref.ListA))  # -> Point, Normal, Colour
dispatch = Dispatch(List=meval.Point, DispatchPattern=[True, False])  # -> ListA, ListB
ln = Line(StartPoint=dispatch.ListA, EndPoint=dispatch.ListB)
join = JoinCurves(Curves=ln, Preserve=False)
lattice_hinge = ClusterOutput(join)  # Joined curves that makes up the lattice hinge

# ==== cluster ConformalPipeDistance: Create a pipe of equal length voxels along a cuve on a surface.

geometry = ClusterInput()  # Geometry to conform to
curve = ClusterInput()  # Curve to voxelize
length = ClusterInput()  # Length of Voxels
periodic = ClusterInput()  # Is curve closed? (Boolean)
thickness = ClusterInput()  # Thickness of pipe (number)
distance = ClusterInput()  # Distance from surface (number)
radius = ClusterInput()  # Inner radius of pipe (number)
rotation = ClusterInput()  # Rotation in degrees (number)
sides = ClusterInput()  # Number of sides of pipe (number)
crv = Curve(reparameterize(curve))
num = Number(distance)
num_2 = Number(length)
num_3 = Number(thickness)
bool = Boolean(periodic)
num_4 = Number(radius)
num_5 = Number(rotation)
geo = Geometry(geometry)
num_6 = Number(sides)
divide = DivideCurve(Curve=crv, Count="2000", Kinks=False)  # -> Points, Tangents, Parameters
intcrv = Interpolate(Vertices=divide.Points, Degree=3, Periodic=False, KnotStyle=1)  # -> Curve, Length, Domain
divdist = DivideDistance(Curve=reparameterize(intcrv.Curve), Distance=num_2)  # -> Points, Tangents, Parameters
ins = InsertItems(List=reverse(divdist.Parameters), Item="0", Indices="0", Wrap=Toggle(True))  # -> reverse(List)
entwine = Entwine(Branch00=divdist.Parameters, Branch01=ins, FlattenInputs=True)  # -> simplify(Result)
branch = TreeBranch(Tree=entwine, Path=bool, MaintainPaths=True)
mesh = Mesh(geo)
pframe = PerpFrame(Curve=reparameterize(intcrv.Curve), Parameter=branch)
pln = Plane(pframe)
meshcp = MeshClosestPoint(Point=pln, Mesh=mesh)  # -> Point, Index, Parameter
deplane = DeconstructPlane(Plane=pln)  # -> Origin, XAxis, YAxis, ZAxis
meval = MeshEval(Mesh=mesh, Parameter=meshcp.Parameter)  # -> Point, Normal, Colour
panel = Panel("Conformal Pipe Distance")
line = LineSDL(Start=deplane.Origin, Direction=deplane.XAxis, Length="10")
line_2 = LineSDL(Start=deplane.Origin, Direction=meval.Normal, Length="10")
angle = Angle(VectorA=line, VectorB=line_2, Plane=pln)  # -> Angle, Reflex
prot = RotatePlane(Plane=pln, Angle=angle.Angle)
amp = Amplitude(Vector=meval.Normal, Amplitude=num)
move = Move(Geometry=prot, Motion=amp)  # -> Geometry, Transform
rad = Radians(Degrees=num_5)
prot_2 = RotatePlane(Plane=move.Geometry, Angle=rad)
polygon = Polygon(Plane=prot_2, Radius=num_4, Segments=num_6, FilletRadius=0)  # -> Polygon, Length
offset = Offset(Curve=polygon.Polygon, Distance=num_3, Plane=prot_2, Corners=1)
disc = Discontinuity(Curve=offset, Level=1)  # -> simplify(Points), Parameters
disc_2 = Discontinuity(Curve=polygon.Polygon, Level=1)  # -> simplify(Points), Parameters
toggle = BooleanToggle(False)
toggle_2 = BooleanToggle(True)
flip = FlipMatrix(Data=disc_2.Points)
flip_2 = FlipMatrix(Data=disc.Points)
shift = ShiftList(List=flip, Shift="1", Wrap=toggle)
shift_2 = ShiftList(List=flip_2, Shift="-1", Wrap=toggle)
shift_3 = ShiftList(List=flip, Shift="-1", Wrap=toggle)
shift_4 = ShiftList(List=flip_2, Shift="1", Wrap=toggle)
flip_3 = FlipMatrix(Data=shift)
flip_4 = FlipMatrix(Data=shift_2)
flip_5 = FlipMatrix(Data=shift_4)
flip_6 = FlipMatrix(Data=shift_3)
shift_5 = ShiftList(List=flip_5, Shift="1", Wrap=toggle_2)
shift_6 = ShiftList(List=flip_4, Shift="1", Wrap=toggle_2)
shift_7 = ShiftList(List=flip_3, Shift="1", Wrap=toggle_2)
shift_8 = ShiftList(List=flip_6, Shift="1", Wrap=toggle_2)
tbox = TwistedBox(
    CornerA=flip_4,
    CornerB=shift_6,
    CornerC=shift_5,
    CornerD=flip_5,
    CornerE=flip_6,
    CornerF=shift_8,
    CornerG=shift_7,
    CornerH=flip_3)
voxels = ClusterOutput(tbox)  # Voxels to be filled with unit cells

# ==== cluster ConformalRibDistance: Create a row of equal length voxels along a cuve on a surface (mesh or brep).

curve = ClusterInput()  # Curve to voxelize
geometry = ClusterInput()  # Geometry to conform to
periodic = ClusterInput()  # Is curve closed? (Boolean)
length = ClusterInput()  # Length of Voxels
height = ClusterInput()  # Voxel Height
width = ClusterInput()  # Voxel Width
crv = Curve(reparameterize(curve))
num = Number(length)
bool = Boolean(periodic)
geo = Geometry(geometry)
num_2 = Number(height)
num_3 = Number(width)
divide = DivideCurve(Curve=reparameterize(crv), Count="2000", Kinks=False)  # -> Points, Tangents, Parameters
intcrv = Interpolate(Vertices=divide.Points, Degree=3, Periodic=False, KnotStyle=1)  # -> Curve, Length, Domain
divdist = DivideDistance(Curve=reparameterize(intcrv.Curve), Distance=num)  # -> Points, Tangents, Parameters
ins = InsertItems(List=reverse(divdist.Parameters), Item="0", Indices="0", Wrap=Toggle(True))  # -> reverse(List)
entwine = Entwine(Branch00=divdist.Parameters, Branch01=ins, FlattenInputs=True)  # -> simplify(Result)
branch = TreeBranch(Tree=entwine, Path=bool, MaintainPaths=True)
mesh = Mesh(geo)
pframe = PerpFrame(Curve=reparameterize(intcrv.Curve), Parameter=branch)
pln = Plane(pframe)
meshcp = MeshClosestPoint(Point=pln, Mesh=mesh)  # -> Point, Index, Parameter
deplane = DeconstructPlane(Plane=pln)  # -> Origin, XAxis, YAxis, ZAxis
meval = MeshEval(Mesh=mesh, Parameter=meshcp.Parameter)  # -> Point, Normal, Colour
panel = Panel("Conformal Rib Distance")
line = LineSDL(Start=deplane.Origin, Direction=meval.Normal, Length="10")
line_2 = LineSDL(Start=deplane.Origin, Direction=deplane.XAxis, Length="10")
division = Division(A=num_3, B="2")
angle = Angle(VectorA=line_2, VectorB=line, Plane=pln)  # -> Angle, Reflex
neg = Negative(Value=division)
prot = RotatePlane(Plane=pln, Angle=angle.Angle)
dom = ConstructDomain(DomainStart=neg, DomainEnd=division)
rectangle = Rectangle(Plane=prot, XSize=num_2, YSize=dom, Radius=0)  # -> Rectangle, Length
disc = Discontinuity(Curve=rectangle.Rectangle, Level=1)  # -> simplify(Points), Parameters
toggle = BooleanToggle(False)
flip = FlipMatrix(Data=disc.Points)
shift = ShiftList(List=flip, Shift="-1", Wrap=toggle)
shift_2 = ShiftList(List=flip, Shift="1", Wrap=toggle)
flip_2 = FlipMatrix(Data=shift)
flip_3 = FlipMatrix(Data=shift_2)
item = ListItem(List=flip_2, Index="1", Wrap=True)
item_2 = ListItem(List=flip_3, Index="1", Wrap=True)
item_3 = ListItem(List=flip_2, Index="0", Wrap=True)
item_4 = ListItem(List=flip_2, Index="3", Wrap=True)
item_5 = ListItem(List=flip_3, Index="3", Wrap=True)
item_6 = ListItem(List=flip_2, Index="2", Wrap=True)
item_7 = ListItem(List=flip_3, Index="2", Wrap=True)
item_8 = ListItem(List=flip_3, Index="0", Wrap=True)
tbox = TwistedBox(
    CornerA=item_3,
    CornerB=item,
    CornerC=item_6,
    CornerD=item_4,
    CornerE=item_8,
    CornerF=item_2,
    CornerG=item_7,
    CornerH=item_5)
voxels = ClusterOutput(tbox)  # Voxels to be filled with unit cells

# ==== cluster ConformalPipeParameter: Create a pipe of varying length and size voxels along a cuve on a surface.

geometry = ClusterInput()  # Geometry to conform to
curve = ClusterInput()  # Curve to voxelize
division_paramter = ClusterInput()  # Parameter for Voxel Divisions (0-1)
periodic = ClusterInput()  # Is curve closed? (Boolean)
radius_paramter = ClusterInput()  # Parameter for pipe radius (0-1)
radius_domain = ClusterInput()  # Domain of pipe radius (Domain)
distance = ClusterInput()  # Distance from surface (number)
thickness_paramter = ClusterInput()  # Parameter for pipe thickness (0-1)
rotation = ClusterInput()  # Rotation in degrees (number)
thickness_domain = ClusterInput()  # Domain of pipe thickness (Domain)
sides = ClusterInput()  # Number of sides of pipe (number)
crv = Curve(reparameterize(curve))
bool = Boolean(periodic)
num = Number(division_paramter)
num_2 = Number(distance)
num_3 = Number(radius_paramter)
geo = Geometry(geometry)
domain = Domain(radius_domain)
num_4 = Number(rotation)
num_5 = Number(thickness_paramter)
num_6 = Number(sides)
domain_2 = Domain(thickness_domain)
lng = ListLength(List=num)
multiplication = Multiplication(A=lng, B="2")
divide = DivideCurve(Curve=crv, Count=multiplication, Kinks=False)  # -> Points, Tangents, Parameters
intcrv = Interpolate(Vertices=divide.Points, Degree=3, Periodic=bool, KnotStyle=1)  # -> Curve, Length, Domain
pframe = PerpFrame(Curve=reparameterize(intcrv.Curve), Parameter=num)
mesh = Mesh(geo)
pln = Plane(pframe)
meshcp = MeshClosestPoint(Point=pln, Mesh=mesh)  # -> Point, Index, Parameter
deplane = DeconstructPlane(Plane=pln)  # -> Origin, XAxis, YAxis, ZAxis
meval = MeshEval(Mesh=mesh, Parameter=meshcp.Parameter)  # -> Point, Normal, Colour
panel = Panel("Conformal Pipe Parameter")
line = LineSDL(Start=deplane.Origin, Direction=deplane.XAxis, Length="10")
line_2 = LineSDL(Start=deplane.Origin, Direction=meval.Normal, Length="10")
angle = Angle(VectorA=line, VectorB=line_2, Plane=pln)  # -> Angle, Reflex
prot = RotatePlane(Plane=pln, Angle=angle.Angle)
amp = Amplitude(Vector=meval.Normal, Amplitude=num_2)
move = Move(Geometry=prot, Motion=amp)  # -> Geometry, Transform
rad = Radians(Degrees=num_4)
remap = RemapNumbers(Value=num_3, Source=Domain(0, 1), Target=domain)  # -> Mapped, Clipped
remap_2 = RemapNumbers(Value=num_5, Source=Domain(0, 1), Target=domain_2)  # -> Mapped, Clipped
prot_2 = RotatePlane(Plane=move.Geometry, Angle=rad)
polygon = Polygon(Plane=prot_2, Radius=remap.Mapped, Segments=num_6, FilletRadius=0)  # -> Polygon, Length
offset = Offset(Curve=polygon.Polygon, Distance=remap_2.Mapped, Plane=prot_2, Corners=1)
disc = Discontinuity(Curve=offset, Level=1)  # -> simplify(Points), Parameters
disc_2 = Discontinuity(Curve=polygon.Polygon, Level=1)  # -> simplify(Points), Parameters
toggle = BooleanToggle(False)
toggle_2 = BooleanToggle(True)
flip = FlipMatrix(Data=disc_2.Points)
flip_2 = FlipMatrix(Data=disc.Points)
shift = ShiftList(List=flip, Shift="1", Wrap=toggle)
shift_2 = ShiftList(List=flip_2, Shift="-1", Wrap=toggle)
shift_3 = ShiftList(List=flip, Shift="-1", Wrap=toggle)
shift_4 = ShiftList(List=flip_2, Shift="1", Wrap=toggle)
flip_3 = FlipMatrix(Data=shift)
flip_4 = FlipMatrix(Data=shift_2)
flip_5 = FlipMatrix(Data=shift_4)
flip_6 = FlipMatrix(Data=shift_3)
shift_5 = ShiftList(List=flip_5, Shift="1", Wrap=toggle_2)
shift_6 = ShiftList(List=flip_4, Shift="1", Wrap=toggle_2)
shift_7 = ShiftList(List=flip_3, Shift="1", Wrap=toggle_2)
shift_8 = ShiftList(List=flip_6, Shift="1", Wrap=toggle_2)
tbox = TwistedBox(
    CornerA=flip_4,
    CornerB=shift_6,
    CornerC=shift_5,
    CornerD=flip_5,
    CornerE=flip_6,
    CornerF=shift_8,
    CornerG=shift_7,
    CornerH=flip_3)
voxels = ClusterOutput(tbox)  # Voxels to be filled with unit cells
