# Grasshopper definition crystallon_V1-0.gh (Grasshopper 0.9.76)
# Copyright: ©2018 GNU General Public License

geometry = Geometry()  # Geometry to voxelize
voxel_size_x = VoxelSizeX()  # Voxel size int the X direction
voxel_size_y = VoxelSizeY()  # Voxel size int the Y direction
voxel_size_z = VoxelSizeZ()  # Voxel size int the Z direction
fill_completely = FillCompletely()  # If true, Voxels will fill entire volume. If false, only Voxels with their centroid within the volume will be kept.
geo = Geometry(geometry)
num = Number(voxel_size_x)
num_2 = Number(voxel_size_y)
num_3 = Number(voxel_size_z)
bbox = BoundingBox(Content=geo, Plane=PlaneXY(0, 0, 0))  # -> Box, Box_2
boxprop = BoxProperties(Box=bbox.Box)  # -> Center, Diagonal, Area, Volume, Degeneracy
one_over_x = OneOverX(Value=num_2)
one_over_x_2 = OneOverX(Value=num)
one_over_x_3 = OneOverX(Value=num_3)
devec = DeconstructVector(Vector=boxprop.Center)  # -> XComponent, YComponent, ZComponent
multiplication = Multiplication(A=boxprop.Diagonal, B=one_over_x)
multiplication_2 = Multiplication(A=boxprop.Diagonal, B=one_over_x_2)
multiplication_3 = Multiplication(A=boxprop.Diagonal, B=one_over_x_3)
devec_2 = DeconstructVector(Vector=multiplication)  # -> XComponent, YComponent, ZComponent
devec_3 = DeconstructVector(Vector=multiplication_2)  # -> XComponent, YComponent, ZComponent
devec_4 = DeconstructVector(Vector=multiplication_3)  # -> XComponent, YComponent, ZComponent
expression = Expression(z=devec_4.ZComponent, Expression="ceiling(z)")
expression_2 = Expression(x=devec_3.XComponent, Expression="ceiling(x)")
expression_3 = Expression(y=devec_2.YComponent, Expression="ceiling(y)")
expression_4 = Expression(x=expression_2, u=num, a=devec.XComponent, Expression="-u*x/2+a")
expression_5 = Expression(y=expression_3, u=num_2, b=devec.YComponent, Expression="-u*y/2+b")
expression_6 = Expression(y=expression, u=num_3, b=devec.ZComponent, Expression="-u*y/2+b")
expression_7 = Expression(x=expression_2, Expression="x+1")
expression_8 = Expression(z=expression, Expression="z+1")
expression_9 = Expression(y=expression_3, Expression="y+1")
series = Series(Start=expression_4, Step=num, Count=expression_7)
series_2 = Series(Start=expression_6, Step=num_3, Count=expression_8)
series_3 = Series(Start=expression_5, Step=num_2, Count=expression_9)
panel = Panel("VOXELIZE")
crossref = CrossReference(ListA=series, ListB=series_3, ListC=series_2, CrossMode=1)  # -> ListA, ListB, ListC
sort = SortList(Keys=[num, num_2, num_3])  # -> Keys, ValuesA
rev = ReverseList(List=sort.Keys)
pt = ConstructPoint(XCoordinate=crossref.ListA, YCoordinate=crossref.ListB, ZCoordinate=crossref.ListC)
item = ListItem(List=rev, Index=0, Wrap=True)
minc = MeshInclusion(Mesh=geo, Point=pt, Strict=False)
meshcp = MeshClosestPoint(Point=pt, Mesh=geo)  # -> Point, Index, Parameter
dist = Distance(PointA=pt, PointB=meshcp.Point)
expression_10 = Expression(a=item, d=dist, Expression="if(d<sqrt(2*(a/2)^2),True,False)")
cull = CullPattern(List=pt, CullPattern=minc)
cull_2 = CullPattern(List=pt, CullPattern=expression_10)
cull_3 = CullPattern(List=cull_2, CullPattern=fill_completely)
merge = Merge(Data1=cull, Data2=cull_3)
expression_11 = Expression(x=num_2, Expression="x/2")
expression_12 = Expression(x=num, Expression="x/2")
expression_13 = Expression(x=num_3, Expression="x/2")
cullpt = CullDuplicates(Points=merge, Tolerance=".001", CullMode=3)  # -> Points, Indices, Valence
box = CenterBox(Base=cullpt.Points, X=expression_12, Y=expression_11, Z=expression_13)
voxels = Voxels(box)  # Voxels to be filled with unit cells

magnitude_min = MagnitudeMin()  # Magnitude of the offset (minimum value)
magnitude_max = MagnitudeMax()  # Magnitude of the offset (maximum value)
influence = Influence()  # Smoothed range of attractor influence (0-1)
attractor = Attractor()  # Any geometry to use as attractor(s)
mesh = Mesh()  # Mesh to offset
lower_limit = LowerLimit()  # Smoothing of the surface closest to the attractor
num_4 = Number(influence)
geo_2 = Geometry(attractor)
mesh_2 = Mesh(mesh)
num_5 = Number(lower_limit)
num_6 = Number(magnitude_min)
num_7 = Number(magnitude_max)
weld = WeldMesh(Mesh=mesh_2, Angle=3.141592654)
dom = ConstructDomain(DomainStart=num_6, DomainEnd=num_7)
demesh = DeconstructMesh(Mesh=weld)  # -> Vertices, Faces, Colours, Normals
deface = DeconstructFace(Face=demesh.Faces)  # -> CornerA, CornerB, CornerC, CornerD
item_2 = ListItem(List=demesh.Vertices, Index=deface.CornerB, Wrap=True)
item_3 = ListItem(List=demesh.Vertices, Index=deface.CornerC, Wrap=True)
item_4 = ListItem(List=demesh.Vertices, Index=deface.CornerA, Wrap=True)
addition = Addition(A=item_4, B=item_2)
addition_2 = Addition(A=item_4, B=item_3)
addition_3 = Addition(A=item_2, B=item_3)
bcentric = Barycentric(PointA=item_4, PointB=item_2, PointC=item_3, CoordinateU=1, CoordinateV=1, CoordinateW=1)
division = Division(A=addition, B="2")
division_2 = Division(A=addition_3, B="2")
division_3 = Division(A=addition_2, B="2")
entwine = Entwine(Branch00=item_4, Branch01=division, Branch02=bcentric, Branch03=division_3, FlattenInputs=True)
entwine_2 = Entwine(Branch00=item_2, Branch01=division_2, Branch02=bcentric, Branch03=division, FlattenInputs=True)
entwine_3 = Entwine(Branch00=item_3, Branch01=division_3, Branch02=bcentric, Branch03=division_2, FlattenInputs=True)
flip = FlipMatrix(Data=entwine)
flip_2 = FlipMatrix(Data=entwine_3)
flip_3 = FlipMatrix(Data=entwine_2)
quad = MeshQuad(CornerA=0, CornerB=1, CornerC=2, CornerD=3)
quad_2 = MeshQuad(CornerA=0, CornerB=1, CornerC=2, CornerD=3)
quad_3 = MeshQuad(CornerA=0, CornerB=1, CornerC=2, CornerD=3)
panel_2 = Panel("MESH OFFSET ATTRACTOR")
conmesh = ConstructMesh(Vertices=flip_2, Faces=quad)
conmesh_2 = ConstructMesh(Vertices=flip_3, Faces=quad_2)
conmesh_3 = ConstructMesh(Vertices=flip, Faces=quad_3)
mjoin = MeshJoin(Meshes=flatten([conmesh_3, conmesh_2, conmesh]))
demesh_2 = DeconstructMesh(Mesh=mjoin)  # -> Vertices, Faces, Colours, Normals
meshcp_2 = MeshClosestPoint(Point=demesh_2.Vertices, Mesh=weld)  # -> Point, Index, Parameter
pull = PullPoint(Point=demesh_2.Vertices, Geometry=geo_2, ClosestOnly=True)  # -> ClosestPoint, Distance
lng = ListLength(List=pull.Distance)
meval = MeshEval(Mesh=weld, Parameter=meshcp_2.Parameter)  # -> Point, Normal, Colour
series_4 = Series(Start=0, Step=1, Count=lng)
smaller = SmallerThan(FirstNumber=pull.Distance, SecondNumber=num_5)  # -> SmallerThan, OrEqualTo
cull_4 = CullPattern(List=series_4, CullPattern=smaller.SmallerThan)
replace = ReplaceItems(List=pull.Distance, Item="0", Indices=cull_4, Wrap=False)
expression_14 = Expression(x=num_4, y=replace, Expression="-1*e^(-x*y)")
bnd = Bounds(Numbers=expression_14)
remap = RemapNumbers(Value=expression_14, Source=bnd, Target=dom)  # -> Mapped, Clipped
amp = Amplitude(Vector=meval.Normal, Amplitude=remap.Mapped)
move = Move(Geometry=demesh_2.Vertices, Motion=amp)  # -> Geometry, Transform
conmesh_4 = ConstructMesh(Vertices=move.Geometry, Faces=demesh_2.Faces)
demesh_3 = DeconstructMesh(Mesh=mjoin)  # -> Vertices, Faces, Colours, Normals
demesh_4 = DeconstructMesh(Mesh=conmesh_4)  # -> Vertices, Faces, Colours, Normals
deface_2 = DeconstructFace(Face=demesh_3.Faces)  # -> CornerA, CornerB, CornerC, CornerD
deface_3 = DeconstructFace(Face=demesh_4.Faces)  # -> CornerA, CornerB, CornerC, CornerD
item_5 = ListItem(List=demesh_4.Vertices, Index=deface_3.CornerA, Wrap=True)
item_6 = ListItem(List=demesh_4.Vertices, Index=deface_3.CornerB, Wrap=True)
item_7 = ListItem(List=demesh_4.Vertices, Index=deface_3.CornerC, Wrap=True)
item_8 = ListItem(List=demesh_4.Vertices, Index=deface_3.CornerD, Wrap=True)
item_9 = ListItem(List=demesh_3.Vertices, Index=deface_2.CornerA, Wrap=True)
item_10 = ListItem(List=demesh_3.Vertices, Index=deface_2.CornerB, Wrap=True)
item_11 = ListItem(List=demesh_3.Vertices, Index=deface_2.CornerC, Wrap=True)
item_12 = ListItem(List=demesh_3.Vertices, Index=deface_2.CornerD, Wrap=True)
tbox = TwistedBox(
    CornerA=item_5,
    CornerB=item_6,
    CornerC=item_7,
    CornerD=item_8,
    CornerE=item_9,
    CornerF=item_10,
    CornerG=item_11,
    CornerH=item_12)
mesh_3 = Mesh(conmesh_4)
mesh_4 = Mesh(mjoin)
voxels_2 = Voxels(tbox)  # Voxels to be filled with unit cells
quad_mesh = QuadMesh(mesh_3)  # Quad mesh generated from the input mesh
offset_quad_mesh = OffsetQuadMesh(mesh_4)  # Offset quad mesh generated from the input mesh

mesh_5 = Mesh()  # Mesh to offset
mesh_6 = Mesh(mesh_5)
distance = Distance()  # Offset distance
weld_2 = WeldMesh(Mesh=mesh_6, Angle=3.141592654)
demesh_5 = DeconstructMesh(Mesh=weld_2)  # -> Vertices, Faces, Colours, Normals
deface_4 = DeconstructFace(Face=demesh_5.Faces)  # -> CornerA, CornerB, CornerC, CornerD
item_13 = ListItem(List=demesh_5.Vertices, Index=deface_4.CornerB, Wrap=True)
item_14 = ListItem(List=demesh_5.Vertices, Index=deface_4.CornerC, Wrap=True)
panel_3 = Panel("0")
panel_4 = Panel("1")
item_15 = ListItem(List=demesh_5.Vertices, Index=deface_4.CornerA, Wrap=True)
panel_5 = Panel("2")
addition_4 = Addition(A=item_15, B=item_13)
addition_5 = Addition(A=item_15, B=item_14)
addition_6 = Addition(A=item_13, B=item_14)
bcentric_2 = Barycentric(PointA=item_15, PointB=item_13, PointC=item_14, CoordinateU=1, CoordinateV=1, CoordinateW=1)
panel_6 = Panel("A")
panel_7 = Panel("B")
panel_8 = Panel("C")
division_4 = Division(A=addition_4, B="2")
division_5 = Division(A=addition_6, B="2")
division_6 = Division(A=addition_5, B="2")
panel_9 = Panel("Z")
entwine_4 = Entwine(Branch00=item_15, Branch01=division_4, Branch02=bcentric_2, Branch03=division_6, FlattenInputs=True)
entwine_5 = Entwine(Branch00=item_13, Branch01=division_5, Branch02=bcentric_2, Branch03=division_4, FlattenInputs=True)
entwine_6 = Entwine(Branch00=item_14, Branch01=division_6, Branch02=bcentric_2, Branch03=division_5, FlattenInputs=True)
flip_4 = FlipMatrix(Data=entwine_4)
flip_5 = FlipMatrix(Data=entwine_6)
flip_6 = FlipMatrix(Data=entwine_5)
quad_4 = MeshQuad(CornerA=0, CornerB=1, CornerC=2, CornerD=3)
quad_5 = MeshQuad(CornerA=0, CornerB=1, CornerC=2, CornerD=3)
quad_6 = MeshQuad(CornerA=0, CornerB=1, CornerC=2, CornerD=3)
panel_10 = Panel("MESH OFFSET")
conmesh_5 = ConstructMesh(Vertices=flip_5, Faces=quad_4)
conmesh_6 = ConstructMesh(Vertices=flip_6, Faces=quad_5)
conmesh_7 = ConstructMesh(Vertices=flip_4, Faces=quad_6)
mjoin_2 = MeshJoin(Meshes=flatten([conmesh_7, conmesh_6, conmesh_5]))
demesh_6 = DeconstructMesh(Mesh=mjoin_2)  # -> Vertices, Faces, Colours, Normals
meshcp_3 = MeshClosestPoint(Point=demesh_6.Vertices, Mesh=weld_2)  # -> Point, Index, Parameter
meval_2 = MeshEval(Mesh=weld_2, Parameter=meshcp_3.Parameter)  # -> Point, Normal, Colour
amp_2 = Amplitude(Vector=meval_2.Normal, Amplitude=distance)
move_2 = Move(Geometry=demesh_6.Vertices, Motion=amp_2)  # -> Geometry, Transform
conmesh_8 = ConstructMesh(Vertices=move_2.Geometry, Faces=demesh_6.Faces)
demesh_7 = DeconstructMesh(Mesh=mjoin_2)  # -> Vertices, Faces, Colours, Normals
demesh_8 = DeconstructMesh(Mesh=conmesh_8)  # -> Vertices, Faces, Colours, Normals
deface_5 = DeconstructFace(Face=demesh_7.Faces)  # -> CornerA, CornerB, CornerC, CornerD
deface_6 = DeconstructFace(Face=demesh_8.Faces)  # -> CornerA, CornerB, CornerC, CornerD
item_16 = ListItem(List=demesh_8.Vertices, Index=deface_6.CornerA, Wrap=True)
item_17 = ListItem(List=demesh_8.Vertices, Index=deface_6.CornerB, Wrap=True)
item_18 = ListItem(List=demesh_8.Vertices, Index=deface_6.CornerC, Wrap=True)
item_19 = ListItem(List=demesh_8.Vertices, Index=deface_6.CornerD, Wrap=True)
item_20 = ListItem(List=demesh_7.Vertices, Index=deface_5.CornerA, Wrap=True)
item_21 = ListItem(List=demesh_7.Vertices, Index=deface_5.CornerB, Wrap=True)
item_22 = ListItem(List=demesh_7.Vertices, Index=deface_5.CornerC, Wrap=True)
item_23 = ListItem(List=demesh_7.Vertices, Index=deface_5.CornerD, Wrap=True)
tbox_2 = TwistedBox(
    CornerA=item_16,
    CornerB=item_17,
    CornerC=item_18,
    CornerD=item_19,
    CornerE=item_20,
    CornerF=item_21,
    CornerG=item_22,
    CornerH=item_23)
mesh_7 = Mesh(conmesh_8)
mesh_8 = Mesh(mjoin_2)
quad_mesh_2 = QuadMesh(mesh_7)  # Quad mesh generated from the input mesh
offset_quad_mesh_2 = OffsetQuadMesh(mesh_8)  # Offset quad mesh generated from the input mesh
voxels_3 = Voxels(tbox_2)  # Voxels to be filled with unit cells

magnitude_max_2 = MagnitudeMax()  # Magnitude of the offset (maximum value)
influence_2 = Influence()  # Smoothed range of attractor influence (0-1)
values = Values()  # Values that correspond to points (flattened)
magnitude_min_2 = MagnitudeMin()  # Magnitude of the offset (minimum value)
distance_influence = DistanceInfluence()  # If true the distance between the points and voxels will affect the magnitude
points = Points()  # List of points (flattened)
mesh_9 = Mesh()  # Mesh to offset
mesh_10 = Mesh(mesh_9)
weld_3 = WeldMesh(Mesh=mesh_10, Angle=3.141592654)
demesh_9 = DeconstructMesh(Mesh=weld_3)  # -> Vertices, Faces, Colours, Normals
deface_7 = DeconstructFace(Face=demesh_9.Faces)  # -> CornerA, CornerB, CornerC, CornerD
item_24 = ListItem(List=demesh_9.Vertices, Index=deface_7.CornerB, Wrap=True)
item_25 = ListItem(List=demesh_9.Vertices, Index=deface_7.CornerC, Wrap=True)
item_26 = ListItem(List=demesh_9.Vertices, Index=deface_7.CornerA, Wrap=True)
addition_7 = Addition(A=item_26, B=item_24)
addition_8 = Addition(A=item_26, B=item_25)
addition_9 = Addition(A=item_24, B=item_25)
bcentric_3 = Barycentric(PointA=item_26, PointB=item_24, PointC=item_25, CoordinateU=1, CoordinateV=1, CoordinateW=1)
division_7 = Division(A=addition_7, B="2")
division_8 = Division(A=addition_9, B="2")
division_9 = Division(A=addition_8, B="2")
entwine_7 = Entwine(Branch00=item_26, Branch01=division_7, Branch02=bcentric_3, Branch03=division_9, FlattenInputs=True)
entwine_8 = Entwine(Branch00=item_24, Branch01=division_8, Branch02=bcentric_3, Branch03=division_7, FlattenInputs=True)
entwine_9 = Entwine(Branch00=item_25, Branch01=division_9, Branch02=bcentric_3, Branch03=division_8, FlattenInputs=True)
flip_7 = FlipMatrix(Data=entwine_7)
flip_8 = FlipMatrix(Data=entwine_9)
flip_9 = FlipMatrix(Data=entwine_8)
quad_7 = MeshQuad(CornerA=0, CornerB=1, CornerC=2, CornerD=3)
quad_8 = MeshQuad(CornerA=0, CornerB=1, CornerC=2, CornerD=3)
quad_9 = MeshQuad(CornerA=0, CornerB=1, CornerC=2, CornerD=3)
panel_18 = Panel("MESH OFFSET VALUE")
conmesh_9 = ConstructMesh(Vertices=flip_8, Faces=quad_7)
pt_2 = Point(points)
conmesh_10 = ConstructMesh(Vertices=flip_9, Faces=quad_8)
conmesh_11 = ConstructMesh(Vertices=flip_7, Faces=quad_9)
num_8 = Number(values)
bnd_2 = Bounds(Numbers=num_8)
dom_2 = ConstructDomain(DomainStart=magnitude_min_2, DomainEnd=magnitude_max_2)
mjoin_3 = MeshJoin(Meshes=flatten([conmesh_11, conmesh_10, conmesh_9]))
remap_2 = RemapNumbers(Value=num_8, Source=bnd_2, Target=dom_2)  # -> Mapped, Clipped
demesh_10 = DeconstructMesh(Mesh=mjoin_3)  # -> Vertices, Faces, Colours, Normals
cp = ClosestPoint(Point=demesh_10.Vertices, Cloud=pt_2)  # -> ClosestPoint, CPIndex, Distance
expression_15 = Expression(x=influence_2, y=cp.Distance, Expression="-1*e^(-x*y)")
item_27 = ListItem(List=remap_2.Mapped, Index=cp.CPIndex, Wrap=True)
meshcp_4 = MeshClosestPoint(Point=demesh_10.Vertices, Mesh=weld_3)  # -> Point, Index, Parameter
bnd_3 = Bounds(Numbers=flatten(expression_15))
meval_3 = MeshEval(Mesh=weld_3, Parameter=meshcp_4.Parameter)  # -> Point, Normal, Colour
remap_3 = RemapNumbers(Value=expression_15, Source=bnd_3, Target="1 to 0")  # -> Mapped, Clipped
not = GateNot(A=distance_influence)
multiplication_4 = Multiplication(A=item_27, B=remap_3.Mapped)
demesh_11 = DeconstructMesh(Mesh=mjoin_3)  # -> Vertices, Faces, Colours, Normals
cull_5 = CullPattern(List=multiplication_4, CullPattern=distance_influence)
cull_6 = CullPattern(List=item_27, CullPattern=not)
amp_3 = Amplitude(Vector=meval_3.Normal, Amplitude=[cull_5, cull_6])
move_3 = Move(Geometry=demesh_10.Vertices, Motion=amp_3)  # -> Geometry, Transform
conmesh_12 = ConstructMesh(Vertices=move_3.Geometry, Faces=demesh_10.Faces)
demesh_12 = DeconstructMesh(Mesh=conmesh_12)  # -> Vertices, Faces, Colours, Normals
deface_8 = DeconstructFace(Face=demesh_11.Faces)  # -> CornerA, CornerB, CornerC, CornerD
deface_9 = DeconstructFace(Face=demesh_12.Faces)  # -> CornerA, CornerB, CornerC, CornerD
item_28 = ListItem(List=demesh_12.Vertices, Index=deface_9.CornerA, Wrap=True)
item_29 = ListItem(List=demesh_12.Vertices, Index=deface_9.CornerB, Wrap=True)
item_30 = ListItem(List=demesh_12.Vertices, Index=deface_9.CornerC, Wrap=True)
item_31 = ListItem(List=demesh_12.Vertices, Index=deface_9.CornerD, Wrap=True)
item_32 = ListItem(List=demesh_11.Vertices, Index=deface_8.CornerA, Wrap=True)
item_33 = ListItem(List=demesh_11.Vertices, Index=deface_8.CornerB, Wrap=True)
item_34 = ListItem(List=demesh_11.Vertices, Index=deface_8.CornerC, Wrap=True)
item_35 = ListItem(List=demesh_11.Vertices, Index=deface_8.CornerD, Wrap=True)
tbox_3 = TwistedBox(
    CornerA=item_28,
    CornerB=item_29,
    CornerC=item_30,
    CornerD=item_31,
    CornerE=item_32,
    CornerF=item_33,
    CornerG=item_34,
    CornerH=item_35)
mesh_11 = Mesh(mjoin_3)
mesh_12 = Mesh(conmesh_12)
voxels_4 = Voxels(tbox_3)  # Voxels to be filled with unit cells
quad_mesh_3 = QuadMesh(mesh_12)  # Quad mesh generated from the input mesh
offset_quad_mesh_3 = OffsetQuadMesh(mesh_11)  # Offset quad mesh generated from the input mesh

magnitude_max_3 = MagnitudeMax()  # Magnitude of the morph (maximum value)
magnitude_min_3 = MagnitudeMin()  # Magnitude of the morph (minimum value)
influence_3 = Influence()  # Smoothed range of attractor influence (0-1)
distance_influence_2 = DistanceInfluence()  # If true the distance between the points and voxels will affect the magnitude
values_2 = Values()  # Values that correspond to points (flattened)
points_2 = Points()  # List of points (flattened)
voxels_5 = Voxels()  # Voxels to be filled with unit cells
pt_3 = Point(points_2)
num_9 = Number(values_2)
tbox_4 = TwistedBox(voxels_5)
dom_3 = ConstructDomain(DomainStart=magnitude_min_3, DomainEnd=magnitude_max_3)
bnd_4 = Bounds(Numbers=num_9)
debrep = DeconstructBrep(Brep=tbox_4)  # -> Faces, Edges, Vertices
cp_2 = ClosestPoint(Point=debrep.Vertices, Cloud=pt_3)  # -> ClosestPoint, CPIndex, Distance
remap_4 = RemapNumbers(Value=num_9, Source=bnd_4, Target=dom_3)  # -> Mapped, Clipped
expression_16 = Expression(x=influence_3, y=cp_2.Distance, Expression="-1*e^(-x*y)")
item_36 = ListItem(List=remap_4.Mapped, Index=cp_2.CPIndex, Wrap=True)
bnd_5 = Bounds(Numbers=flatten(expression_16))
panel_19 = Panel("VOXEL MORPH VALUE")
remap_5 = RemapNumbers(Value=expression_16, Source=bnd_5, Target="1 to 0")  # -> Mapped, Clipped
not_2 = GateNot(A=distance_influence_2)
ln = Line(StartPoint=debrep.Vertices, EndPoint=cp_2.ClosestPoint)
multiplication_5 = Multiplication(A=item_36, B=remap_5.Mapped)
cull_7 = CullPattern(List=item_36, CullPattern=not_2)
cull_8 = CullPattern(List=multiplication_5, CullPattern=distance_influence_2)
amp_4 = Amplitude(Vector=ln, Amplitude=[cull_8, cull_7])
move_4 = Move(Geometry=debrep.Vertices, Motion=amp_4)  # -> Geometry, Transform
item_37 = ListItem(List=move_4.Geometry, Index="0", Wrap=True)
item_38 = ListItem(List=move_4.Geometry, Index="1", Wrap=True)
item_39 = ListItem(List=move_4.Geometry, Index="2", Wrap=True)
item_40 = ListItem(List=move_4.Geometry, Index="3", Wrap=True)
item_41 = ListItem(List=move_4.Geometry, Index="4", Wrap=True)
item_42 = ListItem(List=move_4.Geometry, Index="6", Wrap=True)
item_43 = ListItem(List=move_4.Geometry, Index="5", Wrap=True)
item_44 = ListItem(List=move_4.Geometry, Index="7", Wrap=True)
tbox_5 = TwistedBox(
    CornerA=item_37,
    CornerB=item_38,
    CornerC=item_39,
    CornerD=item_40,
    CornerE=item_43,
    CornerF=item_41,
    CornerG=item_44,
    CornerH=item_42)
voxels_6 = Voxels(tbox_5)  # Voxels to be filled with unit cells

surfaces = Surfaces()  # At least 2 surfaces to morph voxels between
voxel_number_x = VoxelNumberX()  # Number of Voxels in the X direction
voxel_number_y = VoxelNumberY()  # Number of Voxels in the Y direction
voxel_number_z = VoxelNumberZ()  # Number of Voxels in the Z direction
srf = Surface(flatten(surfaces))
num_10 = Number(voxel_number_x)
num_11 = Number(voxel_number_z)
num_12 = Number(voxel_number_y)
sdivide = DivideSurface(Surface=srf, UCount="30", VCount="30")  # -> simplify(Points), Normals, Parameters
pshift = ShiftPaths(Data=sdivide.Points, Offset="-1")
panel_20 = Panel("MORPH BETWEEN SURFACES")
flip_10 = FlipMatrix(Data=pshift)
dom_4 = ConstructDomain(DomainStart=0, DomainEnd=1)
pline = PolyLine(Vertices=flip_10, Closed=False)
range = Range(Domain=dom_4, Steps=num_11)
eval = EvaluateCurve(Curve=reparameterize(pline), Parameter=range)  # -> Point, Tangent, Angle
flip_11 = FlipMatrix(Data=eval.Point)
addition_10 = Addition(A="30", B="1")
srfgrid = SurfaceFromPoints(Points=flip_11, UCount=graft(addition_10), Interpolate=False)  # -> flatten(Surface)
toggle = BooleanToggle(False)
shift = ShiftList(List=srfgrid, Shift="1", Wrap=toggle)
shift_2 = ShiftList(List=srfgrid, Shift="-1", Wrap=toggle)
divide = DivideDomain²(Domain=shift, UCount=num_10, VCount=num_12)
divide_2 = DivideDomain²(Domain=shift_2, UCount=num_10, VCount=num_12)
blendbox = BlendBox(SurfaceA=graft(shift), DomainA=divide, SurfaceB=graft(shift_2), DomainB=divide_2)  # -> flatten(TwistedBox)
voxels_7 = Voxels(blendbox)  # Voxels to be filled with unit cells

voxels_8 = Voxels()  # Voxels to be filled with unit cells
attractor_2 = Attractor()  # Any geometry to use as attractor(s)
influence_4 = Influence()  # Smoothed range of attractor influence (0-1)
tbox_6 = TwistedBox(voxels_8)
magnitude = Magnitude()  # Magnitude of the morph
geo_3 = Geometry(attractor_2)
debrep_2 = DeconstructBrep(Brep=tbox_6)  # -> Faces, Edges, Vertices
pull_2 = PullPoint(Point=debrep_2.Vertices, Geometry=geo_3, ClosestOnly=True)  # -> ClosestPoint, Distance
bnd_6 = Bounds(Numbers=flatten(pull_2.Distance))
panel_21 = Panel("VOXEL MORPH ATTRACTOR")
expression_17 = Expression(x=influence_4, y=pull_2.Distance, Expression="-1*e^(-x*y)")
dedomain = DeconstructDomain(Domain=bnd_6)  # -> Start, End
subtraction = Subtraction(A=dedomain.Start, B=magnitude)
bnd_7 = Bounds(Numbers=flatten(expression_17))
dom_5 = ConstructDomain(DomainStart=subtraction, DomainEnd="0")
ln_2 = Line(StartPoint=debrep_2.Vertices, EndPoint=pull_2.ClosestPoint)
remap_6 = RemapNumbers(Value=expression_17, Source=bnd_7, Target=dom_5)  # -> Mapped, Clipped
amp_5 = Amplitude(Vector=ln_2, Amplitude=remap_6.Mapped)
move_5 = Move(Geometry=debrep_2.Vertices, Motion=amp_5)  # -> Geometry, Transform
item_45 = ListItem(List=move_5.Geometry, Index="0", Wrap=True)
item_46 = ListItem(List=move_5.Geometry, Index="1", Wrap=True)
item_47 = ListItem(List=move_5.Geometry, Index="2", Wrap=True)
item_48 = ListItem(List=move_5.Geometry, Index="3", Wrap=True)
item_49 = ListItem(List=move_5.Geometry, Index="4", Wrap=True)
item_50 = ListItem(List=move_5.Geometry, Index="6", Wrap=True)
item_51 = ListItem(List=move_5.Geometry, Index="5", Wrap=True)
item_52 = ListItem(List=move_5.Geometry, Index="7", Wrap=True)
tbox_7 = TwistedBox(
    CornerA=item_45,
    CornerB=item_46,
    CornerC=item_47,
    CornerD=item_48,
    CornerE=item_51,
    CornerF=item_49,
    CornerG=item_52,
    CornerH=item_50)
voxels_9 = Voxels(tbox_7)  # Voxels to be filled with unit cells

resolution_v = ResolutionV()  # Resolution of points in V direction
surface = Surface()  # Surface to offset
resolution_u = ResolutionU()  # Resolution of points in U direction
points_3 = Points()  # List of points (flattened)
magnitude_max_4 = MagnitudeMax()  # Magnitude of the offset (maximum value)
influence_5 = Influence()  # Smoothed range of attractor influence (0-1)
values_3 = Values()  # Values that correspond to points (flattened)
magnitude_min_4 = MagnitudeMin()  # Magnitude of the offset (minimum value)
distance_influence_3 = DistanceInfluence()  # If true the distance between the points and voxels will affect the magnitude
sdivide_2 = DivideSurface(Surface=surface, UCount=resolution_u, VCount=resolution_v)  # -> Points, Normals, Parameters
pt_4 = Point(points_3)
num_13 = Number(values_3)
bnd_8 = Bounds(Numbers=num_13)
dom_6 = ConstructDomain(DomainStart=magnitude_min_4, DomainEnd=magnitude_max_4)
cp_3 = ClosestPoint(Point=sdivide_2.Points, Cloud=pt_4)  # -> ClosestPoint, CPIndex, Distance
remap_7 = RemapNumbers(Value=num_13, Source=bnd_8, Target=dom_6)  # -> Mapped, Clipped
expression_18 = Expression(x=influence_5, y=cp_3.Distance, Expression="-1*e^(-x*y)")
item_53 = ListItem(List=remap_7.Mapped, Index=cp_3.CPIndex, Wrap=True)
panel_22 = Panel("SURFACE OFFSET VALUE")
bnd_9 = Bounds(Numbers=flatten(expression_18))
remap_8 = RemapNumbers(Value=expression_18, Source=bnd_9, Target="1 to 0")  # -> Mapped, Clipped
not_3 = GateNot(A=distance_influence_3)
multiplication_6 = Multiplication(A=item_53, B=remap_8.Mapped)
cull_9 = CullPattern(List=item_53, CullPattern=not_3)
cull_10 = CullPattern(List=multiplication_6, CullPattern=distance_influence_3)
amp_6 = Amplitude(Vector=sdivide_2.Normals, Amplitude=[cull_10, cull_9])
move_6 = Move(Geometry=sdivide_2.Points, Motion=amp_6)  # -> Geometry, Transform
srfgrid_2 = SurfaceFromPoints(Points=flatten(move_6.Geometry), UCount=expr("x+1", resolution_u), Interpolate=False)
offest_surface = OffestSurface(srfgrid_2)  # Offset Surface

lower_limit_2 = LowerLimit()  # Smoothing of the surface closest to the attractor
attractor_3 = Attractor()  # Any geometry to use as attractor(s)
magnitude_min_5 = MagnitudeMin()  # Magnitude of the offset (minimum value)
magnitude_max_5 = MagnitudeMax()  # Magnitude of the offset (maximum value)
resolution_v_2 = ResolutionV()  # Resolution of points in V direction
surface_2 = Surface()  # Surface to offset
resolution_u_2 = ResolutionU()  # Resolution of points in U direction
influence_6 = Influence()  # Smoothed range of attractor influence (0-1)
num_14 = Number(resolution_v_2)
geo_4 = Geometry(attractor_3)
num_15 = Number(resolution_u_2)
num_16 = Number(lower_limit_2)
num_17 = Number(influence_6)
srf_2 = Surface(surface_2)
num_18 = Number(magnitude_min_5)
num_19 = Number(magnitude_max_5)
series_5 = Series(Start=0, Step=1, Count=expr("x+1", num_14))
series_6 = Series(Start=0, Step=1, Count=expr("x+1", num_15))
sdivide_3 = DivideSurface(Surface=srf_2, UCount=num_15, VCount=num_14)  # -> Points, Normals, Parameters
crossref_2 = CrossReference(ListA=graft(series_6), ListB=series_5, CrossMode=1)  # -> ListA, ListB
panel_23 = Panel("SURFACE OFFSET ATTRACTOR")
pull_3 = PullPoint(Point=sdivide_3.Points, Geometry=geo_4, ClosestOnly=True)  # -> ClosestPoint, Distance
smaller_2 = SmallerThan(FirstNumber=pull_3.Distance, SecondNumber=num_16)  # -> SmallerThan, OrEqualTo
cull_11 = CullPattern(List=crossref_2.ListB, CullPattern=smaller_2.SmallerThan)
replace_2 = ReplaceItems(List=pull_3.Distance, Item="0", Indices=cull_11, Wrap=False)
expression_19 = Expression(x=num_17, y=replace_2, Expression="-1*e^(-x*y)")
bnd_10 = Bounds(Numbers=flatten(expression_19))
dom_7 = ConstructDomain(DomainStart=num_18, DomainEnd=num_19)
remap_9 = RemapNumbers(Value=expression_19, Source=bnd_10, Target=dom_7)  # -> Mapped, Clipped
amp_7 = Amplitude(Vector=sdivide_3.Normals, Amplitude=remap_9.Mapped)
move_7 = Move(Geometry=sdivide_3.Points, Motion=amp_7)  # -> Geometry, Transform
srfgrid_3 = SurfaceFromPoints(Points=flatten(move_7.Geometry), UCount=expr("x+1", num_15), Interpolate=False)
offest_surface_2 = OffestSurface(srfgrid_3)  # Offset Surface

morph_between_surfaces = MorphBetweenSurfaces()
voxel_morph_value = VoxelMorphValue()
voxel_morph_attractor = VoxelMorphAttractor()
surface_offset_value = SurfaceOffsetValue()
surface_offset_attractor = SurfaceOffsetAttractor()
voxelize = Voxelize()
mesh_offset = MeshOffset()  # -> voxels, quad_mesh, offset_quad_mesh
mesh_offset_value = MeshOffsetValue()  # -> voxels, quad_mesh, offset_quad_mesh
mesh_offset_attractor = MeshOffsetAttractor()  # -> voxels, quad_mesh, offset_quad_mesh

geometry_2 = Geometry()  # Geometry to fill
number_of_points = NumberOfPoints()  # The initial number of random points to fill the volume
use_attractor = UseAttractor()  # If true, points will be filtered by distance to attractor(s)
attractor_4 = Attractor()  # Any geometry to use as attractor(s)
magnitude_of_random_filtering = MagnitudeOfRandomFiltering()  # Magnitude of random filtering
number_of_filtered_points = NumberOfFilteredPoints()  # The number of points to filter
enable_voronoi = EnableVoronoi()  # If true, voronoi cells will be generated (can be very slow)
geo_5 = Geometry(geometry_2)
geo_6 = Geometry(attractor_4)
mesh_13 = Mesh(geo_5)
bbox_2 = BoundingBox(Content=mesh_13, Plane=PlaneXY(0, 0, 0))  # -> Box, Box_2
pop3d = Populate3D(Region=bbox_2.Box, Count=number_of_points, Seed=1)
dom_8 = ConstructDomain(DomainStart=expr("x*-1", magnitude_of_random_filtering), DomainEnd=magnitude_of_random_filtering)
pull_4 = PullPoint(Point=pop3d, Geometry=geo_6, ClosestOnly=True)  # -> ClosestPoint, Distance
lng_2 = ListLength(List=pop3d)
random = Random(Range=dom_8, Number=lng_2, Seed=2)
addition_11 = Addition(A=random, B=pull_4.Distance)
sort_2 = SortList(Keys=addition_11, ValuesA=pop3d)  # -> Keys, ValuesA
not_4 = GateNot(A=use_attractor)
panel_25 = Panel("VORONOI FILL")
subset = SubList(List=sort_2.ValuesA, Domain=number_of_filtered_points, Wrap=True)  # -> List, Index
cull_12 = CullPattern(List=pop3d, CullPattern=not_4)
cull_13 = CullPattern(List=subset.List, CullPattern=use_attractor)
pt_5 = Point(flatten([cull_13, cull_12]))
minc_2 = MeshInclusion(Mesh=mesh_13, Point=flatten(pt_5), Strict=False)
cull_14 = CullPattern(List=flatten(pt_5), CullPattern=minc_2)
cull_15 = CullPattern(List=cull_14, CullPattern=enable_voronoi)
voronoi³ = Voronoi3D(Points=flatten(cull_15), Box=bbox_2.Box)  # -> Cells, Boundary
edges = BrepEdges(Brep=voronoi³.Cells)  # -> Naked, Interior, NonManifold
mmx = MeshMesh(MeshA=mesh_13, MeshB=voronoi³.Cells, UseMeshMeshFast=True)
explode = Explode(Curve=flatten(mmx), Recursive=True)  # -> Segments, flatten(Vertices)
remove_duplicate_lines = RemoveDuplicateLines(lattice_l=flatten(edges.Interior))
remove_duplicate_lines_2 = RemoveDuplicateLines(lattice_l=flatten(explode.Segments))
preview_points = PreviewPoints(cull_14)  # Preview of points that will create the voronoi lattice
voronoi_lattice_skin = VoronoiLatticeSkin(remove_duplicate_lines_2)  # List of curves that make up the lattice skin
voronoi_lattice = VoronoiLattice(remove_duplicate_lines)  # List of curves that make up the lattice

distance_influence_4 = DistanceInfluence()  # If true the distance between the points and voxels will affect the magnitude
influence_7 = Influence()  # Smoothed range of attractor influence (0-1)
values_4 = Values()  # Values that correspond to points (flattened)
points_4 = Points()  # List of points (flattened)
voxels_10 = Voxels()  # Voxels to be filled with unit cells
brep = Brep(voxels_10)
num_20 = Number(values_4)
pt_6 = Point(points_4)
area = Area(Geometry=flatten(brep))  # -> Area, Centroid
cp_4 = ClosestPoint(Point=area.Centroid, Cloud=pt_6)  # -> ClosestPoint, CPIndex, Distance
item_54 = ListItem(List=num_20, Index=cp_4.CPIndex, Wrap=True)
panel_26 = Panel("CELL MORPH VALUE")
expression_20 = Expression(x=influence_7, y=cp_4.Distance, Expression="-1*e^(-x*y)")
bnd_11 = Bounds(Numbers=item_54)
remap_10 = RemapNumbers(Value=item_54, Source=bnd_11, Target=Domain(0, 1))  # -> Mapped, Clipped
bnd_12 = Bounds(Numbers=expression_20)
not_5 = GateNot(A=distance_influence_4)
remap_11 = RemapNumbers(Value=expression_20, Source=bnd_12, Target="1 to 0")  # -> Mapped, Clipped
cull_16 = CullPattern(List=remap_10.Mapped, CullPattern=not_5)
multiplication_7 = Multiplication(A=remap_10.Mapped, B=remap_11.Mapped)
cull_17 = CullPattern(List=multiplication_7, CullPattern=distance_influence_4)
num_21 = Number([cull_17, cull_16])
value = Value(num_21)  # Values (0-1) for morph

attractor_5 = Attractor()  # Any geometry to use as attractor(s)
influence_8 = Influence()  # Smoothed range of attractor influence (0-1)
magnitude_min_6 = MagnitudeMin()  # Magnitude of the morph (minimum value)
magnitude_max_6 = MagnitudeMax()  # Magnitude of the morph (maximum value)
voxels_11 = Voxels()  # Voxels to be filled with unit cells
brep_2 = Brep(voxels_11)
geo_7 = Geometry(attractor_5)
volume = Volume(Geometry=flatten(brep_2))  # -> Volume, Centroid
pull_5 = PullPoint(Point=volume.Centroid, Geometry=geo_7, ClosestOnly=True)  # -> ClosestPoint, Distance
panel_27 = Panel("CELL MORPH ATTRACTOR")
expression_21 = Expression(x=influence_8, y=pull_5.Distance, Expression="-1*e^(-x*y)")
dom_9 = ConstructDomain(DomainStart=magnitude_min_6, DomainEnd=magnitude_max_6)
bnd_13 = Bounds(Numbers=expression_21)
remap_12 = RemapNumbers(Value=expression_21, Source=bnd_13, Target=dom_9)  # -> Mapped, Clipped
value_2 = Value(remap_12.Mapped)  # Values (0-1) for cell morph

unit_cell_shell = UnitCellShell()  # Unit cell to populate voxels
voxels_12 = Voxels()  # Voxels to be filled with unit cells
geo_8 = Geometry(unit_cell_shell)
bbox_3 = BoundingBox(Content=geo_8, Plane=PlaneXY(0, 0, 0), UnionBox=True)  # -> Box, Box_2
morph = BoxMorph(Geometry=geo_8, Reference=bbox_3.Box, Target=graft(voxels_12))  # -> flatten(Geometry)
mjoin_4 = MeshJoin(Meshes=morph)
panel_28 = Panel("CELL SHELL FILL")
facen = FaceNormals(Mesh=mjoin_4)  # -> Centers, Normals
demesh_13 = DeconstructMesh(Mesh=mjoin_4)  # -> Vertices, Faces, Colours, Normals
cullpt_2 = CullDuplicates(Points=facen.Centers, Tolerance=".001", CullMode=1)  # -> Points, Indices, Valence
item_55 = ListItem(List=demesh_13.Faces, Index=cullpt_2.Indices, Wrap=True)
conmesh_13 = ConstructMesh(Vertices=demesh_13.Vertices, Faces=item_55)
weld_4 = WeldMesh(Mesh=conmesh_13, Angle=3.141592654)
lattice_shell = LatticeShell(weld_4)  # Joined mesh that makes up the lattice

unit_cell_2 = UnitCell2()  # Unit cell to populate voxels
unit_cell_1 = UnitCell1()  # Unit cell to populate voxels
value_3 = Value()  # Value from 0-1 corresponding to each voxel
voxels_13 = Voxels()  # Voxels to be filled with unit cells
num_22 = Number(value_3)
flip_12 = FlipCurve(Curve=unit_cell_1, Guide=unit_cell_2)  # -> Curve, Flag
tweencrv = TweenCurve(CurveA=flip_12.Curve, CurveB=unit_cell_2, Factor=graft(num_22), BlendType=0)
panel_29 = Panel("TWEEN CELL FILL")
bbox_4 = BoundingBox(Content=tweencrv, Plane=PlaneXY(0, 0, 0), UnionBox=True)  # -> Box, Box_2
morph_2 = BoxMorph(Geometry=tweencrv, Reference=bbox_4.Box, Target=graft(voxels_13))  # -> flatten(Geometry)
line = Line(morph_2)
remove_duplicate_lines_3 = RemoveDuplicateLines(lattice_l=flatten(line))
lattice = Lattice(remove_duplicate_lines_3)  # List of curves that make up the lattice

unit_cell = UnitCell()  # Unit cell to populate voxels
voxels_14 = Voxels()  # Voxels to be filled with unit cells
crv = Curve(unit_cell)
bbox_5 = BoundingBox(Content=crv, Plane=PlaneXY(0, 0, 0), UnionBox=True)  # -> Box, Box_2
panel_30 = Panel("CELL FILL")
morph_3 = BoxMorph(Geometry=crv, Reference=bbox_5.Box, Target=graft(voxels_14))  # -> flatten(Geometry)
remove_duplicate_lines_4 = RemoveDuplicateLines(lattice_l=flatten(morph_3))
lattice_2 = Lattice(remove_duplicate_lines_4)  # List of curves that make up the lattice

unit_cell_3 = UnitCell()  # Unit cell to populate voxels

crv_2 = Curve([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])
crv_3 = Curve([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])
crv_4 = Curve([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])
crv_5 = Curve([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])
crv_6 = Curve([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])
crv_7 = Curve([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])
crv_8 = Curve([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])
crv_9 = Curve([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])
crv_10 = Curve([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])
crv_11 = Curve([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])
crv_12 = Curve([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])
crv_13 = Curve([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])
crv_14 = Curve([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])
crv_15 = Curve([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])
crv_16 = Curve([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])
mesh_14 = Mesh(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)
mesh_15 = Mesh(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)
mesh_16 = Mesh(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)
mesh_17 = Mesh(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)
mesh_18 = Mesh(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)
mesh_19 = Mesh(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)
panel_31 = Panel("CELL TYPES")
entwine_10 = Entwine(
    Branch00=crv_7,
    Branch01=crv_11,
    Branch02=crv_14,
    Branch03=crv_5,
    Branch04=crv_3,
    Branch05=crv_8,
    Branch06=crv_12,
    Branch07=crv_2,
    Branch08=crv_9,
    Branch09=crv_10,
    Branch010=crv_13,
    Branch011=crv_4,
    Branch012=crv_6,
    Branch013=crv_15,
    Branch014=crv_16,
    Branch015=mesh_14,
    Branch016=mesh_15,
    Branch017=mesh_16,
    Branch018=mesh_17,
    Branch019=mesh_18,
    Branch020=mesh_19,
    FlattenInputs=True)  # -> simplify(Result)
unit_cell_selector = UnitCellSelector()
branch = TreeBranch(Tree=entwine_10, Path=unit_cell_selector, MaintainPaths=True)
unit_cell_4 = UnitCell(branch)  # Single unit cell to populate voxels
cell_type = CellType()

panel_32 = Panel("CELL SELECTOR")
unit_cell_selector_2 = CellSelector({"Prim. Cubic": 0, "BC": 1, "BC Cubic": 2, "FC Cubic": 3, "Edge Octa.": 4, "Vertex Octa.": 5, "NaCl": 6, "Star Tet.": 7, "BC Star Tet.": 8, "Octa. Tet.": 9, "Dodecahedron": 10, "Trunc. Octa.": 11, "Tetrahedral": 12, "BC1 (tween)": 13, "BC2 (tween)": 14, "Octa. (shell)": 15, "Dodeca. (shell)": 16, "Trunc. Octa. (shell)": 17, "Gyroid (shell)": 18, "Cubic Center": 19, "Cubic Face": 20}, selected="Dodecahedron")

panel_33 = Panel("POPULATE")
cell_fill = CellFill()
tween_cell_fill = TweenCellFill()
cell_morph_attractor = CellMorphAttractor()
cell_shell_fill = CellShellFill()
cell_morph_value = CellMorphValue()
voronoi_fill = VoronoiFill()  # -> voronoi_lattice, voronoi_lattice_skin, preview_points

max_distance = MaxDistance()  # Maximum distance to merge
lattice_3 = Lattice()  # Lattice to merge
crv_17 = Curve(lattice_3)
num_23 = Number(max_distance)
cp_5 = ControlPoints(Curve=crv_17)  # -> Points, Weights, Knots
cullpt_3 = CullDuplicates(Points=flatten(cp_5.Points), Tolerance=num_23, CullMode=3)  # -> Points, Indices, Valence
fsim = FindSimilarMember(Data=cp_5.Points, Set=cullpt_3.Points)  # -> Hit, Index
panel_34 = Panel("MERGE CURVES")
pline_2 = PolyLine(Vertices=fsim.Hit, Closed=False)  # -> flatten(Polyline)
len = Length(Curve=pline_2)
larger = LargerThan(FirstNumber=len, SecondNumber="0")  # -> LargerThan, OrEqualTo
cull_18 = CullPattern(List=pline_2, CullPattern=larger.LargerThan)
lattice_4 = Lattice(cull_18)  # Merged lattice

geometry_3 = Geometry()  # Geometry to trim with (closed brep or mesh)
lattice_5 = Lattice()  # Lattice curves to trim
geo_9 = Geometry(geometry_3)
crv_18 = Curve(lattice_5)
mesh_20 = Mesh(geo_9)
mcx = MeshCurve(Mesh=mesh_20, Curve=crv_18)  # -> Points, Faces
null = NullItem(Item=mcx.Points)  # -> NullFlags, InvalidFlags, Description
crv_cp = CurveClosestPoint(Point=mcx.Points, Curve=graft(crv_18))  # -> Point, Parameter, Distance
panel_35 = Panel("TRIM LATTICE")
cull_19 = CullPattern(List=graft(crv_18), CullPattern=null.NullFlags)
shatter = Shatter(Curve=graft(crv_18), Parameters=crv_cp.Parameter)
curvepoint = PointOnCurve(cull_19, parameter=0.5)
curvepoint_2 = PointOnCurve(shatter, parameter=0.5)
minc_3 = MeshInclusion(Mesh=mesh_20, Point=curvepoint, Strict=False)
minc_4 = MeshInclusion(Mesh=mesh_20, Point=curvepoint_2, Strict=False)
cull_20 = CullPattern(List=shatter, CullPattern=minc_4)
cull_21 = CullPattern(List=cull_19, CullPattern=minc_3)
crv_19 = Curve(flatten(cull_20))
crv_20 = Curve(flatten(cull_21))
unrimmed_lattice = UnrimmedLattice(crv_20)  # Lattice curves that have not been trimmed (Typically removes curves with valence 1)
trimmed_lattice = TrimmedLattice(crv_19)  # Lattice curves that have been trimmed

lattice_6 = Lattice()  # Lattice curves to filter
valence_number = ValenceNumber()  # The number of connections each curve has
crv_21 = Curve(lattice_6)
cp_6 = ControlPoints(Curve=crv_21)  # -> Points, Weights, Knots
cps = ClosestPoints(Point=cp_6.Points, Cloud=flatten(cp_6.Points), Count=expr("x+1", valence_number))  # -> ClosestPoint, CPIndex, simplify(Distance)
panel_36 = Panel("REMOVE BY VALENCE")
trim = TrimTree(Tree=cps.Distance, Depth=1)
ma = MassAddition(Input=trim)  # -> Result, PartialResults
smaller_3 = SmallerThan(FirstNumber=ma.Result, SecondNumber="0")  # -> SmallerThan, OrEqualTo
cull_22 = CullPattern(List=graft(crv_21), CullPattern=smaller_3.OrEqualTo)  # -> flatten(List)
lattice_7 = Lattice(cull_22)  # Filtered lattice

geometry_4 = Geometry()  # Geometry to trim with (closed brep or mesh)
lattice_shell_2 = LatticeShell()  # Lattice shell to trim
geo_10 = Geometry(geometry_4)
mjoin_5 = MeshJoin(Meshes=flatten(lattice_shell_2))
mesh_21 = Mesh(geo_10)
weld_5 = WeldMesh(Mesh=mjoin_5, Angle=3.141592654)
panel_37 = Panel("TRIM SHELL")
demesh_14 = DeconstructMesh(Mesh=weld_5)  # -> Vertices, Faces, Colours, Normals
minc_5 = MeshInclusion(Mesh=mesh_21, Point=demesh_14.Vertices, Strict=False)
not_6 = GateNot(A=minc_5)
cullv = CullVertices(Mesh=weld_5, Pattern=not_6, Shrink=True)
trimmed_lattice_shell = TrimmedLatticeShell(cullv)  # Trimmed lattice shell

lattice_8 = Lattice()  # Lattice curves to filter
crv_22 = Curve(flatten(lattice_8))
join = JoinCurves(Curves=crv_22, Preserve=False)
line_2 = Line(join)
panel_38 = Panel("REMOVE FLOATING CURVES")
null_2 = NullItem(Item=line_2)  # -> NullFlags, InvalidFlags, Description
cull_23 = CullPattern(List=join, CullPattern=null_2.NullFlags)
explode_2 = Explode(Curve=cull_23, Recursive=True)  # -> flatten(Segments), Vertices
lattice_9 = Lattice(explode_2.Segments)  # Filtered lattice

lattice_10 = Lattice()  # Lattice curves to filter
crv_23 = Curve(lattice_10)
curvepoint_3 = PointOnCurve(crv_23, parameter=0.5)
panel_39 = Panel("REMOVE DUPLICATE CURVES")
cullpt_4 = CullDuplicates(Points=curvepoint_3, Tolerance=".001", CullMode=1)  # -> Points, Indices, Valence
item_56 = ListItem(List=crv_23, Index=cullpt_4.Indices, Wrap=True)
lattice_11 = Lattice(item_56)  # Filtered lattice

lattice_12 = Lattice()  # Lattice curves to filter
length = Length()  # Minimum lenth of lattice curves
crv_24 = Curve(lattice_12)
len_2 = Length(Curve=crv_24)
panel_40 = Panel("REMOVE SHORT")
larger_2 = LargerThan(FirstNumber=len_2, SecondNumber=length)  # -> LargerThan, OrEqualTo
cull_24 = CullPattern(List=crv_24, CullPattern=larger_2.LargerThan)
lattice_13 = Lattice(cull_24)  # Filtered lattice

panel_41 = Panel("CLEAN UP")
remove_floating = RemoveFloating()
remove_duplicate_curves = RemoveDuplicateCurves()
remove_short = RemoveShort()
trim_shell = TrimShell()
merge_curves = MergeCurves()
remove_by_valence = RemoveByValence()
trim_lattice = TrimLattice()  # -> trimmed_lattice, unrimmed_lattice

# ----
# MORPH LATTICE TO SKIN
geometry_5 = Geometry()  # Geometry to morph to
lattice_14 = Lattice()  # Lattice to morph to skin
geometry_6 = Geometry()  # Geometry to morph to
max_distance_2 = MaxDistance()  # Maximum distance from geometry
max_distance_3 = MaxDistance()  # Maximum distance to moprh
geo_11 = Geometry(geometry_6)
crv_25 = Curve(lattice_14)
geo_12 = Geometry(geometry_5)
cp_7 = ControlPoints(Curve=crv_25)  # -> simplify(Points), Weights, Knots
pull_6 = PullPoint(Point=cp_7.Points, Geometry=geo_12, ClosestOnly=True)  # -> ClosestPoint, Distance
smaller_4 = SmallerThan(FirstNumber=pull_6.Distance, SecondNumber=max_distance_2)  # -> SmallerThan, OrEqualTo
not_7 = GateNot(A=smaller_4.SmallerThan)
cull_25 = CullPattern(List=cp_7.Points, CullPattern=smaller_4.SmallerThan)
cull_26 = CullPattern(List=cp_7.Points, CullPattern=not_7)
pull_7 = PullPoint(Point=cull_25, Geometry=geo_11, ClosestOnly=True)  # -> ClosestPoint, Distance
smaller_5 = SmallerThan(FirstNumber=pull_7.Distance, SecondNumber=max_distance_3)  # -> SmallerThan, OrEqualTo
not_8 = GateNot(A=smaller_5.SmallerThan)
cull_27 = CullPattern(List=pull_7.ClosestPoint, CullPattern=smaller_5.SmallerThan)
cull_28 = CullPattern(List=cull_25, CullPattern=not_8)
merge_2 = Merge(Data1=cull_26, Data2=cull_28, Data3=cull_27)
item_57 = ListItem(List=merge_2, Index=0, Wrap=True)  # -> Item1, Item, Item1_2
ln_3 = Line(StartPoint=item_57.Item1, EndPoint=item_57.Item)
remove_duplicate_lines_5 = RemoveDuplicateLines(lattice_l=flatten(ln_3))
len_3 = Length(Curve=remove_duplicate_lines_5)
larger_3 = LargerThan(FirstNumber=len_3, SecondNumber=0)  # -> LargerThan, OrEqualTo
cull_29 = CullPattern(List=remove_duplicate_lines_5, CullPattern=larger_3.LargerThan)
crv_26 = Curve(cull_29)
lattice_15 = Lattice(crv_26)  # Morphed lattice

lattice_b = LatticeB()  # Second lattice to make connections between
lattice_a = LatticeA()  # First lattice to make connections between
number_of_connections = NumberOfConnections()  # Number of Connections
max_distance_4 = MaxDistance()  # Maximum distance between connections
crv_27 = Curve(lattice_a)
crv_28 = Curve(lattice_b)
cp_8 = ControlPoints(Curve=crv_27)  # -> Points, Weights, Knots
cp_9 = ControlPoints(Curve=crv_28)  # -> Points, Weights, Knots
cullpt_5 = CullDuplicates(Points=flatten(cp_8.Points), Tolerance=0.1, CullMode=1)  # -> Points, Indices, Valence
cullpt_6 = CullDuplicates(Points=flatten(cp_9.Points), Tolerance=0.1, CullMode=1)  # -> Points, Indices, Valence
panel_42 = Panel("LATTICE CONNECTIONS")
cps_2 = ClosestPoints(Point=cullpt_5.Points, Cloud=cullpt_6.Points, Count=number_of_connections)  # -> ClosestPoint, CPIndex, Distance
smaller_6 = SmallerThan(FirstNumber=cps_2.Distance, SecondNumber=max_distance_4)  # -> SmallerThan, OrEqualTo
cull_30 = CullPattern(List=cps_2.ClosestPoint, CullPattern=smaller_6.SmallerThan)
ln_4 = Line(StartPoint=graft(cullpt_5.Points), EndPoint=cull_30)
lattice_16 = Lattice(ln_4)  # Lattice connections

# ----
# MORPH SHELL TO SKIN
lattice_shell_3 = LatticeShell()  # Lattice shell to moprh
geometry_7 = Geometry()  # Geometry to morph to
max_distance_5 = MaxDistance()  # Maximum distance from geometry
mesh_22 = Mesh(lattice_shell_3)
geo_13 = Geometry(geometry_7)
mesh_23 = Mesh(geo_13)
demesh_15 = DeconstructMesh(Mesh=mesh_22)  # -> Vertices, Faces, Colours, Normals
pull_8 = PullPoint(Point=demesh_15.Vertices, Geometry=mesh_23, ClosestOnly=True)  # -> ClosestPoint, Distance
lng_3 = ListLength(List=demesh_15.Vertices)
smaller_7 = SmallerThan(FirstNumber=pull_8.Distance, SecondNumber=max_distance_5)  # -> SmallerThan, OrEqualTo
series_7 = Series(Start=0, Step=1, Count=lng_3)
cull_31 = CullPattern(List=pull_8.ClosestPoint, CullPattern=smaller_7.SmallerThan)
cull_32 = CullPattern(List=series_7, CullPattern=smaller_7.SmallerThan)
replace_3 = ReplaceItems(List=demesh_15.Vertices, Item=cull_31, Indices=cull_32, Wrap=False)
conmesh_14 = ConstructMesh(Vertices=replace_3, Faces=demesh_15.Faces)
trimmed_lattice_shell_2 = TrimmedLatticeShell(conmesh_14)  # Trimmed lattice shell

panel_43 = Panel("MODIFY")
morph_shell_to_skin = MorphShellToSkin()
lattice_connections = LatticeConnections()
morph_lattice_to_skin = MorphLatticeToSkin()

lattice_shell_4 = LatticeShell()  # Lattice shell to thicken
points_5 = Points()  # List of points (flattened)
values_5 = Values()  # Values that correspond to points (flattened)
distance_influence_5 = DistanceInfluence()  # If true the distance between the points and voxels will affect the magnitude
influence_9 = Influence()  # Smoothed range of attractor influence (0-1)
magnitude_min_7 = MagnitudeMin()  # Lattice shell thickness (minimum value)
magnitude_max_7 = MagnitudeMax()  # Lattice shell thickness (maximum value)
mesh_24 = Mesh(lattice_shell_4)
num_24 = Number(values_5)
pt_7 = Point(points_5)
demesh_16 = DeconstructMesh(Mesh=mesh_24)  # -> Vertices, Faces, Colours, Normals
cp_10 = ClosestPoint(Point=demesh_16.Vertices, Cloud=pt_7)  # -> ClosestPoint, CPIndex, Distance
item_58 = ListItem(List=num_24, Index=cp_10.CPIndex, Wrap=True)
expression_22 = Expression(x=influence_9, y=cp_10.Distance, Expression="-1*e^(-x*y)")
dom_10 = ConstructDomain(DomainStart=magnitude_min_7, DomainEnd=magnitude_max_7)
bnd_14 = Bounds(Numbers=item_58)
panel_44 = Panel("SHELL THICKNESS VALUE")
remap_13 = RemapNumbers(Value=item_58, Source=bnd_14, Target=dom_10)  # -> Mapped, Clipped
bnd_15 = Bounds(Numbers=expression_22)
not_9 = GateNot(A=distance_influence_5)
remap_14 = RemapNumbers(Value=expression_22, Source=bnd_15, Target="1 to 0")  # -> Mapped, Clipped
multiplication_8 = Multiplication(A=remap_13.Mapped, B=remap_14.Mapped)
cull_33 = CullPattern(List=remap_13.Mapped, CullPattern=not_9)
cull_34 = CullPattern(List=multiplication_8, CullPattern=distance_influence_5)
bnd_16 = Bounds(Numbers=cull_34)
remap_15 = RemapNumbers(Value=cull_34, Source=bnd_16, Target=dom_10)  # -> Mapped, Clipped
num_25 = Number([remap_15.Mapped, cull_33])
value_4 = Value(num_25)  # Values for shell thickness (mesh vertices)

lattice_17 = Lattice()  # Lattice to thicken
points_6 = Points()  # List of points (flattened)
values_6 = Values()  # Values that correspond to points (flattened)
distance_influence_6 = DistanceInfluence()  # If true the distance between the points and voxels will affect the magnitude
influence_10 = Influence()  # Smoothed range of attractor influence (0-1)
magnitude_min_8 = MagnitudeMin()  # Lattice beam thickness (minimum value)
magnitude_max_8 = MagnitudeMax()  # Lattice beam thickness (maximum value)
crv_29 = Curve(lattice_17)
curvepoint_4 = PointOnCurve(crv_29, parameter=0.5)
num_26 = Number(values_6)
pt_8 = Point(points_6)
cp_11 = ClosestPoint(Point=curvepoint_4, Cloud=pt_8)  # -> ClosestPoint, CPIndex, Distance
dom_11 = ConstructDomain(DomainStart=magnitude_min_8, DomainEnd=magnitude_max_8)
item_59 = ListItem(List=num_26, Index=cp_11.CPIndex, Wrap=True)
panel_45 = Panel("LATTICE THICKNESS VALUE")
expression_23 = Expression(x=influence_10, y=cp_11.Distance, Expression="-1*e^(-x*y)")
bnd_17 = Bounds(Numbers=item_59)
remap_16 = RemapNumbers(Value=item_59, Source=bnd_17, Target=dom_11)  # -> Mapped, Clipped
not_10 = GateNot(A=distance_influence_6)
bnd_18 = Bounds(Numbers=expression_23)
remap_17 = RemapNumbers(Value=expression_23, Source=bnd_18, Target="1 to 0")  # -> Mapped, Clipped
cull_35 = CullPattern(List=remap_16.Mapped, CullPattern=not_10)
multiplication_9 = Multiplication(A=remap_16.Mapped, B=remap_17.Mapped)
cull_36 = CullPattern(List=multiplication_9, CullPattern=distance_influence_6)
bnd_19 = Bounds(Numbers=cull_36)
remap_18 = RemapNumbers(Value=cull_36, Source=bnd_19, Target=dom_11)  # -> Mapped, Clipped
num_27 = Number([remap_18.Mapped, cull_35])
value_5 = Value(num_27)  # Values for beam thickness

lattice_18 = Lattice()  # Lattice to thicken
attractor_6 = Attractor()  # Any geometry to use as attractor(s)
influence_11 = Influence()  # Smoothed range of attractor influence (0-1)
magnitude_min_9 = MagnitudeMin()  # Lattice beam thickness (minimum value)
magnitude_max_9 = MagnitudeMax()  # Lattice beam thickness (maximum value)
crv_30 = Curve(lattice_18)
geo_14 = Geometry(attractor_6)
curvepoint_5 = PointOnCurve(crv_30, parameter=0.5)
pull_9 = PullPoint(Point=curvepoint_5, Geometry=geo_14, ClosestOnly=True)  # -> ClosestPoint, Distance
panel_46 = Panel("LATTICE THICKNESS ATTRACTOR")
expression_24 = Expression(x=influence_11, y=pull_9.Distance, Expression="-1*e^(-x*y)")
dom_12 = ConstructDomain(DomainStart=magnitude_min_9, DomainEnd=magnitude_max_9)
bnd_20 = Bounds(Numbers=expression_24)
dedomain_2 = DeconstructDomain(Domain=bnd_20)  # -> Start, End
dom_13 = ConstructDomain(DomainStart=dedomain_2.End, DomainEnd=dedomain_2.Start)
remap_19 = RemapNumbers(Value=expression_24, Source=dom_13, Target=dom_12)  # -> Mapped, Clipped
value_6 = Value(remap_19.Mapped)  # Values for beam thickness

lattice_shell_5 = LatticeShell()  # Lattice shell to thicken
attractor_7 = Attractor()  # Any geometry to use as attractor(s)
influence_12 = Influence()  # Smoothed range of attractor influence (0-1)
magnitude_min_10 = MagnitudeMin()  # Lattice shell thickness (minimum value)
magnitude_max_10 = MagnitudeMax()  # Lattice shell thickness (maximum value)
mesh_25 = Mesh(lattice_shell_5)
geo_15 = Geometry(attractor_7)
demesh_17 = DeconstructMesh(Mesh=mesh_25)  # -> Vertices, Faces, Colours, Normals
pull_10 = PullPoint(Point=demesh_17.Vertices, Geometry=geo_15, ClosestOnly=True)  # -> ClosestPoint, Distance
panel_47 = Panel("SHELL THICKNESS ATTRACTOR")
expression_25 = Expression(x=influence_12, y=pull_10.Distance, Expression="-1*e^(-x*y)")
dom_14 = ConstructDomain(DomainStart=magnitude_min_10, DomainEnd=magnitude_max_10)
bnd_21 = Bounds(Numbers=expression_25)
dedomain_3 = DeconstructDomain(Domain=bnd_21)  # -> Start, End
dom_15 = ConstructDomain(DomainStart=dedomain_3.End, DomainEnd=dedomain_3.Start)
remap_20 = RemapNumbers(Value=expression_25, Source=dom_15, Target=dom_14)  # -> Mapped, Clipped
value_7 = Value(remap_20.Mapped)  # Values for shell thickness (mesh vertices)

panel_48 = Panel("THICKEN")
lattice_thickness_attractor = LatticeThicknessAttractor()
shell_thickness_attractor = ShellThicknessAttractor()
shell_thickness_value = ShellThicknessValue()
lattice_thickness_value = LatticeThicknessValue()

# ==== cluster RemoveDuplicateLines
lattice_l = ClusterInput()
crv = Curve(lattice_l)
curvepoint = PointOnCurve(crv, parameter=0.5)
cullpt = CullDuplicates(Points=curvepoint, Tolerance=".001", CullMode=1)  # -> Points, Indices, Valence
item = ListItem(List=crv, Index=cullpt.Indices, Wrap=True)
lattice = ClusterOutput(item)

# ==== cluster CellFill: Fill voxels with unit cells

unit_cell = ClusterInput()  # Unit cell to populate voxels
voxels = ClusterInput()  # Voxels to be filled with unit cells
crv = Curve(unit_cell)
bbox = BoundingBox(Content=crv, Plane=PlaneXY(0, 0, 0), UnionBox=True)  # -> Box, Box_2
# CRYSTALLON V1.0 -- Lattice structure tools for Grasshopper3D
# 
# Copyright (C) 2018  Aaron Porterfield
# 
# www.studiofathom.com
# www.fequalsf.com
# 
#     This program is free software: you can redistribute it and/or modify
#     it under the terms of the GNU General Public License as published by
#     the Free Software Foundation, either version 3 of the License, or any later version.
# 
#     This program is distributed in the hope that it will be useful,
#     but WITHOUT ANY WARRANTY; without even the implied warranty of
#     MERCHANTABILITY or FITNESS FOR A PARTICULAR PURPOSE.  See the
#     GNU General Public License for more details.
# 
#     You should have received a copy of the GNU General Public License
#     along with this program.  If not, see <http://www.gnu.org/licenses/>.
panel = Panel("CELL FILL")
morph = BoxMorph(Geometry=crv, Reference=bbox.Box, Target=graft(voxels))  # -> flatten(Geometry)
remove_duplicate_lines = RemoveDuplicateLines(lattice_l=flatten(morph))
lattice = ClusterOutput(remove_duplicate_lines)  # List of curves that make up the lattice

# ==== cluster CellShellFill: Fill voxels with shell unit cells

unit_cell_shell = ClusterInput()  # Unit cell to populate voxels
voxels = ClusterInput()  # Voxels to be filled with unit cells
geo = Geometry(unit_cell_shell)
bbox = BoundingBox(Content=geo, Plane=PlaneXY(0, 0, 0), UnionBox=True)  # -> Box, Box_2
morph = BoxMorph(Geometry=geo, Reference=bbox.Box, Target=graft(voxels))  # -> flatten(Geometry)
mjoin = MeshJoin(Meshes=morph)
panel = Panel("CELL SHELL FILL")
facen = FaceNormals(Mesh=mjoin)  # -> Centers, Normals
demesh = DeconstructMesh(Mesh=mjoin)  # -> Vertices, Faces, Colours, Normals
cullpt = CullDuplicates(Points=facen.Centers, Tolerance=".001", CullMode=1)  # -> Points, Indices, Valence
item = ListItem(List=demesh.Faces, Index=cullpt.Indices, Wrap=True)
conmesh = ConstructMesh(Vertices=demesh.Vertices, Faces=item)
weld = WeldMesh(Mesh=conmesh, Angle=3.141592654)
lattice_shell = ClusterOutput(weld)  # Joined mesh that makes up the lattice

# ==== cluster CellMorphAttractor: Morph unit cells with attractor(s)

voxels = ClusterInput()  # Voxels to be filled with unit cells
attractor = ClusterInput()  # Any geometry to use as attractor(s)
influence = ClusterInput()  # Smoothed range of attractor influence (0-1)
magnitude_min = ClusterInput()  # Magnitude of the morph (minimum value)
magnitude_max = ClusterInput()  # Magnitude of the morph (maximum value)
brep = Brep(voxels)
geo = Geometry(attractor)
volume = Volume(Geometry=flatten(brep))  # -> Volume, Centroid
pull = PullPoint(Point=volume.Centroid, Geometry=geo, ClosestOnly=True)  # -> ClosestPoint, Distance
panel = Panel("CELL MORPH ATTRACTOR")
expression = Expression(x=influence, y=pull.Distance, Expression="-1*e^(-x*y)")
dom = ConstructDomain(DomainStart=magnitude_min, DomainEnd=magnitude_max)
bnd = Bounds(Numbers=expression)
remap = RemapNumbers(Value=expression, Source=bnd, Target=dom)  # -> Mapped, Clipped
value = ClusterOutput(remap.Mapped)  # Values (0-1) for cell morph

# ==== cluster CellMorphValue: Morph unit cells with a point cloud and corrosponding values

distance_influence = ClusterInput()  # If true the distance between the points and voxels will affect the magnitude
influence = ClusterInput()  # Smoothed range of attractor influence (0-1)
values = ClusterInput()  # Values that correspond to points (flattened)
points = ClusterInput()  # List of points (flattened)
voxels = ClusterInput()  # Voxels to be filled with unit cells
brep = Brep(voxels)
num = Number(values)
pt = Point(points)
area = Area(Geometry=flatten(brep))  # -> Area, Centroid
cp = ClosestPoint(Point=area.Centroid, Cloud=pt)  # -> ClosestPoint, CPIndex, Distance
item = ListItem(List=num, Index=cp.CPIndex, Wrap=True)
panel = Panel("CELL MORPH VALUE")
expression = Expression(x=influence, y=cp.Distance, Expression="-1*e^(-x*y)")
bnd = Bounds(Numbers=item)
remap = RemapNumbers(Value=item, Source=bnd, Target=Domain(0, 1))  # -> Mapped, Clipped
bnd_2 = Bounds(Numbers=expression)
not = GateNot(A=distance_influence)
remap_2 = RemapNumbers(Value=expression, Source=bnd_2, Target="1 to 0")  # -> Mapped, Clipped
cull = CullPattern(List=remap.Mapped, CullPattern=not)
multiplication = Multiplication(A=remap.Mapped, B=remap_2.Mapped)
cull_2 = CullPattern(List=multiplication, CullPattern=distance_influence)
num_2 = Number([cull_2, cull])
value = ClusterOutput(num_2)  # Values (0-1) for morph

# ==== cluster VoronoiFill: Fill a volume with randomized voronoi cells

geometry = ClusterInput()  # Geometry to fill
number_of_points = ClusterInput()  # The initial number of random points to fill the volume
use_attractor = ClusterInput()  # If true, points will be filtered by distance to attractor(s)
attractor = ClusterInput()  # Any geometry to use as attractor(s)
magnitude_of_random_filtering = ClusterInput()  # Magnitude of random filtering
number_of_filtered_points = ClusterInput()  # The number of points to filter
enable_voronoi = ClusterInput()  # If true, voronoi cells will be generated (can be very slow)
geo = Geometry(geometry)
geo_2 = Geometry(attractor)
mesh = Mesh(geo)
bbox = BoundingBox(Content=mesh, Plane=PlaneXY(0, 0, 0))  # -> Box, Box_2
pop3d = Populate3D(Region=bbox.Box, Count=number_of_points, Seed=1)
dom = ConstructDomain(DomainStart=expr("x*-1", magnitude_of_random_filtering), DomainEnd=magnitude_of_random_filtering)
pull = PullPoint(Point=pop3d, Geometry=geo_2, ClosestOnly=True)  # -> ClosestPoint, Distance
lng = ListLength(List=pop3d)
random = Random(Range=dom, Number=lng, Seed=2)
addition = Addition(A=random, B=pull.Distance)
sort = SortList(Keys=addition, ValuesA=pop3d)  # -> Keys, ValuesA
not = GateNot(A=use_attractor)
panel = Panel("VORONOI FILL")
subset = SubList(List=sort.ValuesA, Domain=number_of_filtered_points, Wrap=True)  # -> List, Index
cull = CullPattern(List=pop3d, CullPattern=not)
cull_2 = CullPattern(List=subset.List, CullPattern=use_attractor)
pt = Point(flatten([cull_2, cull]))
minc = MeshInclusion(Mesh=mesh, Point=flatten(pt), Strict=False)
cull_3 = CullPattern(List=flatten(pt), CullPattern=minc)
cull_4 = CullPattern(List=cull_3, CullPattern=enable_voronoi)
voronoi³ = Voronoi3D(Points=flatten(cull_4), Box=bbox.Box)  # -> Cells, Boundary
edges = BrepEdges(Brep=voronoi³.Cells)  # -> Naked, Interior, NonManifold
mmx = MeshMesh(MeshA=mesh, MeshB=voronoi³.Cells, UseMeshMeshFast=True)
explode = Explode(Curve=flatten(mmx), Recursive=True)  # -> Segments, flatten(Vertices)
remove_duplicate_lines = RemoveDuplicateLines(lattice_l=flatten(edges.Interior))
remove_duplicate_lines_2 = RemoveDuplicateLines(lattice_l=flatten(explode.Segments))
preview_points = ClusterOutput(cull_3)  # Preview of points that will create the voronoi lattice
voronoi_lattice_skin = ClusterOutput(remove_duplicate_lines_2)  # List of curves that make up the lattice skin
voronoi_lattice = ClusterOutput(remove_duplicate_lines)  # List of curves that make up the lattice

# ==== cluster TrimLattice: Trim lattice with a closed volume

geometry = ClusterInput()  # Geometry to trim with (closed brep or mesh)
lattice = ClusterInput()  # Lattice curves to trim
geo = Geometry(geometry)
crv = Curve(lattice)
mesh = Mesh(geo)
mcx = MeshCurve(Mesh=mesh, Curve=crv)  # -> Points, Faces
null = NullItem(Item=mcx.Points)  # -> NullFlags, InvalidFlags, Description
crv_cp = CurveClosestPoint(Point=mcx.Points, Curve=graft(crv))  # -> Point, Parameter, Distance
panel = Panel("TRIM LATTICE")
cull = CullPattern(List=graft(crv), CullPattern=null.NullFlags)
shatter = Shatter(Curve=graft(crv), Parameters=crv_cp.Parameter)
curvepoint = PointOnCurve(cull, parameter=0.5)
curvepoint_2 = PointOnCurve(shatter, parameter=0.5)
minc = MeshInclusion(Mesh=mesh, Point=curvepoint, Strict=False)
minc_2 = MeshInclusion(Mesh=mesh, Point=curvepoint_2, Strict=False)
cull_2 = CullPattern(List=shatter, CullPattern=minc_2)
cull_3 = CullPattern(List=cull, CullPattern=minc)
crv_2 = Curve(flatten(cull_2))
crv_3 = Curve(flatten(cull_3))
unrimmed_lattice = ClusterOutput(crv_3)  # Lattice curves that have not been trimmed (Typically removes curves with valence 1)
trimmed_lattice = ClusterOutput(crv_2)  # Lattice curves that have been trimmed

# ==== cluster RemoveShort: Remove curves by length

lattice = ClusterInput()  # Lattice curves to filter
length = ClusterInput()  # Minimum lenth of lattice curves
crv = Curve(lattice)
len = Length(Curve=crv)
panel = Panel("REMOVE SHORT LINES")
larger = LargerThan(FirstNumber=len, SecondNumber=length)  # -> LargerThan, OrEqualTo
cull = CullPattern(List=crv, CullPattern=larger.LargerThan)
lattice_2 = ClusterOutput(cull)  # Filtered lattice

# ==== cluster RemoveByValence: Remove curves by number of connections

lattice = ClusterInput()  # Lattice curves to filter
valence_number = ClusterInput()  # The number of connections each curve has
crv = Curve(lattice)
cp = ControlPoints(Curve=crv)  # -> Points, Weights, Knots
cps = ClosestPoints(Point=cp.Points, Cloud=flatten(cp.Points), Count=expr("x+1", valence_number))  # -> ClosestPoint, CPIndex, simplify(Distance)
panel = Panel("REMOVE BY VALENCE")
trim = TrimTree(Tree=cps.Distance, Depth=1)
ma = MassAddition(Input=trim)  # -> Result, PartialResults
smaller = SmallerThan(FirstNumber=ma.Result, SecondNumber="0")  # -> SmallerThan, OrEqualTo
cull = CullPattern(List=graft(crv), CullPattern=smaller.OrEqualTo)  # -> flatten(List)
lattice_2 = ClusterOutput(cull)  # Filtered lattice

# ==== cluster TrimShell: Trim shell lattice with a closed volume

lattice_shell = ClusterInput()  # Lattice shell to trim
geometry = ClusterInput()  # Geometry to trim with (closed brep or mesh)
geo = Geometry(geometry)
mjoin = MeshJoin(Meshes=flatten(lattice_shell))
mesh = Mesh(geo)
weld = WeldMesh(Mesh=mjoin, Angle=3.141592654)
panel = Panel("TRIM SHELL")
demesh = DeconstructMesh(Mesh=weld)  # -> Vertices, Faces, Colours, Normals
minc = MeshInclusion(Mesh=mesh, Point=demesh.Vertices, Strict=False)
not = GateNot(A=minc)
cullv = CullVertices(Mesh=weld, Pattern=not, Shrink=True)
trimmed_lattice_shell = ClusterOutput(cullv)  # Trimmed lattice shell

# ==== cluster LatticeConnections: Create connections between two lattices

lattice_b = ClusterInput()  # Second lattice to make connections between
lattice_a = ClusterInput()  # First lattice to make connections between
number_of_connections = ClusterInput()  # Number of Connections
max_distance = ClusterInput()  # Maximum distance between connections
crv = Curve(lattice_a)
crv_2 = Curve(lattice_b)
cp = ControlPoints(Curve=crv)  # -> Points, Weights, Knots
cp_2 = ControlPoints(Curve=crv_2)  # -> Points, Weights, Knots
cullpt = CullDuplicates(Points=flatten(cp.Points), Tolerance=0.1, CullMode=1)  # -> Points, Indices, Valence
cullpt_2 = CullDuplicates(Points=flatten(cp_2.Points), Tolerance=0.1, CullMode=1)  # -> Points, Indices, Valence
panel = Panel("LATTICE CONNECTIONS")
cps = ClosestPoints(Point=cullpt.Points, Cloud=cullpt_2.Points, Count=number_of_connections)  # -> ClosestPoint, CPIndex, Distance
smaller = SmallerThan(FirstNumber=cps.Distance, SecondNumber=max_distance)  # -> SmallerThan, OrEqualTo
cull = CullPattern(List=cps.ClosestPoint, CullPattern=smaller.SmallerThan)
ln = Line(StartPoint=graft(cullpt.Points), EndPoint=cull)
lattice = ClusterOutput(ln)  # Lattice connections

# ==== cluster MorphLatticeToSkin: Morph lattice to connect to skin

geometry = ClusterInput()  # Geometry to morph to
lattice = ClusterInput()  # Lattice to morph to skin
geometry_2 = ClusterInput()  # Geometry to morph to
max_distance = ClusterInput()  # Maximum distance from geometry
max_distance_2 = ClusterInput()  # Maximum distance to moprh
geo = Geometry(geometry_2)
crv = Curve(lattice)
geo_2 = Geometry(geometry)
cp = ControlPoints(Curve=crv)  # -> simplify(Points), Weights, Knots
pull = PullPoint(Point=cp.Points, Geometry=geo_2, ClosestOnly=True)  # -> ClosestPoint, Distance
smaller = SmallerThan(FirstNumber=pull.Distance, SecondNumber=max_distance)  # -> SmallerThan, OrEqualTo
not = GateNot(A=smaller.SmallerThan)
cull = CullPattern(List=cp.Points, CullPattern=smaller.SmallerThan)
cull_2 = CullPattern(List=cp.Points, CullPattern=not)  # -> simplify(List)
pull_2 = PullPoint(Point=cull, Geometry=geo, ClosestOnly=True)  # -> simplify(ClosestPoint), simplify(Distance)
smaller_2 = SmallerThan(FirstNumber=pull_2.Distance, SecondNumber=max_distance_2)  # -> SmallerThan, OrEqualTo
not_2 = GateNot(A=smaller_2.SmallerThan)
panel = Panel("MORPH TO SKIN")
cull_3 = CullPattern(List=pull_2.ClosestPoint, CullPattern=smaller_2.SmallerThan)  # -> simplify(List)
cull_4 = CullPattern(List=cull, CullPattern=not_2)  # -> simplify(List)
merge = Merge(Data1=cull_2, Data2=cull_4, Data3=cull_3)
item = ListItem(List=merge, Index=0, Wrap=True)  # -> Item1, Item, Item1_2
ln = Line(StartPoint=item.Item1, EndPoint=item.Item)
remove_duplicate_lines = RemoveDuplicateLines(lattice_l=flatten(ln))
len = Length(Curve=remove_duplicate_lines)
larger = LargerThan(FirstNumber=len, SecondNumber=0)  # -> LargerThan, OrEqualTo
cull_5 = CullPattern(List=remove_duplicate_lines, CullPattern=larger.LargerThan)
crv_2 = Curve(cull_5)
lattice_2 = ClusterOutput(crv_2)  # Morphed lattice

# ==== cluster MorphShellToSkin: Morph shell lattice to connect to skin

# ----
# MORPH SHELL TO SKIN
lattice_shell = ClusterInput()  # Lattice shell to moprh
geometry = ClusterInput()  # Geometry to morph to
max_distance = ClusterInput()  # Maximum distance from geometry
mesh = Mesh(lattice_shell)
geo = Geometry(geometry)
mesh_2 = Mesh(geo)
demesh = DeconstructMesh(Mesh=mesh)  # -> Vertices, Faces, Colours, Normals
pull = PullPoint(Point=demesh.Vertices, Geometry=mesh_2, ClosestOnly=True)  # -> ClosestPoint, Distance
lng = ListLength(List=demesh.Vertices)
smaller = SmallerThan(FirstNumber=pull.Distance, SecondNumber=max_distance)  # -> SmallerThan, OrEqualTo
series = Series(Start=0, Step=1, Count=lng)
cull = CullPattern(List=pull.ClosestPoint, CullPattern=smaller.SmallerThan)
cull_2 = CullPattern(List=series, CullPattern=smaller.SmallerThan)
replace = ReplaceItems(List=demesh.Vertices, Item=cull, Indices=cull_2, Wrap=False)
conmesh = ConstructMesh(Vertices=replace, Faces=demesh.Faces)
trimmed_lattice_shell = ClusterOutput(conmesh)  # Trimmed lattice shell

# ==== cluster LatticeThicknessAttractor: Apply thickness values to lattice curves with attractor(s)

lattice = ClusterInput()  # Lattice to thicken
attractor = ClusterInput()  # Any geometry to use as attractor(s)
influence = ClusterInput()  # Smoothed range of attractor influence (0-1)
magnitude_min = ClusterInput()  # Lattice beam thickness (minimum value)
magnitude_max = ClusterInput()  # Lattice beam thickness (maximum value)
crv = Curve(lattice)
geo = Geometry(attractor)
curvepoint = PointOnCurve(crv, parameter=0.5)
pull = PullPoint(Point=curvepoint, Geometry=geo, ClosestOnly=True)  # -> ClosestPoint, Distance
panel = Panel("THICKNESS ATTRACTOR")
expression = Expression(x=influence, y=pull.Distance, Expression="-1*e^(-x*y)")
dom = ConstructDomain(DomainStart=magnitude_min, DomainEnd=magnitude_max)
bnd = Bounds(Numbers=expression)
dedomain = DeconstructDomain(Domain=bnd)  # -> Start, End
dom_2 = ConstructDomain(DomainStart=dedomain.End, DomainEnd=dedomain.Start)
remap = RemapNumbers(Value=expression, Source=dom_2, Target=dom)  # -> Mapped, Clipped
value = ClusterOutput(remap.Mapped)  # Values for beam thickness

# ==== cluster LatticeThicknessValue: Apply thickness values to lattice curves with a point cloud and corrosponding values

lattice = ClusterInput()  # Lattice to thicken
points = ClusterInput()  # List of points (flattened)
values = ClusterInput()  # Values that correspond to points (flattened)
distance_influence = ClusterInput()  # If true the distance between the points and voxels will affect the magnitude
influence = ClusterInput()  # Smoothed range of attractor influence (0-1)
magnitude_min = ClusterInput()  # Lattice beam thickness (minimum value)
magnitude_max = ClusterInput()  # Lattice beam thickness (maximum value)
crv = Curve(lattice)
curvepoint = PointOnCurve(crv, parameter=0.5)
num = Number(values)
pt = Point(points)
cp = ClosestPoint(Point=curvepoint, Cloud=pt)  # -> ClosestPoint, CPIndex, Distance
dom = ConstructDomain(DomainStart=magnitude_min, DomainEnd=magnitude_max)
item = ListItem(List=num, Index=cp.CPIndex, Wrap=True)
panel = Panel("THICKNESS VALUE")
expression = Expression(x=influence, y=cp.Distance, Expression="-1*e^(-x*y)")
bnd = Bounds(Numbers=item)
remap = RemapNumbers(Value=item, Source=bnd, Target=dom)  # -> Mapped, Clipped
not = GateNot(A=distance_influence)
bnd_2 = Bounds(Numbers=expression)
remap_2 = RemapNumbers(Value=expression, Source=bnd_2, Target="1 to 0")  # -> Mapped, Clipped
cull = CullPattern(List=remap.Mapped, CullPattern=not)
multiplication = Multiplication(A=remap.Mapped, B=remap_2.Mapped)
cull_2 = CullPattern(List=multiplication, CullPattern=distance_influence)
bnd_3 = Bounds(Numbers=cull_2)
remap_3 = RemapNumbers(Value=cull_2, Source=bnd_3, Target=dom)  # -> Mapped, Clipped
num_2 = Number([remap_3.Mapped, cull])
value = ClusterOutput(num_2)  # Values for beam thickness

# ==== cluster ShellThicknessValue: Apply thickness values to shell vertices with a point cloud and corrosponding values

lattice_shell = ClusterInput()  # Lattice shell to thicken
points = ClusterInput()  # List of points (flattened)
values = ClusterInput()  # Values that correspond to points (flattened)
distance_influence = ClusterInput()  # If true the distance between the points and voxels will affect the magnitude
influence = ClusterInput()  # Smoothed range of attractor influence (0-1)
magnitude_min = ClusterInput()  # Lattice shell thickness (minimum value)
magnitude_max = ClusterInput()  # Lattice shell thickness (maximum value)
mesh = Mesh(lattice_shell)
num = Number(values)
pt = Point(points)
demesh = DeconstructMesh(Mesh=mesh)  # -> Vertices, Faces, Colours, Normals
cp = ClosestPoint(Point=demesh.Vertices, Cloud=pt)  # -> ClosestPoint, CPIndex, Distance
item = ListItem(List=num, Index=cp.CPIndex, Wrap=True)
expression = Expression(x=influence, y=cp.Distance, Expression="-1*e^(-x*y)")
dom = ConstructDomain(DomainStart=magnitude_min, DomainEnd=magnitude_max)
bnd = Bounds(Numbers=item)
panel = Panel("SHELL THICKNESS VALUE")
remap = RemapNumbers(Value=item, Source=bnd, Target=dom)  # -> Mapped, Clipped
bnd_2 = Bounds(Numbers=expression)
not = GateNot(A=distance_influence)
remap_2 = RemapNumbers(Value=expression, Source=bnd_2, Target="1 to 0")  # -> Mapped, Clipped
multiplication = Multiplication(A=remap.Mapped, B=remap_2.Mapped)
cull = CullPattern(List=remap.Mapped, CullPattern=not)
cull_2 = CullPattern(List=multiplication, CullPattern=distance_influence)
bnd_3 = Bounds(Numbers=cull_2)
remap_3 = RemapNumbers(Value=cull_2, Source=bnd_3, Target=dom)  # -> Mapped, Clipped
num_2 = Number([remap_3.Mapped, cull])
value = ClusterOutput(num_2)  # Values for shell thickness (mesh vertices)

# ==== cluster ShellThicknessAttractor: Apply thickness values to shell vertices with attractor(s)

lattice_shell = ClusterInput()  # Lattice shell to thicken
attractor = ClusterInput()  # Any geometry to use as attractor(s)
influence = ClusterInput()  # Smoothed range of attractor influence (0-1)
magnitude_min = ClusterInput()  # Lattice shell thickness (minimum value)
magnitude_max = ClusterInput()  # Lattice shell thickness (maximum value)
mesh = Mesh(lattice_shell)
geo = Geometry(attractor)
demesh = DeconstructMesh(Mesh=mesh)  # -> Vertices, Faces, Colours, Normals
pull = PullPoint(Point=demesh.Vertices, Geometry=geo, ClosestOnly=True)  # -> ClosestPoint, Distance
panel = Panel("SHELL THICKNESS ATTRACTOR")
expression = Expression(x=influence, y=pull.Distance, Expression="-1*e^(-x*y)")
dom = ConstructDomain(DomainStart=magnitude_min, DomainEnd=magnitude_max)
bnd = Bounds(Numbers=expression)
dedomain = DeconstructDomain(Domain=bnd)  # -> Start, End
dom_2 = ConstructDomain(DomainStart=dedomain.End, DomainEnd=dedomain.Start)
remap = RemapNumbers(Value=expression, Source=dom_2, Target=dom)  # -> Mapped, Clipped
value = ClusterOutput(remap.Mapped)  # Values for shell thickness (mesh vertices)

# ==== cluster MeshOffset: Offset mesh triangles into voxels

distance = ClusterInput()  # Offset distance
mesh = ClusterInput()  # Mesh to offset
mesh_2 = Mesh(mesh)
weld = WeldMesh(Mesh=mesh_2, Angle=3.141592654)
demesh = DeconstructMesh(Mesh=weld)  # -> Vertices, Faces, Colours, Normals
deface = DeconstructFace(Face=demesh.Faces)  # -> CornerA, CornerB, CornerC, CornerD
item = ListItem(List=demesh.Vertices, Index=deface.CornerB, Wrap=True)
item_2 = ListItem(List=demesh.Vertices, Index=deface.CornerC, Wrap=True)
panel = Panel("0")
item_3 = ListItem(List=demesh.Vertices, Index=deface.CornerA, Wrap=True)
panel_2 = Panel("1")
panel_3 = Panel("2")
addition = Addition(A=item_3, B=item)
addition_2 = Addition(A=item_3, B=item_2)
addition_3 = Addition(A=item, B=item_2)
bcentric = Barycentric(PointA=item_3, PointB=item, PointC=item_2, CoordinateU=1, CoordinateV=1, CoordinateW=1)
panel_4 = Panel("A")
panel_5 = Panel("B")
panel_6 = Panel("C")
division = Division(A=addition, B="2")
division_2 = Division(A=addition_3, B="2")
division_3 = Division(A=addition_2, B="2")
panel_7 = Panel("Z")
entwine = Entwine(Branch00=item_3, Branch01=division, Branch02=bcentric, Branch03=division_3, FlattenInputs=True)
entwine_2 = Entwine(Branch00=item, Branch01=division_2, Branch02=bcentric, Branch03=division, FlattenInputs=True)
entwine_3 = Entwine(Branch00=item_2, Branch01=division_3, Branch02=bcentric, Branch03=division_2, FlattenInputs=True)
flip = FlipMatrix(Data=entwine)
flip_2 = FlipMatrix(Data=entwine_3)
flip_3 = FlipMatrix(Data=entwine_2)
quad = MeshQuad(CornerA=0, CornerB=1, CornerC=2, CornerD=3)
quad_2 = MeshQuad(CornerA=0, CornerB=1, CornerC=2, CornerD=3)
quad_3 = MeshQuad(CornerA=0, CornerB=1, CornerC=2, CornerD=3)
panel_8 = Panel("MESH OFFSET")
conmesh = ConstructMesh(Vertices=flip_2, Faces=quad)
conmesh_2 = ConstructMesh(Vertices=flip_3, Faces=quad_2)
conmesh_3 = ConstructMesh(Vertices=flip, Faces=quad_3)
mjoin = MeshJoin(Meshes=flatten([conmesh_3, conmesh_2, conmesh]))
demesh_2 = DeconstructMesh(Mesh=mjoin)  # -> Vertices, Faces, Colours, Normals
meshcp = MeshClosestPoint(Point=demesh_2.Vertices, Mesh=weld)  # -> Point, Index, Parameter
meval = MeshEval(Mesh=weld, Parameter=meshcp.Parameter)  # -> Point, Normal, Colour
amp = Amplitude(Vector=meval.Normal, Amplitude=distance)
move = Move(Geometry=demesh_2.Vertices, Motion=amp)  # -> Geometry, Transform
conmesh_4 = ConstructMesh(Vertices=move.Geometry, Faces=demesh_2.Faces)
demesh_3 = DeconstructMesh(Mesh=mjoin)  # -> Vertices, Faces, Colours, Normals
demesh_4 = DeconstructMesh(Mesh=conmesh_4)  # -> Vertices, Faces, Colours, Normals
deface_2 = DeconstructFace(Face=demesh_3.Faces)  # -> CornerA, CornerB, CornerC, CornerD
deface_3 = DeconstructFace(Face=demesh_4.Faces)  # -> CornerA, CornerB, CornerC, CornerD
item_4 = ListItem(List=demesh_4.Vertices, Index=deface_3.CornerA, Wrap=True)
item_5 = ListItem(List=demesh_4.Vertices, Index=deface_3.CornerB, Wrap=True)
item_6 = ListItem(List=demesh_4.Vertices, Index=deface_3.CornerC, Wrap=True)
item_7 = ListItem(List=demesh_4.Vertices, Index=deface_3.CornerD, Wrap=True)
item_8 = ListItem(List=demesh_3.Vertices, Index=deface_2.CornerA, Wrap=True)
item_9 = ListItem(List=demesh_3.Vertices, Index=deface_2.CornerB, Wrap=True)
item_10 = ListItem(List=demesh_3.Vertices, Index=deface_2.CornerC, Wrap=True)
item_11 = ListItem(List=demesh_3.Vertices, Index=deface_2.CornerD, Wrap=True)
tbox = TwistedBox(
    CornerA=item_4,
    CornerB=item_5,
    CornerC=item_6,
    CornerD=item_7,
    CornerE=item_8,
    CornerF=item_9,
    CornerG=item_10,
    CornerH=item_11)
mesh_3 = Mesh(mjoin)
mesh_4 = Mesh(conmesh_4)
quad_mesh = ClusterOutput(mesh_4)  # Quad mesh generated from the input mesh
offset_quad_mesh = ClusterOutput(mesh_3)  # Offset quad mesh generated from the input mesh
voxels = ClusterOutput(tbox)  # Voxels to be filled with unit cells

# ==== cluster VoxelMorphValue: Morph voxels with a point cloud and corrosponding values

voxels = ClusterInput()  # Voxels to be filled with unit cells
points = ClusterInput()  # List of points (flattened)
values = ClusterInput()  # Values that correspond to points (flattened)
distance_influence = ClusterInput()  # If true the distance between the points and voxels will affect the magnitude
influence = ClusterInput()  # Smoothed range of attractor influence (0-1)
magnitude_min = ClusterInput()  # Magnitude of the morph (minimum value)
magnitude_max = ClusterInput()  # Magnitude of the morph (maximum value)
tbox = TwistedBox(voxels)
pt = Point(points)
num = Number(values)
debrep = DeconstructBrep(Brep=tbox)  # -> Faces, Edges, Vertices
cp = ClosestPoint(Point=debrep.Vertices, Cloud=pt)  # -> ClosestPoint, CPIndex, Distance
dom = ConstructDomain(DomainStart=magnitude_min, DomainEnd=magnitude_max)
remap = RemapNumbers(Value=num, Source=Domain(0, 1), Target=dom)  # -> Mapped, Clipped
expression = Expression(x=influence, y=cp.Distance, Expression="-1*e^(-x*y)")
item = ListItem(List=remap.Mapped, Index=cp.CPIndex, Wrap=True)
panel = Panel("VOXEL MORPH VALUE")
bnd = Bounds(Numbers=flatten(expression))
ln = Line(StartPoint=debrep.Vertices, EndPoint=cp.ClosestPoint)
remap_2 = RemapNumbers(Value=expression, Source=bnd, Target="1 to 0")  # -> Mapped, Clipped
not = GateNot(A=distance_influence)
multiplication = Multiplication(A=item, B=remap_2.Mapped)
cull = CullPattern(List=multiplication, CullPattern=distance_influence)
cull_2 = CullPattern(List=item, CullPattern=not)
amp = Amplitude(Vector=ln, Amplitude=[cull, cull_2])
move = Move(Geometry=debrep.Vertices, Motion=amp)  # -> Geometry, Transform
item_2 = ListItem(List=move.Geometry, Index="0", Wrap=True)
item_3 = ListItem(List=move.Geometry, Index="1", Wrap=True)
item_4 = ListItem(List=move.Geometry, Index="2", Wrap=True)
item_5 = ListItem(List=move.Geometry, Index="3", Wrap=True)
item_6 = ListItem(List=move.Geometry, Index="4", Wrap=True)
item_7 = ListItem(List=move.Geometry, Index="6", Wrap=True)
item_8 = ListItem(List=move.Geometry, Index="5", Wrap=True)
item_9 = ListItem(List=move.Geometry, Index="7", Wrap=True)
tbox_2 = TwistedBox(
    CornerA=item_2,
    CornerB=item_3,
    CornerC=item_4,
    CornerD=item_5,
    CornerE=item_8,
    CornerF=item_6,
    CornerG=item_9,
    CornerH=item_7)
voxels_2 = ClusterOutput(tbox_2)  # Voxels to be filled with unit cells

# ==== cluster VoxelMorphAttractor: Morph voxels with attractor(s)

voxels = ClusterInput()  # Voxels to be filled with unit cells
attractor = ClusterInput()  # Any geometry to use as attractor(s)
influence = ClusterInput()  # Smoothed range of attractor influence (0-1)
tbox = TwistedBox(voxels)
magnitude = ClusterInput()  # Magnitude of the morph
geo = Geometry(attractor)
debrep = DeconstructBrep(Brep=tbox)  # -> Faces, Edges, Vertices
pull = PullPoint(Point=debrep.Vertices, Geometry=geo, ClosestOnly=True)  # -> ClosestPoint, Distance
bnd = Bounds(Numbers=flatten(pull.Distance))
panel = Panel("VOXEL MORPH ATTRACTOR")
expression = Expression(x=influence, y=pull.Distance, Expression="-1*e^(-x*y)")
dedomain = DeconstructDomain(Domain=bnd)  # -> Start, End
subtraction = Subtraction(A=dedomain.Start, B=magnitude)
bnd_2 = Bounds(Numbers=flatten(expression))
dom = ConstructDomain(DomainStart=subtraction, DomainEnd="0")
ln = Line(StartPoint=debrep.Vertices, EndPoint=pull.ClosestPoint)
remap = RemapNumbers(Value=expression, Source=bnd_2, Target=dom)  # -> Mapped, Clipped
amp = Amplitude(Vector=ln, Amplitude=remap.Mapped)
move = Move(Geometry=debrep.Vertices, Motion=amp)  # -> Geometry, Transform
item = ListItem(List=move.Geometry, Index="0", Wrap=True)
item_2 = ListItem(List=move.Geometry, Index="1", Wrap=True)
item_3 = ListItem(List=move.Geometry, Index="2", Wrap=True)
item_4 = ListItem(List=move.Geometry, Index="3", Wrap=True)
item_5 = ListItem(List=move.Geometry, Index="4", Wrap=True)
item_6 = ListItem(List=move.Geometry, Index="6", Wrap=True)
item_7 = ListItem(List=move.Geometry, Index="5", Wrap=True)
item_8 = ListItem(List=move.Geometry, Index="7", Wrap=True)
tbox_2 = TwistedBox(
    CornerA=item,
    CornerB=item_2,
    CornerC=item_3,
    CornerD=item_4,
    CornerE=item_7,
    CornerF=item_5,
    CornerG=item_8,
    CornerH=item_6)
voxels_2 = ClusterOutput(tbox_2)  # Voxels to be filled with unit cells

# ==== cluster Voxelize: Fill a volume with uniform sized voxels

geometry = ClusterInput()  # Geometry to voxelize
voxel_size_x = ClusterInput()  # Voxel size int the X direction
voxel_size_y = ClusterInput()  # Voxel size int the Y direction
voxel_size_z = ClusterInput()  # Voxel size int the Z direction
fill_completely = ClusterInput()  # If true, Voxels will fill entire volume. If false, only Voxels with their centroid within the volume will be kept.
geo = Geometry(geometry)
num = Number(voxel_size_x)
num_2 = Number(voxel_size_y)
num_3 = Number(voxel_size_z)
bbox = BoundingBox(Content=geo, Plane=PlaneXY(0, 0, 0))  # -> Box, Box_2
boxprop = BoxProperties(Box=bbox.Box)  # -> Center, Diagonal, Area, Volume, Degeneracy
one_over_x = OneOverX(Value=num_2)
one_over_x_2 = OneOverX(Value=num)
one_over_x_3 = OneOverX(Value=num_3)
devec = DeconstructVector(Vector=boxprop.Center)  # -> XComponent, YComponent, ZComponent
multiplication = Multiplication(A=boxprop.Diagonal, B=one_over_x)
multiplication_2 = Multiplication(A=boxprop.Diagonal, B=one_over_x_2)
multiplication_3 = Multiplication(A=boxprop.Diagonal, B=one_over_x_3)
devec_2 = DeconstructVector(Vector=multiplication)  # -> XComponent, YComponent, ZComponent
devec_3 = DeconstructVector(Vector=multiplication_2)  # -> XComponent, YComponent, ZComponent
devec_4 = DeconstructVector(Vector=multiplication_3)  # -> XComponent, YComponent, ZComponent
expression = Expression(z=devec_4.ZComponent, Expression="ceiling(z)")
expression_2 = Expression(x=devec_3.XComponent, Expression="ceiling(x)")
expression_3 = Expression(y=devec_2.YComponent, Expression="ceiling(y)")
expression_4 = Expression(x=expression_2, u=num, a=devec.XComponent, Expression="-u*x/2+a")
expression_5 = Expression(y=expression_3, u=num_2, b=devec.YComponent, Expression="-u*y/2+b")
expression_6 = Expression(y=expression, u=num_3, b=devec.ZComponent, Expression="-u*y/2+b")
expression_7 = Expression(x=expression_2, Expression="x+1")
expression_8 = Expression(z=expression, Expression="z+1")
expression_9 = Expression(y=expression_3, Expression="y+1")
series = Series(Start=expression_4, Step=num, Count=expression_7)
series_2 = Series(Start=expression_6, Step=num_3, Count=expression_8)
series_3 = Series(Start=expression_5, Step=num_2, Count=expression_9)
panel = Panel("VOXELIZE")
crossref = CrossReference(ListA=series, ListB=series_3, ListC=series_2, CrossMode=1)  # -> ListA, ListB, ListC
sort = SortList(Keys=[num, num_2, num_3])  # -> Keys, ValuesA
rev = ReverseList(List=sort.Keys)
pt = ConstructPoint(XCoordinate=crossref.ListA, YCoordinate=crossref.ListB, ZCoordinate=crossref.ListC)
item = ListItem(List=rev, Index=0, Wrap=True)
minc = MeshInclusion(Mesh=geo, Point=pt, Strict=False)
meshcp = MeshClosestPoint(Point=pt, Mesh=geo)  # -> Point, Index, Parameter
dist = Distance(PointA=pt, PointB=meshcp.Point)
expression_10 = Expression(a=item, d=dist, Expression="if(d<sqrt(2*(a/2)^2),True,False)")
cull = CullPattern(List=pt, CullPattern=minc)
cull_2 = CullPattern(List=pt, CullPattern=expression_10)
cull_3 = CullPattern(List=cull_2, CullPattern=fill_completely)
merge = Merge(Data1=cull, Data2=cull_3)
expression_11 = Expression(x=num_2, Expression="x/2")
expression_12 = Expression(x=num, Expression="x/2")
expression_13 = Expression(x=num_3, Expression="x/2")
cullpt = CullDuplicates(Points=merge, Tolerance=".001", CullMode=3)  # -> Points, Indices, Valence
box = CenterBox(Base=cullpt.Points, X=expression_12, Y=expression_11, Z=expression_13)
voxels = ClusterOutput(box)  # Voxels to be filled with unit cells

# ==== cluster RemoveFloating: Remove disconnected curves

lattice = ClusterInput()  # Lattice curves to filter
crv = Curve(flatten(lattice))
join = JoinCurves(Curves=crv, Preserve=False)
line = Line(join)
panel = Panel("REMOVE FLOATING CURVES")
null = NullItem(Item=line)  # -> NullFlags, InvalidFlags, Description
cull = CullPattern(List=join, CullPattern=null.NullFlags)
explode = Explode(Curve=cull, Recursive=True)  # -> flatten(Segments), Vertices
lattice_2 = ClusterOutput(explode.Segments)  # Filtered lattice

# ==== cluster MorphBetweenSurfaces: Conformal fill of voxels between two or more surfaces

surfaces = ClusterInput()  # At least 2 surfaces to morph voxels between
voxel_number_x = ClusterInput()  # Number of Voxels in the X direction
voxel_number_y = ClusterInput()  # Number of Voxels in the Y direction
voxel_number_z = ClusterInput()  # Number of Voxels in the Z direction
srf = Surface(flatten(surfaces))
num = Number(voxel_number_z)
num_2 = Number(voxel_number_x)
num_3 = Number(voxel_number_y)
sdivide = DivideSurface(Surface=srf, UCount="30", VCount="30")  # -> simplify(Points), Normals, Parameters
pshift = ShiftPaths(Data=sdivide.Points, Offset="-1")
panel = Panel("MORPH BETWEEN SURFACES")
flip = FlipMatrix(Data=pshift)
dom = ConstructDomain(DomainStart=0, DomainEnd=1)
pline = PolyLine(Vertices=flip, Closed=False)
range = Range(Domain=dom, Steps=num)
eval = EvaluateCurve(Curve=reparameterize(pline), Parameter=range)  # -> Point, Tangent, Angle
flip_2 = FlipMatrix(Data=eval.Point)
addition = Addition(A="30", B="1")
srfgrid = SurfaceFromPoints(Points=flip_2, UCount=graft(addition), Interpolate=False)  # -> flatten(Surface)
toggle = BooleanToggle(False)
shift = ShiftList(List=srfgrid, Shift="1", Wrap=toggle)
shift_2 = ShiftList(List=srfgrid, Shift="-1", Wrap=toggle)
divide = DivideDomain²(Domain=shift, UCount=num_2, VCount=num_3)
divide_2 = DivideDomain²(Domain=shift_2, UCount=num_2, VCount=num_3)
blendbox = BlendBox(SurfaceA=graft(shift), DomainA=divide, SurfaceB=graft(shift_2), DomainB=divide_2)  # -> flatten(TwistedBox)
voxels = ClusterOutput(blendbox)  # Voxels to be filled with unit cells

# ==== cluster MeshOffsetValue: Offset mesh triangles into voxels with a point cloud and corrosponding values

magnitude_max = ClusterInput()  # Magnitude of the offset (maximum value)
influence = ClusterInput()  # Smoothed range of attractor influence (0-1)
values = ClusterInput()  # Values that correspond to points (flattened)
magnitude_min = ClusterInput()  # Magnitude of the offset (minimum value)
distance_influence = ClusterInput()  # If true the distance between the points and voxels will affect the magnitude
points = ClusterInput()  # List of points (flattened)
mesh = ClusterInput()  # Mesh to offset
mesh_2 = Mesh(mesh)
weld = WeldMesh(Mesh=mesh_2, Angle=3.141592654)
demesh = DeconstructMesh(Mesh=weld)  # -> Vertices, Faces, Colours, Normals
deface = DeconstructFace(Face=demesh.Faces)  # -> CornerA, CornerB, CornerC, CornerD
item = ListItem(List=demesh.Vertices, Index=deface.CornerB, Wrap=True)
item_2 = ListItem(List=demesh.Vertices, Index=deface.CornerC, Wrap=True)
panel = Panel("0")
item_3 = ListItem(List=demesh.Vertices, Index=deface.CornerA, Wrap=True)
panel_2 = Panel("1")
panel_3 = Panel("2")
addition = Addition(A=item_3, B=item)
addition_2 = Addition(A=item_3, B=item_2)
addition_3 = Addition(A=item, B=item_2)
bcentric = Barycentric(PointA=item_3, PointB=item, PointC=item_2, CoordinateU=1, CoordinateV=1, CoordinateW=1)
panel_4 = Panel("A")
panel_5 = Panel("B")
panel_6 = Panel("C")
division = Division(A=addition, B="2")
division_2 = Division(A=addition_3, B="2")
division_3 = Division(A=addition_2, B="2")
panel_7 = Panel("Z")
entwine = Entwine(Branch00=item_3, Branch01=division, Branch02=bcentric, Branch03=division_3, FlattenInputs=True)
entwine_2 = Entwine(Branch00=item, Branch01=division_2, Branch02=bcentric, Branch03=division, FlattenInputs=True)
entwine_3 = Entwine(Branch00=item_2, Branch01=division_3, Branch02=bcentric, Branch03=division_2, FlattenInputs=True)
flip = FlipMatrix(Data=entwine)
flip_2 = FlipMatrix(Data=entwine_3)
flip_3 = FlipMatrix(Data=entwine_2)
quad = MeshQuad(CornerA=0, CornerB=1, CornerC=2, CornerD=3)
quad_2 = MeshQuad(CornerA=0, CornerB=1, CornerC=2, CornerD=3)
quad_3 = MeshQuad(CornerA=0, CornerB=1, CornerC=2, CornerD=3)
panel_8 = Panel("MESH OFFSET VALUE")
conmesh = ConstructMesh(Vertices=flip_2, Faces=quad)
pt = Point(points)
conmesh_2 = ConstructMesh(Vertices=flip_3, Faces=quad_2)
conmesh_3 = ConstructMesh(Vertices=flip, Faces=quad_3)
num = Number(values)
bnd = Bounds(Numbers=num)
dom = ConstructDomain(DomainStart=magnitude_min, DomainEnd=magnitude_max)
mjoin = MeshJoin(Meshes=flatten([conmesh_3, conmesh, conmesh_2]))
remap = RemapNumbers(Value=num, Source=bnd, Target=dom)  # -> Mapped, Clipped
demesh_2 = DeconstructMesh(Mesh=mjoin)  # -> Vertices, Faces, Colours, Normals
cp = ClosestPoint(Point=demesh_2.Vertices, Cloud=pt)  # -> ClosestPoint, CPIndex, Distance
expression = Expression(x=influence, y=cp.Distance, Expression="-1*e^(-x*y)")
item_4 = ListItem(List=remap.Mapped, Index=cp.CPIndex, Wrap=True)
meshcp = MeshClosestPoint(Point=demesh_2.Vertices, Mesh=weld)  # -> Point, Index, Parameter
bnd_2 = Bounds(Numbers=flatten(expression))
meval = MeshEval(Mesh=weld, Parameter=meshcp.Parameter)  # -> Point, Normal, Colour
remap_2 = RemapNumbers(Value=expression, Source=bnd_2, Target="1 to 0")  # -> Mapped, Clipped
not = GateNot(A=distance_influence)
multiplication = Multiplication(A=item_4, B=remap_2.Mapped)
demesh_3 = DeconstructMesh(Mesh=mjoin)  # -> Vertices, Faces, Colours, Normals
cull = CullPattern(List=multiplication, CullPattern=distance_influence)
cull_2 = CullPattern(List=item_4, CullPattern=not)
amp = Amplitude(Vector=meval.Normal, Amplitude=[cull, cull_2])
move = Move(Geometry=demesh_2.Vertices, Motion=amp)  # -> Geometry, Transform
conmesh_4 = ConstructMesh(Vertices=move.Geometry, Faces=demesh_2.Faces)
demesh_4 = DeconstructMesh(Mesh=conmesh_4)  # -> Vertices, Faces, Colours, Normals
deface_2 = DeconstructFace(Face=demesh_3.Faces)  # -> CornerA, CornerB, CornerC, CornerD
deface_3 = DeconstructFace(Face=demesh_4.Faces)  # -> CornerA, CornerB, CornerC, CornerD
item_5 = ListItem(List=demesh_4.Vertices, Index=deface_3.CornerA, Wrap=True)
item_6 = ListItem(List=demesh_4.Vertices, Index=deface_3.CornerB, Wrap=True)
item_7 = ListItem(List=demesh_4.Vertices, Index=deface_3.CornerC, Wrap=True)
item_8 = ListItem(List=demesh_4.Vertices, Index=deface_3.CornerD, Wrap=True)
item_9 = ListItem(List=demesh_3.Vertices, Index=deface_2.CornerA, Wrap=True)
item_10 = ListItem(List=demesh_3.Vertices, Index=deface_2.CornerB, Wrap=True)
item_11 = ListItem(List=demesh_3.Vertices, Index=deface_2.CornerC, Wrap=True)
item_12 = ListItem(List=demesh_3.Vertices, Index=deface_2.CornerD, Wrap=True)
tbox = TwistedBox(
    CornerA=item_5,
    CornerB=item_6,
    CornerC=item_7,
    CornerD=item_8,
    CornerE=item_9,
    CornerF=item_10,
    CornerG=item_11,
    CornerH=item_12)
mesh_3 = Mesh(mjoin)
mesh_4 = Mesh(conmesh_4)
voxels = ClusterOutput(tbox)  # Voxels to be filled with unit cells
quad_mesh = ClusterOutput(mesh_4)  # Quad mesh generated from the input mesh
offset_quad_mesh = ClusterOutput(mesh_3)  # Offset quad mesh generated from the input mesh

# ==== cluster SurfaceOffsetValue: Offset a surface with with a point cloud and corrosponding values

resolution_v = ClusterInput()  # Resolution of points in V direction
surface = ClusterInput()  # Surface to offset
resolution_u = ClusterInput()  # Resolution of points in U direction
points = ClusterInput()  # List of points (flattened)
magnitude_max = ClusterInput()  # Magnitude of the offset (maximum value)
influence = ClusterInput()  # Smoothed range of attractor influence (0-1)
values = ClusterInput()  # Values that correspond to points (flattened)
magnitude_min = ClusterInput()  # Magnitude of the offset (minimum value)
distance_influence = ClusterInput()  # If true the distance between the points and voxels will affect the magnitude
sdivide = DivideSurface(Surface=surface, UCount=resolution_u, VCount=resolution_v)  # -> Points, Normals, Parameters
pt = Point(points)
num = Number(values)
bnd = Bounds(Numbers=num)
dom = ConstructDomain(DomainStart=magnitude_min, DomainEnd=magnitude_max)
cp = ClosestPoint(Point=sdivide.Points, Cloud=pt)  # -> ClosestPoint, CPIndex, Distance
remap = RemapNumbers(Value=num, Source=bnd, Target=dom)  # -> Mapped, Clipped
expression = Expression(x=influence, y=cp.Distance, Expression="-1*e^(-x*y)")
item = ListItem(List=remap.Mapped, Index=cp.CPIndex, Wrap=True)
panel = Panel("SURFACE OFFSET VALUE")
bnd_2 = Bounds(Numbers=flatten(expression))
remap_2 = RemapNumbers(Value=expression, Source=bnd_2, Target="1 to 0")  # -> Mapped, Clipped
not = GateNot(A=distance_influence)
multiplication = Multiplication(A=item, B=remap_2.Mapped)
cull = CullPattern(List=item, CullPattern=not)
cull_2 = CullPattern(List=multiplication, CullPattern=distance_influence)
amp = Amplitude(Vector=sdivide.Normals, Amplitude=[cull_2, cull])
move = Move(Geometry=sdivide.Points, Motion=amp)  # -> Geometry, Transform
srfgrid = SurfaceFromPoints(Points=flatten(move.Geometry), UCount=expr("x+1", resolution_u), Interpolate=False)
offest_surface = ClusterOutput(srfgrid)  # Offset Surface

# ==== cluster SurfaceOffsetAttractor: Offset a surface with attractor(s)

lower_limit = ClusterInput()  # Smoothing of the surface closest to the attractor
attractor = ClusterInput()  # Any geometry to use as attractor(s)
magnitude_min = ClusterInput()  # Magnitude of the offset (minimum value)
magnitude_max = ClusterInput()  # Magnitude of the offset (maximum value)
resolution_v = ClusterInput()  # Resolution of points in V direction
surface = ClusterInput()  # Surface to offset
resolution_u = ClusterInput()  # Resolution of points in U direction
influence = ClusterInput()  # Smoothed range of attractor influence (0-1)
num = Number(resolution_v)
num_2 = Number(lower_limit)
num_3 = Number(resolution_u)
num_4 = Number(influence)
srf = Surface(surface)
num_5 = Number(magnitude_min)
num_6 = Number(magnitude_max)
series = Series(Start=0, Step=1, Count=expr("x+1", num))
series_2 = Series(Start=0, Step=1, Count=expr("x+1", num_3))
sdivide = DivideSurface(Surface=srf, UCount=num_3, VCount=num)  # -> Points, Normals, Parameters
crossref = CrossReference(ListA=graft(series_2), ListB=series, CrossMode=1)  # -> ListA, ListB
panel = Panel("SURFACE OFFSET ATTRACTOR")
dom = ConstructDomain(DomainStart=num_5, DomainEnd=num_6)

geo = Geometry(attractor)

pull = PullPoint(Point=sdivide.Points, Geometry=geo, ClosestOnly=True)  # -> ClosestPoint, Distance
smaller = SmallerThan(FirstNumber=pull.Distance, SecondNumber=num_2)  # -> SmallerThan, OrEqualTo
cull = CullPattern(List=crossref.ListB, CullPattern=smaller.SmallerThan)
replace = ReplaceItems(List=pull.Distance, Item="0", Indices=cull, Wrap=False)
expression = Expression(x=num_4, y=replace, Expression="-1*e^(-x*y)")
bnd = Bounds(Numbers=flatten(expression))
remap = RemapNumbers(Value=expression, Source=bnd, Target=dom)  # -> Mapped, Clipped
amp = Amplitude(Vector=sdivide.Normals, Amplitude=remap.Mapped)
move = Move(Geometry=sdivide.Points, Motion=amp)  # -> Geometry, Transform
srfgrid = SurfaceFromPoints(Points=flatten(move.Geometry), UCount=expr("x+1", num_3), Interpolate=False)
offest_surface = ClusterOutput(srfgrid)  # Offset Surface

# ==== cluster MeshOffsetAttractor: Offset mesh triangles into voxels with attractor(s)

magnitude_min = ClusterInput()  # Magnitude of the offset (minimum value)
magnitude_max = ClusterInput()  # Magnitude of the offset (maximum value)
influence = ClusterInput()  # Smoothed range of attractor influence (0-1)
attractor = ClusterInput()  # Any geometry to use as attractor(s)
mesh = ClusterInput()  # Mesh to offset
lower_limit = ClusterInput()  # Smoothing of the surface closest to the attractor
num = Number(influence)
geo = Geometry(attractor)
mesh_2 = Mesh(mesh)
num_2 = Number(lower_limit)
num_3 = Number(magnitude_min)
num_4 = Number(magnitude_max)
weld = WeldMesh(Mesh=mesh_2, Angle=3.141592654)
dom = ConstructDomain(DomainStart=num_3, DomainEnd=num_4)
demesh = DeconstructMesh(Mesh=weld)  # -> Vertices, Faces, Colours, Normals
deface = DeconstructFace(Face=demesh.Faces)  # -> CornerA, CornerB, CornerC, CornerD
item = ListItem(List=demesh.Vertices, Index=deface.CornerB, Wrap=True)
item_2 = ListItem(List=demesh.Vertices, Index=deface.CornerC, Wrap=True)
item_3 = ListItem(List=demesh.Vertices, Index=deface.CornerA, Wrap=True)
addition = Addition(A=item_3, B=item)
addition_2 = Addition(A=item_3, B=item_2)
addition_3 = Addition(A=item, B=item_2)
bcentric = Barycentric(PointA=item_3, PointB=item, PointC=item_2, CoordinateU=1, CoordinateV=1, CoordinateW=1)
division = Division(A=addition, B="2")
division_2 = Division(A=addition_3, B="2")
division_3 = Division(A=addition_2, B="2")
entwine = Entwine(Branch00=item_3, Branch01=division, Branch02=bcentric, Branch03=division_3, FlattenInputs=True)
entwine_2 = Entwine(Branch00=item, Branch01=division_2, Branch02=bcentric, Branch03=division, FlattenInputs=True)
entwine_3 = Entwine(Branch00=item_2, Branch01=division_3, Branch02=bcentric, Branch03=division_2, FlattenInputs=True)
flip = FlipMatrix(Data=entwine)
flip_2 = FlipMatrix(Data=entwine_3)
flip_3 = FlipMatrix(Data=entwine_2)
quad = MeshQuad(CornerA=0, CornerB=1, CornerC=2, CornerD=3)
quad_2 = MeshQuad(CornerA=0, CornerB=1, CornerC=2, CornerD=3)
quad_3 = MeshQuad(CornerA=0, CornerB=1, CornerC=2, CornerD=3)
panel = Panel("MESH OFFSET ATTRACTOR")
conmesh = ConstructMesh(Vertices=flip_2, Faces=quad)
conmesh_2 = ConstructMesh(Vertices=flip_3, Faces=quad_2)
conmesh_3 = ConstructMesh(Vertices=flip, Faces=quad_3)
mjoin = MeshJoin(Meshes=flatten([conmesh_3, conmesh_2, conmesh]))
demesh_2 = DeconstructMesh(Mesh=mjoin)  # -> Vertices, Faces, Colours, Normals
meshcp = MeshClosestPoint(Point=demesh_2.Vertices, Mesh=weld)  # -> Point, Index, Parameter
pull = PullPoint(Point=demesh_2.Vertices, Geometry=geo, ClosestOnly=True)  # -> ClosestPoint, Distance
lng = ListLength(List=pull.Distance)
meval = MeshEval(Mesh=weld, Parameter=meshcp.Parameter)  # -> Point, Normal, Colour
series = Series(Start=0, Step=1, Count=lng)
smaller = SmallerThan(FirstNumber=pull.Distance, SecondNumber=num_2)  # -> SmallerThan, OrEqualTo
cull = CullPattern(List=series, CullPattern=smaller.SmallerThan)
replace = ReplaceItems(List=pull.Distance, Item="0", Indices=cull, Wrap=False)
expression = Expression(x=num, y=replace, Expression="-1*e^(-x*y)")
bnd = Bounds(Numbers=expression)
remap = RemapNumbers(Value=expression, Source=bnd, Target=dom)  # -> Mapped, Clipped
amp = Amplitude(Vector=meval.Normal, Amplitude=remap.Mapped)
move = Move(Geometry=demesh_2.Vertices, Motion=amp)  # -> Geometry, Transform
conmesh_4 = ConstructMesh(Vertices=move.Geometry, Faces=demesh_2.Faces)
demesh_3 = DeconstructMesh(Mesh=mjoin)  # -> Vertices, Faces, Colours, Normals
demesh_4 = DeconstructMesh(Mesh=conmesh_4)  # -> Vertices, Faces, Colours, Normals
deface_2 = DeconstructFace(Face=demesh_3.Faces)  # -> CornerA, CornerB, CornerC, CornerD
deface_3 = DeconstructFace(Face=demesh_4.Faces)  # -> CornerA, CornerB, CornerC, CornerD
item_4 = ListItem(List=demesh_4.Vertices, Index=deface_3.CornerA, Wrap=True)
item_5 = ListItem(List=demesh_4.Vertices, Index=deface_3.CornerB, Wrap=True)
item_6 = ListItem(List=demesh_4.Vertices, Index=deface_3.CornerC, Wrap=True)
item_7 = ListItem(List=demesh_4.Vertices, Index=deface_3.CornerD, Wrap=True)
item_8 = ListItem(List=demesh_3.Vertices, Index=deface_2.CornerA, Wrap=True)
item_9 = ListItem(List=demesh_3.Vertices, Index=deface_2.CornerB, Wrap=True)
item_10 = ListItem(List=demesh_3.Vertices, Index=deface_2.CornerC, Wrap=True)
item_11 = ListItem(List=demesh_3.Vertices, Index=deface_2.CornerD, Wrap=True)
tbox = TwistedBox(
    CornerA=item_4,
    CornerB=item_5,
    CornerC=item_6,
    CornerD=item_7,
    CornerE=item_8,
    CornerF=item_9,
    CornerG=item_10,
    CornerH=item_11)
mesh_3 = Mesh(conmesh_4)
mesh_4 = Mesh(mjoin)
voxels = ClusterOutput(tbox)  # Voxels to be filled with unit cells
quad_mesh = ClusterOutput(mesh_3)  # Quad mesh generated from the input mesh
offset_quad_mesh = ClusterOutput(mesh_4)  # Offset quad mesh generated from the input mesh

# ==== cluster CellType: Preset unit cells

crv = Curve([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])
crv_2 = Curve([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])
crv_3 = Curve([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])
crv_4 = Curve([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])
crv_5 = Curve([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])
crv_6 = Curve([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])
crv_7 = Curve([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])
crv_8 = Curve([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])
crv_9 = Curve([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])
crv_10 = Curve([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])
crv_11 = Curve([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])
crv_12 = Curve([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])
crv_13 = Curve([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])
crv_14 = Curve([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])
crv_15 = Curve([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])
mesh = Mesh(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)
mesh_2 = Mesh(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)
mesh_3 = Mesh(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)
mesh_4 = Mesh(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)
mesh_5 = Mesh(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)
mesh_6 = Mesh(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)
entwine = Entwine(
    Branch00=crv_6,
    Branch01=crv_10,
    Branch02=crv_13,
    Branch03=crv_4,
    Branch04=crv_2,
    Branch05=crv_8,
    Branch06=crv_11,
    Branch07=crv,
    Branch08=crv_7,
    Branch09=crv_9,
    Branch010=crv_12,
    Branch011=crv_3,
    Branch012=crv_5,
    Branch013=crv_14,
    Branch014=crv_15,
    Branch015=mesh,
    Branch016=mesh_2,
    Branch017=mesh_3,
    Branch018=mesh_4,
    Branch019=mesh_5,
    Branch020=mesh_6,
    FlattenInputs=True)  # -> simplify(Result)
unit_cell_selector = ClusterInput()
branch = TreeBranch(Tree=entwine, Path=unit_cell_selector, MaintainPaths=True)
unit_cell = ClusterOutput(branch)  # Single unit cell to populate voxels

# ==== cluster RemoveDuplicateCurves: Remove curves that share the same midpoint

lattice = ClusterInput()  # Lattice curves to filter
crv = Curve(lattice)
curvepoint = PointOnCurve(crv, parameter=0.5)
panel = Panel("REMOVE DUPLICATE CURVES")
cullpt = CullDuplicates(Points=curvepoint, Tolerance=".001", CullMode=1)  # -> Points, Indices, Valence
item = ListItem(List=crv, Index=cullpt.Indices, Wrap=True)
lattice_2 = ClusterOutput(item)  # Filtered lattice

# ==== cluster MergeCurves: Merge endpoints of curves by distance.

max_distance = ClusterInput()  # Maximum distance to merge
lattice = ClusterInput()  # Lattice to merge
crv = Curve(lattice)
num = Number(max_distance)
cp = ControlPoints(Curve=crv)  # -> Points, Weights, Knots
cullpt = CullDuplicates(Points=flatten(cp.Points), Tolerance=num, CullMode=3)  # -> Points, Indices, Valence
fsim = FindSimilarMember(Data=cp.Points, Set=cullpt.Points)  # -> Hit, Index
panel = Panel("MERGE CURVES")
pline = PolyLine(Vertices=fsim.Hit, Closed=False)  # -> flatten(Polyline)
len = Length(Curve=pline)
larger = LargerThan(FirstNumber=len, SecondNumber="0")  # -> LargerThan, OrEqualTo
cull = CullPattern(List=pline, CullPattern=larger.LargerThan)
lattice_2 = ClusterOutput(cull)  # Merged lattice

# ==== cluster TweenCellFill: Fill voxels with morphed unit cells

unit_cell_2 = ClusterInput()  # Unit cell to populate voxels
unit_cell_1 = ClusterInput()  # Unit cell to populate voxels
value = ClusterInput()  # Value from 0-1 corresponding to each voxel
voxels = ClusterInput()  # Voxels to be filled with unit cells
num = Number(value)
flip = FlipCurve(Curve=unit_cell_1, Guide=unit_cell_2)  # -> Curve, Flag
tweencrv = TweenCurve(CurveA=flip.Curve, CurveB=unit_cell_2, Factor=graft(num), BlendType=0)
panel = Panel("TWEEN CELL FILL")
bbox = BoundingBox(Content=tweencrv, Plane=PlaneXY(0, 0, 0), UnionBox=True)  # -> Box, Box_2
morph = BoxMorph(Geometry=tweencrv, Reference=bbox.Box, Target=graft(voxels))  # -> flatten(Geometry)
line = Line(morph)
remove_duplicate_lines = RemoveDuplicateLines(lattice_l=flatten(line))
lattice = ClusterOutput(remove_duplicate_lines)  # List of curves that make up the lattice
